# Grasshopper definition 211102_Base Grid + Orientation.gh (Grasshopper 1.0.7)
# plug-ins: Human, PTComponentLibrary, EleFront

# ---- group: Proximity Search
min_radius_tolerance_minus_from_grid_siz = Slider(0.02, range=0..1)  # "Min Radius Tolerance (minus from Grid size)"
# B. Nodes Checker
max_radius_tolerance_add_to_grid_size = Slider(0.02, range=0..1)

# ---- group: RELINK TO FILE LOCATION WITH edge_dict.txt
file_path_to_edge_dict_txt = Panel("/Users/junwenloo/OneDrive/2020 ONWARDS/06_Delft/15_Y2Q1/01_Earthy/03_Scripts/Earthy4.2/0_Configuration/C_Adjacency & Transition/211024_edge_dict.txt")

# ----
# D. Allocation of Modules
# Dummy or Actual Module?
# False = Dummy
# True = Actual
boolean_toggle = BooleanToggle(False)

# ---- group: RELINK TO FILE LOCATION WITH final_nodes.txt
file_path_to_nodes_final_txt = Panel("/Users/junwenloo/OneDrive/2020 ONWARDS/06_Delft/15_Y2Q1/01_Earthy/03_Scripts/Earthy4.2/0_Configuration/C_Adjacency & Transition/211024_nodes_final.txt")

# ----
middle_street_width_2x = Slider(2, range=0..4)
local_street_width_x = Slider(1, range=0..5)
# ii: Tolerances for Node/Edge Rel.
external_layer = Slider(1, range=0..5)
# ii: Street width & Layers characteristics
boundary_radius_m = Slider(43, range=1..101)

# ---- group: Do not adjust
angle_of_intersection = Slider(90, range=30..150)

# ---- group: Local Street Generation
# BASE GRID AND OREINTATE MODULE SCRIPT
# Authors: Jun Wen Loo & Christopher Bierach
# A. Street Setup
# i: Intersection Derivation
unit_y = UnitY(Factor=boundary_radius_m)
move = Move(Geometry="0,0,0", Motion=unit_y)  # -> Geometry, Transform
rotate = Rotate(Geometry=move.Geometry, Angle=degrees(angle_of_intersection), Plane=PlaneXY(0, 0, 0))  # -> Geometry, Transform
line = Line(StartPoint="0,0,0", EndPoint=rotate.Geometry)

# ----
middle_street_layers = Slider(5, range=0..20)
local_street_layers = Slider(3, range=0..20)
offset_distance = Slider(3, range=0..10)
offset_height = Slider(3.5, range=0..10)
node_check = Slider(513, range=0..700)
# C. Export Data?
layer = Slider(1, range=1..7)
local_street_1 = Line(line)
middle_street = Line(Line((0, 92.48797601, 0), (0, -89.02387439, 0)))
center_point = CurveCurve(CurveA=middle_street, CurveB=local_street_1)  # -> Points, ParamsA, ParamsB
circle = Circle(Plane=center_point.Points, Radius=boundary_radius_m)
mirror = Mirror(Geometry=line, Plane=PlaneYZ(0, 0, 0))  # -> Geometry, Transform
addition = Addition(A=middle_street_layers, B="1")
ms_width = Multiplication(A=offset_distance, B=middle_street_width_2x)
ls_width = Multiplication(A=offset_distance, B=local_street_width_x)
addition_2 = Addition(A=local_street_layers, B="1")
addition_3 = Addition(A=offset_distance, B=max_radius_tolerance_add_to_grid_size)
subtraction = Subtraction(A=offset_distance, B=min_radius_tolerance_minus_from_grid_siz)
curve_curve = CurveCurve(CurveA=middle_street, CurveB=circle)  # -> Points, ParamsA, ParamsB
curve_curve_2 = CurveCurve(CurveA=local_street_1, CurveB=circle)  # -> Points, ParamsA, ParamsB
line_2 = Line(StartPoint=center_point.Points, EndPoint=[curve_curve.Points, curve_curve_2.Points])

# ---- group: Obtaining Regular Grid Point on Street
# 0. Grid Setup
merge = Merge(Data1=curve_curve.Points, Data2=curve_curve_2.Points)
vector_2pt = Vector2Pt(PointA=center_point.Points, PointB=merge, Unitize=True)  # -> Vector, Length
length = Length(Curve=line_2)
amplitude = Amplitude(Vector=vector_2pt.Vector, Amplitude=offset_distance)
division = Division(A=length, B=offset_distance)

# ---- group: Local Street Middle Line
list_item = ListItem(List=line_2, Index="2", Wrap=True)

# ---- group: Local Street 1 Generation
division_2 = Division(A=ls_width, B="2")
multiplication = Multiplication(A=division_2, B="-1")
horizontal_frame = HorizontalFrame(Curve=list_item, Parameter="0,0,0")
deconstruct_plane = DeconstructPlane(Plane=horizontal_frame)  # -> Origin, XAxis, YAxis, ZAxis
offset_curve = OffsetCurve(Curve=list_item, Distance=[division_2, multiplication], Plane=deconstruct_plane.YAxis, Corners=1)
series = Series(Start=offset_distance, Step=offset_distance, Count=local_street_layers)
list_item_2 = ListItem(List=flatten(offset_curve), Index=0, Wrap=True)  # -> Item, Item1
multiplication_2 = Multiplication(A=series, B="-1")
loft = Loft(
    Curves=flatten(offset_curve),
    Options={Adjust=False, Closed=False, LoftEnds=0, LoftSimp=0, LoftType=0, Rebuild=10, Refit=0.01})
offset_curve_2 = OffsetCurve(Curve=list_item_2.Item1, Distance=multiplication_2, Plane=deconstruct_plane.YAxis, Corners=1)  # -> flatten(Curve)
offset_curve_3 = OffsetCurve(Curve=list_item_2.Item, Distance=series, Plane=deconstruct_plane.YAxis, Corners=1)  # -> flatten(Curve)

# ----
round = Round(Number=division)  # -> Nearest, Floor, Ceiling

# ---- group: Street Boundary
curve = Curve(<curve referenced from the Rhino model>)
surface = Surface(curve)
custom_preview = CustomPreview(Geometry=surface, Material=ColourSwatch(SwatchColor=RGB(168, 168, 168)))

# ---- group: Plane Recolouring
number_slider = Slider(5, range=0..10)  # disabled
colour_swatch = ColourSwatch(SwatchColor=RGB(250, 72, 208))  # disabled
colour_swatch_2 = ColourSwatch(SwatchColor=RGB(116, 184, 0))  # disabled
plane_preview = CSharpScript(X=colour_swatch, Y=colour_swatch_2, Thk=number_slider)  # -> out; inputs Pln: Plane, X: Color, Y: Color, Z: Color, Thk: Int32; disabled
# ---------- plane_preview: C# ----------
    if(this.Iteration == 0){
      planes = new List<Plane>();
      bb = BoundingBox.Empty;
      xColor = X;
      yColor = Y;
      zColor = Z;
      thk = Thk;
      gridColor = Grasshopper.Instances.Settings.GetValue("DefaultPreviewColour", Color.IndianRed);
      gridColorSelected = Grasshopper.Instances.Settings.GetValue("DefaultPreviewColourSelected", Color.YellowGreen);
    }

    planes.Add(Pln);

    double r = Grasshopper.CentralSettings.PreviewPlaneRadius;
    Interval ri = new Interval(-r, r);
    bb = BoundingBox.Union(bb, new Box(Pln, ri, ri, ri).BoundingBox);
# ---------- plane_preview: C# additional code ----------
  List<Plane> planes;
  BoundingBox bb;
  Color xColor;
  Color yColor;
  Color zColor;
  Color gridColor;
  Color gridColorSelected;
  int thk;

  //Return a BoundingBox that contains all the geometry you are about to draw.
  public override BoundingBox ClippingBox
  {
    get
    {
      return bb;
    }
  }

  //Draw all meshes in this method.
  public override void DrawViewportMeshes(IGH_PreviewArgs args)
  {
  }

  //Draw all wires and points in this method.
  public override void DrawViewportWires(IGH_PreviewArgs args)
  {
    if(this.Component.Hidden || planes.Count == 0)return;

    Color grid = this.Component.Attributes.Selected ? gridColorSelected : gridColor;
     
    double r = Grasshopper.CentralSettings.PreviewPlaneRadius;
    double step = 1 / 5.0;
    foreach(Plane pln in planes){
      //Grid
      for(double i = -1.0; i <= 1.0; i += step){
        Point3d p0 = pln.PointAt(i * r, -r);
        Point3d p1 = pln.PointAt(i * r, r);
        args.Display.DrawLine(p0, p1, grid);
        p0 = pln.PointAt(-r, i * r);
        p1 = pln.PointAt(r, i * r);
        args.Display.DrawLine(p0, p1, grid);
      }
      //Axis
      args.Display.DrawLine(pln.Origin, pln.Origin + pln.XAxis * r, xColor, thk);
      args.Display.DrawLine(pln.Origin, pln.Origin + pln.YAxis * r, yColor, thk);
      if(zColor.A != 0) args.Display.DrawLine(pln.Origin, pln.Origin + pln.ZAxis * r, zColor, thk);
    }
  }
# ---------- end plane_preview ----------

# ---- group: Boundary Circle
dash_pattern = DashPattern(Curve=circle, Pattern="0.5, 1")  # -> Dashes, Gaps
custom_preview_lineweights = CustomPreviewLineweights(
    Geometry=dash_pattern.Dashes,
    Shader=ColourSwatch(SwatchColor=RGB(152, 184, 214)),
    Thickness=Slider(3, range=0..10),
    Absolute=False)

# ----
panel = Panel("/Users/junwenloo/OneDrive/2020 ONWARDS/06_Delft/15_Y2Q1/01_Earthy/03_Scripts/Earthy4.2/0_Configuration/Foundation/nodes.txt")
panel_2 = Panel("/Users/junwenloo/OneDrive/2020 ONWARDS/06_Delft/15_Y2Q1/01_Earthy/03_Scripts/Earthy4.2/0_Configuration/Foundation/nodes_2.txt")
file_path_with_40_series = FilePath(file_path_to_nodes_final_txt)
file_path = FilePath(file_path_to_edge_dict_txt)
# 8. Read JSON file setup Modules
reading_json_output = GhPythonScript(edges=file_path, file=file_path_with_40_series)  # -> out, connection, flatten(module), all_edge, node_list, names_list, type_list
# ---------- reading_json_output: Python ----------
"""Provides a scripting component.
    Inputs:
        edges: Tree with Branch No. as nodes and items in branch as nodes it connects to
        file: Filepath to updated Nodes json file
    Output:
        connection: Types of connections (0 = Open, 1 =. Close)
        module: Module type required for each node
        all_edge: Tree with Branch no. = Index of node in node_list, and items in branch as nodes it connects to
        node_list: Nodes involved in allocation on site"""

__author__ = "junwenloo"

import rhinoscriptsyntax as rs
from ghpythonlib import treehelpers as th
import json

#reading exported Nodes JSON file
with open(str(file)) as json_file_nodes:
    nodes = json.load(json_file_nodes)
    nodes = {int(k):v for k, v in nodes.items()}
    
#reading exported Edges JSON file
with open(str(edges)) as json_file_edges:
    edges_list = json.load(json_file_edges)
    edges_list = {int(k):v for k, v in edges_list.items()}

#alternative to retrieve edges from previous steps, but this is inaccurate
"""edges = th.tree_to_list(edges, None)
edges_list = {}
for num, item in enumerate(edges):
    edges_list[num] = item"""

#edges_list = th.tree_to_list(edges, None)

node_list = []

all_edge_list = []
connection_list = []
module_list = []
names_list = []
names_dict = {}
type_list = []
counter = 0
j_count = []

for node in nodes:
    all_edge = edges_list[node]
    connection = nodes[node]["connection"]
    if nodes[node]["module"] != None:
        module = [nodes[node]["module"]]
        module_list.append(module)
        all_edge_list.append(all_edge)
        connection_list.append(connection)
        node_list.append(node)
        names_list.append(nodes[node]["tag"])
        type_list.append(nodes[node]["type"])
        
#count number of occurence for each name
for name in names_list:
    count = names_list.count(name)
    names_dict[name] = count

all_edge = th.list_to_tree(all_edge_list)
connection = th.list_to_tree(connection_list)
module = th.list_to_tree(module_list)
# ---------- end reading_json_output ----------

# ---- group: Nodes Doctor
nodes = Slider(33, range=0..580)
equality = Equality(FirstNumber=reading_json_output.node_list, SecondNumber=nodes)  # -> Equality, Inequality
cull_pattern = CullPattern(List=reading_json_output.node_list, CullPattern=equality.Equality)
item_index = ItemIndex(List=reading_json_output.node_list, Item=cull_pattern)
tree_branch = TreeBranch(Tree=simplify(reading_json_output.connection), Path=item_index, MaintainPaths=True)
tree_branch_2 = TreeBranch(Tree=simplify(reading_json_output.all_edge), Path=item_index, MaintainPaths=True)
list_item_3 = ListItem(List=reading_json_output.module, Index=item_index, Wrap=True)
node_to_edge_sequence = Panel(tree_branch_2)
types_of_modules = Panel(list_item_3)
connection_of_edges = Panel(tree_branch)

# ----
connection_of_edges_2 = Panel(reading_json_output.connection)
node = Panel(reading_json_output.node_list)

type_20_1 = Geometry(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)
type_50_1 = Geometry(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)
# 8.1: Dummy Modules
type_10_1 = Geometry(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)
type_30_1 = Geometry(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)
type_40_1 = Geometry(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)
type_52_2 = Geometry(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)
type_20_2 = Geometry(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)
type_32_1 = Geometry(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)
type_30_2 = Geometry(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)
type_32_2 = Geometry(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)
type_52_1 = Geometry(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)
type_50_2 = Geometry(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)
type_51_2 = Geometry(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)
type_10_1_2 = Geometry(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)
type_21_2 = Geometry(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)
type_31_2 = Geometry(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)
type_44_2 = Geometry(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)
type_51_1 = Geometry(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)
type_21_1 = Geometry(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)
type_31_1 = Geometry(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)
type_40_2 = Geometry(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)
type_42_2 = Geometry(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)
type_43_2 = Geometry(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)
type_45_2 = Geometry(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)
type_42_1 = Geometry(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)
type_43_1 = Geometry(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)
type_44_1 = Geometry(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)
type_45_1 = Geometry(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)
type_41_2 = Geometry(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)
type_41_1 = Geometry(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)
merge_2 = Merge(
    Data1=type_10_1,
    Data2=type_10_1_2,
    Data3=type_20_1,
    Data4=type_21_1,
    Data5=type_20_2,
    Data6=type_21_2,
    Data7=type_30_1,
    Data8=type_31_1,
    Data9=type_32_1,
    Data10=type_30_2,
    Data11=type_31_2,
    Data12=type_32_2,
    Data13=type_40_1,
    Data14=type_41_1,
    Data15=type_42_1,
    Data16=type_43_1,
    Data17=type_44_1,
    Data18=type_45_1,
    Data19=type_40_2,
    Data20=type_41_2,
    Data21=type_42_2,
    Data22=type_43_2,
    Data23=type_44_2,
    Data24=type_45_2,
    Data25=type_50_1,
    Data26=type_51_1,
    Data27=type_52_1,
    Data28=type_50_2,
    Data29=type_51_2,
    Data30=type_52_2)

type_20_1_2 = Geometry(<mesh referenced from the Rhino model>)
type_30_1_2 = Geometry(<mesh referenced from the Rhino model>)
type_40_1_2 = Geometry(<mesh referenced from the Rhino model>)
type_50_1_2 = Geometry(<mesh referenced from the Rhino model>)
# 8.2: Actual Modules
type_10_1_3 = Geometry(<mesh referenced from the Rhino model>)
type_44_2_2 = Geometry(<mesh referenced from the Rhino model>)
type_20_2_2 = Geometry(<mesh referenced from the Rhino model>)
type_30_2_2 = Geometry(<mesh referenced from the Rhino model>)
type_32_2_2 = Geometry(<mesh referenced from the Rhino model>)
type_40_2_2 = Geometry(<mesh referenced from the Rhino model>)
type_42_2_2 = Geometry(<mesh referenced from the Rhino model>)
type_43_2_2 = Geometry(<mesh referenced from the Rhino model>)
type_45_2_2 = Geometry(<mesh referenced from the Rhino model>)
type_50_2_2 = Geometry(<mesh referenced from the Rhino model>)
# Use rhino file: 211102_Base Grid Foundation.3dm
# to obtain actual modules
# All actual module types will be received
# as input after structural approximation
# and assessment script from 03_Structuring
type_52_2_2 = Geometry(<mesh referenced from the Rhino model>)
type_10_2 = Geometry(<mesh referenced from the Rhino model>)
type_21_2_2 = Geometry(<mesh referenced from the Rhino model>)
type_32_1_2 = Geometry(<mesh referenced from the Rhino model>)
type_31_2_2 = Geometry(<mesh referenced from the Rhino model>)
type_42_1_2 = Geometry(<mesh referenced from the Rhino model>)
type_43_1_2 = Geometry(<mesh referenced from the Rhino model>)
type_44_1_2 = Geometry(<mesh referenced from the Rhino model>)
type_45_1_2 = Geometry(<mesh referenced from the Rhino model>)
type_41_2_2 = Geometry(<mesh referenced from the Rhino model>)
type_52_1_2 = Geometry(<mesh referenced from the Rhino model>)
type_51_2_2 = Geometry(<mesh referenced from the Rhino model>)
type_21_1_2 = Geometry(<mesh referenced from the Rhino model>)
type_31_1_2 = Geometry(<mesh referenced from the Rhino model>)
type_41_1_2 = Geometry(<mesh referenced from the Rhino model>)
type_51_1_2 = Geometry(<mesh referenced from the Rhino model>)
merge_3 = Merge(
    Data1=type_10_1_3,
    Data2=type_10_2,
    Data3=type_20_1_2,
    Data4=type_21_1_2,
    Data5=type_20_2_2,
    Data6=type_21_2_2,
    Data7=type_30_1_2,
    Data8=type_31_1_2,
    Data9=type_32_1_2,
    Data10=type_30_2_2,
    Data11=type_31_2_2,
    Data12=type_32_2_2,
    Data13=type_40_1_2,
    Data14=type_41_1_2,
    Data15=type_42_1_2,
    Data16=type_43_1_2,
    Data17=type_44_1_2,
    Data18=type_45_1_2,
    Data19=type_40_2_2,
    Data20=type_41_2_2,
    Data21=type_42_2_2,
    Data22=type_43_2_2,
    Data23=type_44_2_2,
    Data24=type_45_2_2,
    Data25=type_50_1_2,
    Data26=type_51_1_2,
    Data27=type_52_1_2,
    Data28=type_50_2_2,
    Data29=type_51_2_2,
    Data30=type_52_2_2)

node_to_edge_sequence_2 = Panel(reading_json_output.all_edge)
types_of_modules_2 = Panel(reading_json_output.module)
list_of_all_module_types = Panel("""10.1
10.2
20.1
21.1
20.2
21.2
30.1
31.1
32.1
30.2
31.2
32.2
40.1
41.1
42.1
43.1
44.1
45.1
40.2
41.2
42.2
43.2
44.2
45.2
50.1
51.1
52.1
50.2
51.2
52.2""")
define_block = DefineBlock(Geometry=graft(merge_3), BlockName=graft(list_of_all_module_types), BasePlane=PlaneXY(0, 0, 0))  # -> flatten(Block)

sorty_module_to_logic = GhPythonScript(module=reading_json_output.module)  # -> out, index_list, module_index; inputs module: list
# ---------- sorty_module_to_logic: Python ----------
"""Provides a scripting component.
    Inputs:
        module: Module Number combinations, ordered in sequence of nodes
    Output:
        index_list: List of index to apply to specific logic, each branch represent 1 logic
        module_index: Contains the index of the module types"""

__author__ = "junwenloo"

import rhinoscriptsyntax as rs
from ghpythonlib import treehelpers as th

#definition takes in a logic_list, the type of module to evaluate and the current index of the node and sorts it to the logic it
#belongs to and to a nested index_list to be distributed to the 8 different logics required to orient the modules
def append_index_type(logic_list, type, current_node):
    for n, logic in enumerate(logic_list):
        if type in logic:
            module_index.append(type_sequence.index(type))
            index_list[n].append(current_node)

module_index = []

#Each Logic represents a method of orientation, which applies to specific module types only
logic_1 = [10.1,10.2]
logic_2 = [20.1, 21.1, 20.2, 20.2]
logic_31 = [30.1, 32.1, 32.2, 30.2]
logic_32 = [31.1, 31.2]
logic_41 = [40.1, 42.1, 45.1, 45.2, 40.2, 42.2]
logic_42 = [43.1, 43.2]
logic_43 = [41.1, 41.2, 44.1, 44.2]
logic_51 = [50.1, 52.1, 50.2, 52.2]
logic_52 = [51.1, 51.2]


logic_list = [logic_1, logic_2, logic_31, logic_32,
                logic_41, logic_42, logic_43, logic_51, logic_52]

#sequence of types: Index position corresponds to its index in GH Merge component of all types, smallest to largest 
type_sequence = [10.1, 10.2, 20.1, 21.1, 20.1, 20.2, 30.1, 31.1, 32.1, 30.2, 31.2, 32.2, 40.1, 41.1, 42.1, 
                43.1, 44.1, 45.1, 40.2, 41.2, 42.2, 43.2, 44.2, 45.2, 50.1, 51.1, 52.1, 50.2, 51.2, 52.2]
                

#initiating the list of nodes which will require specifc orientation logic
logic_1_index = []
logic_2_index = []
logic_31_index = []
logic_32_index = []
logic_41_index = []
logic_42_index = []
logic_43_index = []
logic_51_index = []
logic_52_index = []

index_list = [logic_1_index, logic_2_index, logic_31_index, logic_32_index,
                logic_41_index, logic_42_index, logic_43_index, logic_51_index,
                logic_52_index]

#adding each nodes to the logic they apply to
for num, type in enumerate(module):
    append_index_type(logic_list, round(type, 1), num)

index_list = [logic_1_index, logic_2_index, logic_31_index, logic_32_index,
                logic_41_index, logic_42_index, logic_43_index, logic_51_index,
                logic_52_index]

for i in index_list:
    if len(i) == 0:
        i.append("Null")

index_list = th.list_to_tree(index_list, None)
# ---------- end sorty_module_to_logic ----------
param_viewer = ParamViewer(sorty_module_to_logic.index_list)
panel_3 = Panel(sorty_module_to_logic.module_index)

stream_filter = StreamFilter(Gate=boolean_toggle, Stream0=merge_2, Stream1=define_block)

# ---- group: Create Plane Origin for Dummy Modules
bounding_box = BoundingBox(Content=merge_2, Plane=PlaneXY(0, 0, 0))  # -> Box, Box_2
volume = Volume(Geometry=bounding_box.Box)  # -> Volume, Centroid
deconstruct = Deconstruct(Point=volume.Centroid)  # -> XComponent, YComponent, ZComponent
construct_point = ConstructPoint(XCoordinate=deconstruct.XComponent, YCoordinate=deconstruct.YComponent, ZCoordinate=0)

# ---- group: Type Label
list_length = ListLength(List=stream_filter)
series_2 = Series(Start=1, Step=1, Count=list_length)
concatenate = Concatenate(FragmentA="Type ", FragmentB=series_2)
unit_y_2 = UnitY(Factor=Slider(3, range=0..10))
move_2 = Move(Geometry=construct_point, Motion=unit_y_2)  # -> Geometry, Transform
text_tag_3d = TextTag3D(Location=move_2.Geometry, Text=concatenate, Size=Slider(0.5, range=0..1), Justification=5)

# ---- group: Create Plane Origin for actual modules
unit_x = UnitX(Factor=Slider(36, range=1..70))
move_3 = Move(Geometry=construct_point, Motion=unit_x)  # -> Geometry, Transform

# ----
# {0} = Logic 1
# {1} = Logic 2
# {2} = Logic 3.1
# {3} = Logic 3.2
# {4} = Logic 4.1
# {5} = Logic 4.2
# {6} =  Logic 4.3
# {7} = Logic 5.1
# {8} = Logic 5.2
explode_tree = ExplodeTree(Data=simplify(sorty_module_to_logic.index_list))  # -> Branch0, Branch1, Branch2, Branch3, Branch4, Branch5, Branch6, Branch7, Branch8

stream_filter_2 = StreamFilter(Gate=boolean_toggle, Stream0=construct_point, Stream1=move_3.Geometry)
all_modules_plane = Plane(stream_filter_2)
all_module_types = Geometry(stream_filter)
create_set = CreateSet(List=reading_json_output.type_list)  # -> Set, Map
# 11. Colour Visual acording to programme type
addition_4 = Addition(A=create_set.Map, B="1")

# ---- group: LS 2
multiples_of_grid = Slider(5, range=0..50)
multiplication_3 = Multiplication(A=multiples_of_grid, B=offset_distance)
addition_5 = Addition(A=multiplication_3, B=ls_width)
unit_y_3 = UnitY(Factor=addition_5)
move_4 = Move(Geometry=mirror.Geometry, Motion=unit_y_3)  # -> Geometry, Transform

# ----
local_street_2 = Line(move_4.Geometry)

# ---- group: LS 2 (continued)
curve_curve_3 = CurveCurve(CurveA=middle_street, CurveB=local_street_2)  # -> Points, ParamsA, ParamsB
curve_curve_4 = CurveCurve(CurveA=local_street_2, CurveB=circle)  # -> Points, ParamsA, ParamsB
line_3 = Line(StartPoint=curve_curve_3.Points, EndPoint=curve_curve_4.Points)

# ---- group: Local Street 2 Generation
division_3 = Division(A=ls_width, B="2")
multiplication_4 = Multiplication(A=division_3, B="-1")
horizontal_frame_2 = HorizontalFrame(Curve=line_3, Parameter="0,0,0")
deconstruct_plane_2 = DeconstructPlane(Plane=horizontal_frame_2)  # -> Origin, XAxis, YAxis, ZAxis
offset_curve_4 = OffsetCurve(Curve=line_3, Distance=[division_3, multiplication_4], Plane=deconstruct_plane_2.YAxis, Corners=1)
series_3 = Series(Start=offset_distance, Step=offset_distance, Count=local_street_layers)
list_item_4 = ListItem(List=flatten(offset_curve_4), Index=0, Wrap=True)  # -> Item, Item1
multiplication_5 = Multiplication(A=series_3, B="-1")
loft_2 = Loft(
    Curves=flatten(offset_curve_4),
    Options={Adjust=False, Closed=False, LoftEnds=0, LoftSimp=0, LoftType=0, Rebuild=10, Refit=0.01})
offset_curve_5 = OffsetCurve(Curve=list_item_4.Item1, Distance=multiplication_5, Plane=deconstruct_plane_2.YAxis, Corners=1)  # -> flatten(Curve)
offset_curve_6 = OffsetCurve(Curve=list_item_4.Item, Distance=series_3, Plane=deconstruct_plane_2.YAxis, Corners=1)  # -> flatten(Curve)

# ---- group: LS 3
multiples_of_grid_2 = Slider(5, range=0..50)
multiplication_6 = Multiplication(A=multiples_of_grid_2, B=offset_distance)
addition_6 = Addition(A=multiplication_6, B=ls_width)
unit_y_4 = UnitY(Factor=expr("-x", addition_6))
move_5 = Move(Geometry=mirror.Geometry, Motion=unit_y_4)  # -> Geometry, Transform

# ----
local_street_3 = Line(move_5.Geometry)

# ---- group: LS 3 (continued)
curve_curve_5 = CurveCurve(CurveA=middle_street, CurveB=local_street_3)  # -> Points, ParamsA, ParamsB
curve_curve_6 = CurveCurve(CurveA=local_street_3, CurveB=circle)  # -> Points, ParamsA, ParamsB
line_4 = Line(StartPoint=curve_curve_5.Points, EndPoint=curve_curve_6.Points)

# ---- group: Local Street 3 Generation
division_4 = Division(A=ls_width, B="2")
multiplication_7 = Multiplication(A=division_4, B="-1")
horizontal_frame_3 = HorizontalFrame(Curve=line_4, Parameter="0,0,0")
deconstruct_plane_3 = DeconstructPlane(Plane=horizontal_frame_3)  # -> Origin, XAxis, YAxis, ZAxis
offset_curve_7 = OffsetCurve(Curve=line_4, Distance=[division_4, multiplication_7], Plane=deconstruct_plane_3.YAxis, Corners=1)
series_4 = Series(Start=offset_distance, Step=offset_distance, Count=local_street_layers)
list_item_5 = ListItem(List=flatten(offset_curve_7), Index=0, Wrap=True)  # -> Item, Item1
multiplication_8 = Multiplication(A=series_4, B="-1")
loft_3 = Loft(
    Curves=flatten(offset_curve_7),
    Options={Adjust=False, Closed=False, LoftEnds=0, LoftSimp=0, LoftType=0, Rebuild=10, Refit=0.01})
offset_curve_8 = OffsetCurve(Curve=list_item_5.Item1, Distance=multiplication_8, Plane=deconstruct_plane_3.YAxis, Corners=1)  # -> flatten(Curve)
offset_curve_9 = OffsetCurve(Curve=list_item_5.Item, Distance=series_4, Plane=deconstruct_plane_3.YAxis, Corners=1)  # -> flatten(Curve)

# ---- group: Streets
custom_preview_lineweights_2 = CustomPreviewLineweights(
    Geometry=[loft, loft_2, loft_3],
    Shader=ColourSwatch(SwatchColor=RGB(235, 181, 171)),
    Thickness=Slider(5, range=0..10),
    Absolute=False)

# ----
# 1. Street & Layers Offset
list_item_6 = ListItem(List=line_2, Index=0, Wrap=True)  # -> Item, Item1
join_curves = JoinCurves(Curves=[list_item_6.Item, list_item_6.Item1], Preserve=False)
line_5 = Line([list_item_2.Item, offset_curve_3])
line_6 = Line([list_item_2.Item1, offset_curve_2])
line_7 = Line([list_item_4.Item, offset_curve_6])
line_8 = Line([list_item_4.Item1, offset_curve_5])
line_9 = Line([list_item_5.Item, offset_curve_9])
line_10 = Line([list_item_5.Item1, offset_curve_8])

list_item_7 = ListItem(List=line_7, Index=-1, Wrap=True)
list_item_8 = ListItem(List=line_9, Index=-1, Wrap=True)
list_item_9 = ListItem(List=line_5, Index=-1, Wrap=True)
list_item_10 = ListItem(List=line_8, Index=-1, Wrap=True)
list_item_11 = ListItem(List=line_10, Index=-1, Wrap=True)
list_item_12 = ListItem(List=line_6, Index=-1, Wrap=True)
end_points = EndPoints(Curve=list_item_7)  # -> Start, End
end_points_2 = EndPoints(Curve=list_item_10)  # -> Start, End
end_points_3 = EndPoints(Curve=list_item_8)  # -> Start, End
end_points_4 = EndPoints(Curve=list_item_9)  # -> Start, End
end_points_5 = EndPoints(Curve=list_item_11)  # -> Start, End
end_points_6 = EndPoints(Curve=list_item_12)  # -> Start, End
interpolate = Interpolate(Vertices=[end_points.Start, end_points_2.Start, end_points_2.End, end_points.End], Degree=1, Periodic=True, KnotStyle=1)  # -> Curve, Length, Domain
interpolate_2 = Interpolate(
    Vertices=[end_points_3.Start, end_points_5.Start, end_points_5.End, end_points_3.End],
    Degree=1,
    Periodic=True,
    KnotStyle=1)  # -> Curve, Length, Domain
interpolate_3 = Interpolate(
    Vertices=[end_points_4.Start, end_points_6.Start, end_points_6.End, end_points_4.End],
    Degree=1,
    Periodic=True,
    KnotStyle=1)  # -> Curve, Length, Domain

# ----
# 4. Find Street Nodes: Local Street = 0, Medium Street = 1, External Nodes = ‘x’
local_street = Geometry([loft, loft_2, loft_3])
deconstruct_brep = DeconstructBrep(Brep=flatten(local_street))  # -> Faces, Edges, Vertices
join_curves_2 = JoinCurves(Curves=deconstruct_brep.Edges, Preserve=False)

# ----
# 6. Find Available Nodes for each street type
merge_4 = Merge(Data1=interpolate_3.Curve, Data2=interpolate.Curve, Data3=interpolate_2.Curve)

# ---- group: Medium Street Generation
division_5 = Division(A=ms_width, B="2")
multiplication_9 = Multiplication(A=division_5, B="-1")
horizontal_frame_4 = HorizontalFrame(Curve=join_curves, Parameter="0,0,0")
deconstruct_plane_4 = DeconstructPlane(Plane=horizontal_frame_4)  # -> Origin, XAxis, YAxis, ZAxis
offset_curve_10 = OffsetCurve(Curve=join_curves, Distance=[division_5, multiplication_9], Plane=deconstruct_plane_4.YAxis, Corners=1)  # -> simplify(Curve)
series_5 = Series(Start=offset_distance, Step=offset_distance, Count=middle_street_layers)
multiplication_10 = Multiplication(A=series_5, B="-1")
loft_4 = Loft(
    Curves=flatten(offset_curve_10),
    Options={Adjust=False, Closed=False, LoftEnds=0, LoftSimp=0, LoftType=0, Rebuild=10, Refit=0.01})

# ---- group: Streets
custom_preview_lineweights_3 = CustomPreviewLineweights(Geometry=loft_4, Shader=ColourSwatch(SwatchColor=RGB(255, 156, 156)), Thickness=Slider(5, range=0..10), Absolute=False)

# ----
medium_street = Geometry(loft_4)
deconstruct_brep_2 = DeconstructBrep(Brep=flatten(medium_street))  # -> Faces, Edges, Vertices
join_curves_3 = JoinCurves(Curves=deconstruct_brep_2.Edges, Preserve=False)

region_difference = RegionDifference(CurvesA=merge_4, MediumStreet=join_curves_3)
region_difference_2 = RegionDifference(CurvesA=region_difference, LocalStreet=flatten(join_curves_2))

addition_7 = Addition(A=round.Ceiling, B=external_layer)

# ---- group: Setting Grid Points
# i = x direction
# j = y-direction
panel_4 = Panel("""1,0,0
-1,0,0""")
panel_5 = Panel("""0,1,0
0,-1,0""")
planar_grid = PlanarGrid(
    BasePoint=center_point.Points,
    IDir=panel_4,
    JDir=graft(panel_5),
    IDistance=expr("x/2", offset_distance),
    JDistance=expr("x/2", offset_distance),
    INumber=expr("2*x", addition_7),
    JNumber=expr("2*x", addition_7))

# ----
tree_statistics = TreeStatistics(Tree=planar_grid)  # -> Paths, Length, Count
dispatch = Dispatch(List=tree_statistics.Paths, DispatchPattern=[True, False])  # -> ListA, ListB
tree_branch_3 = TreeBranch(Tree=planar_grid, Path=dispatch.ListB, MaintainPaths=True)
cull_nth = CullNth(List=tree_branch_3, CullFrequency=2)
cull_duplicates = CullDuplicates(Points=flatten(cull_nth), Tolerance=0.1, CullMode=3)  # -> Points, Indices, Valence

list_item_13 = ListItem(List=flatten(offset_curve_10), Index=0, Wrap=True)  # -> Item, Item1
offset_curve_11 = OffsetCurve(Curve=graft(list_item_13.Item1), Distance=multiplication_10, Plane=deconstruct_plane_4.YAxis, Corners=1)  # -> flatten(Curve)
line_11 = Line([list_item_13.Item1, offset_curve_11])

# ---- group: Right Top
curve_curve_7 = CurveCurve(CurveA=line_11, CurveB=line_9)  # -> flatten(Points), flatten(ParamsA), flatten(ParamsB)
create_set_2 = CreateSet(List=curve_curve_7.ParamsA)  # -> Set, Map
create_set_3 = CreateSet(List=curve_curve_7.ParamsB)  # -> Set, Map
construct_domain = ConstructDomain(DomainStart=create_set_2.Set, DomainEnd=1)
construct_domain_2 = ConstructDomain(DomainStart=create_set_3.Set, DomainEnd=1)
sub_curve = SubCurve(BaseCurve=line_11, Domain=construct_domain)  # -> graft(Curve)
sub_curve_2 = SubCurve(BaseCurve=line_9, Domain=construct_domain_2)  # -> graft(Curve)
join_curves_4 = JoinCurves(Curves=[sub_curve, sub_curve_2], Preserve=False)

curve_curve_8 = CurveCurve(CurveA=line_11, CurveB=line_8)  # -> flatten(Points), flatten(ParamsA), flatten(ParamsB)
create_set_4 = CreateSet(List=curve_curve_8.ParamsA)  # -> Set, Map
create_set_5 = CreateSet(List=curve_curve_8.ParamsB)  # -> Set, Map
construct_domain_3 = ConstructDomain(DomainStart=0, DomainEnd=create_set_4.Set)
construct_domain_4 = ConstructDomain(DomainStart=create_set_5.Set, DomainEnd=1)
sub_curve_3 = SubCurve(BaseCurve=line_11, Domain=construct_domain_3)  # -> graft(Curve)
sub_curve_4 = SubCurve(BaseCurve=line_8, Domain=construct_domain_4)  # -> graft(Curve)
join_curves_5 = JoinCurves(Curves=[sub_curve_3, sub_curve_4], Preserve=False)

# ---- group: Medium Street Generation (continued)
offset_curve_12 = OffsetCurve(Curve=list_item_13.Item, Distance=series_5, Plane=deconstruct_plane_4.YAxis, Corners=1)  # -> flatten(Curve)

# ----
line_12 = Line([list_item_13.Item, offset_curve_12])

# ---- group: Left Bottom
curve_curve_9 = CurveCurve(CurveA=line_12, CurveB=line_6)  # -> flatten(Points), flatten(ParamsA), flatten(ParamsB)
create_set_6 = CreateSet(List=curve_curve_9.ParamsA)  # -> Set, Map
create_set_7 = CreateSet(List=curve_curve_9.ParamsB)  # -> Set, Map
construct_domain_5 = ConstructDomain(DomainStart=create_set_6.Set, DomainEnd=1)
construct_domain_6 = ConstructDomain(DomainStart=create_set_7.Set, DomainEnd=1)
sub_curve_5 = SubCurve(BaseCurve=line_12, Domain=construct_domain_5)  # -> graft(Curve)
sub_curve_6 = SubCurve(BaseCurve=line_6, Domain=construct_domain_6)  # -> graft(Curve)
join_curves_6 = JoinCurves(Curves=[sub_curve_5, sub_curve_6], Preserve=False)

# ---- group: Left Top
# 2. Intersection Resolution
curve_curve_10 = CurveCurve(CurveA=line_12, CurveB=line_5)  # -> flatten(Points), flatten(ParamsA), flatten(ParamsB)
create_set_8 = CreateSet(List=curve_curve_10.ParamsA)  # -> Set, Map
create_set_9 = CreateSet(List=curve_curve_10.ParamsB)  # -> Set, Map
construct_domain_7 = ConstructDomain(DomainStart=0, DomainEnd=create_set_8.Set)
construct_domain_8 = ConstructDomain(DomainStart=create_set_9.Set, DomainEnd=1)
sub_curve_7 = SubCurve(BaseCurve=line_12, Domain=construct_domain_7)  # -> graft(Curve)
sub_curve_8 = SubCurve(BaseCurve=line_5, Domain=construct_domain_8)  # -> graft(Curve)
join_curves_7 = JoinCurves(Curves=[sub_curve_7, sub_curve_8], Preserve=False)

# ---- group: Middle Right
curve_curve_11 = CurveCurve(CurveA=line_10, CurveB=line_11)  # -> Points, flatten(ParamsA), flatten(ParamsB)
curve_curve_12 = CurveCurve(CurveA=line_7, CurveB=line_11)  # -> Points, flatten(ParamsA), flatten(ParamsB)
line_13 = Line(StartPoint=curve_curve_12.Points, EndPoint=curve_curve_11.Points)
line_sdl = LineSDL(Start=curve_curve_12.Points, Direction="1,0,0", Length=boundary_radius_m)
line_sdl_2 = LineSDL(Start=curve_curve_11.Points, Direction="1,0,0", Length=boundary_radius_m)
join_curves_8 = JoinCurves(Curves=[line_sdl, line_sdl_2, line_13], Preserve=False)  # -> flatten(Curves)

# ---- group: Final Street & Layers offset
# 3. Nodes & Edges Generation
medium_right = Line(graft([line_11, join_curves]))
right_bottom = Curve(join_curves_4)
right_middle = Curve(join_curves_8)
left_bottom = Curve(join_curves_6)
right_top = Curve(join_curves_5)
left_top = Curve(join_curves_7)

# ---- group: Offset Streets
colour_swatch_3 = ColourSwatch(SwatchColor=RGB(255, 176, 176))
custom_preview_lineweights_4 = CustomPreviewLineweights(
    SelectedEdgesOfNode=[join_curves_5, join_curves_8, join_curves_4, join_curves_6, join_curves_7],
    Shader=ColourSwatch(SwatchColor=RGB(168, 168, 168)),
    Thickness=Slider(2, range=0..10),
    Absolute=False)

# ----
curve_closest_point = CurveClosestPoint(Point=flatten(cull_duplicates.Points), Curve=graft(left_bottom))  # -> Point, Parameter, Distance
curve_closest_point_2 = CurveClosestPoint(Point=flatten(cull_duplicates.Points), Curve=graft(left_top))  # -> Point, Parameter, Distance
curve_closest_point_3 = CurveClosestPoint(Point=flatten(cull_duplicates.Points), Curve=graft([right_top, right_bottom, right_middle, medium_right]))  # -> Point, Parameter, Distance
cull_duplicates_2 = CullDuplicates(Points=flatten(curve_closest_point.Point), Tolerance=0.1, CullMode=3)  # -> simplify(Points), Indices, Valence
cull_duplicates_3 = CullDuplicates(Points=flatten(curve_closest_point_3.Point), Tolerance=0.1, CullMode=3)  # -> simplify(Points), Indices, Valence
cull_duplicates_4 = CullDuplicates(Points=flatten(curve_closest_point_2.Point), Tolerance=0.1, CullMode=3)  # -> simplify(Points), Indices, Valence
merge_5 = Merge(
    Data1=flatten(cull_duplicates_3.Points),
    Data2=flatten(cull_duplicates_2.Points),
    Data3=flatten(cull_duplicates_4.Points))  # -> simplify(flatten(Result))
point_in_curve = PointInCurve(Point=merge_5, Curve=circle)  # -> Relationship, Point
equality_2 = Equality(FirstNumber=2, SecondNumber=point_in_curve.Relationship)  # -> Equality, Inequality
cull_pattern_2 = CullPattern(List=merge_5, CullPattern=equality_2.Equality)
proximity_2d = Proximity2D(Points=cull_pattern_2, Plane=PlaneXY(0, 0, 0), Group=5, MinRadius=subtraction, MaxRadius=addition_3)  # -> Links, simplify(Topology)
unit_y_5 = UnitY(Factor=expr("x/2", offset_distance))
unit_x_2 = UnitX(Factor=expr("x/2", offset_distance))
boundary_surfaces = BoundarySurfaces(Edges=flatten(proximity_2d.Links))
addition_8 = Addition(A=unit_x_2, B=unit_y_5)
move_6 = Move(Geometry=cull_pattern_2, Motion=addition_8)  # -> Geometry, Transform
deconstruct_brep_3 = DeconstructBrep(Brep=boundary_surfaces)  # -> Faces, Edges, Vertices

interpolate_4 = Interpolate(Vertices=deconstruct_brep_3.Vertices, Degree=1, Periodic=True, KnotStyle=0)  # -> flatten(Curve), Length, Domain

# ----
# 5. Create External X grid (a bug with offset not working nicely)
offset_curve_13 = OffsetCurve(Curve=interpolate_4.Curve, Distance=offset_distance, Corners=1)
curve_closest_point_4 = CurveClosestPoint(Point=cull_duplicates.Points, Curve=offset_curve_13)  # -> Point, Parameter, Distance
cull_duplicates_5 = CullDuplicates(Points=curve_closest_point_4.Point, Tolerance=0.1, CullMode=3)  # -> Points, Indices, Valence
merge_6 = Merge(Data1=cull_pattern_2, Data2=cull_duplicates_5.Points)  # -> flatten(Result)
proximity_2d_2 = Proximity2D(Points=flatten(merge_6), Plane=PlaneXY(0, 0, 0), Group=5, MinRadius=subtraction, MaxRadius=addition_3)  # -> Links, simplify(Topology)
boundary_surfaces_2 = BoundarySurfaces(Edges=flatten(proximity_2d_2.Links))
surface_split = SurfaceSplit(Surface=boundary_surfaces_2, Curves=interpolate_4.Curve)
list_item_14 = ListItem(List=surface_split, Index=0, Wrap=True)  # -> Item, Item1
surface_split_2 = SurfaceSplit(Surface=list_item_14.Item, Curves=flatten(proximity_2d_2.Links))
area = Area(Geometry=surface_split_2)  # -> Area, Centroid

boundary_curve = Curve(interpolate_4.Curve)
region_intersection = RegionIntersection(CurvesA=region_difference_2, CurvesB=boundary_curve)

point_in_curves = PointInCurves(Point=move_6.Geometry, Curves=interpolate_4.Curve)  # -> Relationship, Index, Point
cull_pattern_3 = CullPattern(List=move_6.Geometry, CullPattern=point_in_curves.Relationship)

# ---- group: Include External Nodes into Nodes List
merge_7 = Merge(Data1=cull_pattern_3, Data2=area.Centroid)  # -> flatten(Result)

# ---- group: Retrieve points list based on layer / step from street
merge_8 = Merge(
    Data1=simplify(join_curves_7),
    Data2=simplify(join_curves_6),
    Data3=simplify(join_curves_5),
    Data4=simplify(join_curves_4),
    Data5=simplify(graft(join_curves_8)))
explode_tree_2 = ExplodeTree(Data=merge_8)  # -> Branch0, Branch1, Branch2, Branch3, Branch4, Branch5
offset_curve_14 = OffsetCurve(Curve=explode_tree_2.Branch1, Distance=expr("x/2", offset_distance), Corners=1)  # -> flatten(Curve)
offset_curve_15 = OffsetCurve(Curve=explode_tree_2.Branch2, Distance=expr("x/2", offset_distance), Corners=1)  # -> flatten(Curve)
offset_curve_16 = OffsetCurve(Curve=explode_tree_2.Branch5, Distance=expr("x/2", offset_distance), Corners=1)  # -> flatten(Curve)
offset_curve_17 = OffsetCurve(Curve=explode_tree_2.Branch3, Distance=expr("x/2", offset_distance), Corners=1)  # -> flatten(Curve)
offset_curve_18 = OffsetCurve(Curve=explode_tree_2.Branch4, Distance=expr("x/2", offset_distance), Corners=1)  # -> flatten(Curve)

# ----
distance = Distance(PointA=center_point.Points, PointB=merge_7)
sort_nodes_by_proximity = SortList(Keys=distance, ValuesValuesA=merge_7)  # -> Keys, ValuesValuesA

# ----
# Colour Visuals
number_slider_2 = Slider(18, range=0..100)
smaller_than = SmallerThan(FirstNumber=sort_nodes_by_proximity.Keys, SecondNumber=number_slider_2)  # -> SmallerThan, OrEqualTo
colour_swatch_4 = ColourSwatch(SwatchColor=RGB(255, 145, 145))

# ---- group: Cell Outline
colour_swatch_5 = ColourSwatch(SwatchColor=RGB(254, 255, 255))
cell_line = Line(simplify(proximity_2d.Links))
custom_preview_lineweights_5 = CustomPreviewLineweights(
    Geometry=cell_line,
    Shader=ColourSwatch(SwatchColor=RGB(168, 168, 168)),
    Thickness=Slider(2, range=0..10),
    Absolute=False)

# ----
cull_pattern_4 = CullPattern(List=sort_nodes_by_proximity.ValuesValuesA, CullPattern=smaller_than.OrEqualTo)
circle_2 = Circle(Plane=PlaneXY(0, 0, 0), Radius=number_slider_2)

# ---- group: Names Label
concatenate_2 = Concatenate(FragmentA=reading_json_output.names_list)

# ---- group: Layer Label
subtraction_2 = Subtraction(A=layer, B="1")

# ---- group: Outputs
nodes_distance_from_intersection = Data(sort_nodes_by_proximity.Keys)
nodes_points_level_1 = Point(sort_nodes_by_proximity.ValuesValuesA)

# ----
point_in_curves_2 = PointInCurves(Point=nodes_points_level_1, Curves=flatten(join_curves_3))  # -> Relationship, Index, Point
point_in_curves_3 = PointInCurves(Point=nodes_points_level_1, Curves=flatten(join_curves_2))  # -> Relationship, Index, Point
cull_pattern_5 = CullPattern(List=nodes_points_level_1, CullPattern=point_in_curves_2.Relationship)
cull_pattern_6 = CullPattern(List=nodes_points_level_1, CullPattern=point_in_curves_3.Relationship)
item_index_2 = ItemIndex(List=nodes_points_level_1, Item=cull_pattern_5)
item_index_3 = ItemIndex(List=nodes_points_level_1, Item=cull_pattern_6)
index_of_medium_street_nodes = Data(item_index_2)
list_item_15 = ListItem(List=nodes_points_level_1, Index=index_of_medium_street_nodes, Wrap=True)
index_of_local_street_nodes = Data(item_index_3)
list_item_16 = ListItem(List=nodes_points_level_1, Index=index_of_local_street_nodes, Wrap=True)
medium_street_nodes = Point(list_item_15)
local_street_nodes = Point(list_item_16)

item_index_4 = ItemIndex(List=nodes_points_level_1, Item=area.Centroid)
sort_list = SortList(Keys=item_index_4, ValuesValuesA=area.Centroid)  # -> Keys, ValuesValuesA
external_nodes_index = Data(flatten(sort_list.Keys))
list_item_17 = ListItem(List=nodes_points_level_1, Index=external_nodes_index, Wrap=True)
external_nodes = Point(list_item_17)

# ----
# Main Dependency in script
# is topology re-branching
# number to change
proximity_2d_3 = Proximity2D(Points=nodes_points_level_1, Plane=PlaneXY(0, 0, 0), Group=5, MinRadius=subtraction, MaxRadius=addition_3)  # -> simplify(Links), simplify(Topology)
tree_statistics_2 = TreeStatistics(Tree=proximity_2d_3.Links)  # -> Paths, Length, Count
tree_statistics_3 = TreeStatistics(Tree=proximity_2d_3.Topology)  # -> Paths, Length, Count
sort_links_by_proximity = SortList(Keys=distance, ValuesValuesA=tree_statistics_2.Paths)  # -> Keys, ValuesValuesA
sort_topology_by_proximity = SortList(Keys=distance, ValuesValuesA=tree_statistics_3.Paths)  # -> Keys, ValuesValuesA
tree_branch_4 = TreeBranch(Tree=proximity_2d_3.Links, Path=sort_links_by_proximity.ValuesValuesA, MaintainPaths=True)
tree_branch_5 = TreeBranch(Tree=proximity_2d_3.Topology, Path=sort_topology_by_proximity.ValuesValuesA, MaintainPaths=True)
create_set_10 = CreateSet(List=nodes_points_level_1)  # -> Set, Map

# ---- group: Retrieve points list based on layer / step from street (continued)
curve_closest_point_5 = CurveClosestPoint(Point=nodes_points_level_1, Curve=simplify(graft(offset_curve_14)))  # -> Point, Parameter, Distance
curve_closest_point_6 = CurveClosestPoint(Point=nodes_points_level_1, Curve=simplify(graft(offset_curve_15)))  # -> Point, Parameter, Distance
curve_closest_point_7 = CurveClosestPoint(Point=nodes_points_level_1, Curve=simplify(graft(offset_curve_17)))  # -> Point, Parameter, Distance
curve_closest_point_8 = CurveClosestPoint(Point=nodes_points_level_1, Curve=simplify(graft(offset_curve_18)))  # -> Point, Parameter, Distance
curve_closest_point_9 = CurveClosestPoint(Point=nodes_points_level_1, Curve=simplify(graft(offset_curve_16)))  # -> Point, Parameter, Distance
cull_duplicates_6 = CullDuplicates(Points=curve_closest_point_5.Point, Tolerance=0.1, CullMode=3)  # -> flatten(Points), Indices, Valence
cull_duplicates_7 = CullDuplicates(Points=curve_closest_point_6.Point, Tolerance=0.1, CullMode=3)  # -> flatten(Points), Indices, Valence
cull_duplicates_8 = CullDuplicates(Points=curve_closest_point_7.Point, Tolerance=0.1, CullMode=3)  # -> flatten(Points), Indices, Valence
cull_duplicates_9 = CullDuplicates(Points=curve_closest_point_8.Point, Tolerance=0.1, CullMode=3)  # -> flatten(Points), Indices, Valence
cull_duplicates_10 = CullDuplicates(Points=curve_closest_point_9.Point, Tolerance=0.1, CullMode=3)  # -> flatten(Points), Indices, Valence
member_index = MemberIndex(Set=nodes_points_level_1, Member=cull_duplicates_7.Points)  # -> flatten(Index), Count
member_index_2 = MemberIndex(Set=nodes_points_level_1, Member=cull_duplicates_8.Points)  # -> flatten(Index), Count
member_index_3 = MemberIndex(Set=nodes_points_level_1, Member=cull_duplicates_9.Points)  # -> flatten(Index), Count
member_index_4 = MemberIndex(Set=nodes_points_level_1, Member=cull_duplicates_6.Points)  # -> flatten(Index), Count
member_index_5 = MemberIndex(Set=nodes_points_level_1, Member=cull_duplicates_10.Points)  # -> flatten(Index), Count
remove_overlap_pts = GhPythonScript(list_a=member_index_2.Index, list_b=member_index_3.Index)  # -> out, new_list_b; inputs list_a: list of Int32, list_b: list of Int32
# ---------- remove_overlap_pts: Python ----------
__author__ = "junwenloo"

import rhinoscriptsyntax as rs

for i in list_a:
    if i in list_b:
        list_b.remove(i)
        print(i)

new_list_b = list_b
# ---------- end remove_overlap_pts ----------
remove_overlap_pts_2 = GhPythonScript(list_a=member_index_2.Index, list_b=member_index_5.Index)  # -> out, new_list_b; inputs list_a: list of Int32, list_b: list of Int32; same code as remove_overlap_pts
entwine = Entwine(
    Branch00=member_index_4.Index,
    Branch01=member_index.Index,
    Branch02=member_index_2.Index,
    Branch03=remove_overlap_pts.new_list_b,
    Branch04=remove_overlap_pts_2.new_list_b,
    FlattenInputs=True)  # -> simplify(Result)
param_viewer_2 = ParamViewer(entwine)

# ---- group: Node Labelling
point_list = PointList(AllNodes=flatten(nodes_points_level_1), Size=Slider(0.8, range=0..10))

# ---- group: All Edges (Level 1)
all_edges = Line(simplify(proximity_2d_3.Links))
custom_preview_lineweights_6 = CustomPreviewLineweights(
    Geometry=all_edges,
    Shader=ColourSwatch(SwatchColor=RGB(255, 229, 112)),
    Thickness=Slider(3, range=0..10),
    Absolute=False)

# ----
point_in_curves_4 = PointInCurves(Point=nodes_points_level_1, Curves=region_intersection)  # -> Relationship, Index, Point
cull_pattern_7 = CullPattern(List=point_in_curves_4.Point, CullPattern=point_in_curves_4.Relationship)
item_index_5 = ItemIndex(List=point_in_curves_4.Point, Item=cull_pattern_7)  # -> flatten(Index)
local_street_available_node_index = Data(item_index_5)

# ---- group: Creating Nodes & Edges for 2nd Level
deconstruct_2 = Deconstruct(Point=nodes_points_level_1)  # -> XComponent, YComponent, ZComponent
construct_point_2 = ConstructPoint(XCoordinate=deconstruct_2.XComponent, YCoordinate=deconstruct_2.YComponent, ZCoordinate=offset_height)
list_length_2 = ListLength(List=construct_point_2)
proximity_2d_4 = Proximity2D(Points=construct_point_2, Plane=PlaneXY(0, 0, 0), Group=5, MinRadius=subtraction, MaxRadius=addition_3)  # -> simplify(Links), simplify(Topology)
addition_9 = Addition(A=proximity_2d_4.Topology, B=list_length_2)
path_mapper = PathMapper(addition_9, source="{A;B}", target="{path_index +580}")

# ---- group: All Edges (Level 2)
all_edges_2 = Line(simplify(proximity_2d_4.Links))
custom_preview_lineweights_7 = CustomPreviewLineweights(
    Geometry=all_edges_2,
    Shader=ColourSwatch(SwatchColor=RGB(255, 242, 184)),
    Thickness=Slider(5, range=0..10),
    Absolute=False)

# ---- group: Outputs (continued)
sorted_topology_level_1 = Data(tree_branch_5)
sorted_links_level_2 = Line(proximity_2d_4.Links)
sorted_links_level_1 = Line(tree_branch_4)
nodes_points_level_2 = Point(construct_point_2)
layer_nodes_index = Data(entwine)
node_index = Data(create_set_10.Map)

# ----
cull_index = CullIndex(
    List=node_index,
    Indices=flatten([external_nodes_index, index_of_local_street_nodes, index_of_medium_street_nodes, local_street_available_node_index]),
    Wrap=True)  # -> simplify(List)
medium_street_available_node_index = Data(cull_index)

merge_9 = Merge(Data1=nodes_points_level_1, Data2=nodes_points_level_2)
addition_10 = Addition(A=node_index, B=list_length_2)

# ---- group: Creating Nodes & Edges for 2nd Level (continued)
merge_10 = Merge(Data1=sorted_topology_level_1, Data2=path_mapper)

# ---- group: Selected Node
tree_statistics_4 = TreeStatistics(Tree=sorted_topology_level_1)  # -> Paths, Length, Count
list_item_18 = ListItem(List=tree_statistics_4.Paths, Index=node_check, Wrap=True)
tree_branch_6 = TreeBranch(Tree=sorted_links_level_1, Path=list_item_18, MaintainPaths=True)
custom_preview_lineweights_8 = CustomPreviewLineweights(
    SelectedEdgesOfNode=tree_branch_6,
    Shader=ColourSwatch(SwatchColor=RGB(255, 125, 125)),
    Thickness=Slider(7, range=0..10),
    Absolute=False)

# ---- group: Outputs (continued)
node_index_with_2nd_level = Data(addition_10)
sorted_topology_all = Data(merge_10)
nodes_index_all = Integer([node_index, node_index_with_2nd_level])
nodes_all = Point(merge_9)

# ---- group: Layer Label (continued)
list_item_19 = ListItem(List=nodes_all, Index=member_index_4.Index, Wrap=True)
list_item_20 = ListItem(List=nodes_all, Index=member_index.Index, Wrap=True)
list_item_21 = ListItem(List=nodes_all, Index=member_index_2.Index, Wrap=True)
list_item_22 = ListItem(List=nodes_all, Index=remove_overlap_pts.new_list_b, Wrap=True)
list_item_23 = ListItem(List=nodes_all, Index=remove_overlap_pts_2.new_list_b, Wrap=True)
entwine_2 = Entwine(
    Branch00=list_item_19,
    Branch01=list_item_20,
    Branch02=list_item_21,
    Branch03=list_item_22,
    Branch04=list_item_23,
    FlattenInputs=True)
tree_branch_7 = TreeBranch(Tree=simplify(entwine_2), Path=subtraction_2, MaintainPaths=True)
custom_preview_2 = CustomPreview(Geometry=tree_branch_7, Material=ColourSwatch(SwatchColor=RGB(245, 93, 93)))

# ---- group: Names Label (continued)
list_item_24 = ListItem(List=nodes_all, Index=reading_json_output.node_list, Wrap=True)
text_tag_3d_2 = TextTag3D(
    Location=list_item_24,
    Text=concatenate_2,
    Size=Slider(0.5, range=0..1),
    Colour=ColourSwatch(SwatchColor=RGB(16, 61, 61)),
    Justification=5)

# ----
# Explanation of outputs:
# Each item in this list represents the
# distance of each node from the intersection
# Each item in this list represents a node
# as a point in 3d space (thus having coordinates)
# Each branch number represents 1 node,
# and the items in each branch are the edges
# as “lines” that each node is connected to
# Each branch number represents 1 node,
# and the items in each branch are the other
# nodes it connects to
# Each item represents the index of 1 node
#  that lies on the street
# Each item represents 1 node that lies on the
# Medium street
# Each item represents 1 node that lies on the
# Local street
# Each item represents the index of the
# External Node outside the available nodes for placement
# Each item represents the Point3D of the
# External Node
# Each item represents the index of available
# nodes along a Local Street
# Each item represents the index of available
# nodes along a Medium Street
ls_avail_node_index = Panel(local_street_available_node_index)
ms_avail_node_index = Panel(medium_street_available_node_index)
nodes_dist_from_intersection = Panel(nodes_distance_from_intersection)
nodes_2 = Panel(nodes_points_level_1)
edges_lines = Panel(sorted_links_level_1)
edges_connection = Panel(sorted_topology_level_1)
index_of_nodes_on_street = Panel(index_of_medium_street_nodes)
medium_street_nodes_2 = Panel(medium_street_nodes)
local_street_nodes_2 = Panel(local_street_nodes)
external_nodes_index_2 = Panel(external_nodes_index)
external_nodes_2 = Panel(external_nodes)

# ---- group: Node Labelling with level 2
point_list_2 = PointList(AllNodes=flatten(merge_9), Size=Slider(0.9, range=0..10))

# ----
# Conversion to JSON file
panel_6 = Panel("/Users/junwenloo/OneDrive/2020 ONWARDS/06_Delft/15_Y2Q1/01_Earthy/03_Scripts/Earthy4.2/0_Configuration/Foundation/edges.txt")
panel_7 = Panel("/Users/junwenloo/OneDrive/2020 ONWARDS/06_Delft/15_Y2Q1/01_Earthy/03_Scripts/Earthy4.2/0_Configuration/Foundation/nodes_1.txt")
# 7. Data Export
panel_8 = Panel("""83
97
118
140
171
84
99
119
141
172""")
topology_extraction_export = GhPythonScript(
    nodes_index=nodes_index_all,
    ms_nodes_index=index_of_medium_street_nodes,
    ls_nodes_index=index_of_local_street_nodes,
    x_nodes_index=external_nodes_index,
    ls_avail_nodes_index=local_street_available_node_index,
    ms_avail_nodes_index=medium_street_available_node_index,
    layer_nodes_index=layer_nodes_index,
    point_count=list_length_2,
    edge_list=sorted_topology_level_1,
    stair_nodes=panel_8,
    fpath_nodes=panel,
    fpath_nodes_1=panel_7,
    fpath_nodes_2=panel_2,
    fpath_edges=panel_6,
    run=Toggle(False))  # -> out, edges; inputs nodes_index: list of Int32, ms_nodes_index: list of Int32, ls_nodes_index: list of Int32, x_nodes_index: list of Int32, ls_avail_nodes_index: list of Int32, ms_avail_nodes_index: list of Int32, layer_nodes_index: tree of Int32, point_count: Int32, edge_list: tree of Int32, stair_nodes: list of Int32, run: Boolean
# ---------- topology_extraction_export: Python ----------
"""Provides a scripting component.
    Inputs:
        nodes_index: List of points, flattened
        ms_nodes_list: Index of Medium Street Nodes
        ls_nodes_index: Index of Local Street Nodes
        x_nodes_index: Index of External Nodes
        ls_avail_nodes_index: Index of Local Street available nodes
        ms_avail_nodes_index: Index of Medium Street available nodes
        edge_list: Tree of Edges with each branch representing a node
        layer_nodes_index: Tree with each branch representing a "step" from the street, and items in branch as index of nodes on that "step"
        point_count: Int of number of points in 1 level of the site
        stair_nodes: List of Layer 1 nodes which represents a staircase module
        fpath_nodes: Filepath for Nodes file
        fpath_edges: Filepath for Edges file
        run: False = No writing to file, True = Write
"""

__author__ = "junwenloo"

import rhinoscriptsyntax as rs
from ghpythonlib import treehelpers as th
import json

#obtained definition from stack overflow, https://stackoverflow.com/questions/38987/how-do-i-merge-two-dictionaries-in-a-single-expression-taking-union-of-dictiona
def merge_two_dicts(x, y):
    z = x.copy()   # start with keys and values of x
    z.update(y)    # modifies z with keys and values of y
    return z

"""
    Node Attributes graph creation, filled only with 'tag' and 'use_frequency' data
Key as nodes and values of each nodes as a dictionary of attributes:
"name" - Node index
'district' - Based on user's district
"type" - None
"use_frequency - "D" (Local Street, Daily), "M" (Medium Street, Monthly) [[Future work - "O" (Main Street, Occasional)]]
"units" - None 
"tag" - None (available node), 0 (Local Street), 1 (Medium Street), 2 (Main Street), 3 (Staircase), 4 (2nd Level Street), "x" (External Node)
"layer" - 1,2,3,4,5 etc - Represents the number of steps from the street
"""

nodes_1 = {}
nodes_2 = {}


layer_nodes_index = th.tree_to_list(layer_nodes_index, None)

for i in nodes_index:
    
    half = int((len(nodes_index))/2)
    
    if i < half:
        #level 1 nodes

        n_attr_dict = {}
        n_attr_dict["name"] = i
        n_attr_dict['district'] = 7
        n_attr_dict['type'] = None
        n_attr_dict['units'] = None

        if i in ms_nodes_index:
            #medium street attributes
            n_attr_dict['use_frequency'] = "M"
            n_attr_dict['tag'] = 1
            
        elif i in ls_nodes_index:
            #local street attributes
            n_attr_dict['use_frequency'] = "D"
            n_attr_dict['tag'] = 0
        
        elif i in x_nodes_index:
            #external nodes attributes
            n_attr_dict['use_frequency'] = None
            n_attr_dict['tag'] = "x"

        elif i in ls_avail_nodes_index:
            #local street available nodes
            n_attr_dict['use_frequency'] = "D"
            
            #to locate the stair nodes
            if i in stair_nodes:
                n_attr_dict['tag'] = 3
            else:
                n_attr_dict['tag'] = None
                
        elif i in ms_avail_nodes_index:
            #medium street available nodes
            n_attr_dict['use_frequency'] = "M"
            
            #to locate the stair nodes
            if i in stair_nodes:
                n_attr_dict['tag'] = 3
            else:
                n_attr_dict['tag'] = None

        nodes_1[int(i)] = n_attr_dict
    
    else:
        #level 2 nodes
        
        n_attr_dict = {}
        n_attr_dict["name"] = i
        n_attr_dict['district'] = 7
        n_attr_dict['type'] = None
        n_attr_dict['units'] = None
            
        if i-point_count in ms_nodes_index:
            #medium street attributes
            n_attr_dict['use_frequency'] = "M"
            n_attr_dict['tag'] = 1
            
        elif i-point_count in ls_nodes_index:
            #local street attributes
            n_attr_dict['use_frequency'] = "D"
            n_attr_dict['tag'] = 0
        
        elif i-point_count in x_nodes_index:
            #external nodes attributes
            n_attr_dict['use_frequency'] = None
            n_attr_dict['tag'] = "x"

        elif i-point_count in ls_avail_nodes_index:
            #local street available nodes
            n_attr_dict['use_frequency'] = "D"
            
            #to locate the stair nodes
            if i in stair_nodes:
                n_attr_dict['tag'] = 3
            else:
                n_attr_dict['tag'] = None
        
        elif i-point_count in ms_avail_nodes_index:
            #medium street available nodes
            n_attr_dict['use_frequency'] = "M"
            
            #to locate the stair nodes
            if i in stair_nodes:
                n_attr_dict['tag'] = 3
            else:
                n_attr_dict['tag'] = None
        
        nodes_2[int(i)] = n_attr_dict


#adding layer information
for index, step in enumerate(layer_nodes_index):
    for node in step:
            #for level 1 nodes
            nodes_1[node]["layer"] = int(index + 1)
            #for 2nd level nodes
            nodes_2[node + point_count]["layer"] = int(index + 1)

"""
    Create Edge list as tuples of (Start_node, ened_node) to build graph in Networkx
"""

edge_list = th.tree_to_list(edge_list, None)

edges = []

for start_node in range(len(edge_list)):
    for end_node in edge_list[start_node]:
        
        edges.append((start_node, end_node))
        edges.append((start_node + point_count, end_node + point_count))
"""
    Optional: Combining Nodes_1 and Nodes_2 together into nodes.txt
"""

nodes = merge_two_dicts(nodes_1, nodes_2)

"""
    Writing JSON file of nodes.txt and edges.txt
"""

if run:
    
    with open(str(fpath_nodes), 'w') as outfile:
        json.dump(nodes, outfile)

    with open(str(fpath_nodes_1), 'w') as outfile:
        json.dump(nodes_1, outfile)

    with open(str(fpath_nodes_2), 'w') as outfile:
        json.dump(nodes_2, outfile)

    with open(str(fpath_edges), 'w') as outfile:
        json.dump(edges, outfile)
# ---------- end topology_extraction_export ----------

# ----
# Logic 4.1: Y-axis to 0
tree_branch_8 = TreeBranch(Tree=simplify(reading_json_output.connection), Path=explode_tree.Branch4, MaintainPaths=True)
tree_branch_9 = TreeBranch(Tree=simplify(reading_json_output.all_edge), Path=explode_tree.Branch4, MaintainPaths=True)
list_item_25 = ListItem(List=reading_json_output.node_list, Index=explode_tree.Branch4, Wrap=True)
panel_9 = Panel(tree_branch_8)
panel_10 = Panel(tree_branch_9)
cull_pattern_8 = CullPattern(List=tree_branch_9, CullPattern=invert(tree_branch_8))
base_node = ListItem(List=nodes_all, Index=list_item_25, Wrap=True)
_2_neighbouring_points = ListItem(List=nodes_all, Index=cull_pattern_8, Wrap=True)  # -> flatten(Item)
x_axis_derivation = XAxisDerivation(plane=base_node, geometry=_2_neighbouring_points)
vector_2pt_2 = Vector2Pt(PointA=base_node, PointB=_2_neighbouring_points, Unitize=True)  # -> Vector, Length
construct_plane = ConstructPlane(Origin=graft(base_node), XAxis=graft(x_axis_derivation), YAxis=graft(vector_2pt_2.Vector))  # -> flatten(Plane)

# ----
# 9. Frames Orientation Logics
# Logic 1.0: Any Orientation
list_item_26 = ListItem(List=reading_json_output.node_list, Index=explode_tree.Branch0, Wrap=True)
list_item_27 = ListItem(List=nodes_all, Index=list_item_26, Wrap=True)
construct_plane_2 = ConstructPlane(Origin=list_item_27, XAxis=Vector(1, 0, 0), YAxis=Vector(0, 1, 0))

replace_items = ReplaceItems(List=reading_json_output.node_list, Item=construct_plane_2, Indices=explode_tree.Branch0, Wrap=False)
panel_11 = Panel(replace_items)

# ----
# Logic 4.2: Y-axis to 0, X-axis to 1
tree_branch_10 = TreeBranch(Tree=simplify(reading_json_output.connection), Path=explode_tree.Branch5, MaintainPaths=True)
tree_branch_11 = TreeBranch(Tree=simplify(reading_json_output.all_edge), Path=explode_tree.Branch5, MaintainPaths=True)
list_item_28 = ListItem(List=reading_json_output.node_list, Index=explode_tree.Branch5, Wrap=True)
panel_12 = Panel(tree_branch_10)
panel_13 = Panel(tree_branch_11)
equality_3 = Equality(FirstNumber=tree_branch_10, SecondNumber="1")  # -> Equality, Inequality
base_node_2 = ListItem(List=nodes_all, Index=list_item_28, Wrap=True)

# ---- group: Get "0" node
cull_pattern_9 = CullPattern(List=tree_branch_11, CullPattern=invert(tree_branch_10))

# ---- group: Get "1" node
cull_pattern_10 = CullPattern(List=tree_branch_11, CullPattern=equality_3.Equality)

# ----
_2_neighbouring_points_2 = ListItem(List=nodes_all, Index=cull_pattern_9, Wrap=True)  # -> flatten(Item)
vector_2pt_3 = Vector2Pt(PointA=base_node_2, PointB=_2_neighbouring_points_2, Unitize=True)  # -> Vector, Length
_2_neighbouring_points_3 = ListItem(List=nodes_all, Index=cull_pattern_10, Wrap=True)  # -> flatten(Item)
vector_2pt_4 = Vector2Pt(PointA=base_node_2, PointB=_2_neighbouring_points_3, Unitize=True)  # -> Vector, Length
construct_plane_3 = ConstructPlane(Origin=graft(base_node_2), XAxis=graft(vector_2pt_4.Vector), YAxis=graft(vector_2pt_3.Vector))  # -> flatten(Plane)

panel_14 = Panel(equality_3.Equality)

# ----
# Logic 4.3: Y-axis to 0, X-axis to 2
tree_branch_12 = TreeBranch(Tree=simplify(reading_json_output.connection), Path=explode_tree.Branch6, MaintainPaths=True)
tree_branch_13 = TreeBranch(Tree=simplify(reading_json_output.all_edge), Path=explode_tree.Branch6, MaintainPaths=True)
list_item_29 = ListItem(List=reading_json_output.node_list, Index=explode_tree.Branch6, Wrap=True)
panel_15 = Panel(tree_branch_12)
panel_16 = Panel(tree_branch_13)
equality_4 = Equality(FirstNumber=tree_branch_12, SecondNumber="2")  # -> Equality, Inequality
base_node_3 = ListItem(List=nodes_all, Index=list_item_29, Wrap=True)

# ---- group: Get "0" node
cull_pattern_11 = CullPattern(List=tree_branch_13, CullPattern=invert(tree_branch_12))

# ---- group: Get "2" node
cull_pattern_12 = CullPattern(List=tree_branch_13, CullPattern=equality_4.Equality)

# ----
# Logic 5.1: Y-axis to 1
tree_branch_14 = TreeBranch(Tree=simplify(reading_json_output.connection), Path=explode_tree.Branch7, MaintainPaths=True)
tree_branch_15 = TreeBranch(Tree=simplify(reading_json_output.all_edge), Path=explode_tree.Branch7, MaintainPaths=True)
panel_17 = Panel(tree_branch_15)
panel_18 = Panel(tree_branch_14)
list_item_30 = ListItem(List=reading_json_output.node_list, Index=explode_tree.Branch7, Wrap=True)  # -> graft(Item)
base_node_4 = ListItem(List=nodes_all, Index=list_item_30, Wrap=True)

# ---- group: To get "1" facing nodes
cull_pattern_13 = CullPattern(List=tree_branch_15, CullPattern=tree_branch_14)

# ----
list_item_31 = ListItem(List=cull_pattern_13, Index=0, Wrap=True)
_1_neighbouring_point = ListItem(List=nodes_all, Index=list_item_31, Wrap=True)
rotate_2 = Rotate(Geometry=_1_neighbouring_point, Angle=degrees("90"), Plane=base_node_4)  # -> Geometry, Transform
vector_2pt_5 = Vector2Pt(PointA=graft(base_node_4), PointB=_1_neighbouring_point, Unitize=True)  # -> Vector, Length
vector_2pt_6 = Vector2Pt(PointA=rotate_2.Geometry, PointB=base_node_4, Unitize=True)  # -> Vector, Length
construct_plane_4 = ConstructPlane(Origin=base_node_4, XAxis=vector_2pt_6.Vector, YAxis=vector_2pt_5.Vector)  # -> flatten(Plane)

# ----
# Logic 5.2: Y-axis to 1, X-axis to 0
tree_branch_16 = TreeBranch(Tree=simplify(reading_json_output.connection), Path=explode_tree.Branch8, MaintainPaths=True)
tree_branch_17 = TreeBranch(Tree=simplify(reading_json_output.all_edge), Path=explode_tree.Branch8, MaintainPaths=True)
equality_5 = Equality(FirstNumber=tree_branch_16, SecondNumber="0")  # -> Equality, Inequality
panel_19 = Panel(tree_branch_16)
panel_20 = Panel(tree_branch_17)
list_item_32 = ListItem(List=reading_json_output.node_list, Index=explode_tree.Branch8, Wrap=True)  # -> graft(Item)
equality_6 = Equality(FirstNumber=tree_branch_16, SecondNumber="1")  # -> Equality, Inequality
cull_pattern_14 = CullPattern(List=tree_branch_17, CullPattern=equality_5.Equality)
base_node_5 = ListItem(List=nodes_all, Index=list_item_32, Wrap=True)
list_item_33 = ListItem(List=cull_pattern_14, Index=0, Wrap=True)  # -> Item, Item1
_1_neighbouring_point_2 = ListItem(List=nodes_all, Index=list_item_33.Item1, Wrap=True)
vector_2pt_7 = Vector2Pt(PointA=base_node_5, PointB=_1_neighbouring_point_2, Unitize=True)  # -> Vector, Length

# ---- group: To get "1" facing nodes
cull_pattern_15 = CullPattern(List=tree_branch_17, CullPattern=equality_6.Equality)

# ----
_1_neighbouring_point_3 = ListItem(List=nodes_all, Index=cull_pattern_15, Wrap=True)
vector_2pt_8 = Vector2Pt(PointA=graft(base_node_5), PointB=_1_neighbouring_point_3, Unitize=True)  # -> Vector, Length
construct_plane_5 = ConstructPlane(Origin=base_node_5, XAxis=vector_2pt_7.Vector, YAxis=vector_2pt_8.Vector)  # -> flatten(Plane)

# ----
# Logic 2.0: Y-axis to 1 or 2
tree_branch_18 = TreeBranch(Tree=simplify(reading_json_output.connection), Path=explode_tree.Branch1, MaintainPaths=True)
tree_branch_19 = TreeBranch(Tree=simplify(reading_json_output.all_edge), Path=explode_tree.Branch1, MaintainPaths=True)
panel_21 = Panel(tree_branch_19)
panel_22 = Panel(tree_branch_18)
list_item_34 = ListItem(List=reading_json_output.node_list, Index=explode_tree.Branch1, Wrap=True)  # -> graft(Item)
base_node_6 = ListItem(List=nodes_all, Index=list_item_34, Wrap=True)

# ---- group: To get "1" facing nodes
cull_pattern_16 = CullPattern(List=tree_branch_19, CullPattern=tree_branch_18)

# ----
list_item_35 = ListItem(List=cull_pattern_16, Index=0, Wrap=True)
_1_neighbouring_point_4 = ListItem(List=nodes_all, Index=list_item_35, Wrap=True)
rotate_3 = Rotate(Geometry=_1_neighbouring_point_4, Angle=degrees("90"), Plane=base_node_6)  # -> Geometry, Transform
vector_2pt_9 = Vector2Pt(PointA=graft(base_node_6), PointB=_1_neighbouring_point_4, Unitize=True)  # -> Vector, Length
vector_2pt_10 = Vector2Pt(PointA=rotate_3.Geometry, PointB=base_node_6, Unitize=True)  # -> Vector, Length
construct_plane_6 = ConstructPlane(Origin=base_node_6, XAxis=vector_2pt_10.Vector, YAxis=vector_2pt_9.Vector)  # -> flatten(Plane)

replace_items_2 = ReplaceItems(List=replace_items, Item=flatten(construct_plane_6), Indices=explode_tree.Branch1, Wrap=False)
panel_23 = Panel(replace_items_2)

# ----
# Logic 3.1: Both X & Y-axis to 1 or 2
tree_branch_20 = TreeBranch(Tree=simplify(reading_json_output.connection), Path=explode_tree.Branch2, MaintainPaths=True)
tree_branch_21 = TreeBranch(Tree=simplify(reading_json_output.all_edge), Path=explode_tree.Branch2, MaintainPaths=True)
list_item_36 = ListItem(List=reading_json_output.node_list, Index=explode_tree.Branch2, Wrap=True)
panel_24 = Panel(tree_branch_20)
panel_25 = Panel(tree_branch_21)
base_node_7 = ListItem(List=nodes_all, Index=list_item_36, Wrap=True)

# ---- group: To get "1" facing nodes
cull_pattern_17 = CullPattern(List=tree_branch_21, CullPattern=tree_branch_20)

# ----
panel_26 = Panel(cull_pattern_17)

# ----
# Logic 3.2: Y-axis to 2, X-axis to 1
tree_branch_22 = TreeBranch(Tree=simplify(reading_json_output.connection), Path=explode_tree.Branch3, MaintainPaths=True)
tree_branch_23 = TreeBranch(Tree=simplify(reading_json_output.all_edge), Path=explode_tree.Branch3, MaintainPaths=True)
list_item_37 = ListItem(List=reading_json_output.node_list, Index=explode_tree.Branch3, Wrap=True)
panel_27 = Panel(tree_branch_22)
panel_28 = Panel(tree_branch_23)
equality_7 = Equality(FirstNumber=tree_branch_22, SecondNumber="1")  # -> Equality, Inequality
equality_8 = Equality(FirstNumber=tree_branch_22, SecondNumber="2")  # -> Equality, Inequality
base_node_8 = ListItem(List=nodes_all, Index=list_item_37, Wrap=True)  # -> graft(Item)

# ---- group: To get "2" facing node
cull_pattern_18 = CullPattern(List=tree_branch_23, CullPattern=equality_8.Equality)

# ---- group: To get "1" facing nodes
cull_pattern_19 = CullPattern(List=tree_branch_23, CullPattern=equality_7.Equality)

# ----
_2_neighbouring_points_4 = ListItem(List=nodes_all, Index=[cull_pattern_19, cull_pattern_18], Wrap=True)
vector_2pt_11 = Vector2Pt(PointA=simplify(base_node_8), PointB=simplify(_2_neighbouring_points_4), Unitize=True)  # -> Vector, Length
list_item_38 = ListItem(List=vector_2pt_11.Vector, Index=0, Wrap=True)  # -> Item, Item1
_2_neighbouring_points_5 = ListItem(List=nodes_all, Index=cull_pattern_19, Wrap=True)
construct_plane_7 = ConstructPlane(Origin=graft(base_node_8), XAxis=list_item_38.Item, YAxis=list_item_38.Item1)  # -> flatten(Plane)

list_item_39 = ListItem(List=cull_pattern_17, Index=0, Wrap=True)  # -> Item, Item1
_2_neighbouring_points_6 = ListItem(List=nodes_all, Index=list_item_39.Item, Wrap=True)
_2_neighbouring_points_7 = ListItem(List=nodes_all, Index=list_item_39.Item1, Wrap=True)
vector_2pt_12 = Vector2Pt(PointA=graft(base_node_7), PointB=_2_neighbouring_points_6, Unitize=True)  # -> Vector, Length

vector_2pt_13 = Vector2Pt(PointA=graft(base_node_7), PointB=_2_neighbouring_points_7, Unitize=True)  # -> Vector, Length

construct_plane_8 = ConstructPlane(Origin=graft(base_node_7), XAxis=vector_2pt_12.Vector, YAxis=vector_2pt_13.Vector)  # -> flatten(Plane)

replace_items_3 = ReplaceItems(List=replace_items_2, Item=construct_plane_8, Indices=explode_tree.Branch2, Wrap=False)
replace_items_4 = ReplaceItems(List=replace_items_3, Item=construct_plane_7, Indices=explode_tree.Branch3, Wrap=False)
replace_items_5 = ReplaceItems(List=replace_items_4, Item=flatten(construct_plane), Indices=explode_tree.Branch4, Wrap=False)
replace_items_6 = ReplaceItems(List=replace_items_5, Item=flatten(construct_plane_3), Indices=explode_tree.Branch5, Wrap=False)
panel_29 = Panel(replace_items_3)
panel_30 = Panel(replace_items_4)
panel_31 = Panel(replace_items_5)
panel_32 = Panel(replace_items_6)

_2_neighbouring_points_8 = ListItem(List=nodes_all, Index=cull_pattern_11, Wrap=True)  # -> flatten(Item)
vector_2pt_14 = Vector2Pt(PointA=base_node_3, PointB=_2_neighbouring_points_8, Unitize=True)  # -> Vector, Length
_2_neighbouring_points_9 = ListItem(List=nodes_all, Index=cull_pattern_12, Wrap=True)

list_item_40 = ListItem(List=_2_neighbouring_points_9, Index=0, Wrap=True)  # -> flatten(Item), flatten(Item1)

vector_2pt_15 = Vector2Pt(PointA=base_node_3, PointB=list_item_40.Item, Unitize=True)  # -> Vector, Length
construct_plane_9 = ConstructPlane(Origin=graft(base_node_3), XAxis=graft(vector_2pt_15.Vector), YAxis=graft(vector_2pt_14.Vector))  # -> flatten(Plane)

replace_items_7 = ReplaceItems(List=replace_items_6, Item=flatten(construct_plane_9), Indices=explode_tree.Branch6, Wrap=False)
replace_items_8 = ReplaceItems(List=replace_items_7, Item=flatten(construct_plane_4), Indices=explode_tree.Branch7, Wrap=False)  # -> flatten(List)
replace_items_9 = ReplaceItems(List=replace_items_8, Item=flatten(construct_plane_5), Indices=explode_tree.Branch8, Wrap=False)  # -> flatten(List)
panel_33 = Panel(replace_items_7)
panel_34 = Panel(replace_items_8)
panel_35 = Panel(replace_items_9)

# ---- group: Final Orientation Sequence
# 10. Orientate all modules with Aligned Target Frames
list_item_41 = ListItem(List=all_module_types, Index=sorty_module_to_logic.module_index, Wrap=True)
list_item_42 = ListItem(List=all_modules_plane, Index=sorty_module_to_logic.module_index, Wrap=True)
orient = Orient(Geometry=list_item_41, Source=list_item_42, Target=replace_items_9)  # -> Geometry, Transform

# ----
deconstruct_plane_5 = DeconstructPlane(Plane=replace_items_9)  # -> Origin, XAxis, YAxis, ZAxis
deconstruct_3 = Deconstruct(Point=deconstruct_plane_5.ZAxis)  # -> XComponent, YComponent, ZComponent
equality_9 = Equality(FirstNumber=deconstruct_3.ZComponent, SecondNumber="-1")  # -> Equality, Inequality
member_index_6 = MemberIndex(Set=equality_9.Equality, Member=Toggle(True))  # -> Index, Count
list_item_43 = ListItem(List=orient.Geometry, Index=member_index_6.Index, Wrap=True)
list_item_44 = ListItem(List=deconstruct_plane_5.Origin, Index=member_index_6.Index, Wrap=True)
xy_plane = XYPlane(Origin=list_item_44)
mirror_2 = Mirror(Geometry=list_item_43, Plane=xy_plane)  # -> Geometry, Transform
replace_items_10 = ReplaceItems(List=orient.Geometry, Item=mirror_2.Geometry, Indices=member_index_6.Index, Wrap=False)

# ---- group: Shops
equality_10 = Equality(FirstNumber=addition_4, SecondNumber="1")  # -> Equality, Inequality
cull_pattern_20 = CullPattern(List=replace_items_10, CullPattern=equality_10.Equality)

# ---- group: Shops & WS
equality_11 = Equality(FirstNumber=addition_4, SecondNumber="2")  # -> Equality, Inequality
cull_pattern_21 = CullPattern(List=replace_items_10, CullPattern=equality_11.Equality)

# ---- group: WS
equality_12 = Equality(FirstNumber=addition_4, SecondNumber="3")  # -> Equality, Inequality
cull_pattern_22 = CullPattern(List=replace_items_10, CullPattern=equality_12.Equality)

# ---- group: Street Cover
equality_13 = Equality(FirstNumber=addition_4, SecondNumber="0")  # -> Equality, Inequality
cull_pattern_23 = CullPattern(List=replace_items_10, CullPattern=equality_13.Equality)

# ----
colour_swatch_6 = ColourSwatch(SwatchColor=RGB(161, 186, 255))
custom_preview_3 = CustomPreview(Geometry=cull_pattern_20, Material=ColourSwatch(SwatchColor=RGB(255, 148, 148)))
custom_preview_4 = CustomPreview(Geometry=cull_pattern_21, Material=ColourSwatch(SwatchColor=RGB(252, 248, 106)))
custom_preview_5 = CustomPreview(Geometry=cull_pattern_22, Material=ColourSwatch(SwatchColor=RGB(110, 255, 136)))
custom_preview_6 = CustomPreview(Geometry=cull_pattern_23, Material=ColourSwatch(SwatchColor=RGBA(161, 186, 255, 121)))

# ==== cluster XAxisDerivation
geometry = ClusterInput()
plane = ClusterInput()
rotate = Rotate(Geometry=geometry, Angle=expr("-x", degrees("90")), Plane=plane)  # -> Geometry, Transform
vector_2pt = Vector2Pt(PointA=plane, PointB=rotate.Geometry, Unitize=False)  # -> Vector, Length
vector = ClusterOutput(vector_2pt.Vector)
