# Grasshopper definition 2021_11_02_Modules_Generation.gh (Grasshopper 1.0.7)
# plug-ins: Pufferfish, Weaverbird, Kangaroo2 Components, MeshEdit Components, EleFront

list = ValueList({"Own Mesh": 0, "Internalize mesh": 1}, selected="Internalize mesh")

# ---- group: Canguro Control
number_slider = Slider(1, range=0..2)
number_slider_2 = Slider(20, range=0..20)
number_slider_3 = Slider(0.03, range=0..0.05)
reset_relaxation = Button()
kangaroo_on_off = BooleanToggle(False)

# ---- group: Mesh Parameters
# MODULES BASE ON REGULAR GRID GENERATION
# Authors: Felipe Lopez Taverne
# CONTROL PANEL
size_m = Slider(3, range=0..10)
steps_to_rise_heigth = ValueList({"6", "7", "8", "12", "16", "24", "29"}, selected="24")

# ----
# Set final module heigth (m).
# The diference with the mesh will be absorved by the firts step (Colums or walls)
panel = Panel("3.5")

# ---- group: Creating Triangles
dom = ConstructDomain(DomainStart="0", DomainEnd=steps_to_rise_heigth)
range = Range(Domain=dom, Steps=steps_to_rise_heigth)

# ---- group: Creating Triangles / Creating steps to rice the diagonal
dom_2 = ConstructDomain(DomainStart="0", DomainEnd=range)
range_2 = Range(Domain=dom_2, Steps=range)
lastdex = LastIndex(List=range_2)
cull_i = CullIndex(List=range_2, Indices=lastdex, Wrap=lastdex)  # -> simplify(List)
lastdex_2 = LastIndex(List=cull_i)
cull_i_2 = CullIndex(List=cull_i, Indices=lastdex_2, Wrap=lastdex)  # -> simplify(List)
clean = CleanTree(RemoveNulls=True, RemoveInvalid=True, RemoveEmpty=Toggle(True), Tree=cull_i_2)  # -> simplify(Tree)

# ---- group: Creating Triangles / Creating vector to move triangles
multiplication = Multiplication(A=steps_to_rise_heigth, B="2")
division = Division(A=size_m, B=multiplication)
item = ListItem(List=division, Index=0, Wrap=True)  # -> Item, Item1
vec = VectorXYZ(XComponent=0, YComponent=item.Item, ZComponent=0)  # -> Vector, Length
multiplication_2 = Multiplication(A=simplify(vec.Vector), B=simplify(clean))

# ----
width = Data(size_m)

# ---- group: Creating Surface Vertices
# A. Regular mesh Generation
higth = Data(size_m)
division_2 = Division(A=higth, B="2")
division_3 = Division(A=width, B="2")
panel_2 = Panel(division_2)
panel_3 = Panel(higth)
_1 = ConstructPoint(XCoordinate="0", YCoordinate=panel_2, ZCoordinate=0)
_1_2 = ConstructPoint(XCoordinate="0", YCoordinate=panel_3, ZCoordinate=0)
_1_3 = ConstructPoint(XCoordinate="0", YCoordinate="0", ZCoordinate=0)
panel_4 = Panel(division_2)
panel_5 = Panel(higth)
panel_6 = Panel(division_3)
_1_4 = ConstructPoint(XCoordinate=panel_6, YCoordinate=panel_4, ZCoordinate=0)
_1_5 = ConstructPoint(XCoordinate=panel_6, YCoordinate="0", ZCoordinate=0)
_1_6 = ConstructPoint(XCoordinate=panel_6, YCoordinate=panel_5, ZCoordinate=0)
panel_7 = Panel(width)
panel_8 = Panel(division_2)
panel_9 = Panel(higth)
_1_7 = ConstructPoint(XCoordinate=panel_7, YCoordinate=panel_8, ZCoordinate=0)
_1_8 = ConstructPoint(XCoordinate=panel_7, YCoordinate="0", ZCoordinate=0)
_1_9 = ConstructPoint(XCoordinate=panel_7, YCoordinate=panel_9, ZCoordinate=0)

# ---- group: Creating Triangles / Determing steps to multiplicate vector
dom_3 = ConstructDomain(DomainStart="0", DomainEnd=steps_to_rise_heigth)
range_3 = Range(Domain=dom_3, Steps=steps_to_rise_heigth)
panel_10 = Panel(range_3)
lastdex_3 = LastIndex(List=panel_10)
cull_i_3 = CullIndex(List=panel_10, Indices=lastdex_3, Wrap=True)

# ---- group: Creating Triangles / Creating vector to move triangles
multiplication_3 = Multiplication(A=steps_to_rise_heigth, B="2")
division_4 = Division(A=size_m, B=multiplication_3)
item_2 = ListItem(List=division_4, Index=0, Wrap=True)  # -> Item, Item1
vec_2 = VectorXYZ(XComponent=item_2.Item1, YComponent=item_2.Item, ZComponent=0)  # -> Vector, Length
multiplication_4 = Multiplication(A=vec_2.Vector, B=cull_i_3)

# ---- group: Creating First Squares line / Determing steps to multiplicate vector
dom_4 = ConstructDomain(DomainStart="0", DomainEnd=steps_to_rise_heigth)
range_4 = Range(Domain=dom_4, Steps=steps_to_rise_heigth)
panel_11 = Panel(range_4)
lastdex_4 = LastIndex(List=panel_11)
cull_i_4 = CullIndex(List=panel_11, Indices=flatten([lastdex_4, "0"]), Wrap=True)

# ---- group: Creating First Squares line / Creating vector to move triangles
multiplication_5 = Multiplication(A=steps_to_rise_heigth, B="2")
division_5 = Division(A=size_m, B=multiplication_5)
item_3 = ListItem(List=division_5, Index=0, Wrap=True)  # -> Item, Item1
vec_3 = VectorXYZ(XComponent=item_3.Item1, YComponent=0, ZComponent=0)  # -> Vector, Length
multiplication_6 = Multiplication(A=vec_3.Vector, B=cull_i_4)

# ---- group: Central Axis and mirror plane
Z = UnitZ(Factor=1)
move = Move(Geometry=_1_4, Motion=Z)  # -> Geometry, Transform
ln = Line(StartPoint=_1_4, EndPoint=move.Geometry)
pl_3pt = Plane3Pt(PointA=_1, PointB=_1_7, PointC=move.Geometry)

# ---- group: Base Triangule and Rectangle
srf4pt = _4PointSurface(CornerA=_1_3, CornerB=_1, CornerC=_1_4, CornerD=_1_5)
srf4pt_2 = _4PointSurface(CornerA=_1_3, CornerB=_1_4, CornerC=_1_5)

# ---- group: Creating Triangles / Scaling and Moving Triangles
division_6 = Division(A="1", B=steps_to_rise_heigth)
scale = Scale(Geometry=graft(srf4pt_2), Center=Point(0, 0, 0), Factor=division_6)  # -> Geometry, Transform
move_2 = Move(Geometry=scale.Geometry, Motion=multiplication_4)  # -> Geometry, Transform

# ---- group: Creating First Squares line / Scaling and Moving Triangles
division_7 = Division(A="1", B=steps_to_rise_heigth)
scale_2 = Scale(Geometry=graft(srf4pt), Center=Point(0, 0, 0), Factor=division_7)  # -> Geometry, Transform
move_3 = Move(Geometry=scale_2.Geometry, Motion=multiplication_6)  # -> Geometry, Transform

# ---- group: Creating Triangles / Scaling and Moving Triangles
move_4 = Move(Geometry=simplify(graft(move_3.Geometry)), Motion=multiplication_2)  # -> simplify(Geometry), Transform

# ---- group: Mesh Generation
srf = Surface([move_4.Geometry, move_2.Geometry])
mirror = Mirror(Geometry=srf, Plane=pl_3pt)  # -> Geometry, Transform

panel_12 = Panel("""0
90
180
270""")
rad = Radians(Degrees=panel_12)
rotax = RotateAxis(Geometry=graft([srf, mirror.Geometry]), Angle=rad, Axis=ln)  # -> flatten(Geometry), Transform
wbjoin = WeaverbirdsJoinMeshesAndWeld(Mesh=rotax.Geometry, Weld=Toggle(True))
unifynormals = MeshUnifyNormals(Mesh=wbjoin)

# ---- group: Creating Radius Curve from coplanarity
# B. Dinamic Relaxation (Kangaroo)
subtraction = Subtraction(A=steps_to_rise_heigth, B="1")
dom_5 = ConstructDomain(DomainStart="1", DomainEnd=steps_to_rise_heigth)
step_length = Division(A=division_3, B=steps_to_rise_heigth)
range_5 = Range(Domain=dom_5, Steps=subtraction)
multiplication_7 = Multiplication(A=step_length, B=range_5)  # -> graft(Result)
pt = ConstructPoint(XCoordinate=multiplication_7, YCoordinate=multiplication_7, ZCoordinate=0)
pt_2 = ConstructPoint(XCoordinate=multiplication_7, YCoordinate="0", ZCoordinate=0)
pt_3 = ConstructPoint(XCoordinate="0", YCoordinate=multiplication_7, ZCoordinate=0)
pline = PolyLine(Vertices=[pt_3, pt, pt_2], Closed=False)
panel_13 = Panel("""0
90
180
270""")
rad_2 = Radians(Degrees=panel_13)
rotax_2 = RotateAxis(Geometry=pline, Angle=rad_2, Axis=ln)  # -> simplify(Geometry), Transform

# ---- group: Creating Triangles / Determing steps to multiplicate vector
dom_6 = ConstructDomain(DomainStart="0", DomainEnd=steps_to_rise_heigth)
range_6 = Range(Domain=dom_6, Steps=steps_to_rise_heigth)
panel_14 = Panel(range_6)
lastdex_5 = LastIndex(List=panel_14)
cull_i_5 = CullIndex(List=panel_14, Indices=lastdex_5, Wrap=True)
lastdex_6 = LastIndex(List=cull_i_5)
cull_i_6 = CullIndex(List=cull_i_5, Indices=lastdex_6, Wrap=True)

# ---- group: Creating Triangles / Creating vector to move triangles
# C.Bricks Shape Generation
multiplication_8 = Multiplication(A=steps_to_rise_heigth, B="2")
division_8 = Division(A=size_m, B=multiplication_8)
item_4 = ListItem(List=division_8, Index=0, Wrap=True)  # -> Item, Item1
vec_4 = VectorXYZ(XComponent=item_4.Item1, YComponent=item_4.Item, ZComponent=0)  # -> Vector, Length
multiplication_9 = Multiplication(A=vec_4.Vector, B=cull_i_6)

# ---- group: Creating First Squares line fOR THE vaULT (Not Triangles) / Determing steps to multiplicate vector
dom_7 = ConstructDomain(DomainStart="0", DomainEnd=steps_to_rise_heigth)
range_7 = Range(Domain=dom_7, Steps=steps_to_rise_heigth)
panel_15 = Panel(range_7)
lastdex_7 = LastIndex(List=panel_15)
cull_i_7 = CullIndex(List=panel_15, Indices=flatten(lastdex_7), Wrap=True)

# ---- group: Creating First Squares line fOR THE vaULT (Not Triangles) / Creating vector to move triangles
multiplication_10 = Multiplication(A=steps_to_rise_heigth, B="2")
division_9 = Division(A=size_m, B=multiplication_10)
item_5 = ListItem(List=division_9, Index=0, Wrap=True)  # -> Item, Item1
vec_5 = VectorXYZ(XComponent=item_5.Item1, YComponent=0, ZComponent=0)  # -> Vector, Length
multiplication_11 = Multiplication(A=vec_5.Vector, B=cull_i_7)

# ---- group: Creating First Squares line / Determing steps to multiplicate vector
dom_8 = ConstructDomain(DomainStart="0", DomainEnd=steps_to_rise_heigth)
range_8 = Range(Domain=dom_8, Steps=steps_to_rise_heigth)
panel_16 = Panel(range_8)
lastdex_8 = LastIndex(List=panel_16)
cull_i_8 = CullIndex(List=panel_16, Indices=flatten(lastdex_8), Wrap=True)

# ---- group: Creating First Squares line / Creating vector to move triangles
multiplication_12 = Multiplication(A=steps_to_rise_heigth, B="2")
division_10 = Division(A=size_m, B=multiplication_12)
item_6 = ListItem(List=division_10, Index=0, Wrap=True)  # -> Item, Item1
vec_6 = VectorXYZ(XComponent=0, YComponent=item_6.Item1, ZComponent=0)  # -> Vector, Length
multiplication_13 = Multiplication(A=vec_6.Vector, B=cull_i_8)

# ---- group: Creating First Squares line / Scaling and Moving Rectangles halft size
division_11 = Division(A="2", B=steps_to_rise_heigth)
xy = XYPlane(Origin=Point(0, 0, 0))
division_12 = Division(A=division_11, B="2")
scale_nu = ScaleNU(Geometry=srf4pt, Plane=xy, ScaleX=division_12, ScaleY=division_11, ScaleZ=1)  # -> Geometry, Transform
move_5 = Move(Geometry=scale_nu.Geometry, Motion=multiplication_13)  # -> Geometry, Transform

# ---- group: Creating First Squares line fOR THE vaULT (Not Triangles) / Scaling and Moving Triangles
division_13 = Division(A="2", B=steps_to_rise_heigth)
scale_3 = Scale(Geometry=graft(srf4pt), Center=Point(0, 0, 0), Factor=division_13)  # -> Geometry, Transform
move_6 = Move(Geometry=scale_3.Geometry, Motion=multiplication_11)  # -> Geometry, Transform

# ---- group: Creating Triangles / Scaling and Moving Triangles
division_14 = Division(A="2", B=steps_to_rise_heigth)
scale_4 = Scale(Geometry=graft(srf4pt_2), Center=Point(0, 0, 0), Factor=division_14)  # -> Geometry, Transform
move_7 = Move(Geometry=scale_4.Geometry, Motion=multiplication_9)  # -> graft(Geometry), Transform

# ---- group: Creating First Squares line / Determing steps to multiplicate vector
dom_9 = ConstructDomain(DomainStart="0", DomainEnd=steps_to_rise_heigth)
range_9 = Range(Domain=dom_9, Steps=steps_to_rise_heigth)
panel_17 = Panel(range_9)
lastdex_9 = LastIndex(List=panel_17)
cull_i_9 = CullIndex(List=panel_17, Indices=flatten([lastdex_9, "0"]), Wrap=True)

# ---- group: Creating First Squares line / Creating vector to move triangles
multiplication_14 = Multiplication(A=steps_to_rise_heigth, B="2")
division_15 = Division(A=size_m, B=multiplication_14)
item_7 = ListItem(List=division_15, Index=0, Wrap=True)  # -> Item, Item1
vec_7 = VectorXYZ(XComponent=item_7.Item1, YComponent=0, ZComponent=0)  # -> Vector, Length
multiplication_15 = Multiplication(A=vec_7.Vector, B=cull_i_9)

# ---- group: Creating First Squares line / Scaling and Moving Triangles
division_16 = Division(A="2", B=steps_to_rise_heigth)
scale_5 = Scale(Geometry=graft(srf4pt), Center=Point(0, 0, 0), Factor=division_16)  # -> Geometry, Transform
move_8 = Move(Geometry=scale_5.Geometry, Motion=multiplication_15)  # -> Geometry, Transform

# ---- group: Creating First Squares line / Determing steps to multiplicate vector
dom_10 = ConstructDomain(DomainStart="0", DomainEnd=steps_to_rise_heigth)
range_10 = Range(Domain=dom_10, Steps=steps_to_rise_heigth)
panel_18 = Panel(range_10)
lastdex_10 = LastIndex(List=panel_18)
cull_i_10 = CullIndex(List=panel_18, Indices=flatten([lastdex_10, "0"]), Wrap=True)

# ---- group: Creating First Squares line / Creating vector to move triangles
multiplication_16 = Multiplication(A=steps_to_rise_heigth, B="2")
division_17 = Division(A=size_m, B=multiplication_16)
item_8 = ListItem(List=division_17, Index=0, Wrap=True)  # -> Item, Item1
vec_8 = VectorXYZ(XComponent=item_8.Item1, YComponent=0, ZComponent=0)  # -> Vector, Length
multiplication_17 = Multiplication(A=vec_8.Vector, B=cull_i_10)

# ---- group: Creating First Squares line / Scaling and Moving Rectangles halft size
division_18 = Division(A="2", B=steps_to_rise_heigth)
xy_2 = XYPlane(Origin=Point(0, 0, 0))
division_19 = Division(A=division_18, B="2")
scale_nu_2 = ScaleNU(Geometry=srf4pt, Plane=xy_2, ScaleX=division_18, ScaleY=division_19, ScaleZ=1)  # -> Geometry, Transform
move_9 = Move(Geometry=scale_nu_2.Geometry, Motion=multiplication_17)  # -> Geometry, Transform

# ---- group: Creating First Squares line
panel_19 = Panel("""1
0""")
cull = CullPattern(List=move_9.Geometry, CullPattern=panel_19)  # -> graft(List)

panel_20 = Panel("""1
0""")
cull_2 = CullPattern(List=move_5.Geometry, CullPattern=panel_20)

# ---- group: Creating Triangles
dom_11 = ConstructDomain(DomainStart="0", DomainEnd=steps_to_rise_heigth)
range_11 = Range(Domain=dom_11, Steps=steps_to_rise_heigth)

# ---- group: Creating last brick to close vault
item_9 = ListItem(List=multiplication_11, Index="2", Wrap=True)
lastdex_11 = LastIndex(List=move_6.Geometry)
division_20 = Division(A=item_9, B="2")
item_10 = ListItem(List=multiplication_11, Index=lastdex_11, Wrap=True)
addition = Addition(A=division_20, B=item_10)
move_10 = Move(Geometry=cull_2, Motion=addition)  # -> Geometry, Transform
entwine = Entwine(Branch00=cull_2, Branch01=move_10.Geometry, FlattenInputs=True)
flip = FlipMatrix(Data=entwine)

# ---- group: Creating Triangles / Creating steps to rice the diagonal
dom_12 = ConstructDomain(DomainStart="0", DomainEnd=range_11)
range_12 = Range(Domain=dom_12, Steps=range_11)
lastdex_12 = LastIndex(List=range_12)
cull_i_11 = CullIndex(List=range_12, Indices=lastdex_12, Wrap=True)  # -> simplify(List)
lastdex_13 = LastIndex(List=cull_i_11)
cull_i_12 = CullIndex(List=cull_i_11, Indices=lastdex_13, Wrap=True)  # -> simplify(List)
clean_2 = CleanTree(RemoveNulls=True, RemoveInvalid=True, RemoveEmpty=Toggle(True), Tree=cull_i_12)  # -> simplify(Tree)

# ---- group: Creating Triangles / Creating vector to move triangles
multiplication_18 = Multiplication(A=steps_to_rise_heigth, B="2")
division_21 = Division(A=size_m, B=multiplication_18)
item_11 = ListItem(List=division_21, Index=0, Wrap=True)  # -> Item, Item1
vec_9 = VectorXYZ(XComponent=0, YComponent=item_11.Item, ZComponent=0)  # -> Vector, Length
multiplication_19 = Multiplication(A=simplify(vec_9.Vector), B=simplify(clean_2))

# ----
integer_division = IntegerDivision(A=range_11, B="2")

# ---- group: Creating Squares for the vault (not Triangles)
dom_13 = ConstructDomain(DomainStart="0", DomainEnd=steps_to_rise_heigth)
range_13 = Range(Domain=dom_13, Steps=steps_to_rise_heigth)

# ---- group: Creating Squares for the vault (not Triangles) / Creating vector to move triangles
multiplication_20 = Multiplication(A=steps_to_rise_heigth, B="2")
division_22 = Division(A=size_m, B=multiplication_20)
item_12 = ListItem(List=division_22, Index=0, Wrap=True)  # -> Item, Item1
vec_10 = VectorXYZ(XComponent=0, YComponent=item_12.Item, ZComponent=0)  # -> Vector, Length
multiplication_21 = Multiplication(A=simplify(vec_10.Vector), B=simplify(range_13))

# ---- group: Creating Triangles / Scaling and Moving Triangles
move_11 = Move(Geometry=simplify(graft(move_8.Geometry)), Motion=multiplication_19)  # -> simplify(Geometry), Transform

# ----
multiplication_22 = Multiplication(A=clean_2, B=2)

# ---- group: Creating Squares for the vault (not Triangles) / Scaling and Moving Triangles
move_12 = Move(Geometry=simplify(graft(move_6.Geometry)), Motion=multiplication_21)  # -> simplify(Geometry), Transform

# ---- group: Selecting Overlaping Squares
lastdex_14 = LastIndex(List=move_12.Geometry)
cull_i_13 = CullIndex(List=move_12.Geometry, Indices=lastdex_14, Wrap=True)  # -> simplify(List)
panel_21 = Panel("""1
0""")
panel_22 = Panel("""0
1""")
cull_3 = CullPattern(List=cull_i_13, CullPattern=panel_22)
cull_4 = CullPattern(List=cull_i_13, CullPattern=panel_21)
flip_2 = FlipMatrix(Data=cull_4)
flip_3 = FlipMatrix(Data=cull_3)
panel_23 = Panel("""1
0""")
panel_24 = Panel("""0
1""")
cull_5 = CullPattern(List=flip_3, CullPattern=panel_23)
cull_6 = CullPattern(List=flip_2, CullPattern=panel_24)

lastdex_15 = LastIndex(List=move_11.Geometry)
cull_i_14 = CullIndex(List=move_11.Geometry, Indices=lastdex_15, Wrap=True)  # -> simplify(List)
panel_25 = Panel("""1
0""")
panel_26 = Panel("""0
1""")
cull_7 = CullPattern(List=cull_i_14, CullPattern=panel_26)
cull_8 = CullPattern(List=cull_i_14, CullPattern=panel_25)
flip_4 = FlipMatrix(Data=cull_8)
flip_5 = FlipMatrix(Data=cull_7)
panel_27 = Panel("""1
0""")
panel_28 = Panel("""0
1""")
cull_9 = CullPattern(List=flip_5, CullPattern=panel_27)
cull_10 = CullPattern(List=flip_4, CullPattern=panel_28)

# ---- group: Organizing Piece A.1 bricks by level
flip_6 = FlipMatrix(Data=cull_9)
flip_7 = FlipMatrix(Data=cull_10)
# C. Organizing Pieces bricks by level
bang = ExplodeTree(Data=flip_7)  # -> Branch0, Branch1, Branch2, Branch3, Branch4, Branch5, Branch6, Branch7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
bang_2 = ExplodeTree(Data=flip_6)  # -> Branch0, Branch1, Branch2, Branch3, Branch4, Branch5, Branch6, Branch7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
bang_3 = ExplodeTree(Data=cull)  # -> _0000, _0001, _0002, _0003, _0004, _0005, _0006, _0007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
bang_4 = ExplodeTree(Data=simplify(move_7.Geometry))  # -> Branch0, Branch1, Branch2, Branch3, Branch4, Branch5, Branch6, Branch7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
srf_2 = Surface(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)
srf_3 = Surface([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])
relay = Relay([bang_4.Branch1, bang_3._0000])
relay_2 = Relay([bang_2.Branch2, bang_3._0002, bang_4.Branch5])
relay_3 = Relay([bang_4.Branch6, bang.Branch2])
relay_4 = Relay([bang_4.Branch7, bang_3._0003, bang_2.Branch3])
relay_5 = Relay([bang_4.Branch9, bang_3._0004, bang_2.Branch4])
relay_6 = Relay([bang_4.Branch14, bang.Branch6])
relay_7 = Relay([bang_4.Branch21, bang_3._00010, bang_2.Branch10])
relay_8 = Relay([bang_2.Branch11, bang_3._00011, bang_4.Branch23])
relay_9 = Relay([bang.Branch0, bang_4.Branch2])
relay_10 = Relay([bang_4.Branch3, bang_3._0001, bang_2.Branch0, bang_2.Branch1])
relay_11 = Relay([bang_4.Branch4, bang.Branch1])
relay_12 = Relay([bang_4.Branch8, bang.Branch3])
relay_13 = Relay([bang_4.Branch10, bang.Branch4])
relay_14 = Relay([bang_4.Branch11, bang_3._0005, bang_2.Branch5])
relay_15 = Relay([bang_4.Branch12, bang.Branch5])
relay_16 = Relay([bang_4.Branch13, bang_3._0006, bang_2.Branch6])
relay_17 = Relay([bang_4.Branch15, bang_3._0007, bang_2.Branch7])
relay_18 = Relay([bang_4.Branch16, bang.Branch7])
relay_19 = Relay([bang_3._0008, bang_2.Branch8, bang_4.Branch17])
relay_20 = Relay([bang.Branch8, bang_4.Branch18])
relay_21 = Relay([bang_4.Branch19, bang_3._0009, bang_2.Branch9])
relay_22 = Relay([bang_4.Branch20, bang.Branch9])
relay_23 = Relay([bang_4.Branch22, bang.Branch10])
srf_4 = Surface(bang_4.Branch0)
srf_5 = Surface([relay_9, srf_3])
srf_6 = Surface([relay_10, relay])
srf_7 = Surface([relay_11, relay_9])
srf_8 = Surface([relay_2, relay_10])
srf_9 = Surface([relay_3, relay_11])
srf_10 = Surface([relay_4, relay_2])
srf_11 = Surface([relay_12, relay_3])
srf_12 = Surface([relay_5, relay_4])
srf_13 = Surface([relay_13, relay_12])
srf_14 = Surface([relay_14, relay_5])
srf_15 = Surface([relay_15, relay_13])
srf_16 = Surface([relay_16, relay_14])
srf_17 = Surface([relay_6, relay_15])
srf_18 = Surface([relay_17, relay_16])
srf_19 = Surface([relay_18, relay_6])
srf_20 = Surface([relay_19, relay_17])
srf_21 = Surface([relay_21, relay_19])
srf_22 = Surface([relay_22, relay_20])
srf_23 = Surface([relay_7, relay_21])
srf_24 = Surface([relay_23, relay_22])
srf_25 = Surface([relay_8, relay_7, srf_2])
srf_26 = Surface([bang_4.Branch24, bang.Branch11])
srf_27 = Surface([bang_2.Branch12, bang_3.Branch12, bang_4.Branch25])
srf_28 = Surface([bang_4.Branch26, bang.Branch12])
srf_29 = Surface(bang.Branch13)
srf_30 = Surface([relay_20, relay_18])
srf_31 = Surface([bang_2.Branch13, bang_3.Branch13, bang_4.Branch27])
srf_32 = Surface(relay)

# ---- group: Organizing Piece B.1 bricks by level
bang_5 = ExplodeTree(Data=cull_9)  # -> Branch0, Branch1, Branch2, Branch3, Branch4, Branch5, Branch6, Branch7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
bang_6 = ExplodeTree(Data=cull_10)  # -> Branch0, Branch1, Branch2, Branch3, Branch4, Branch5, Branch6, Branch7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
bang_7 = ExplodeTree(Data=simplify(move_7.Geometry))  # -> Branch0, Branch1, Branch2, Branch3, Branch4, Branch5, Branch6, Branch7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
relay_24 = Relay([bang_7.Branch5, bang_5.Branch2])
relay_25 = Relay([bang_7.Branch6, bang_6.Branch3])
relay_26 = Relay([bang_7.Branch7, bang_5.Branch3])
relay_27 = Relay([bang_7.Branch9, bang_5.Branch4])
relay_28 = Relay([bang_7.Branch14, bang_6.Branch7])
relay_29 = Relay([bang_7.Branch0, bang_6.Branch0])
relay_30 = Relay([bang_7.Branch1, bang_5.Branch0])
relay_31 = Relay([bang_7.Branch2, bang_6.Branch1])
relay_32 = Relay([bang_7.Branch3, bang_5.Branch1])
relay_33 = Relay([bang_6.Branch2, bang_7.Branch4])
relay_34 = Relay([bang_7.Branch8, bang_6.Branch4])
relay_35 = Relay([bang_7.Branch10, bang_6.Branch5])
relay_36 = Relay([bang_7.Branch11, bang_5.Branch5])
relay_37 = Relay([bang_7.Branch12, bang_6.Branch6])
relay_38 = Relay([bang_7.Branch13, bang_5.Branch6])
relay_39 = Relay([bang_7.Branch15, bang_5.Branch7])
relay_40 = Relay([bang_6.Branch8, bang_7.Branch16])
relay_41 = Relay([bang_5.Branch8, bang_7.Branch17])
relay_42 = Relay([bang_7.Branch18, bang_6.Branch9])
relay_43 = Relay([bang_7.Branch19, bang_5.Branch9])
relay_44 = Relay([bang_7.Branch20, bang_6.Branch10])
relay_45 = Relay([bang_7.Branch21, bang_5.Branch10])
relay_46 = Relay([bang_6.Branch11, bang_7.Branch22])
srf_33 = Surface([relay_24, relay_32])
srf_34 = Surface([relay_26, relay_24])
srf_35 = Surface([relay_28, relay_37])
srf_36 = Surface([bang_7.Branch25, bang_5.Branch12])
srf_37 = Surface(relay_29)
srf_38 = Surface([relay_30, relay_29])
srf_39 = Surface([relay_31, relay_29])
srf_40 = Surface([relay_32, relay_30])
srf_41 = Surface([relay_33, relay_31])
srf_42 = Surface([relay_25, relay_33])
srf_43 = Surface([relay_34, relay_25])
srf_44 = Surface([relay_27, relay_26])
srf_45 = Surface([relay_35, relay_34])
srf_46 = Surface([relay_36, relay_27])
srf_47 = Surface([relay_37, relay_35])
srf_48 = Surface([relay_38, relay_36])
srf_49 = Surface([relay_39, relay_38])
srf_50 = Surface([relay_40, relay_28])
srf_51 = Surface([relay_41, relay_39])
srf_52 = Surface([relay_42, relay_40])
srf_53 = Surface([relay_43, relay_41])
srf_54 = Surface([relay_44, relay_42])
srf_55 = Surface([relay_45, relay_43])
srf_56 = Surface([relay_46, relay_44])
srf_57 = Surface([bang_7.Branch23, bang_5.Branch11, srf_56])
srf_58 = Surface([bang_6.Branch12, bang_7.Branch24])
srf_59 = Surface([bang_6.Branch13, bang_7.Branch26])
srf_60 = Surface(bang_5.Branch13)
srf_61 = Surface()

# ---- group: Organizing Piece C.1 bricks by level
bang_8 = ExplodeTree(Data=cull_5)  # -> Branch0, Branch1, Branch2, Branch3, Branch4, Branch5, Branch6, Branch7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
bang_9 = ExplodeTree(Data=cull_6)  # -> Branch0, Branch1, Branch2, Branch3, Branch4, Branch5, Branch6, Branch7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
bang_10 = ExplodeTree(Data=flip)  # -> Branch0, Branch1, Branch2, Branch3, Branch4, Branch5, Branch6, Branch7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
relay_47 = Relay([bang_9.Branch3, bang_10.Branch3])
relay_48 = Relay([bang_9.Branch5, bang_10.Branch5])
relay_49 = Relay([bang_9.Branch7, bang_10.Branch7])
relay_50 = Relay([bang_9.Branch0, bang_10.Branch0])
relay_51 = Relay([bang_9.Branch1, bang_10.Branch1])
relay_52 = Relay([bang_9.Branch2, bang_10.Branch2])
relay_53 = Relay([bang_9.Branch4, bang_10.Branch4])
relay_54 = Relay([bang_9.Branch6, bang_10.Branch6])
relay_55 = Relay([bang_9.Branch8, bang_10.Branch8])
relay_56 = Relay([bang_9.Branch9, bang_10.Branch9])
relay_57 = Relay([bang_9.Branch10, bang_10.Branch10])
relay_58 = Relay([bang_9.Branch11, bang_10.Branch11])
srf_62 = Surface([bang_8.Branch0, relay_50])
srf_63 = Surface([bang_8.Branch2, bang_8.Branch1])
srf_64 = Surface([bang_8.Branch11, bang_8.Branch10])
srf_65 = Surface(relay_50)
srf_66 = Surface([relay_51, relay_50])
srf_67 = Surface([bang_8.Branch1, bang_8.Branch0])
srf_68 = Surface([relay_52, relay_51])
srf_69 = Surface([relay_47, relay_52])
srf_70 = Surface([bang_8.Branch3, bang_8.Branch2])
srf_71 = Surface([relay_53, relay_47])
srf_72 = Surface([bang_8.Branch4, bang_8.Branch3])
srf_73 = Surface([relay_48, relay_53])
srf_74 = Surface([bang_8.Branch5, bang_8.Branch4])
srf_75 = Surface([relay_54, relay_48])
srf_76 = Surface([bang_8.Branch6, bang_8.Branch5])
srf_77 = Surface([relay_49, relay_54])
srf_78 = Surface([bang_8.Branch7, bang_8.Branch6])
srf_79 = Surface([relay_55, relay_49])
srf_80 = Surface([bang_8.Branch8, bang_8.Branch7])
srf_81 = Surface([relay_56, relay_55])
srf_82 = Surface([bang_8.Branch9, bang_8.Branch8])
srf_83 = Surface([relay_57, relay_56])
srf_84 = Surface([bang_8.Branch10, bang_8.Branch9])
srf_85 = Surface([relay_58, relay_57])
srf_86 = Surface([bang_9.Branch12, bang_10.Branch12])
srf_87 = Surface(bang_8.Branch12)
srf_88 = Surface([bang_9.Branch13, bang_10.Branch13])
srf_89 = Surface(bang_8.Branch13)
srf_90 = Surface([bang_9.Branch14, bang_10.Branch14])

# ---- group: Organizing Piece A.2 bricks by level
flip_8 = FlipMatrix(Data=cull_9)
flip_9 = FlipMatrix(Data=cull_10)
bang_11 = ExplodeTree(Data=flip_9)  # -> Branch0, Branch1, Branch2, Branch3, Branch4, Branch5, Branch6, Branch7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
bang_12 = ExplodeTree(Data=flip_8)  # -> Branch0, Branch1, Branch2, Branch3, Branch4, Branch5, Branch6, Branch7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
bang_13 = ExplodeTree(Data=cull)  # -> _0000, _0001, _0002, _0003, _0004, _0005, _0006, _0007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
bang_14 = ExplodeTree(Data=simplify(move_7.Geometry))  # -> Branch0, Branch1, Branch2, Branch3, Branch4, Branch5, Branch6, Branch7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
relay_59 = Relay([bang_14.Branch1, bang_13._0000])
srf_91 = Surface([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])
srf_92 = Surface([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])
relay_60 = Relay([bang_12.Branch2, bang_13._0002, bang_14.Branch5])
relay_61 = Relay([bang_14.Branch6, bang_11.Branch2])
relay_62 = Relay([bang_14.Branch7, bang_13._0003, bang_12.Branch3])
relay_63 = Relay([bang_14.Branch9, bang_13._0004, bang_12.Branch4])
relay_64 = Relay([bang_14.Branch14, bang_11.Branch6])
relay_65 = Relay([bang_14.Branch21, bang_13._00010, bang_12.Branch10])
relay_66 = Relay([bang_12.Branch11, bang_13._00011, bang_14.Branch23])
relay_67 = Relay([bang_11.Branch0, bang_14.Branch2])
relay_68 = Relay([bang_14.Branch3, bang_13._0001, bang_12.Branch0, bang_12.Branch1])
relay_69 = Relay([bang_14.Branch4, bang_11.Branch1])
relay_70 = Relay([bang_14.Branch8, bang_11.Branch3])
relay_71 = Relay([bang_14.Branch10, bang_11.Branch4])
relay_72 = Relay([bang_14.Branch11, bang_13._0005, bang_12.Branch5])
relay_73 = Relay([bang_14.Branch12, bang_11.Branch5])
relay_74 = Relay([bang_14.Branch13, bang_13._0006, bang_12.Branch6])
relay_75 = Relay([bang_14.Branch15, bang_13._0007, bang_12.Branch7])
relay_76 = Relay([bang_14.Branch16, bang_11.Branch7])
relay_77 = Relay([bang_13._0008, bang_12.Branch8, bang_14.Branch17])
relay_78 = Relay([bang_11.Branch8, bang_14.Branch18])
relay_79 = Relay([bang_14.Branch19, bang_13._0009, bang_12.Branch9])
relay_80 = Relay([bang_14.Branch20, bang_11.Branch9])
relay_81 = Relay([bang_14.Branch22, bang_11.Branch10])
srf_93 = Surface(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)
srf_94 = Surface(srf_92)
srf_95 = Surface(bang_14.Branch0)
srf_96 = Surface([srf_94, relay_68])
srf_97 = Surface([relay_60, srf_96])
srf_98 = Surface([relay_62, srf_97])
srf_99 = Surface([relay_63, srf_98])
srf_100 = Surface([relay_72, srf_99])
srf_101 = Surface([relay_74, srf_100])
srf_102 = Surface([relay_75, srf_101])
srf_103 = Surface([relay_77, srf_102])
srf_104 = Surface([relay_79, srf_103])
srf_105 = Surface([relay_65, srf_104])
srf_106 = Surface([relay_66, srf_105, srf_93])
srf_107 = Surface([bang_14.Branch24, bang_11.Branch11])
srf_108 = Surface([bang_12.Branch12, bang_13.Branch12, bang_14.Branch25])
srf_109 = Surface([bang_14.Branch26, bang_11.Branch12])
srf_110 = Surface([bang_12.Branch13, bang_13.Branch13, bang_14.Branch27])
srf_111 = Surface(bang_11.Branch13)
srf_112 = Surface(srf_91)
srf_113 = Surface([relay_69, srf_112])
srf_114 = Surface([relay_61, srf_113])
srf_115 = Surface([relay_70, srf_114])
srf_116 = Surface([relay_71, srf_115])
srf_117 = Surface([relay_73, srf_116])
srf_118 = Surface([relay_64, srf_117])
srf_119 = Surface([relay_76, srf_118])
srf_120 = Surface([relay_78, srf_119])
srf_121 = Surface([relay_80, srf_120])
srf_122 = Surface([relay_81, srf_121])

# ---- group: Organizing Piece B.2 bricks by level
bang_15 = ExplodeTree(Data=cull_9)  # -> Branch0, Branch1, Branch2, Branch3, Branch4, Branch5, Branch6, Branch7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
bang_16 = ExplodeTree(Data=cull_10)  # -> Branch0, Branch1, Branch2, Branch3, Branch4, Branch5, Branch6, Branch7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
bang_17 = ExplodeTree(Data=simplify(move_7.Geometry))  # -> Branch0, Branch1, Branch2, Branch3, Branch4, Branch5, Branch6, Branch7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
relay_82 = Relay([bang_17.Branch5, bang_15.Branch2])
relay_83 = Relay([bang_17.Branch6, bang_16.Branch3])
relay_84 = Relay([bang_17.Branch7, bang_15.Branch3])
relay_85 = Relay([bang_17.Branch9, bang_15.Branch4])
relay_86 = Relay([bang_17.Branch14, bang_16.Branch7])
relay_87 = Relay([bang_17.Branch0, bang_16.Branch0])
relay_88 = Relay([bang_17.Branch1, bang_15.Branch0])
relay_89 = Relay([bang_17.Branch2, bang_16.Branch1])
relay_90 = Relay([bang_17.Branch3, bang_15.Branch1])
relay_91 = Relay([bang_16.Branch2, bang_17.Branch4])
relay_92 = Relay([bang_17.Branch8, bang_16.Branch4])
relay_93 = Relay([bang_17.Branch10, bang_16.Branch5])
relay_94 = Relay([bang_17.Branch11, bang_15.Branch5])
relay_95 = Relay([bang_17.Branch12, bang_16.Branch6])
relay_96 = Relay([bang_17.Branch13, bang_15.Branch6])
relay_97 = Relay([bang_17.Branch15, bang_15.Branch7])
relay_98 = Relay([bang_16.Branch8, bang_17.Branch16])
relay_99 = Relay([bang_15.Branch8, bang_17.Branch17])
relay_100 = Relay([bang_17.Branch18, bang_16.Branch9])
relay_101 = Relay([bang_17.Branch19, bang_15.Branch9])
relay_102 = Relay([bang_17.Branch20, bang_16.Branch10])
relay_103 = Relay([bang_17.Branch21, bang_15.Branch10])
relay_104 = Relay([bang_16.Branch11, bang_17.Branch22])
srf_123 = Surface(relay_87)
srf_124 = Surface([bang_16.Branch12, bang_17.Branch24])
srf_125 = Surface([bang_17.Branch25, bang_15.Branch12])
srf_126 = Surface()
srf_127 = Surface([relay_89, srf_123])
srf_128 = Surface([relay_91, srf_127])
srf_129 = Surface([relay_83, srf_128])
srf_130 = Surface([relay_92, srf_129])
srf_131 = Surface([relay_93, srf_130])
srf_132 = Surface([relay_95, srf_131])
srf_133 = Surface([relay_86, srf_132])
srf_134 = Surface([relay_98, srf_133])
srf_135 = Surface([relay_100, srf_134])
srf_136 = Surface([relay_102, srf_135])
srf_137 = Surface([relay_104, srf_136])
srf_138 = Surface([bang_17.Branch23, bang_15.Branch11, srf_137])
srf_139 = Surface([bang_16.Branch13, bang_17.Branch26])
srf_140 = Surface(bang_15.Branch13)
srf_141 = Surface([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])
srf_142 = Surface([relay_88, srf_141])
srf_143 = Surface([relay_90, srf_142])
srf_144 = Surface([relay_82, srf_143])
srf_145 = Surface([relay_84, srf_144])
srf_146 = Surface([relay_85, srf_145])
srf_147 = Surface([relay_94, srf_146])
srf_148 = Surface([relay_96, srf_147])
srf_149 = Surface([relay_97, srf_148])
srf_150 = Surface([relay_99, srf_149])
srf_151 = Surface([relay_101, srf_150])
srf_152 = Surface([relay_103, srf_151])

# ---- group: Organizing Surface by level
bang_18 = ExplodeTree(Data=cull_5)  # -> Branch0, Branch1, Branch2, Branch3, Branch4, Branch5, Branch6, Branch7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
bang_19 = ExplodeTree(Data=cull_6)  # -> Branch0, Branch1, Branch2, Branch3, Branch4, Branch5, Branch6, Branch7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
bang_20 = ExplodeTree(Data=flip)  # -> Branch0, Branch1, Branch2, Branch3, Branch4, Branch5, Branch6, Branch7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
relay_105 = Relay([bang_19.Branch3, bang_20.Branch3])
relay_106 = Relay([bang_19.Branch5, bang_20.Branch5])
relay_107 = Relay([bang_19.Branch7, bang_20.Branch7])
relay_108 = Relay([bang_19.Branch0, bang_20.Branch0])
relay_109 = Relay([bang_19.Branch1, bang_20.Branch1])
relay_110 = Relay([bang_19.Branch2, bang_20.Branch2])
relay_111 = Relay([bang_19.Branch4, bang_20.Branch4])
relay_112 = Relay([bang_19.Branch6, bang_20.Branch6])
relay_113 = Relay([bang_19.Branch8, bang_20.Branch8])
relay_114 = Relay([bang_19.Branch9, bang_20.Branch9])
relay_115 = Relay([bang_19.Branch10, bang_20.Branch10])
relay_116 = Relay([bang_19.Branch11, bang_20.Branch11])
srf_153 = Surface([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])
srf_154 = Surface([bang_18.Branch0, srf_153])
srf_155 = Surface(relay_108)
srf_156 = Surface([bang_19.Branch12, bang_20.Branch12])
srf_157 = Surface(bang_18.Branch12)
srf_158 = Surface([bang_19.Branch13, bang_20.Branch13])
srf_159 = Surface([bang_19.Branch14, bang_20.Branch14])
srf_160 = Surface([relay_109, srf_155])
srf_161 = Surface([relay_110, srf_160])
srf_162 = Surface([relay_105, srf_161])
srf_163 = Surface([relay_111, srf_162])
srf_164 = Surface([relay_106, srf_163])
srf_165 = Surface([relay_112, srf_164])
srf_166 = Surface([relay_107, srf_165])
srf_167 = Surface([relay_113, srf_166])
srf_168 = Surface([bang_18.Branch1, srf_154])
srf_169 = Surface([bang_18.Branch2, srf_168])
srf_170 = Surface([bang_18.Branch3, srf_169])
srf_171 = Surface([bang_18.Branch4, srf_170])
srf_172 = Surface([bang_18.Branch5, srf_171])
srf_173 = Surface([bang_18.Branch6, srf_172])
srf_174 = Surface([bang_18.Branch7, srf_173])
srf_175 = Surface([bang_18.Branch8, srf_174])
srf_176 = Surface([bang_18.Branch9, srf_175])
srf_177 = Surface([bang_18.Branch10, srf_176])
srf_178 = Surface([bang_18.Branch11, srf_177])
srf_179 = Surface([relay_114, srf_167])
srf_180 = Surface([relay_115, srf_179])
srf_181 = Surface([relay_116, srf_180])
srf_182 = Surface(bang_18.Branch13)

# ----
# A. Regular mesh Generation
# B. Dinamic Relaxation (Kangaroo)
# Liberate relaxed mesh to Bricks  Shape Generation
# C. Organizing Pieces bricks by level
# D. Extruding pieces (A1, A2, B1, B2, C1 and C2)
# E. Generating pieces in 8 positions
# A.2
# A.1
# B.1
# B.2
# C.1
# C.3
# F. Mixign pieces and geting modules
# Generate Second Floor Modules
# 10.1
# 20.1
# 30.1
# 40.1
# 50.1
# Baking modules
# One mesh per module
# All bricks as individual breps
# Generate Firts Floor Modules
# 10.2
# 20.2
# 30.2
# 40.2
# 50.2
# Baking modules
# One mesh per module
# All bricks as individual breps
dam = DataDam(DataA=unifynormals, BufferDelay=10000000, BufferMode=0)

mesh = Mesh(dam)

# ---- group: Kangoroo Inputs
edgelengths = EdgeLengths(Mesh=mesh, LengthFactor=number_slider, Strength=number_slider_2)
show = Show(G=mesh)
vertexloads = VertexLoads(Mesh=mesh, Strength=number_slider_3)

# ---- group: Creating Points to target and anchor
nakededge = MeshNakedEdge(Mesh=mesh)  # -> V, A, B

# ---- group: Restrictions / Coplanar Restrictions
bang_21 = ExplodeTree(Data=rotax_2.Geometry)  # -> Branch0, Branch1, Branch2, Branch3, Branch4, Branch5, Branch6, Branch7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
cluster = Cluster(P=nakededge.V, C=bang_21.Branch21)
cluster_2 = Cluster(P=nakededge.V, C=bang_21.Branch11)
cluster_3 = Cluster(P=nakededge.V, C=bang_21.Branch1)
cluster_4 = Cluster(P=nakededge.V, C=bang_21.Branch22)
cluster_5 = Cluster(P=nakededge.V, C=bang_21.Branch12)
cluster_6 = Cluster(P=nakededge.V, C=bang_21.Branch2)
cluster_7 = Cluster(P=nakededge.V, C=bang_21.Branch23)
cluster_8 = Cluster(P=nakededge.V, C=bang_21.Branch13)
cluster_9 = Cluster(P=nakededge.V, C=bang_21.Branch3)
cluster_10 = Cluster(P=nakededge.V, C=bang_21.Branch24)
cluster_11 = Cluster(P=nakededge.V, C=bang_21.Branch14)
cluster_12 = Cluster(P=nakededge.V, C=bang_21.Branch4)
cluster_13 = Cluster(P=nakededge.V, C=bang_21.Branch25)
cluster_14 = Cluster(P=nakededge.V, C=bang_21.Branch15)
cluster_15 = Cluster(P=nakededge.V, C=bang_21.Branch5)
cluster_16 = Cluster(P=nakededge.V, C=bang_21.Branch26)
cluster_17 = Cluster(P=nakededge.V, C=bang_21.Branch16)
cluster_18 = Cluster(P=nakededge.V, C=bang_21.Branch6)
cluster_19 = Cluster(P=nakededge.V, C=bang_21.Branch27)
cluster_20 = Cluster(P=nakededge.V, C=bang_21.Branch17)
cluster_21 = Cluster(P=nakededge.V, C=bang_21.Branch7)
cluster_22 = Cluster(P=nakededge.V, C=bang_21.Branch28)
cluster_23 = Cluster(P=nakededge.V, C=bang_21.Branch18)
cluster_24 = Cluster(P=nakededge.V, C=bang_21.Branch8)
cluster_25 = Cluster(P=nakededge.V, C=bang_21.Branch19)
cluster_26 = Cluster(P=nakededge.V, C=bang_21.Branch9)
cluster_27 = Cluster(P=nakededge.V, C=bang_21.Branch20)
cluster_28 = Cluster(P=nakededge.V, C=bang_21.Branch10)
data = Data([cluster_3, cluster_6, cluster_9, cluster_12, cluster_15, cluster_18, cluster_21, cluster_24, cluster_26, cluster_28, cluster_2, cluster_5, cluster_8, cluster_11, cluster_14, cluster_17, cluster_20, cluster_23, cluster_25, cluster_27, cluster, cluster_4, cluster_7, cluster_10, cluster_13, cluster_16, cluster_19, cluster_22])

# ---- group: Restrictions / Anchor Points
crv_cp = CurveClosestPoint(Point=nakededge.V, Curve=graft(bang_21.Branch0))  # -> simplify(flatten(Point)), Parameter, Distance
mc = MeshCorners(Mesh=mesh, Angle=2.35619449)
anchor = Anchor(Point=flatten([mc, crv_cp.Point]), Strength=10000)

# ---- group: Restrictions / Vertical Restriction
anchorxyz = AnchorXYZ(Point=nakededge.V, X=Toggle(True), Y=False, Z=False, Strength=1000)
anchorxyz_2 = AnchorXYZ(Point=nakededge.V, X=False, Y=Toggle(True), Z=False, Strength=1000)

# ---- group: Protecting canguro null requirements
subtraction_2 = Subtraction(A=steps_to_rise_heigth, B=1)
split = SplitList(List=data, Index=subtraction_2)  # -> ListA, ListB

# ---- group: Solver
solver = Solver(
    GoalObjects=flatten([edgelengths, vertexloads, show, anchor, anchorxyz, anchorxyz_2, cluster_3, split.ListA]),
    Reset=[Button(), reset_relaxation],
    Threshold=1e-15,
    Tolerance=0.01,
    On=kangaroo_on_off)  # -> I, V, O
item_13 = ListItem(List=solver.O, Index="0", Wrap=True)

# ----
dam_2 = DataDam(DataA=item_13, BufferDelay=10000000, BufferMode=0)

# ---- group: Calculating Vectors to extrude
mesh_2 = Mesh(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)
merge = Merge(Data1=dam_2, Data2=mesh_2)
pt_4 = Point(_1_3)
xz = XZPlane(Origin=pt_4)
item_14 = ListItem(List=merge, Index=list, Wrap=True)
demesh = DeconstructMesh(Mesh=item_14)  # -> Vertices, Faces, Colours, Normals
cp = PlaneClosestPoint(Point=demesh.Vertices, Plane=xz)  # -> Point, UVPoint, Distance
sort = SortList(Keys=cp.Distance, ValuesA=demesh.Vertices)  # -> Keys, ValuesA
multiplication_23 = Multiplication(A=sort.Keys, B="-1")
smaller = SmallerThan(FirstNumber=multiplication_23, SecondNumber=Slider(0.01, range=0..1))  # -> SmallerThan, OrEqualTo
cull_11 = CullPattern(List=sort.ValuesA, CullPattern=smaller.SmallerThan)
cullpt = CullDuplicates(Points=cull_11, Tolerance=Slider(0.01, range=0..0.1), CullMode=3)  # -> Points, Indices, Valence
anchor_points = Point(cullpt.Points)
yz = YZPlane(Origin=pt_4)
cp_2 = PlaneClosestPoint(Point=anchor_points, Plane=yz)  # -> Point, UVPoint, Distance
sort_2 = SortList(Keys=cp_2.Distance, ValuesA=anchor_points)  # -> Keys, reverse(ValuesA)
dom_14 = ConstructDomain(DomainStart=0, DomainEnd=steps_to_rise_heigth)
subset = SubList(List=sort_2.ValuesA, Domain=dom_14, Wrap=True)  # -> List, Index
xy_3 = XYPlane(Origin=Point(0, 0, 0))
project = Project(Geometry=subset.List, Plane=xy_3)  # -> Geometry, Transform
dist = Distance(PointA=subset.List, PointB=project.Geometry)
sort_3 = SortList(Keys=dist)  # -> Keys, ValuesA
lastdex_16 = LastIndex(List=sort_3.Keys)
item_15 = ListItem(List=sort_3.Keys, Index=lastdex_16, Wrap=True)
panel_29 = Panel(sort_3.Keys)
subtraction_3 = Subtraction(A=panel, B=item_15)
addition_2 = Addition(A=subtraction_3, B=dist)
Z_2 = UnitZ(Factor=addition_2)  # -> graft(UnitVector)

# ---- group: Peace A
bang_22 = ExplodeTree(Data=simplify(Z_2))  # -> Branch0, Branch1, Branch2, Branch3, Branch4, Branch5, Branch6, Branch7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
cluster_29 = Cluster_2(G=srf_154, step_floor=bang_22.Branch1, step_roof=bang_22.Branch2)  # -> E, C
cluster_30 = Cluster_2(G=srf_172, step_floor=bang_22.Branch11, step_roof=bang_22.Branch12)  # -> E, C
extr = Extrude(Base=srf_155, Direction=bang_22.Branch0)
cluster_31 = Cluster_2(G=srf_167, step_floor=bang_22.Branch16, step_roof=bang_22.Branch17)  # -> E, C
cluster_32 = Cluster_2(G=srf_177, step_floor=bang_22.Branch21, step_roof=bang_22.Branch22)  # -> E, C
cluster_33 = Cluster_2(G=srf_158, step_floor=bang_22.Branch26, step_roof=bang_22.Branch27)  # -> E, C
cluster_34 = Cluster_2(G=srf_162, step_floor=bang_22.Branch6, step_roof=bang_22.Branch7)  # -> E, C
cluster_35 = Cluster_2(G=srf_170, step_floor=bang_22.Branch7, step_roof=bang_22.Branch8)  # -> E, C
cluster_36 = Cluster_2(G=srf_165, step_floor=bang_22.Branch12, step_roof=bang_22.Branch13)  # -> E, C
cluster_37 = Cluster_2(G=srf_160, step_floor=bang_22.Branch2, step_roof=bang_22.Branch3)  # -> E, C
cluster_38 = Cluster_2(G=srf_175, step_floor=bang_22.Branch17, step_roof=bang_22.Branch18)  # -> E, C
cluster_39 = Cluster_2(G=srf_181, step_floor=bang_22.Branch22, step_roof=bang_22.Branch23)  # -> E, C
cluster_40 = Cluster_2(G=srf_182, step_floor=bang_22.Branch27, step_roof=bang_22.Branch28)  # -> E, C
cluster_41 = Cluster_2(G=srf_163, step_floor=bang_22.Branch8, step_roof=bang_22.Branch9)  # -> E, C
cluster_42 = Cluster_2(G=srf_168, step_floor=bang_22.Branch3, step_roof=bang_22.Branch4)  # -> E, C
cluster_43 = Cluster_2(G=srf_173, step_floor=bang_22.Branch13, step_roof=bang_22.Branch14)  # -> E, C
cluster_44 = Cluster_2(G=srf_179, step_floor=bang_22.Branch18, step_roof=bang_22.Branch19)  # -> E, C
cluster_45 = Cluster_2(G=srf_178, step_floor=bang_22.Branch23, step_roof=bang_22.Branch24)  # -> E, C
cluster_46 = Cluster_2(G=srf_159, step_floor=bang_22.Branch28, step_roof=bang_22.Branch29)  # -> E, C
cluster_47 = Cluster_2(G=srf_171, step_floor=bang_22.Branch9, step_roof=bang_22.Branch10)  # -> E, C
cluster_48 = Cluster_2(G=srf_161, step_floor=bang_22.Branch4, step_roof=bang_22.Branch5)  # -> E, C
cluster_49 = Cluster_2(G=srf_166, step_floor=bang_22.Branch14, step_roof=bang_22.Branch15)  # -> E, C
cluster_50 = Cluster_2(G=srf_176, step_floor=bang_22.Branch19, step_roof=bang_22.Branch20)  # -> E, C
cluster_51 = Cluster_2(G=srf_156, step_floor=bang_22.Branch24, step_roof=bang_22.Branch25)  # -> E, C
cluster_52 = Cluster_2(G=srf_164, step_floor=bang_22.Branch10, step_roof=bang_22.Branch11)  # -> E, C
cluster_53 = Cluster_2(G=srf_169, step_floor=bang_22.Branch5, step_roof=bang_22.Branch6)  # -> E, C
cluster_54 = Cluster_2(G=srf_174, step_floor=bang_22.Branch15, step_roof=bang_22.Branch16)  # -> E, C
cluster_55 = Cluster_2(G=srf_180, step_floor=bang_22.Branch20, step_roof=bang_22.Branch21)  # -> E, C
cluster_56 = Cluster_2(G=srf_157, step_floor=bang_22.Branch25, step_roof=bang_22.Branch26)  # -> E, C
brep = Brep([cluster_29.E, cluster_37.E, cluster_42.E, cluster_48.E, cluster_53.E, cluster_34.E, cluster_35.E, cluster_41.E, cluster_47.E, cluster_52.E, cluster_30.E, cluster_36.E, cluster_43.E, cluster_49.E, cluster_54.E, cluster_31.E, cluster_38.E, cluster_44.E, cluster_50.E, cluster_55.E, cluster_32.E, cluster_39.E, cluster_45.E, cluster_51.E, cluster_56.E, cluster_33.E, cluster_40.E, cluster_46.E, extr])

bang_23 = ExplodeTree(Data=simplify(Z_2))  # -> Branch0, Branch1, Branch2, Branch3, Branch4, Branch5, Branch6, Branch7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
vec_11 = VectorXYZ(XComponent="0", YComponent="0", ZComponent="0")  # -> Vector, Length
cluster_57 = Cluster_2(G=srf_100, step_floor=bang_23.Branch11, step_roof=bang_23.Branch12)  # -> E, C
cluster_58 = Cluster_2(G=srf_119, step_floor=bang_23.Branch16, step_roof=bang_23.Branch17)  # -> E, C
cluster_59 = Cluster_2(G=srf_105, step_floor=bang_23.Branch21, step_roof=bang_23.Branch22)  # -> E, C
cluster_60 = Cluster_2(G=srf_109, step_floor=bang_23.Branch26, step_roof=bang_23.Branch27)  # -> E, C
cluster_61 = Cluster_2(G=srf_112, step_floor=vec_11.Vector, step_roof=bang_23.Branch2)  # -> E, C
cluster_62 = Cluster_2(G=srf_114, step_floor=bang_23.Branch6, step_roof=bang_23.Branch7)  # -> E, C
extr_2 = Extrude(Base=srf_91, Direction=bang_23.Branch0)
cluster_63 = Cluster_2(G=srf_98, step_floor=bang_23.Branch7, step_roof=bang_23.Branch8)  # -> E, C
cluster_64 = Cluster_2(G=srf_117, step_floor=bang_23.Branch12, step_roof=bang_23.Branch13)  # -> E, C
cluster_65 = Cluster_2(G=srf_112, step_floor=bang_23.Branch2, step_roof=bang_23.Branch3)  # -> E, C
cluster_66 = Cluster_2(G=srf_103, step_floor=bang_23.Branch17, step_roof=bang_23.Branch18)  # -> E, C
cluster_67 = Cluster_2(G=srf_122, step_floor=bang_23.Branch22, step_roof=bang_23.Branch23)  # -> E, C
cluster_68 = Cluster_2(G=srf_110, step_floor=bang_23.Branch27, step_roof=bang_23.Branch28)  # -> E, C
cluster_69 = Cluster_2(G=srf_115, step_floor=bang_23.Branch8, step_roof=bang_23.Branch9)  # -> E, C
cluster_70 = Cluster_2(G=srf_96, step_floor=bang_23.Branch3, step_roof=bang_23.Branch4)  # -> E, C
cluster_71 = Cluster_2(G=srf_101, step_floor=bang_23.Branch13, step_roof=bang_23.Branch14)  # -> E, C
cluster_72 = Cluster_2(G=srf_120, step_floor=bang_23.Branch18, step_roof=bang_23.Branch19)  # -> E, C
cluster_73 = Cluster_2(G=srf_111, step_floor=bang_23.Branch28, step_roof=bang_23.Branch29)  # -> E, C
cluster_74 = Cluster_2(G=srf_106, step_floor=bang_23.Branch23, step_roof=bang_23.Branch24)  # -> E, C
cluster_75 = Cluster_2(G=srf_99, step_floor=bang_23.Branch9, step_roof=bang_23.Branch10)  # -> E, C
cluster_76 = Cluster_2(G=srf_113, step_floor=bang_23.Branch4, step_roof=bang_23.Branch5)  # -> E, C
cluster_77 = Cluster_2(G=srf_118, step_floor=bang_23.Branch14, step_roof=bang_23.Branch15)  # -> E, C
cluster_78 = Cluster_2(G=srf_104, step_floor=bang_23.Branch19, step_roof=bang_23.Branch20)  # -> E, C
cluster_79 = Cluster_2(G=srf_107, step_floor=bang_23.Branch24, step_roof=bang_23.Branch25)  # -> E, C
cluster_80 = Cluster_2(G=srf_116, step_floor=bang_23.Branch10, step_roof=bang_23.Branch11)  # -> E, C
cluster_81 = Cluster_2(G=srf_97, step_floor=bang_23.Branch5, step_roof=bang_23.Branch6)  # -> E, C
cluster_82 = Cluster_2(G=srf_102, step_floor=bang_23.Branch15, step_roof=bang_23.Branch16)  # -> E, C
cluster_83 = Cluster_2(G=srf_121, step_floor=bang_23.Branch20, step_roof=bang_23.Branch21)  # -> E, C
cluster_84 = Cluster_2(G=srf_108, step_floor=bang_23.Branch25, step_roof=bang_23.Branch26)  # -> E, C
brep_2 = Brep([cluster_61.E, cluster_65.E, cluster_70.E, cluster_76.E, cluster_81.E, cluster_62.E, cluster_63.E, cluster_69.E, cluster_75.E, cluster_80.E, cluster_57.E, cluster_64.E, cluster_71.E, cluster_77.E, cluster_82.E, cluster_58.E, cluster_66.E, cluster_72.E, cluster_78.E, cluster_83.E, cluster_59.E, cluster_67.E, cluster_74.E, cluster_79.E, cluster_84.E, cluster_60.E, cluster_68.E, cluster_73.E])

bang_24 = ExplodeTree(Data=simplify(Z_2))  # -> Branch0, Branch1, Branch2, Branch3, Branch4, Branch5, Branch6, Branch7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
cluster_85 = Cluster_2(G=srf_147, step_floor=bang_24.Branch11, step_roof=bang_24.Branch12)  # -> E, C
cluster_86 = Cluster_2(G=srf_134, step_floor=bang_24.Branch16, step_roof=bang_24.Branch17)  # -> E, C
cluster_87 = Cluster_2(G=srf_152, step_floor=bang_24.Branch21, step_roof=bang_24.Branch22)  # -> E, C
cluster_88 = Cluster_2(G=srf_139, step_floor=bang_24.Branch26, step_roof=bang_24.Branch27)  # -> E, C
cluster_89 = Cluster_2(G=srf_142, step_floor=bang_24.Branch1, step_roof=bang_24.Branch2)  # -> E, C
cluster_90 = Cluster_2(G=srf_129, step_floor=bang_24.Branch6, step_roof=bang_24.Branch7)  # -> E, C
extr_3 = Extrude(Base=srf_123, Direction=bang_24.Branch0)
cluster_91 = Cluster_2(G=srf_145, step_floor=bang_24.Branch7, step_roof=bang_24.Branch8)  # -> E, C
cluster_92 = Cluster_2(G=srf_132, step_floor=bang_24.Branch12, step_roof=bang_24.Branch13)  # -> E, C
cluster_93 = Cluster_2(G=srf_127, step_floor=bang_24.Branch2, step_roof=bang_24.Branch3)  # -> E, C
cluster_94 = Cluster_2(G=srf_150, step_floor=bang_24.Branch17, step_roof=bang_24.Branch18)  # -> E, C
cluster_95 = Cluster_2(G=srf_137, step_floor=bang_24.Branch22, step_roof=bang_24.Branch23)  # -> E, C
cluster_96 = Cluster_2(G=srf_140, step_floor=bang_24.Branch27, step_roof=bang_24.Branch28)  # -> E, C
cluster_97 = Cluster_2(G=srf_130, step_floor=bang_24.Branch8, step_roof=bang_24.Branch9)  # -> E, C
cluster_98 = Cluster_2(G=srf_143, step_floor=bang_24.Branch3, step_roof=bang_24.Branch4)  # -> E, C
cluster_99 = Cluster_2(G=srf_148, step_floor=bang_24.Branch13, step_roof=bang_24.Branch14)  # -> E, C
cluster_100 = Cluster_2(G=srf_135, step_floor=bang_24.Branch18, step_roof=bang_24.Branch19)  # -> E, C
cluster_101 = Cluster_2(G=srf_138, step_floor=bang_24.Branch23, step_roof=bang_24.Branch24)  # -> E, C
cluster_102 = Cluster_2(G=srf_126, step_floor=bang_24.Branch28, step_roof=bang_24.Branch29)  # -> E, C
cluster_103 = Cluster_2(G=srf_146, step_floor=bang_24.Branch9, step_roof=bang_24.Branch10)  # -> E, C
cluster_104 = Cluster_2(G=srf_128, step_floor=bang_24.Branch4, step_roof=bang_24.Branch5)  # -> E, C
cluster_105 = Cluster_2(G=srf_133, step_floor=bang_24.Branch14, step_roof=bang_24.Branch15)  # -> E, C
cluster_106 = Cluster_2(G=srf_151, step_floor=bang_24.Branch19, step_roof=bang_24.Branch20)  # -> E, C
cluster_107 = Cluster_2(G=srf_124, step_floor=bang_24.Branch24, step_roof=bang_24.Branch25)  # -> E, C
cluster_108 = Cluster_2(G=srf_131, step_floor=bang_24.Branch10, step_roof=bang_24.Branch11)  # -> E, C
cluster_109 = Cluster_2(G=srf_144, step_floor=bang_24.Branch5, step_roof=bang_24.Branch6)  # -> E, C
cluster_110 = Cluster_2(G=srf_149, step_floor=bang_24.Branch15, step_roof=bang_24.Branch16)  # -> E, C
cluster_111 = Cluster_2(G=srf_136, step_floor=bang_24.Branch20, step_roof=bang_24.Branch21)  # -> E, C
cluster_112 = Cluster_2(G=srf_125, step_floor=bang_24.Branch25, step_roof=bang_24.Branch26)  # -> E, C
brep_3 = Brep([cluster_89.E, cluster_93.E, cluster_98.E, cluster_104.E, cluster_109.E, cluster_90.E, cluster_91.E, cluster_97.E, cluster_103.E, cluster_108.E, cluster_85.E, cluster_92.E, cluster_99.E, cluster_105.E, cluster_110.E, cluster_86.E, cluster_94.E, cluster_100.E, cluster_106.E, cluster_111.E, cluster_87.E, cluster_95.E, cluster_101.E, cluster_107.E, cluster_112.E, cluster_88.E, cluster_96.E, cluster_102.E, extr_3])

bang_25 = ExplodeTree(Data=simplify(Z_2))  # -> Branch0, Branch1, Branch2, Branch3, Branch4, Branch5, Branch6, Branch7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
cluster_113 = Cluster_2(G=srf_62, step_floor=bang_25.Branch1, step_roof=bang_25.Branch2)  # -> E, C
extr_4 = Extrude(Base=srf_65, Direction=bang_25.Branch0)
cluster_114 = Cluster_2(G=srf_74, step_floor=bang_25.Branch11, step_roof=bang_25.Branch12)  # -> E, C
cluster_115 = Cluster_2(G=srf_79, step_floor=bang_25.Branch16, step_roof=bang_25.Branch17)  # -> E, C
cluster_116 = Cluster_2(G=srf_84, step_floor=bang_25.Branch21, step_roof=bang_25.Branch22)  # -> E, C
cluster_117 = Cluster_2(G=srf_88, step_floor=bang_25.Branch26, step_roof=bang_25.Branch27)  # -> E, C
cluster_118 = Cluster_2(G=srf_69, step_floor=bang_25.Branch6, step_roof=bang_25.Branch7)  # -> E, C
cluster_119 = Cluster_2(G=srf_70, step_floor=bang_25.Branch7, step_roof=bang_25.Branch8)  # -> E, C
cluster_120 = Cluster_2(G=srf_75, step_floor=bang_25.Branch12, step_roof=bang_25.Branch13)  # -> E, C
cluster_121 = Cluster_2(G=srf_66, step_floor=bang_25.Branch2, step_roof=bang_25.Branch3)  # -> E, C
cluster_122 = Cluster_2(G=srf_80, step_floor=bang_25.Branch17, step_roof=bang_25.Branch18)  # -> E, C
cluster_123 = Cluster_2(G=srf_85, step_floor=bang_25.Branch22, step_roof=bang_25.Branch23)  # -> E, C
cluster_124 = Cluster_2(G=srf_89, step_floor=bang_25.Branch27, step_roof=bang_25.Branch28)  # -> E, C
cluster_125 = Cluster_2(G=srf_71, step_floor=bang_25.Branch8, step_roof=bang_25.Branch9)  # -> E, C
cluster_126 = Cluster_2(G=srf_67, step_floor=bang_25.Branch3, step_roof=bang_25.Branch4)  # -> E, C
cluster_127 = Cluster_2(G=srf_76, step_floor=bang_25.Branch13, step_roof=bang_25.Branch14)  # -> E, C
cluster_128 = Cluster_2(G=srf_81, step_floor=bang_25.Branch18, step_roof=bang_25.Branch19)  # -> E, C
cluster_129 = Cluster_2(G=srf_64, step_floor=bang_25.Branch23, step_roof=bang_25.Branch24)  # -> E, C
cluster_130 = Cluster_2(G=srf_90, step_floor=bang_25.Branch28, step_roof=bang_25.Branch29)  # -> E, C
cluster_131 = Cluster_2(G=srf_72, step_floor=bang_25.Branch9, step_roof=bang_25.Branch10)  # -> E, C
cluster_132 = Cluster_2(G=srf_68, step_floor=bang_25.Branch4, step_roof=bang_25.Branch5)  # -> E, C
cluster_133 = Cluster_2(G=srf_77, step_floor=bang_25.Branch14, step_roof=bang_25.Branch15)  # -> E, C
cluster_134 = Cluster_2(G=srf_82, step_floor=bang_25.Branch19, step_roof=bang_25.Branch20)  # -> E, C
cluster_135 = Cluster_2(G=srf_86, step_floor=bang_25.Branch24, step_roof=bang_25.Branch25)  # -> E, C
cluster_136 = Cluster_2(G=srf_73, step_floor=bang_25.Branch10, step_roof=bang_25.Branch11)  # -> E, C
cluster_137 = Cluster_2(G=srf_63, step_floor=bang_25.Branch5, step_roof=bang_25.Branch6)  # -> E, C
cluster_138 = Cluster_2(G=srf_78, step_floor=bang_25.Branch15, step_roof=bang_25.Branch16)  # -> E, C
cluster_139 = Cluster_2(G=srf_83, step_floor=bang_25.Branch20, step_roof=bang_25.Branch21)  # -> E, C
cluster_140 = Cluster_2(G=srf_87, step_floor=bang_25.Branch25, step_roof=bang_25.Branch26)  # -> E, C
brep_4 = Brep([cluster_113.E, cluster_121.E, cluster_126.E, cluster_132.E, cluster_137.E, cluster_118.E, cluster_119.E, cluster_125.E, cluster_131.E, cluster_136.E, cluster_114.E, cluster_120.E, cluster_127.E, cluster_133.E, cluster_138.E, cluster_115.E, cluster_122.E, cluster_128.E, cluster_134.E, cluster_139.E, cluster_116.E, cluster_123.E, cluster_129.E, cluster_135.E, cluster_140.E, cluster_117.E, cluster_124.E, cluster_130.E, extr_4])

# D. Extruding pieces (A1, A2, B1, B2, C1 and C2)
panel_30 = Panel("0")
bang_26 = ExplodeTree(Data=simplify(Z_2))  # -> Branch0, Branch1, Branch2, Branch3, Branch4, Branch5, Branch6, Branch7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
vec_12 = VectorXYZ(XComponent=panel_30, YComponent=panel_30, ZComponent=panel_30)  # -> Vector, Length
cluster_141 = Cluster_2(G=srf_14, step_floor=bang_26.Branch11, step_roof=bang_26.Branch12)  # -> E, C
cluster_142 = Cluster_2(G=srf_19, step_floor=bang_26.Branch16, step_roof=bang_26.Branch17)  # -> E, C
cluster_143 = Cluster_2(G=srf_23, step_floor=bang_26.Branch21, step_roof=bang_26.Branch22)  # -> E, C
cluster_144 = Cluster_2(G=srf_28, step_floor=bang_26.Branch26, step_roof=bang_26.Branch27)  # -> E, C
cluster_145 = Cluster_2(G=srf_5, step_floor=vec_12.Vector, step_roof=bang_26.Branch2)  # -> E, C
cluster_146 = Cluster_2(G=srf_9, step_floor=bang_26.Branch6, step_roof=bang_26.Branch7)  # -> E, C
extr_5 = Extrude(Base=srf_3, Direction=bang_26.Branch0)
cluster_147 = Cluster_2(G=srf_10, step_floor=bang_26.Branch7, step_roof=bang_26.Branch8)  # -> E, C
cluster_148 = Cluster_2(G=srf_15, step_floor=bang_26.Branch12, step_roof=bang_26.Branch13)  # -> E, C
cluster_149 = Cluster_2(G=srf_5, step_floor=bang_26.Branch2, step_roof=bang_26.Branch3)  # -> E, C
cluster_150 = Cluster_2(G=srf_20, step_floor=bang_26.Branch17, step_roof=bang_26.Branch18)  # -> E, C
cluster_151 = Cluster_2(G=srf_24, step_floor=bang_26.Branch22, step_roof=bang_26.Branch23)  # -> E, C
cluster_152 = Cluster_2(G=srf_31, step_floor=bang_26.Branch27, step_roof=bang_26.Branch28)  # -> E, C
cluster_153 = Cluster_2(G=srf_11, step_floor=bang_26.Branch8, step_roof=bang_26.Branch9)  # -> E, C
cluster_154 = Cluster_2(G=srf_6, step_floor=bang_26.Branch3, step_roof=bang_26.Branch4)  # -> E, C
cluster_155 = Cluster_2(G=srf_16, step_floor=bang_26.Branch13, step_roof=bang_26.Branch14)  # -> E, C
cluster_156 = Cluster_2(G=srf_30, step_floor=bang_26.Branch18, step_roof=bang_26.Branch19)  # -> E, C
cluster_157 = Cluster_2(G=srf_25, step_floor=bang_26.Branch23, step_roof=bang_26.Branch24)  # -> E, C
cluster_158 = Cluster_2(G=srf_29, step_floor=bang_26.Branch28, step_roof=bang_26.Branch29)  # -> E, C
cluster_159 = Cluster_2(G=srf_12, step_floor=bang_26.Branch9, step_roof=bang_26.Branch10)  # -> E, C
cluster_160 = Cluster_2(G=srf_7, step_floor=bang_26.Branch4, step_roof=bang_26.Branch5)  # -> E, C
cluster_161 = Cluster_2(G=srf_17, step_floor=bang_26.Branch14, step_roof=bang_26.Branch15)  # -> E, C
cluster_162 = Cluster_2(G=srf_21, step_floor=bang_26.Branch19, step_roof=bang_26.Branch20)  # -> E, C
cluster_163 = Cluster_2(G=srf_26, step_floor=bang_26.Branch24, step_roof=bang_26.Branch25)  # -> E, C
cluster_164 = Cluster_2(G=srf_13, step_floor=bang_26.Branch10, step_roof=bang_26.Branch11)  # -> E, C
cluster_165 = Cluster_2(G=srf_8, step_floor=bang_26.Branch5, step_roof=bang_26.Branch6)  # -> E, C
cluster_166 = Cluster_2(G=srf_18, step_floor=bang_26.Branch15, step_roof=bang_26.Branch16)  # -> E, C
cluster_167 = Cluster_2(G=srf_22, step_floor=bang_26.Branch20, step_roof=bang_26.Branch21)  # -> E, C
cluster_168 = Cluster_2(G=srf_27, step_floor=bang_26.Branch25, step_roof=bang_26.Branch26)  # -> E, C
brep_5 = Brep([cluster_145.E, cluster_149.E, cluster_154.E, cluster_160.E, cluster_165.E, cluster_146.E, cluster_147.E, cluster_153.E, cluster_159.E, cluster_164.E, cluster_141.E, cluster_148.E, cluster_155.E, cluster_161.E, cluster_166.E, cluster_142.E, cluster_150.E, cluster_156.E, cluster_162.E, cluster_167.E, cluster_143.E, cluster_151.E, cluster_157.E, cluster_163.E, cluster_168.E, cluster_144.E, cluster_152.E, cluster_158.E])

bang_27 = ExplodeTree(Data=simplify(Z_2))  # -> Branch0, Branch1, Branch2, Branch3, Branch4, Branch5, Branch6, Branch7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
cluster_169 = Cluster_2(G=srf_46, step_floor=bang_27.Branch11, step_roof=bang_27.Branch12)  # -> E, C
cluster_170 = Cluster_2(G=srf_50, step_floor=bang_27.Branch16, step_roof=bang_27.Branch17)  # -> E, C
cluster_171 = Cluster_2(G=srf_55, step_floor=bang_27.Branch21, step_roof=bang_27.Branch22)  # -> E, C
cluster_172 = Cluster_2(G=srf_59, step_floor=bang_27.Branch26, step_roof=bang_27.Branch27)  # -> E, C
cluster_173 = Cluster_2(G=srf_38, step_floor=bang_27.Branch1, step_roof=bang_27.Branch2)  # -> E, C
cluster_174 = Cluster_2(G=srf_42, step_floor=bang_27.Branch6, step_roof=bang_27.Branch7)  # -> E, C
extr_6 = Extrude(Base=srf_37, Direction=bang_27.Branch0)
cluster_175 = Cluster_2(G=srf_34, step_floor=bang_27.Branch7, step_roof=bang_27.Branch8)  # -> E, C
cluster_176 = Cluster_2(G=srf_47, step_floor=bang_27.Branch12, step_roof=bang_27.Branch13)  # -> E, C
cluster_177 = Cluster_2(G=srf_39, step_floor=bang_27.Branch2, step_roof=bang_27.Branch3)  # -> E, C
cluster_178 = Cluster_2(G=srf_51, step_floor=bang_27.Branch17, step_roof=bang_27.Branch18)  # -> E, C
cluster_179 = Cluster_2(G=srf_60, step_floor=bang_27.Branch27, step_roof=bang_27.Branch28)  # -> E, C
cluster_180 = Cluster_2(G=srf_56, step_floor=bang_27.Branch22, step_roof=bang_27.Branch23)  # -> E, C
cluster_181 = Cluster_2(G=srf_43, step_floor=bang_27.Branch8, step_roof=bang_27.Branch9)  # -> E, C
cluster_182 = Cluster_2(G=srf_40, step_floor=bang_27.Branch3, step_roof=bang_27.Branch4)  # -> E, C
cluster_183 = Cluster_2(G=srf_48, step_floor=bang_27.Branch13, step_roof=bang_27.Branch14)  # -> E, C
cluster_184 = Cluster_2(G=srf_52, step_floor=bang_27.Branch18, step_roof=bang_27.Branch19)  # -> E, C
cluster_185 = Cluster_2(G=srf_57, step_floor=bang_27.Branch23, step_roof=bang_27.Branch24)  # -> E, C
cluster_186 = Cluster_2(G=srf_61, step_floor=bang_27.Branch28, step_roof=bang_27.Branch29)  # -> E, C
cluster_187 = Cluster_2(G=srf_44, step_floor=bang_27.Branch9, step_roof=bang_27.Branch10)  # -> E, C
cluster_188 = Cluster_2(G=srf_41, step_floor=bang_27.Branch4, step_roof=bang_27.Branch5)  # -> E, C
cluster_189 = Cluster_2(G=srf_35, step_floor=bang_27.Branch14, step_roof=bang_27.Branch15)  # -> E, C
cluster_190 = Cluster_2(G=srf_53, step_floor=bang_27.Branch19, step_roof=bang_27.Branch20)  # -> E, C
cluster_191 = Cluster_2(G=srf_58, step_floor=bang_27.Branch24, step_roof=bang_27.Branch25)  # -> E, C
cluster_192 = Cluster_2(G=srf_45, step_floor=bang_27.Branch10, step_roof=bang_27.Branch11)  # -> E, C
cluster_193 = Cluster_2(G=srf_33, step_floor=bang_27.Branch5, step_roof=bang_27.Branch6)  # -> E, C
cluster_194 = Cluster_2(G=srf_49, step_floor=bang_27.Branch15, step_roof=bang_27.Branch16)  # -> E, C
cluster_195 = Cluster_2(G=srf_54, step_floor=bang_27.Branch20, step_roof=bang_27.Branch21)  # -> E, C
cluster_196 = Cluster_2(G=srf_36, step_floor=bang_27.Branch25, step_roof=bang_27.Branch26)  # -> E, C
brep_6 = Brep([cluster_173.E, cluster_177.E, cluster_182.E, cluster_188.E, cluster_193.E, cluster_174.E, cluster_175.E, cluster_181.E, cluster_187.E, cluster_192.E, cluster_169.E, cluster_176.E, cluster_183.E, cluster_189.E, cluster_194.E, cluster_170.E, cluster_178.E, cluster_184.E, cluster_190.E, cluster_195.E, cluster_171.E, cluster_180.E, cluster_185.E, cluster_191.E, cluster_196.E, cluster_172.E, cluster_179.E, cluster_186.E, extr_6])

# ----
dam_3 = DataDam(DataA=brep_5, BufferDelay=10000000, BufferMode=0)
dam_4 = DataDam(DataA=brep_6, BufferDelay=10000000, BufferMode=0)
dam_5 = DataDam(DataA=brep_4, BufferDelay=10000000, BufferMode=0)
dam_6 = DataDam(DataA=brep_2, BufferDelay=10000000, BufferMode=0)
dam_7 = DataDam(DataA=brep_3, BufferDelay=10000000, BufferMode=0)
dam_8 = DataDam(DataA=brep, BufferDelay=10000000, BufferMode=0)

# ---- group: Peace "C.1" Generation (8 ones)
data_2 = Data(dam_5)
mirror_2 = Mirror(Geometry=data_2, Plane=pl_3pt)  # -> Geometry, Transform
rad_3 = Radians(Degrees="180")
rad_4 = Radians(Degrees="90")
rad_5 = Radians(Degrees="270")
rad_6 = Radians(Degrees="180")
rad_7 = Radians(Degrees="90")
rad_8 = Radians(Degrees="270")
rotax_3 = RotateAxis(Geometry=graft(mirror_2.Geometry), Angle=rad_4, Axis=ln)  # -> Geometry, Transform
rotax_4 = RotateAxis(Geometry=graft(data_2), Angle=rad_8, Axis=ln)  # -> Geometry, Transform
rotax_5 = RotateAxis(Geometry=graft(mirror_2.Geometry), Angle=rad_5, Axis=ln)  # -> Geometry, Transform
rotax_6 = RotateAxis(Geometry=graft(data_2), Angle=rad_3, Axis=ln)  # -> Geometry, Transform
rotax_7 = RotateAxis(Geometry=graft(mirror_2.Geometry), Angle=rad_6, Axis=ln)  # -> Geometry, Transform
rotax_8 = RotateAxis(Geometry=graft(data_2), Angle=rad_7, Axis=ln)  # -> Geometry, Transform
data_3 = Data(data_2)
data_4 = Data(mirror_2.Geometry)

# ---- group: Peace "B.1" Generation (8 ones)
data_5 = Data(dam_4)
mirror_3 = Mirror(Geometry=data_5, Plane=pl_3pt)  # -> Geometry, Transform
rad_9 = Radians(Degrees="180")
rad_10 = Radians(Degrees="90")
rad_11 = Radians(Degrees="270")
rad_12 = Radians(Degrees="180")
rad_13 = Radians(Degrees="90")
rad_14 = Radians(Degrees="270")
rotax_9 = RotateAxis(Geometry=graft(mirror_3.Geometry), Angle=rad_10, Axis=ln)  # -> Geometry, Transform
rotax_10 = RotateAxis(Geometry=graft(data_5), Angle=rad_14, Axis=ln)  # -> Geometry, Transform
rotax_11 = RotateAxis(Geometry=graft(data_5), Angle=rad_9, Axis=ln)  # -> Geometry, Transform
rotax_12 = RotateAxis(Geometry=graft(mirror_3.Geometry), Angle=rad_11, Axis=ln)  # -> Geometry, Transform
rotax_13 = RotateAxis(Geometry=graft(data_5), Angle=rad_13, Axis=ln)  # -> Geometry, Transform
rotax_14 = RotateAxis(Geometry=graft(mirror_3.Geometry), Angle=rad_12, Axis=ln)  # -> Geometry, Transform
data_6 = Data(data_5)
data_7 = Data(mirror_3.Geometry)

# ---- group: Peace "A.1" Generation (8 ones)
# E. Generating pieces in 8 positions
data_8 = Data(dam_3)
mirror_4 = Mirror(Geometry=data_8, Plane=pl_3pt)  # -> Geometry, Transform
rad_15 = Radians(Degrees="180")
rad_16 = Radians(Degrees="90")
rad_17 = Radians(Degrees="270")
rad_18 = Radians(Degrees="180")
rad_19 = Radians(Degrees="90")
rad_20 = Radians(Degrees="270")
rotax_15 = RotateAxis(Geometry=graft(data_8), Angle=rad_20, Axis=ln)  # -> Geometry, Transform
rotax_16 = RotateAxis(Geometry=graft(data_8), Angle=rad_15, Axis=ln)  # -> Geometry, Transform
rotax_17 = RotateAxis(Geometry=graft(mirror_4.Geometry), Angle=rad_17, Axis=ln)  # -> Geometry, Transform
rotax_18 = RotateAxis(Geometry=graft(data_8), Angle=rad_19, Axis=ln)  # -> Geometry, Transform
rotax_19 = RotateAxis(Geometry=graft(mirror_4.Geometry), Angle=rad_18, Axis=ln)  # -> Geometry, Transform
rotax_20 = RotateAxis(Geometry=graft(mirror_4.Geometry), Angle=rad_16, Axis=ln)  # -> Geometry, Transform
data_9 = Data(data_8)
data_10 = Data(mirror_4.Geometry)

# ---- group: Peace "B.2" Generation (8 ones)
data_11 = Data(dam_7)
mirror_5 = Mirror(Geometry=data_11, Plane=pl_3pt)  # -> Geometry, Transform
rad_21 = Radians(Degrees="180")
rad_22 = Radians(Degrees="90")
rad_23 = Radians(Degrees="270")
rad_24 = Radians(Degrees="180")
rad_25 = Radians(Degrees="90")
rad_26 = Radians(Degrees="270")
rotax_21 = RotateAxis(Geometry=graft(mirror_5.Geometry), Angle=rad_22, Axis=ln)  # -> Geometry, Transform
rotax_22 = RotateAxis(Geometry=graft(data_11), Angle=rad_26, Axis=ln)  # -> Geometry, Transform
rotax_23 = RotateAxis(Geometry=graft(data_11), Angle=rad_21, Axis=ln)  # -> Geometry, Transform
rotax_24 = RotateAxis(Geometry=graft(mirror_5.Geometry), Angle=rad_23, Axis=ln)  # -> Geometry, Transform
rotax_25 = RotateAxis(Geometry=graft(data_11), Angle=rad_25, Axis=ln)  # -> Geometry, Transform
rotax_26 = RotateAxis(Geometry=graft(mirror_5.Geometry), Angle=rad_24, Axis=ln)  # -> Geometry, Transform
data_12 = Data(data_11)
data_13 = Data(mirror_5.Geometry)

# ---- group: Peace "A.2" Generation (8 ones)
data_14 = Data(dam_6)
mirror_6 = Mirror(Geometry=data_14, Plane=pl_3pt)  # -> Geometry, Transform
rad_27 = Radians(Degrees="180")
rad_28 = Radians(Degrees="90")
rad_29 = Radians(Degrees="270")
rad_30 = Radians(Degrees="180")
rad_31 = Radians(Degrees="90")
rad_32 = Radians(Degrees="270")
rotax_27 = RotateAxis(Geometry=graft(data_14), Angle=rad_32, Axis=ln)  # -> Geometry, Transform
rotax_28 = RotateAxis(Geometry=graft(data_14), Angle=rad_27, Axis=ln)  # -> Geometry, Transform
rotax_29 = RotateAxis(Geometry=graft(mirror_6.Geometry), Angle=rad_29, Axis=ln)  # -> Geometry, Transform
rotax_30 = RotateAxis(Geometry=graft(data_14), Angle=rad_31, Axis=ln)  # -> Geometry, Transform
rotax_31 = RotateAxis(Geometry=graft(mirror_6.Geometry), Angle=rad_30, Axis=ln)  # -> Geometry, Transform
rotax_32 = RotateAxis(Geometry=graft(mirror_6.Geometry), Angle=rad_28, Axis=ln)  # -> Geometry, Transform
data_15 = Data(data_14)
data_16 = Data(mirror_6.Geometry)

# ---- group: Peace "C.2" Generation (8 ones)
data_17 = Data(dam_8)
mirror_7 = Mirror(Geometry=data_17, Plane=pl_3pt)  # -> Geometry, Transform
rad_33 = Radians(Degrees="180")
rad_34 = Radians(Degrees="90")
rad_35 = Radians(Degrees="270")
rad_36 = Radians(Degrees="180")
rad_37 = Radians(Degrees="90")
rad_38 = Radians(Degrees="270")
rotax_33 = RotateAxis(Geometry=graft(mirror_7.Geometry), Angle=rad_34, Axis=ln)  # -> Geometry, Transform
rotax_34 = RotateAxis(Geometry=graft(data_17), Angle=rad_38, Axis=ln)  # -> Geometry, Transform
rotax_35 = RotateAxis(Geometry=graft(mirror_7.Geometry), Angle=rad_35, Axis=ln)  # -> Geometry, Transform
rotax_36 = RotateAxis(Geometry=graft(data_17), Angle=rad_33, Axis=ln)  # -> Geometry, Transform
rotax_37 = RotateAxis(Geometry=graft(mirror_7.Geometry), Angle=rad_36, Axis=ln)  # -> Geometry, Transform
rotax_38 = RotateAxis(Geometry=graft(data_17), Angle=rad_37, Axis=ln)  # -> Geometry, Transform
data_18 = Data(data_17)
data_19 = Data(mirror_7.Geometry)

# ----
dam_9 = DataDam(
    DataA=[data_10, rotax_16.Geometry, rotax_17.Geometry, rotax_18.Geometry, data_6, rotax_9.Geometry, rotax_10.Geometry, rotax_14.Geometry],
    BufferDelay=10000000,
    BufferMode=0)
dam_10 = DataDam(
    DataA=[data_15, rotax_32.Geometry, rotax_27.Geometry, data_16, rotax_29.Geometry, rotax_30.Geometry, rotax_31.Geometry, rotax_28.Geometry],
    BufferDelay=10000000,
    BufferMode=0)
dam_11 = DataDam(
    DataA=[data_9, rotax_20.Geometry, rotax_15.Geometry, data_10, rotax_17.Geometry, rotax_18.Geometry, rotax_19.Geometry, rotax_16.Geometry],
    BufferDelay=10000000,
    BufferMode=0)
dam_12 = DataDam(
    DataA=[data_15, rotax_32.Geometry, rotax_30.Geometry, rotax_31.Geometry, data_13, rotax_23.Geometry, rotax_29.Geometry, rotax_27.Geometry],
    BufferDelay=10000000,
    BufferMode=0)
dam_13 = DataDam(
    DataA=[data_9, rotax_20.Geometry, rotax_18.Geometry, rotax_19.Geometry, data_7, rotax_11.Geometry, rotax_17.Geometry, rotax_15.Geometry],
    BufferDelay=10000000,
    BufferMode=0)
dam_14 = DataDam(
    DataA=[data_16, rotax_28.Geometry, rotax_29.Geometry, rotax_30.Geometry, data_12, rotax_21.Geometry, rotax_22.Geometry, rotax_26.Geometry],
    BufferDelay=10000000,
    BufferMode=0)
dam_15 = DataDam(DataA=[data_3, rotax_7.Geometry, data_4, rotax_6.Geometry], BufferDelay=10000000, BufferMode=0)
dam_16 = DataDam(DataA=[data_18, rotax_37.Geometry, data_19, rotax_36.Geometry], BufferDelay=10000000, BufferMode=0)
dam_17 = DataDam(
    DataA=[data_3, data_4, rotax_11.Geometry, rotax_12.Geometry, rotax_13.Geometry, rotax_14.Geometry],
    BufferDelay=10000000,
    BufferMode=0)
dam_18 = DataDam(
    DataA=[data_18, data_19, rotax_23.Geometry, rotax_24.Geometry, rotax_25.Geometry, rotax_26.Geometry],
    BufferDelay=10000000,
    BufferMode=0)

# ---- group: OOOO
vec_13 = VectorXYZ(XComponent="4", YComponent=0, ZComponent=panel)  # -> Vector, Length
move_13 = Move(Geometry=dam_9, Motion=vec_13.Vector)  # -> Geometry, Transform

# ---- group: OOOO / OCOC
# F. Mixign pieces and geting modules
vec_14 = VectorXYZ(XComponent="4", YComponent=0, ZComponent=0)  # -> Vector, Length
move_14 = Move(Geometry=dam_14, Motion=vec_14.Vector)  # -> Geometry, Transform

# ----
wbjoin_2 = WeaverbirdsJoinMeshesAndWeld(Mesh=flatten(move_13.Geometry), Weld=False)
wbjoin_3 = WeaverbirdsJoinMeshesAndWeld(Mesh=flatten(move_14.Geometry), Weld=False)

# ---- group: OOOO
vec_15 = VectorXYZ(XComponent="8", YComponent=0, ZComponent=panel)  # -> Vector, Length
move_15 = Move(Geometry=dam_11, Motion=vec_15.Vector)  # -> Geometry, Transform

vec_16 = VectorXYZ(XComponent="8", YComponent=0, ZComponent=0)  # -> Vector, Length
move_16 = Move(Geometry=dam_10, Motion=vec_16.Vector)  # -> Geometry, Transform

# ----
wbjoin_4 = WeaverbirdsJoinMeshesAndWeld(Mesh=flatten(move_15.Geometry), Weld=False)
wbjoin_5 = WeaverbirdsJoinMeshesAndWeld(Mesh=flatten(move_16.Geometry), Weld=False)

# ---- group: OOOC
vec_17 = VectorXYZ(XComponent="12", YComponent=0, ZComponent=panel)  # -> Vector, Length
move_17 = Move(Geometry=dam_13, Motion=vec_17.Vector)  # -> Geometry, Transform

vec_18 = VectorXYZ(XComponent="12", YComponent=0, ZComponent=0)  # -> Vector, Length
move_18 = Move(Geometry=dam_12, Motion=vec_18.Vector)  # -> Geometry, Transform

# ----
wbjoin_6 = WeaverbirdsJoinMeshesAndWeld(Mesh=flatten(move_17.Geometry), Weld=False)
wbjoin_7 = WeaverbirdsJoinMeshesAndWeld(Mesh=flatten(move_18.Geometry), Weld=False)

# ---- group: OCOC
vec_19 = VectorXYZ(XComponent="16", YComponent=0, ZComponent=panel)  # -> Vector, Length
move_19 = Move(Geometry=dam_15, Motion=vec_19.Vector)  # -> Geometry, Transform

vec_20 = VectorXYZ(XComponent="16", YComponent=0, ZComponent=0)  # -> Vector, Length
move_20 = Move(Geometry=dam_16, Motion=vec_20.Vector)  # -> Geometry, Transform

# ----
wbjoin_8 = WeaverbirdsJoinMeshesAndWeld(Mesh=flatten(move_19.Geometry), Weld=False)

# ---- group: OCOC
vec_21 = VectorXYZ(XComponent="20", YComponent=0, ZComponent=panel)  # -> Vector, Length
move_21 = Move(Geometry=dam_17, Motion=vec_21.Vector)  # -> Geometry, Transform

# ----
wbjoin_9 = WeaverbirdsJoinMeshesAndWeld(Mesh=flatten(move_20.Geometry), Weld=False)

# ---- group: OCCC
vec_22 = VectorXYZ(XComponent="20", YComponent=0, ZComponent=0)  # -> Vector, Length
move_22 = Move(Geometry=dam_18, Motion=vec_22.Vector)  # -> Geometry, Transform

# ----
wbjoin_10 = WeaverbirdsJoinMeshesAndWeld(Mesh=flatten(move_21.Geometry), Weld=False)
wbjoin_11 = WeaverbirdsJoinMeshesAndWeld(Mesh=flatten(move_22.Geometry), Weld=False)

bake = BakeObjects(Geometry=[wbjoin_3, wbjoin_5, wbjoin_7, wbjoin_9, wbjoin_11], Bake=False)
bake_2 = BakeObjects(Geometry=[wbjoin_2, wbjoin_4, wbjoin_6, wbjoin_8, wbjoin_10], Bake=False)
bake_3 = BakeObjects(Geometry=[move_14.Geometry, move_16.Geometry, move_18.Geometry, move_20.Geometry, move_22.Geometry], Bake=False)
bake_4 = BakeObjects(Geometry=[move_13.Geometry, move_15.Geometry, move_17.Geometry, move_19.Geometry, move_21.Geometry], Bake=False)

# ==== cluster Cluster
P = ClusterInput()
C = ClusterInput()
crv_cp = CurveClosestPoint(Point=P, Curve=graft(C))  # -> simplify(flatten(Point)), Parameter, Distance
coplanar = CoPlanar(Points=crv_cp.Point, Strength=1)
C_2 = ClusterOutput(coplanar)

# ==== cluster Cluster_2
step_roof = ClusterInput()
step_floor = ClusterInput()
step_roof_2 = Data(step_roof)
step_floor_2 = Data(step_floor)
G = ClusterInput()
move = Move(Geometry=G, Motion=step_floor_2)  # -> Geometry, Transform
subtraction = Subtraction(A=step_roof_2, B=step_floor_2)
extr = Extrude(Base=move.Geometry, Direction=subtraction)
mesh = MeshBrep(
    Brep=extr,
    Settings={GridMaxCount=0, GridMinCount=16, JaggedSeams=False, MaxEdgeLength=0, MinEdgeLength=0.0001, MinTolerance=0, Refine=True, RefineAngle=0, RelativeTolerance=0.65, SimplePlanes=True, Tolerance=0})
volume = Volume(Geometry=extr)  # -> Volume, Centroid
E = ClusterOutput([extr, mesh])
C = ClusterOutput(volume.Centroid)
