# Grasshopper definition 211019_Ortho Grid Script (5 way).gh (Grasshopper 1.0.7)
# plug-ins: Human, PTComponentLibrary, Kangaroo2 Components, Weaverbird

# ---- group: Proximity Search
min_radius_tolerance_minus_from_grid_siz = Slider(0.02, range=0..1)  # "Min Radius Tolerance (minus from Grid size)"
# B. Nodes Checker
max_radius_tolerance_add_to_grid_size = Slider(0.02, range=0..1)

# ----
middle_street_width_2x = Slider(2, range=0..4)
local_street_width_x = Slider(1, range=0..5)
# ii: Tolerances for Node/Edge Rel.
external_layer = Slider(1, range=0..5)
boundary_radius_m = Slider(43, range=1..101)
# ii: Street width & Layers characteristics
panel = Panel("43")

# ---- group: Do not adjust
angle_of_intersection = Slider(90, range=30..150)

# ---- group: Local Street Generation
# A. Street Setup
# i: Intersection Derivation
unit_y = UnitY(Factor=boundary_radius_m)
move = Move(Geometry="0,0,0", Motion=unit_y)  # -> Geometry, Transform
rotate = Rotate(Geometry=move.Geometry, Angle=degrees(angle_of_intersection), Plane=PlaneXY(0, 0, 0))  # -> Geometry, Transform
line = Line(StartPoint="0,0,0", EndPoint=rotate.Geometry)

# ----
middle_street_layers = Slider(5, range=0..20)
middle_street_width = Slider(6, range=0..10)  # disabled
local_street_layers = Slider(3, range=0..20)
local_street_width = Slider(3, range=0..10)  # disabled
offset_distance = Slider(3, range=0..10)
offset_height = Slider(3, range=0..10)
node_check = Slider(17, range=0..500)
layer = Slider(1, range=1..7)
local_street_1 = Line(line)
middle_street = Line(Line((0, 92.48797601, 0), (0, -89.02387439, 0)))
center_point = CurveCurve(CurveA=middle_street, CurveB=local_street_1)  # -> Points, ParamsA, ParamsB
circle = Circle(Plane=center_point.Points, Radius=boundary_radius_m)
mirror = Mirror(Geometry=line, Plane=PlaneYZ(0, 0, 0))  # -> Geometry, Transform
addition = Addition(A=middle_street_layers, B="1")
ms_width = Multiplication(A=offset_distance, B=middle_street_width_2x)
ls_width = Multiplication(A=offset_distance, B=local_street_width_x)
addition_2 = Addition(A=local_street_layers, B="1")
addition_3 = Addition(A=offset_distance, B=max_radius_tolerance_add_to_grid_size)
subtraction = Subtraction(A=offset_distance, B=min_radius_tolerance_minus_from_grid_siz)
curve_curve = CurveCurve(CurveA=middle_street, CurveB=circle)  # -> Points, ParamsA, ParamsB
curve_curve_2 = CurveCurve(CurveA=local_street_1, CurveB=circle)  # -> Points, ParamsA, ParamsB
line_2 = Line(StartPoint=center_point.Points, EndPoint=[curve_curve.Points, curve_curve_2.Points])

# ---- group: Obtaining Regular Grid Point on Street
# 0. Grid Setup
merge = Merge(Data1=curve_curve.Points, Data2=curve_curve_2.Points)
vector_2pt = Vector2Pt(PointA=center_point.Points, PointB=merge, Unitize=True)  # -> Vector, Length
length = Length(Curve=line_2)
amplitude = Amplitude(Vector=vector_2pt.Vector, Amplitude=offset_distance)
division = Division(A=length, B=offset_distance)

# ---- group: Local Street Middle Line
list_item = ListItem(List=line_2, Index="2", Wrap=True)

# ---- group: Local Street 1 Generation
division_2 = Division(A=ls_width, B="2")
multiplication = Multiplication(A=division_2, B="-1")
horizontal_frame = HorizontalFrame(Curve=list_item, Parameter="0,0,0")
deconstruct_plane = DeconstructPlane(Plane=horizontal_frame)  # -> Origin, XAxis, YAxis, ZAxis
offset_curve = OffsetCurve(Curve=list_item, Distance=[division_2, multiplication], Plane=deconstruct_plane.YAxis, Corners=1)
series = Series(Start=offset_distance, Step=offset_distance, Count=local_street_layers)
list_item_2 = ListItem(List=flatten(offset_curve), Index=0, Wrap=True)  # -> Item, Item1
multiplication_2 = Multiplication(A=series, B="-1")
loft = Loft(
    Curves=flatten(offset_curve),
    Options={Adjust=False, Closed=False, LoftEnds=0, LoftSimp=0, LoftType=0, Rebuild=10, Refit=0.01})
offset_curve_2 = OffsetCurve(Curve=list_item_2.Item1, Distance=multiplication_2, Plane=deconstruct_plane.YAxis, Corners=1)  # -> flatten(Curve)
offset_curve_3 = OffsetCurve(Curve=list_item_2.Item, Distance=series, Plane=deconstruct_plane.YAxis, Corners=1)  # -> flatten(Curve)

# ----
round = Round(Number=division)  # -> Nearest, Floor, Ceiling

# ---- group: Boundary Circle
custom_preview_lineweights = CustomPreviewLineweights(Geometry=circle, Shader=ColourSwatch(SwatchColor=RGB(152, 184, 214)), Thickness=Slider(5, range=0..10), Absolute=False)

# ----
file_path = FilePath("/Users/junwenloo/OneDrive/2020 ONWARDS/06_Delft/15_Y2Q1/01_Earthy/03_Scripts/GH/erendata.txt")
type_10 = Geometry(<brep referenced from the Rhino model>)
type_20 = Geometry(<brep referenced from the Rhino model>)
type_50 = Geometry(<brep referenced from the Rhino model>)
type_30 = Geometry(<brep referenced from the Rhino model>)
type_40 = Geometry(<brep referenced from the Rhino model>)
type_11 = Geometry(<brep referenced from the Rhino model>)
type_22 = Geometry(<brep referenced from the Rhino model>)
type_32 = Geometry(<brep referenced from the Rhino model>)
type_33 = Geometry(<brep referenced from the Rhino model>)
type_43 = Geometry(<brep referenced from the Rhino model>)
type_47 = Geometry(<brep referenced from the Rhino model>)
type_51 = Geometry(<brep referenced from the Rhino model>)
type_52 = Geometry(<brep referenced from the Rhino model>)
type_21 = Geometry(<brep referenced from the Rhino model>)
type_23 = Geometry(<brep referenced from the Rhino model>)
type_31 = Geometry(<brep referenced from the Rhino model>)
type_34 = Geometry(<brep referenced from the Rhino model>)
type_35 = Geometry(<brep referenced from the Rhino model>)
type_41 = Geometry(<brep referenced from the Rhino model>)
type_42 = Geometry(<brep referenced from the Rhino model>)
type_44 = Geometry(<brep referenced from the Rhino model>)
type_45 = Geometry(<brep referenced from the Rhino model>)
type_46 = Geometry(<brep referenced from the Rhino model>)

# ---- group: Final Model
type_1 = Mesh(<mesh referenced from the Rhino model>)
type_2 = Mesh(<mesh referenced from the Rhino model>)
type_3 = Mesh(<mesh referenced from the Rhino model>)
type_4 = Mesh(<mesh referenced from the Rhino model>)
type_5 = Mesh(<mesh referenced from the Rhino model>)
merge_2 = Merge(Data1=type_1, Data2=type_2, Data3=type_3, Data4=type_4, Data5=type_5)

# ----
merge_3 = Merge(
    Data1=type_10,
    Data2=type_11,
    Data3=type_20,
    Data4=type_21,
    Data5=type_22,
    Data6=type_23,
    Data7=type_30,
    Data8=type_31,
    Data9=type_32,
    Data10=type_33,
    Data11=type_34,
    Data12=type_35,
    Data13=type_40,
    Data14=type_41,
    Data15=type_42,
    Data16=type_43,
    Data17=type_44,
    Data18=type_45,
    Data19=type_46,
    Data20=type_47,
    Data21=type_50,
    Data22=type_51,
    Data23=type_52)
stream_filter = StreamFilter(Gate=Toggle(False), Stream0=merge_3, Stream1=merge_2)

unit_x = UnitX(Factor=offset_distance)  # disabled
unit_x_2 = UnitX(Factor=offset_distance)  # disabled
unit_x_3 = UnitX(Factor=offset_distance)  # disabled
unit_x_4 = UnitX(Factor=offset_distance)  # disabled
boolean_toggle = BooleanToggle(False)  # disabled
# Creating dummy modules
curve = Curve(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)  # disabled
surface = Surface(curve)  # disabled
move_2 = Move(Geometry=curve, Motion=expr("2*x", unit_x))  # -> Geometry, Transform; disabled
move_3 = Move(Geometry=curve, Motion=expr("4*x", unit_x_2))  # -> Geometry, Transform; disabled
move_4 = Move(Geometry=curve, Motion=expr("6*x", unit_x_3))  # -> Geometry, Transform; disabled
move_5 = Move(Geometry=curve, Motion=expr("8*x", unit_x_4))  # -> Geometry, Transform; disabled
number_slider = Slider(12, range=0..20)  # disabled
surface_2 = Surface(move_2.Geometry)  # disabled
surface_3 = Surface(move_3.Geometry)  # disabled
surface_4 = Surface(move_4.Geometry)  # disabled
number_slider_2 = Slider(12, range=0..20)  # disabled
surface_5 = Surface(move_5.Geometry)  # disabled
number_slider_3 = Slider(12, range=0..20)  # disabled
number_slider_4 = Slider(12, range=0..20)  # disabled
explode = Explode(Curve=curve, Recursive=True)  # -> Segments, Vertices; disabled
number_slider_5 = Slider(12, range=0..20)  # disabled
number_slider_6 = Slider(3, range=0..5)  # disabled
explode_2 = Explode(Curve=move_2.Geometry, Recursive=True)  # -> Segments, Vertices; disabled
explode_3 = Explode(Curve=move_3.Geometry, Recursive=True)  # -> Segments, Vertices; disabled
panel_2 = Panel("""2
3""")  # disabled
mesh_surface = MeshSurface(Surface=surface, UCount=number_slider, VCount=number_slider, Overhang=True, Equalize=False)  # disabled
cull_duplicates = CullDuplicates(Points=explode.Vertices, Tolerance=0.1, CullMode=3)  # -> Points, Indices, Valence; disabled
divide_curve = DivideCurve(Curve=explode.Segments, Count=number_slider, Kinks=False)  # -> Points, Tangents, Parameters; disabled
explode_4 = Explode(Curve=move_4.Geometry, Recursive=True)  # -> Segments, Vertices; disabled
panel_3 = Panel("""0
1
2""")  # disabled
explode_5 = Explode(Curve=move_5.Geometry, Recursive=True)  # -> Segments, Vertices; disabled
panel_4 = Panel("""1
3""")  # disabled
cull_index = CullIndex(List=divide_curve.Points, Indices=[0, -1], Wrap=True)  # disabled
mesh_surface_2 = MeshSurface(Surface=surface_2, UCount=number_slider_2, VCount=number_slider_2, Overhang=True, Equalize=False)  # disabled
divide_curve_2 = DivideCurve(Curve=explode_2.Segments, Count=number_slider_2, Kinks=False)  # -> Points, Tangents, Parameters; disabled
tree_branch = TreeBranch(Tree=simplify(divide_curve_2.Points), Path=number_slider_6, MaintainPaths=True)  # disabled
cull_duplicates_2 = CullDuplicates(Points=flatten([explode_2.Vertices, tree_branch]), Tolerance=0.1, CullMode=3)  # -> Points, Indices, Valence; disabled
mesh_surface_3 = MeshSurface(Surface=surface_3, UCount=number_slider_3, VCount=number_slider_3, Overhang=True, Equalize=False)  # disabled
divide_curve_3 = DivideCurve(Curve=explode_3.Segments, Count=number_slider_3, Kinks=False)  # -> Points, Tangents, Parameters; disabled
tree_branch_2 = TreeBranch(Tree=simplify(divide_curve_3.Points), Path=panel_2, MaintainPaths=True)  # disabled
cull_duplicates_3 = CullDuplicates(Points=flatten([explode_3.Vertices, tree_branch_2]), Tolerance=0.1, CullMode=3)  # -> Points, Indices, Valence; disabled
mesh_surface_4 = MeshSurface(Surface=surface_4, UCount=number_slider_4, VCount=number_slider_4, Overhang=True, Equalize=False)  # disabled
divide_curve_4 = DivideCurve(Curve=explode_4.Segments, Count=number_slider_4, Kinks=False)  # -> Points, Tangents, Parameters; disabled
tree_branch_3 = TreeBranch(Tree=simplify(divide_curve_4.Points), Path=panel_3, MaintainPaths=True)  # disabled
cull_duplicates_4 = CullDuplicates(Points=flatten([explode_4.Vertices, tree_branch_3]), Tolerance=0.1, CullMode=3)  # -> Points, Indices, Valence; disabled
mesh_surface_5 = MeshSurface(Surface=surface_5, UCount=number_slider_5, VCount=number_slider_5, Overhang=True, Equalize=False)  # disabled
divide_curve_5 = DivideCurve(Curve=explode_5.Segments, Count=number_slider_5, Kinks=False)  # -> Points, Tangents, Parameters; disabled
tree_branch_4 = TreeBranch(Tree=simplify(divide_curve_5.Points), Path=panel_4, MaintainPaths=True)  # disabled
cull_duplicates_5 = CullDuplicates(Points=flatten([explode_5.Vertices, tree_branch_4]), Tolerance=0.1, CullMode=3)  # -> Points, Indices, Valence; disabled
number_slider_7 = Slider(10000, range=0..10000)  # disabled
number_slider_8 = Slider(1, range=0..5)  # disabled
number_slider_9 = Slider(20, range=0..20)  # disabled
number_slider_10 = Slider(0.34, range=0..5)  # disabled
cull_index_2 = CullIndex(List=divide_curve_2.Points, Indices=[0, -1], Wrap=True)  # disabled
boolean_toggle_2 = BooleanToggle(True)  # disabled
cull_index_3 = CullIndex(List=divide_curve_3.Points, Indices=[0, -1], Wrap=True)  # disabled
cull_index_4 = CullIndex(List=divide_curve_4.Points, Indices=[0, -1], Wrap=True)  # disabled
cull_index_5 = CullIndex(List=divide_curve_5.Points, Indices=[0, -1], Wrap=True)  # disabled
number_slider_11 = Slider(10000, range=0..10000)  # disabled
number_slider_12 = Slider(10000, range=0..10000)  # disabled
number_slider_13 = Slider(20, range=0..20)  # disabled
number_slider_14 = Slider(1, range=0..5)  # disabled
number_slider_15 = Slider(0.637, range=0..5)  # disabled
number_slider_16 = Slider(10000, range=0..10000)  # disabled
number_slider_17 = Slider(1, range=0..5)  # disabled
number_slider_18 = Slider(20, range=0..20)  # disabled
number_slider_19 = Slider(0.918, range=0..5)  # disabled
boolean_toggle_3 = BooleanToggle(True)  # disabled
number_slider_20 = Slider(1, range=0..5)  # disabled
number_slider_21 = Slider(20, range=0..20)  # disabled
number_slider_22 = Slider(1.529, range=0..5)  # disabled
number_slider_23 = Slider(10000, range=0..10000)  # disabled
boolean_toggle_4 = BooleanToggle(True)  # disabled
boolean_toggle_5 = BooleanToggle(True)  # disabled
number_slider_24 = Slider(1, range=0..5)  # disabled
number_slider_25 = Slider(20, range=0..20)  # disabled
number_slider_26 = Slider(1.514, range=0..5)  # disabled
boolean_toggle_6 = BooleanToggle(True)  # disabled
edgelengths = EdgeLengths(Mesh=mesh_surface, LengthFactor=number_slider_8, Strength=number_slider_9)  # disabled
anchor = Anchor(Point=flatten(cull_duplicates.Points), Strength=10000)  # disabled
anchorxyz = AnchorXYZ(Point=flatten(cull_index), X=boolean_toggle_2, Y=boolean_toggle_2, Z=False, Strength=number_slider_7)  # disabled
vertexloads = VertexLoads(Mesh=mesh_surface, Strength=number_slider_10)  # disabled
show = Show(G=mesh_surface)  # disabled
edgelengths_2 = EdgeLengths(Mesh=mesh_surface_2, LengthFactor=number_slider_14, Strength=number_slider_13)  # disabled
anchor_2 = Anchor(Point=flatten(cull_duplicates_2.Points), Strength=10000)  # disabled
anchorxyz_2 = AnchorXYZ(Point=flatten(cull_index_2), X=boolean_toggle_3, Y=boolean_toggle_3, Z=False, Strength=number_slider_11)  # disabled
edgelengths_3 = EdgeLengths(Mesh=mesh_surface_3, LengthFactor=number_slider_17, Strength=number_slider_18)  # disabled
button = Button()  # disabled
vertexloads_2 = VertexLoads(Mesh=mesh_surface_2, Strength=number_slider_15)  # disabled
anchor_3 = Anchor(Point=flatten(cull_duplicates_3.Points), Strength=10000)  # disabled
anchorxyz_3 = AnchorXYZ(Point=flatten(cull_index_3), X=boolean_toggle_4, Y=boolean_toggle_4, Z=False, Strength=number_slider_12)  # disabled
edgelengths_4 = EdgeLengths(Mesh=mesh_surface_4, LengthFactor=number_slider_20, Strength=number_slider_21)  # disabled
anchor_4 = Anchor(Point=flatten(cull_duplicates_4.Points), Strength=10000)  # disabled
anchorxyz_4 = AnchorXYZ(Point=flatten(cull_index_4), X=boolean_toggle_5, Y=boolean_toggle_5, Z=False, Strength=number_slider_16)  # disabled
vertexloads_3 = VertexLoads(Mesh=mesh_surface_3, Strength=number_slider_19)  # disabled
show_2 = Show(G=mesh_surface_2)  # disabled
vertexloads_4 = VertexLoads(Mesh=mesh_surface_4, Strength=number_slider_22)  # disabled
edgelengths_5 = EdgeLengths(Mesh=mesh_surface_5, LengthFactor=number_slider_24, Strength=number_slider_25)  # disabled
anchor_5 = Anchor(Point=flatten(cull_duplicates_5.Points), Strength=10000)  # disabled
anchorxyz_5 = AnchorXYZ(Point=flatten(cull_index_5), X=boolean_toggle_6, Y=boolean_toggle_6, Z=False, Strength=number_slider_23)  # disabled
show_3 = Show(G=mesh_surface_3)  # disabled
vertexloads_5 = VertexLoads(Mesh=mesh_surface_5, Strength=number_slider_26)  # disabled
show_4 = Show(G=mesh_surface_4)  # disabled
show_5 = Show(G=mesh_surface_5)  # disabled
solver = Solver(
    GoalObjects=[show, vertexloads, edgelengths, anchorxyz, anchor],
    Reset=button,
    Threshold=1e-15,
    Tolerance=0.0001,
    On=boolean_toggle)  # -> I, V, O; disabled
button_2 = Button()  # disabled
button_3 = Button()  # disabled
button_4 = Button()  # disabled
button_5 = Button()  # disabled
solver_2 = Solver(
    GoalObjects=[show_2, vertexloads_2, edgelengths_2, anchorxyz_2, anchor_2],
    Reset=button_2,
    Threshold=1e-15,
    Tolerance=0.0001,
    On=boolean_toggle)  # -> I, V, O; disabled
solver_3 = Solver(
    GoalObjects=[show_3, vertexloads_3, edgelengths_3, anchorxyz_3, anchor_3],
    Reset=button_3,
    Threshold=1e-15,
    Tolerance=0.0001,
    On=boolean_toggle)  # -> I, V, O; disabled
solver_4 = Solver(
    GoalObjects=[show_4, vertexloads_4, edgelengths_4, anchorxyz_4, anchor_4],
    Reset=button_4,
    Threshold=1e-15,
    Tolerance=0.0001,
    On=boolean_toggle)  # -> I, V, O; disabled
solver_5 = Solver(
    GoalObjects=[show_5, vertexloads_5, edgelengths_5, anchorxyz_5, anchor_5],
    Reset=button_5,
    Threshold=1e-15,
    Tolerance=0.0001,
    On=boolean_toggle)  # -> I, V, O; disabled
data_dam = DataDam(DataDataA=solver.O, BufferDelay=10000000, BufferMode=0)  # disabled
data_dam_2 = DataDam(DataDataA=solver_2.O, BufferDelay=10000000, BufferMode=0)  # disabled
data_dam_3 = DataDam(DataDataA=solver_3.O, BufferDelay=10000000, BufferMode=0)  # disabled
data_dam_4 = DataDam(DataDataA=solver_4.O, BufferDelay=10000000, BufferMode=0)  # disabled
data_dam_5 = DataDam(DataDataA=solver_5.O, BufferDelay=10000000, BufferMode=0)  # disabled
list_item_3 = ListItem(List=flatten(data_dam), Index=0, Wrap=True)  # disabled
list_item_4 = ListItem(List=flatten(data_dam_2), Index=0, Wrap=True)  # disabled
list_item_5 = ListItem(List=flatten(data_dam_3), Index=0, Wrap=True)  # disabled
list_item_6 = ListItem(List=flatten(data_dam_4), Index=0, Wrap=True)  # disabled
list_item_7 = ListItem(List=flatten(data_dam_5), Index=0, Wrap=True)  # disabled
type_1_2 = Mesh(list_item_3)  # disabled
type_2_2 = Mesh(list_item_4)  # disabled
type_3_2 = Mesh(list_item_5)  # disabled
type_4_2 = Mesh(list_item_6)  # disabled
type_5_2 = Mesh(list_item_7)  # disabled
weaverbird_s_mesh_edges = WeaverbirdsMeshEdges(MeshOrPolylines=type_1_2)  # disabled
weaverbird_s_mesh_edges_2 = WeaverbirdsMeshEdges(MeshOrPolylines=type_2_2)  # disabled
weaverbird_s_mesh_edges_3 = WeaverbirdsMeshEdges(MeshOrPolylines=type_3_2)  # disabled
weaverbird_s_mesh_edges_4 = WeaverbirdsMeshEdges(MeshOrPolylines=type_4_2)  # disabled
weaverbird_s_mesh_edges_5 = WeaverbirdsMeshEdges(MeshOrPolylines=type_5_2)  # disabled

merge_4 = Merge(Data1=type_1_2, Data2=type_2_2, Data3=type_3_2, Data4=type_4_2, Data5=type_5_2)

bounding_box = BoundingBox(Content=stream_filter, Plane=PlaneXY(0, 0, 0))  # -> Box, Box_2
volume = Volume(Geometry=bounding_box.Box)  # -> Volume, Centroid
deconstruct = Deconstruct(Point=volume.Centroid)  # -> XComponent, YComponent, ZComponent
construct_point = ConstructPoint(XCoordinate=deconstruct.XComponent, YCoordinate=deconstruct.YComponent, ZCoordinate=0)

# ---- group: Type Label
list_length = ListLength(List=stream_filter)
series_2 = Series(Start=1, Step=1, Count=list_length)
concatenate = Concatenate(FragmentA="Type ", FragmentB=series_2)
unit_y_2 = UnitY(Factor=Slider(3, range=0..10))
move_6 = Move(Geometry=construct_point, Motion=unit_y_2)  # -> Geometry, Transform
text_tag_3d = TextTag3D(Location=move_6.Geometry, Text=concatenate, Size=Slider(0.5, range=0..1), Justification=5)

# ----
deconstruct_box = DeconstructBox(Box=bounding_box.Box)  # -> Plane, X, Y, Z
all_module_types = Geometry(stream_filter)
all_modules_plane = Plane(construct_point)
deconstruct_domain = DeconstructDomain(Domain=deconstruct_box.X)  # -> Start, End
deconstruct_domain_2 = DeconstructDomain(Domain=deconstruct_box.Y)  # -> Start, End
deconstruct_domain_3 = DeconstructDomain(Domain=deconstruct_box.Z)  # -> Start, End
subtraction_2 = Subtraction(A=deconstruct_domain.End, B=deconstruct_domain.Start)
subtraction_3 = Subtraction(A=deconstruct_domain_2.End, B=deconstruct_domain_2.Start)
subtraction_4 = Subtraction(A=deconstruct_domain_3.End, B=deconstruct_domain_3.Start)
panel_5 = Panel(subtraction_2)
panel_6 = Panel(subtraction_3)
panel_7 = Panel(subtraction_4)

# ---- group: LS 2
multiples_of_grid = Slider(5, range=0..50)
multiplication_3 = Multiplication(A=multiples_of_grid, B=offset_distance)
addition_4 = Addition(A=multiplication_3, B=ls_width)
unit_y_3 = UnitY(Factor=addition_4)
move_7 = Move(Geometry=mirror.Geometry, Motion=unit_y_3)  # -> Geometry, Transform

# ----
local_street_2 = Line(move_7.Geometry)

# ---- group: LS 2 (continued)
curve_curve_3 = CurveCurve(CurveA=middle_street, CurveB=local_street_2)  # -> Points, ParamsA, ParamsB
curve_curve_4 = CurveCurve(CurveA=local_street_2, CurveB=circle)  # -> Points, ParamsA, ParamsB
line_3 = Line(StartPoint=curve_curve_3.Points, EndPoint=curve_curve_4.Points)

# ---- group: Local Street 2 Generation
division_3 = Division(A=ls_width, B="2")
multiplication_4 = Multiplication(A=division_3, B="-1")
horizontal_frame_2 = HorizontalFrame(Curve=line_3, Parameter="0,0,0")
deconstruct_plane_2 = DeconstructPlane(Plane=horizontal_frame_2)  # -> Origin, XAxis, YAxis, ZAxis
offset_curve_4 = OffsetCurve(Curve=line_3, Distance=[division_3, multiplication_4], Plane=deconstruct_plane_2.YAxis, Corners=1)
series_3 = Series(Start=offset_distance, Step=offset_distance, Count=local_street_layers)
list_item_8 = ListItem(List=flatten(offset_curve_4), Index=0, Wrap=True)  # -> Item, Item1
multiplication_5 = Multiplication(A=series_3, B="-1")
loft_2 = Loft(
    Curves=flatten(offset_curve_4),
    Options={Adjust=False, Closed=False, LoftEnds=0, LoftSimp=0, LoftType=0, Rebuild=10, Refit=0.01})
offset_curve_5 = OffsetCurve(Curve=list_item_8.Item1, Distance=multiplication_5, Plane=deconstruct_plane_2.YAxis, Corners=1)  # -> flatten(Curve)
offset_curve_6 = OffsetCurve(Curve=list_item_8.Item, Distance=series_3, Plane=deconstruct_plane_2.YAxis, Corners=1)  # -> flatten(Curve)

# ---- group: LS 3
multiples_of_grid_2 = Slider(5, range=0..50)
multiplication_6 = Multiplication(A=multiples_of_grid_2, B=offset_distance)
addition_5 = Addition(A=multiplication_6, B=ls_width)
unit_y_4 = UnitY(Factor=expr("-x", addition_5))
move_8 = Move(Geometry=mirror.Geometry, Motion=unit_y_4)  # -> Geometry, Transform

# ----
local_street_3 = Line(move_8.Geometry)

# ---- group: LS 3 (continued)
curve_curve_5 = CurveCurve(CurveA=middle_street, CurveB=local_street_3)  # -> Points, ParamsA, ParamsB
curve_curve_6 = CurveCurve(CurveA=local_street_3, CurveB=circle)  # -> Points, ParamsA, ParamsB
line_4 = Line(StartPoint=curve_curve_5.Points, EndPoint=curve_curve_6.Points)

# ---- group: Local Street 3 Generation
division_4 = Division(A=ls_width, B="2")
multiplication_7 = Multiplication(A=division_4, B="-1")
horizontal_frame_3 = HorizontalFrame(Curve=line_4, Parameter="0,0,0")
deconstruct_plane_3 = DeconstructPlane(Plane=horizontal_frame_3)  # -> Origin, XAxis, YAxis, ZAxis
offset_curve_7 = OffsetCurve(Curve=line_4, Distance=[division_4, multiplication_7], Plane=deconstruct_plane_3.YAxis, Corners=1)
series_4 = Series(Start=offset_distance, Step=offset_distance, Count=local_street_layers)
list_item_9 = ListItem(List=flatten(offset_curve_7), Index=0, Wrap=True)  # -> Item, Item1
multiplication_8 = Multiplication(A=series_4, B="-1")
loft_3 = Loft(
    Curves=flatten(offset_curve_7),
    Options={Adjust=False, Closed=False, LoftEnds=0, LoftSimp=0, LoftType=0, Rebuild=10, Refit=0.01})
offset_curve_8 = OffsetCurve(Curve=list_item_9.Item1, Distance=multiplication_8, Plane=deconstruct_plane_3.YAxis, Corners=1)  # -> flatten(Curve)
offset_curve_9 = OffsetCurve(Curve=list_item_9.Item, Distance=series_4, Plane=deconstruct_plane_3.YAxis, Corners=1)  # -> flatten(Curve)

# ---- group: Streets
custom_preview_lineweights_2 = CustomPreviewLineweights(
    Geometry=[local_street_1, loft, loft_2, loft_3],
    Shader=ColourSwatch(SwatchColor=RGB(253, 255, 150)),
    Thickness=Slider(5, range=0..10),
    Absolute=False)

# ----
# 1. Street & Layers Offset
list_item_10 = ListItem(List=line_2, Index=0, Wrap=True)  # -> Item, Item1
join_curves = JoinCurves(Curves=[list_item_10.Item, list_item_10.Item1], Preserve=False)
line_5 = Line([list_item_2.Item, offset_curve_3])
line_6 = Line([list_item_2.Item1, offset_curve_2])
line_7 = Line([list_item_8.Item, offset_curve_6])
line_8 = Line([list_item_8.Item1, offset_curve_5])
line_9 = Line([list_item_9.Item, offset_curve_9])
line_10 = Line([list_item_9.Item1, offset_curve_8])

list_item_11 = ListItem(List=line_7, Index=-1, Wrap=True)
list_item_12 = ListItem(List=line_9, Index=-1, Wrap=True)
list_item_13 = ListItem(List=line_5, Index=-1, Wrap=True)
list_item_14 = ListItem(List=line_8, Index=-1, Wrap=True)
list_item_15 = ListItem(List=line_10, Index=-1, Wrap=True)
list_item_16 = ListItem(List=line_6, Index=-1, Wrap=True)
end_points = EndPoints(Curve=list_item_11)  # -> Start, End
end_points_2 = EndPoints(Curve=list_item_14)  # -> Start, End
end_points_3 = EndPoints(Curve=list_item_12)  # -> Start, End
end_points_4 = EndPoints(Curve=list_item_13)  # -> Start, End
end_points_5 = EndPoints(Curve=list_item_15)  # -> Start, End
end_points_6 = EndPoints(Curve=list_item_16)  # -> Start, End
interpolate = Interpolate(Vertices=[end_points.Start, end_points_2.Start, end_points_2.End, end_points.End], Degree=1, Periodic=True, KnotStyle=1)  # -> Curve, Length, Domain
interpolate_2 = Interpolate(
    Vertices=[end_points_3.Start, end_points_5.Start, end_points_5.End, end_points_3.End],
    Degree=1,
    Periodic=True,
    KnotStyle=1)  # -> Curve, Length, Domain
interpolate_3 = Interpolate(
    Vertices=[end_points_4.Start, end_points_6.Start, end_points_6.End, end_points_4.End],
    Degree=1,
    Periodic=True,
    KnotStyle=1)  # -> Curve, Length, Domain

# ----
# 4. Find Street Nodes: Local Street = 0, Medium Street = 1, External Nodes = ‘x’
local_street = Geometry([loft, loft_2, loft_3])
deconstruct_brep = DeconstructBrep(Brep=flatten(local_street))  # -> Faces, Edges, Vertices
join_curves_2 = JoinCurves(Curves=deconstruct_brep.Edges, Preserve=False)

# ----
# 6. Find Available Nodes for each street type
merge_5 = Merge(Data1=interpolate_3.Curve, Data2=interpolate.Curve, Data3=interpolate_2.Curve)

# ---- group: Medium Street Generation
division_5 = Division(A=ms_width, B="2")
multiplication_9 = Multiplication(A=division_5, B="-1")
horizontal_frame_4 = HorizontalFrame(Curve=join_curves, Parameter="0,0,0")
deconstruct_plane_4 = DeconstructPlane(Plane=horizontal_frame_4)  # -> Origin, XAxis, YAxis, ZAxis
offset_curve_10 = OffsetCurve(Curve=join_curves, Distance=[division_5, multiplication_9], Plane=deconstruct_plane_4.YAxis, Corners=1)  # -> simplify(Curve)
series_5 = Series(Start=offset_distance, Step=offset_distance, Count=middle_street_layers)
multiplication_10 = Multiplication(A=series_5, B="-1")
loft_4 = Loft(
    Curves=flatten(offset_curve_10),
    Options={Adjust=False, Closed=False, LoftEnds=0, LoftSimp=0, LoftType=0, Rebuild=10, Refit=0.01})

# ---- group: Streets
custom_preview_lineweights_3 = CustomPreviewLineweights(
    Geometry=[middle_street, loft_4],
    Shader=ColourSwatch(SwatchColor=RGB(150, 255, 220)),
    Thickness=Slider(5, range=0..10),
    Absolute=False)

# ----
medium_street = Geometry(loft_4)
deconstruct_brep_2 = DeconstructBrep(Brep=flatten(medium_street))  # -> Faces, Edges, Vertices
join_curves_3 = JoinCurves(Curves=deconstruct_brep_2.Edges, Preserve=False)

region_difference = RegionDifference(CurvesA=merge_5, MediumStreet=join_curves_3)
region_difference_2 = RegionDifference(CurvesA=region_difference, LocalStreet=flatten(join_curves_2))

addition_6 = Addition(A=round.Ceiling, B=external_layer)

# ---- group: Setting Grid Points
# i = x direction
# j = y-direction
panel_8 = Panel("""1,0,0
-1,0,0""")
panel_9 = Panel("""0,1,0
0,-1,0""")
planar_grid = PlanarGrid(
    BasePoint=center_point.Points,
    IDir=panel_8,
    JDir=graft(panel_9),
    IDistance=expr("x/2", offset_distance),
    JDistance=expr("x/2", offset_distance),
    INumber=expr("2*x", addition_6),
    JNumber=expr("2*x", addition_6))

# ----
tree_statistics = TreeStatistics(Tree=planar_grid)  # -> Paths, Length, Count
dispatch = Dispatch(List=tree_statistics.Paths, DispatchPattern=[True, False])  # -> ListA, ListB
tree_branch_5 = TreeBranch(Tree=planar_grid, Path=dispatch.ListB, MaintainPaths=True)
cull_nth = CullNth(List=tree_branch_5, CullFrequency=2)
cull_duplicates_6 = CullDuplicates(Points=flatten(cull_nth), Tolerance=0.1, CullMode=3)  # -> Points, Indices, Valence

list_item_17 = ListItem(List=flatten(offset_curve_10), Index=0, Wrap=True)  # -> Item, Item1
offset_curve_11 = OffsetCurve(Curve=graft(list_item_17.Item1), Distance=multiplication_10, Plane=deconstruct_plane_4.YAxis, Corners=1)  # -> flatten(Curve)
line_11 = Line([list_item_17.Item1, offset_curve_11])

# ---- group: Right Top
curve_curve_7 = CurveCurve(CurveA=line_11, CurveB=line_9)  # -> flatten(Points), flatten(ParamsA), flatten(ParamsB)
create_set = CreateSet(List=curve_curve_7.ParamsA)  # -> Set, Map
create_set_2 = CreateSet(List=curve_curve_7.ParamsB)  # -> Set, Map
construct_domain = ConstructDomain(DomainStart=create_set.Set, DomainEnd=1)
construct_domain_2 = ConstructDomain(DomainStart=create_set_2.Set, DomainEnd=1)
sub_curve = SubCurve(BaseCurve=line_11, Domain=construct_domain)  # -> graft(Curve)
sub_curve_2 = SubCurve(BaseCurve=line_9, Domain=construct_domain_2)  # -> graft(Curve)
join_curves_4 = JoinCurves(Curves=[sub_curve, sub_curve_2], Preserve=False)

curve_curve_8 = CurveCurve(CurveA=line_11, CurveB=line_8)  # -> flatten(Points), flatten(ParamsA), flatten(ParamsB)
create_set_3 = CreateSet(List=curve_curve_8.ParamsA)  # -> Set, Map
create_set_4 = CreateSet(List=curve_curve_8.ParamsB)  # -> Set, Map
construct_domain_3 = ConstructDomain(DomainStart=0, DomainEnd=create_set_3.Set)
construct_domain_4 = ConstructDomain(DomainStart=create_set_4.Set, DomainEnd=1)
sub_curve_3 = SubCurve(BaseCurve=line_11, Domain=construct_domain_3)  # -> graft(Curve)
sub_curve_4 = SubCurve(BaseCurve=line_8, Domain=construct_domain_4)  # -> graft(Curve)
join_curves_5 = JoinCurves(Curves=[sub_curve_3, sub_curve_4], Preserve=False)

# ---- group: Medium Street Generation (continued)
offset_curve_12 = OffsetCurve(Curve=list_item_17.Item, Distance=series_5, Plane=deconstruct_plane_4.YAxis, Corners=1)  # -> flatten(Curve)

# ----
line_12 = Line([list_item_17.Item, offset_curve_12])

# ---- group: Left Bottom
curve_curve_9 = CurveCurve(CurveA=line_12, CurveB=line_6)  # -> flatten(Points), flatten(ParamsA), flatten(ParamsB)
create_set_5 = CreateSet(List=curve_curve_9.ParamsA)  # -> Set, Map
create_set_6 = CreateSet(List=curve_curve_9.ParamsB)  # -> Set, Map
construct_domain_5 = ConstructDomain(DomainStart=create_set_5.Set, DomainEnd=1)
# 3. Nodes & Edges Generation
construct_domain_6 = ConstructDomain(DomainStart=create_set_6.Set, DomainEnd=1)
sub_curve_5 = SubCurve(BaseCurve=line_12, Domain=construct_domain_5)  # -> graft(Curve)
sub_curve_6 = SubCurve(BaseCurve=line_6, Domain=construct_domain_6)  # -> graft(Curve)
join_curves_6 = JoinCurves(Curves=[sub_curve_5, sub_curve_6], Preserve=False)

# ---- group: Left Top
# 2. Intersection Resolution
curve_curve_10 = CurveCurve(CurveA=line_12, CurveB=line_5)  # -> flatten(Points), flatten(ParamsA), flatten(ParamsB)
create_set_7 = CreateSet(List=curve_curve_10.ParamsA)  # -> Set, Map
create_set_8 = CreateSet(List=curve_curve_10.ParamsB)  # -> Set, Map
construct_domain_7 = ConstructDomain(DomainStart=0, DomainEnd=create_set_7.Set)
construct_domain_8 = ConstructDomain(DomainStart=create_set_8.Set, DomainEnd=1)
sub_curve_7 = SubCurve(BaseCurve=line_12, Domain=construct_domain_7)  # -> graft(Curve)
sub_curve_8 = SubCurve(BaseCurve=line_5, Domain=construct_domain_8)  # -> graft(Curve)
join_curves_7 = JoinCurves(Curves=[sub_curve_7, sub_curve_8], Preserve=False)

# ---- group: Middle Right
curve_curve_11 = CurveCurve(CurveA=line_10, CurveB=line_11)  # -> Points, flatten(ParamsA), flatten(ParamsB)
curve_curve_12 = CurveCurve(CurveA=line_7, CurveB=line_11)  # -> Points, flatten(ParamsA), flatten(ParamsB)
line_13 = Line(StartPoint=curve_curve_12.Points, EndPoint=curve_curve_11.Points)
line_sdl = LineSDL(Start=curve_curve_12.Points, Direction="1,0,0", Length=boundary_radius_m)
line_sdl_2 = LineSDL(Start=curve_curve_11.Points, Direction="1,0,0", Length=boundary_radius_m)
join_curves_8 = JoinCurves(Curves=[line_sdl, line_sdl_2, line_13], Preserve=False)  # -> flatten(Curves)

# ---- group: Final Street & Layers offset
medium_right = Line(graft([line_11, join_curves]))
right_bottom = Curve(join_curves_4)
right_middle = Curve(join_curves_8)
left_bottom = Curve(join_curves_6)
right_top = Curve(join_curves_5)
left_top = Curve(join_curves_7)

# ----
merge_6 = Merge(
    Data1=simplify(join_curves_7),
    Data2=simplify(join_curves_6),
    Data3=simplify(join_curves_5),
    Data4=simplify(join_curves_4),
    Data5=simplify(graft(join_curves_8)))
explode_tree = ExplodeTree(Data=merge_6)  # -> Branch0, Branch1, Branch2, Branch3, Branch4, Branch5
offset_curve_13 = OffsetCurve(Curve=explode_tree.Branch1, Distance=expr("x/2", offset_distance), Corners=1)  # -> flatten(Curve)
offset_curve_14 = OffsetCurve(Curve=explode_tree.Branch2, Distance=expr("x/2", offset_distance), Corners=1)  # -> flatten(Curve)
offset_curve_15 = OffsetCurve(Curve=explode_tree.Branch5, Distance=expr("x/2", offset_distance), Corners=1)  # -> flatten(Curve)
offset_curve_16 = OffsetCurve(Curve=explode_tree.Branch3, Distance=expr("x/2", offset_distance), Corners=1)  # -> flatten(Curve)
offset_curve_17 = OffsetCurve(Curve=explode_tree.Branch4, Distance=expr("x/2", offset_distance), Corners=1)  # -> flatten(Curve)

curve_closest_point = CurveClosestPoint(Point=flatten(cull_duplicates_6.Points), Curve=graft(left_bottom))  # -> Point, Parameter, Distance
curve_closest_point_2 = CurveClosestPoint(Point=flatten(cull_duplicates_6.Points), Curve=graft(left_top))  # -> Point, Parameter, Distance
curve_closest_point_3 = CurveClosestPoint(Point=flatten(cull_duplicates_6.Points), Curve=graft([right_top, right_bottom, right_middle, medium_right]))  # -> Point, Parameter, Distance
cull_duplicates_7 = CullDuplicates(Points=flatten(curve_closest_point.Point), Tolerance=0.1, CullMode=3)  # -> simplify(Points), Indices, Valence
cull_duplicates_8 = CullDuplicates(Points=flatten(curve_closest_point_3.Point), Tolerance=0.1, CullMode=3)  # -> simplify(Points), Indices, Valence
cull_duplicates_9 = CullDuplicates(Points=flatten(curve_closest_point_2.Point), Tolerance=0.1, CullMode=3)  # -> simplify(Points), Indices, Valence
merge_7 = Merge(
    Data1=flatten(cull_duplicates_8.Points),
    Data2=flatten(cull_duplicates_7.Points),
    Data3=flatten(cull_duplicates_9.Points))  # -> simplify(flatten(Result))
point_in_curve = PointInCurve(Point=merge_7, Curve=circle)  # -> Relationship, Point
equality = Equality(FirstNumber=2, SecondNumber=point_in_curve.Relationship)  # -> Equality, Inequality
cull_pattern = CullPattern(List=merge_7, CullPattern=equality.Equality)
proximity_2d = Proximity2D(Points=cull_pattern, Plane=PlaneXY(0, 0, 0), Group=5, MinRadius=subtraction, MaxRadius=addition_3)  # -> Links, simplify(Topology)
unit_y_5 = UnitY(Factor=expr("x/2", offset_distance))
unit_x_5 = UnitX(Factor=expr("x/2", offset_distance))
boundary_surfaces = BoundarySurfaces(Edges=flatten(proximity_2d.Links))
addition_7 = Addition(A=unit_x_5, B=unit_y_5)
move_9 = Move(Geometry=cull_pattern, Motion=addition_7)  # -> Geometry, Transform
deconstruct_brep_3 = DeconstructBrep(Brep=boundary_surfaces)  # -> Faces, Edges, Vertices

interpolate_4 = Interpolate(Vertices=deconstruct_brep_3.Vertices, Degree=1, Periodic=True, KnotStyle=0)  # -> flatten(Curve), Length, Domain

# ---- group: Cell Outline
cell_line = Line(simplify(proximity_2d.Links))
custom_preview_lineweights_4 = CustomPreviewLineweights(Geometry=cell_line, Shader=ColourSwatch(SwatchColor=RGB(254, 255, 255)), Absolute=False)

# ----
# 5. Create External X grid (a bug with offset not working nicely)
offset_curve_18 = OffsetCurve(Curve=interpolate_4.Curve, Distance=offset_distance, Corners=1)
curve_closest_point_4 = CurveClosestPoint(Point=cull_duplicates_6.Points, Curve=offset_curve_18)  # -> Point, Parameter, Distance
cull_duplicates_10 = CullDuplicates(Points=curve_closest_point_4.Point, Tolerance=0.1, CullMode=3)  # -> Points, Indices, Valence
merge_8 = Merge(Data1=cull_pattern, Data2=cull_duplicates_10.Points)  # -> flatten(Result)
proximity_2d_2 = Proximity2D(Points=flatten(merge_8), Plane=PlaneXY(0, 0, 0), Group=5, MinRadius=subtraction, MaxRadius=addition_3)  # -> Links, simplify(Topology)
boundary_surfaces_2 = BoundarySurfaces(Edges=flatten(proximity_2d_2.Links))
surface_split = SurfaceSplit(Surface=boundary_surfaces_2, Curves=interpolate_4.Curve)
list_item_18 = ListItem(List=surface_split, Index=0, Wrap=True)  # -> Item, Item1
surface_split_2 = SurfaceSplit(Surface=list_item_18.Item, Curves=flatten(proximity_2d_2.Links))
area = Area(Geometry=surface_split_2)  # -> Area, Centroid

boundary_curve = Curve(interpolate_4.Curve)
region_intersection = RegionIntersection(CurvesA=region_difference_2, CurvesB=boundary_curve)

point_in_curves = PointInCurves(Point=move_9.Geometry, Curves=interpolate_4.Curve)  # -> Relationship, Index, Point
cull_pattern_2 = CullPattern(List=move_9.Geometry, CullPattern=point_in_curves.Relationship)

# ---- group: Include External Nodes into Nodes List
merge_9 = Merge(Data1=cull_pattern_2, Data2=area.Centroid)  # -> flatten(Result)

# ----
distance = Distance(PointA=center_point.Points, PointB=merge_9)
sort_nodes_by_proximity = SortList(Keys=distance, ValuesValuesA=merge_9)  # -> Keys, ValuesValuesA

# ----
# Colour Visuals
number_slider_27 = Slider(18, range=0..100)
smaller_than = SmallerThan(FirstNumber=sort_nodes_by_proximity.Keys, SecondNumber=number_slider_27)  # -> SmallerThan, OrEqualTo

cull_pattern_3 = CullPattern(List=sort_nodes_by_proximity.ValuesValuesA, CullPattern=smaller_than.OrEqualTo)
circle_2 = Circle(Plane=PlaneXY(0, 0, 0), Radius=number_slider_27)

# ---- group: Outputs
nodes_points_level_1 = Point(sort_nodes_by_proximity.ValuesValuesA)
nodes_distance_from_intersection = Data(sort_nodes_by_proximity.Keys)

# ----
proximity_2d_3 = Proximity2D(Points=nodes_points_level_1, Plane=PlaneXY(0, 0, 0), Group=5, MinRadius=subtraction, MaxRadius=addition_3)  # -> simplify(Links), simplify(Topology)
tree_statistics_2 = TreeStatistics(Tree=proximity_2d_3.Links)  # -> Paths, Length, Count
tree_statistics_3 = TreeStatistics(Tree=proximity_2d_3.Topology)  # -> Paths, Length, Count
sort_links_by_proximity = SortList(Keys=distance, ValuesValuesA=tree_statistics_2.Paths)  # -> Keys, ValuesValuesA
sort_topology_by_proximity = SortList(Keys=distance, ValuesValuesA=tree_statistics_3.Paths)  # -> Keys, ValuesValuesA
tree_branch_6 = TreeBranch(Tree=proximity_2d_3.Links, Path=sort_links_by_proximity.ValuesValuesA, MaintainPaths=True)
tree_branch_7 = TreeBranch(Tree=proximity_2d_3.Topology, Path=sort_topology_by_proximity.ValuesValuesA, MaintainPaths=True)
create_set_9 = CreateSet(List=nodes_points_level_1)  # -> Set, Map

deconstruct_2 = Deconstruct(Point=nodes_points_level_1)  # -> XComponent, YComponent, ZComponent
construct_point_2 = ConstructPoint(XCoordinate=deconstruct_2.XComponent, YCoordinate=deconstruct_2.YComponent, ZCoordinate=offset_height)
list_length_2 = ListLength(List=construct_point_2)
proximity_2d_4 = Proximity2D(Points=construct_point_2, Plane=PlaneXY(0, 0, 0), Group=5, MinRadius=subtraction, MaxRadius=addition_3)  # -> simplify(Links), simplify(Topology)

addition_8 = Addition(A=proximity_2d_4.Topology, B=list_length_2)
nodes_points_level_2 = Point(construct_point_2)
# Main Dependency in script
# is topology re-branching
# number to change
path_mapper = PathMapper(addition_8, source="{A;B}", target="{path_index +580}")
curve_closest_point_5 = CurveClosestPoint(Point=nodes_points_level_1, Curve=simplify(graft(offset_curve_13)))  # -> Point, Parameter, Distance
curve_closest_point_6 = CurveClosestPoint(Point=nodes_points_level_1, Curve=simplify(graft(offset_curve_14)))  # -> Point, Parameter, Distance
curve_closest_point_7 = CurveClosestPoint(Point=nodes_points_level_1, Curve=simplify(graft(offset_curve_16)))  # -> Point, Parameter, Distance
curve_closest_point_8 = CurveClosestPoint(Point=nodes_points_level_1, Curve=simplify(graft(offset_curve_17)))  # -> Point, Parameter, Distance
curve_closest_point_9 = CurveClosestPoint(Point=nodes_points_level_1, Curve=simplify(graft(offset_curve_15)))  # -> Point, Parameter, Distance
panel_10 = Panel(proximity_2d_4.Topology)
merge_10 = Merge(Data1=nodes_points_level_1, Data2=nodes_points_level_2)
cull_duplicates_11 = CullDuplicates(Points=curve_closest_point_5.Point, Tolerance=0.1, CullMode=3)  # -> flatten(Points), Indices, Valence
cull_duplicates_12 = CullDuplicates(Points=curve_closest_point_6.Point, Tolerance=0.1, CullMode=3)  # -> flatten(Points), Indices, Valence
cull_duplicates_13 = CullDuplicates(Points=curve_closest_point_7.Point, Tolerance=0.1, CullMode=3)  # -> flatten(Points), Indices, Valence
cull_duplicates_14 = CullDuplicates(Points=curve_closest_point_8.Point, Tolerance=0.1, CullMode=3)  # -> flatten(Points), Indices, Valence
cull_duplicates_15 = CullDuplicates(Points=curve_closest_point_9.Point, Tolerance=0.1, CullMode=3)  # -> flatten(Points), Indices, Valence
sorted_links_level_2 = Line(proximity_2d_4.Links)
member_index = MemberIndex(Set=nodes_points_level_1, Member=cull_duplicates_12.Points)  # -> flatten(Index), Count
member_index_2 = MemberIndex(Set=nodes_points_level_1, Member=cull_duplicates_13.Points)  # -> flatten(Index), Count
member_index_3 = MemberIndex(Set=nodes_points_level_1, Member=cull_duplicates_14.Points)  # -> flatten(Index), Count
member_index_4 = MemberIndex(Set=nodes_points_level_1, Member=cull_duplicates_11.Points)  # -> flatten(Index), Count
member_index_5 = MemberIndex(Set=nodes_points_level_1, Member=cull_duplicates_15.Points)  # -> flatten(Index), Count
remove_overlap_pts = GhPythonScript(list_a=member_index_2.Index, list_b=member_index_3.Index)  # -> out, new_list_b; inputs list_a: list of Int32, list_b: list of Int32
# ---------- remove_overlap_pts: Python ----------
__author__ = "junwenloo"

import rhinoscriptsyntax as rs

for i in list_a:
    if i in list_b:
        list_b.remove(i)
        print(i)

new_list_b = list_b
# ---------- end remove_overlap_pts ----------
remove_overlap_pts_2 = GhPythonScript(list_a=member_index_2.Index, list_b=member_index_5.Index)  # -> out, new_list_b; inputs list_a: list of Int32, list_b: list of Int32; same code as remove_overlap_pts
entwine = Entwine(
    Branch00=member_index_4.Index,
    Branch01=member_index.Index,
    Branch02=member_index_2.Index,
    Branch03=remove_overlap_pts.new_list_b,
    Branch04=remove_overlap_pts_2.new_list_b,
    FlattenInputs=True)  # -> simplify(Result)
layer_nodes_index = Data(entwine)
panel_11 = Panel(entwine)
param_viewer = ParamViewer(entwine)

# ---- group: All Edges (Level 2)
all_edges = Line(simplify(proximity_2d_4.Links))
custom_preview_lineweights_5 = CustomPreviewLineweights(
    Geometry=all_edges,
    Shader=ColourSwatch(SwatchColor=RGB(255, 242, 184)),
    Thickness=Slider(5, range=0..10),
    Absolute=False)

# ---- group: Node Labelling
point_list = PointList(AllNodes=flatten(nodes_points_level_1), Size=Slider(0.9, range=0..10))

point_list_2 = PointList(AllNodes=flatten(merge_10), Size=Slider(0.9, range=0..10))

# ---- group: All Edges (Level 1)
all_edges_2 = Line(simplify(proximity_2d_3.Links))
custom_preview_lineweights_6 = CustomPreviewLineweights(
    Geometry=all_edges_2,
    Shader=ColourSwatch(SwatchColor=RGB(255, 229, 112)),
    Thickness=Slider(5, range=0..10),
    Absolute=False)

# ----
point_in_curves_2 = PointInCurves(Point=nodes_points_level_1, Curves=flatten(join_curves_3))  # -> Relationship, Index, Point
point_in_curves_3 = PointInCurves(Point=nodes_points_level_1, Curves=flatten(join_curves_2))  # -> Relationship, Index, Point
cull_pattern_4 = CullPattern(List=nodes_points_level_1, CullPattern=point_in_curves_2.Relationship)
cull_pattern_5 = CullPattern(List=nodes_points_level_1, CullPattern=point_in_curves_3.Relationship)
item_index = ItemIndex(List=nodes_points_level_1, Item=cull_pattern_4)
item_index_2 = ItemIndex(List=nodes_points_level_1, Item=cull_pattern_5)

point_in_curves_4 = PointInCurves(Point=nodes_points_level_1, Curves=region_intersection)  # -> Relationship, Index, Point
cull_pattern_6 = CullPattern(List=point_in_curves_4.Point, CullPattern=point_in_curves_4.Relationship)
item_index_3 = ItemIndex(List=point_in_curves_4.Point, Item=cull_pattern_6)  # -> flatten(Index)
local_street_available_node_index = Data(item_index_3)

item_index_4 = ItemIndex(List=nodes_points_level_1, Item=area.Centroid)
sort_list = SortList(Keys=item_index_4, ValuesValuesA=area.Centroid)  # -> Keys, ValuesValuesA

# ---- group: Outputs (continued)
index_of_medium_street_nodes = Data(item_index)
index_of_local_street_nodes = Data(item_index_2)
external_nodes_index = Data(flatten(sort_list.Keys))
sorted_links_level_1 = Line(tree_branch_6)
sorted_topology_level_1 = Data(tree_branch_7)
node_index = Data(create_set_9.Map)
nodes_all = Point(merge_10)

# ----
cull_index_6 = CullIndex(
    List=node_index,
    Indices=flatten([external_nodes_index, index_of_local_street_nodes, index_of_medium_street_nodes, local_street_available_node_index]),
    Wrap=True)  # -> simplify(List)
medium_street_available_node_index = Data(cull_index_6)

list_item_19 = ListItem(List=nodes_points_level_1, Index=external_nodes_index, Wrap=True)

list_item_20 = ListItem(List=nodes_points_level_1, Index=index_of_medium_street_nodes, Wrap=True)
list_item_21 = ListItem(List=nodes_points_level_1, Index=index_of_local_street_nodes, Wrap=True)

addition_9 = Addition(A=node_index, B=list_length_2)
merge_11 = Merge(Data1=sorted_topology_level_1, Data2=path_mapper)

# ---- group: Outputs (continued)
node_index_with_2nd_level = Data(addition_9)
medium_street_nodes = Point(list_item_20)
local_street_nodes = Point(list_item_21)
nodes_index_all = Integer([node_index, node_index_with_2nd_level])
external_nodes = Point(list_item_19)

# ----
sorted_topology_all = Data(merge_11)

# ----
# Explanation of outputs:
# Each item in this list represents the
# distance of each node from the intersection
# Each item in this list represents a node
# as a point in 3d space (thus having coordinates)
# Each branch number represents 1 node,
# and the items in each branch are the edges
# as “lines” that each node is connected to
# Each branch number represents 1 node,
# and the items in each branch are the other
# nodes it connects to
# Each item represents the index of 1 node
#  that lies on the street
# Each item represents 1 node that lies on the
# Medium street
# Each item represents 1 node that lies on the
# Local street
# Each item represents the index of the
# External Node outside the available nodes for placement
# Each item represents the Point3D of the
# External Node
# Each item represents the index of available
# nodes along a Local Street
# Each item represents the index of available
# nodes along a Medium Street
ls_avail_node_index = Panel(local_street_available_node_index)
ms_avail_node_index = Panel(medium_street_available_node_index)
nodes_dist_from_intersection = Panel(nodes_distance_from_intersection)
nodes = Panel(nodes_points_level_1)
edges_lines = Panel(sorted_links_level_1)
edges_connection = Panel(sorted_topology_level_1)
index_of_nodes_on_street = Panel(index_of_medium_street_nodes)
medium_street_nodes_2 = Panel(medium_street_nodes)
local_street_nodes_2 = Panel(local_street_nodes)
external_nodes_2 = Panel(external_nodes)
external_nodes_index_2 = Panel(external_nodes_index)

# ----
# Conversion to JSON file
panel_12 = Panel("/Users/junwenloo/OneDrive/2020 ONWARDS/06_Delft/15_Y2Q1/01_Earthy/03_Scripts/GH/nodes.txt")
panel_13 = Panel("/Users/junwenloo/OneDrive/2020 ONWARDS/06_Delft/15_Y2Q1/01_Earthy/03_Scripts/GH/edges.txt")
tpological_extraction_export = GhPythonScript(
    nodes_index=nodes_index_all,
    ms_nodes_index=index_of_medium_street_nodes,
    ls_nodes_index=index_of_local_street_nodes,
    x_nodes_index=external_nodes_index,
    ls_avail_nodes_index=local_street_available_node_index,
    ms_avail_nodes_index=medium_street_available_node_index,
    layer_nodes_index=layer_nodes_index,
    point_count=list_length_2,
    edge_list=sorted_topology_level_1,
    fpath_nodes=panel_12,
    fpath_edges=panel_13,
    run=Toggle(False))  # -> out; inputs nodes_index: list of Int32, ms_nodes_index: list of Int32, ls_nodes_index: list of Int32, x_nodes_index: list of Int32, ls_avail_nodes_index: list of Int32, ms_avail_nodes_index: list of Int32, layer_nodes_index: tree of Int32, point_count: Int32, edge_list: tree of Int32, run: Boolean
# ---------- tpological_extraction_export: Python ----------
"""Provides a scripting component.
    Inputs:
        nodes_index: List of points, flattened
        ms_nodes_list: Index of Medium Street Nodes
        ls_nodes_index: Index of Local Street Nodes
        x_nodes_index: Index of External Nodes
        ls_avail_nodes_index: Index of Local Street available nodes
        ms_avail_nodes_index: Index of Medium Street available nodes
        edge_list: Tree of Edges with each branch representing a node
        layer_nodes_index: Tree with each branch representing a "step" from the street, and items in branch as index of nodes on that "step"
        point_count: Int of number of points in 1 level of the site
        fpath_nodes: Filepath for Nodes file
        fpath_edges: Filepath for Edges file
        run: False = No writing to file, True = Write
"""

__author__ = "junwenloo"

import rhinoscriptsyntax as rs
from ghpythonlib import treehelpers as th
import json

nodes = {}

"""
    Node Attributes graph creation, filled only with 'tag' and 'use_frequency' data
Key as nodes and values of each nodes as a dictionary of attributes:
"name" - Node index
"type" - None
"use_frequency - "D" (Local Street, Daily), "M" (Medium Street, Monthly) [[Future work - "O" (Main Street, Occasional)]]
"units" - None 
"tag" - None (available node), 0 (Local Street), 1 (Medium Street), 2 (Main Street), 3 (Staircase), 4 (2nd Level Street), "x" (External Node)
"layer" - 1,2,3,4,5 etc - Represents the number of steps from the street
"""

layer_nodes_index = th.tree_to_list(layer_nodes_index, None)

for i in nodes_index:
    
    half = int((len(nodes_index))/2)
    
    if i < half:
        #level 1 nodes

        n_attr_dict = {}
        n_attr_dict["name"] = i
        n_attr_dict['district'] = 7
        n_attr_dict['type'] = None
        n_attr_dict['units'] = None

        if i in ms_nodes_index:
            #medium street attributes
            n_attr_dict['use_frequency'] = "M"
            n_attr_dict['tag'] = 1
            
        elif i in ls_nodes_index:
            #local street attributes
            n_attr_dict['use_frequency'] = "D"
            n_attr_dict['tag'] = 0
        
        elif i in x_nodes_index:
            #external nodes attributes
            n_attr_dict['use_frequency'] = None
            n_attr_dict['tag'] = "x"

        elif i in ls_avail_nodes_index:
            #local street available nodes
            n_attr_dict['use_frequency'] = "D"
            if i == 82 or i ==85 or i == 82+point_count or i ==85+point_count:
                n_attr_dict['tag'] = 3
            else:
                n_attr_dict['tag'] = None
                
        elif i in ms_avail_nodes_index:
            #medium street available nodes
            n_attr_dict['use_frequency'] = "M"
            if i == 83 or i == 84 or i == 83+point_count or i == 84+point_count:
                n_attr_dict['tag'] = 3
            else:
                n_attr_dict['tag'] = None
                    
        nodes[int(i)] = n_attr_dict
    
    else:
        #level 2 nodes
        
        n_attr_dict = {}
        n_attr_dict["name"] = i
        n_attr_dict['district'] = 7
        n_attr_dict['type'] = None
        n_attr_dict['units'] = None
            
        if i-point_count in ms_nodes_index:
            #medium street attributes
            n_attr_dict['use_frequency'] = "M"
            n_attr_dict['tag'] = 1
            
        elif i-point_count in ls_nodes_index:
            #local street attributes
            n_attr_dict['use_frequency'] = "D"
            n_attr_dict['tag'] = 0
        
        elif i-point_count in x_nodes_index:
            #external nodes attributes
            n_attr_dict['use_frequency'] = None
            n_attr_dict['tag'] = "x"

        elif i-point_count in ls_avail_nodes_index:
            #local street available nodes
            n_attr_dict['use_frequency'] = "D"
            n_attr_dict['tag'] = None
        
        elif i-point_count in ms_avail_nodes_index:
            #medium street available nodes
            n_attr_dict['use_frequency'] = "M"
            n_attr_dict['tag'] = None
        
        
        nodes[int(i)] = n_attr_dict


#adding layer information


for index, step in enumerate(layer_nodes_index):
    for node in step:
            #for level 1 nodes
            nodes[node]["layer"] = int(index + 1)
            #for 2nd level nodes
            nodes[node + point_count]["layer"] = int(index + 1)

"""
    Create Edge list as tuples of (Start_node, ened_node) to build graph in Networkx
"""

edge_list = th.tree_to_list(edge_list, None)

edges = []

for start_node in range(len(edge_list)):
    for end_node in edge_list[start_node]:
        
        edges.append((start_node, end_node))
        edges.append((start_node + point_count, end_node + point_count))

"""
Writing JSON file of nodes.txt and edges.txt
"""

if run:

    with open(str(fpath_nodes), 'w') as outfile:
        json.dump(nodes, outfile)

    with open(str(fpath_edges), 'w') as outfile:
        json.dump(edges, outfile)
# ---------- end tpological_extraction_export ----------

# ---- group: Layer Label
list_item_22 = ListItem(List=nodes_all, Index=member_index_4.Index, Wrap=True)
list_item_23 = ListItem(List=nodes_all, Index=member_index.Index, Wrap=True)
list_item_24 = ListItem(List=nodes_all, Index=member_index_2.Index, Wrap=True)
list_item_25 = ListItem(List=nodes_all, Index=remove_overlap_pts.new_list_b, Wrap=True)
list_item_26 = ListItem(List=nodes_all, Index=remove_overlap_pts_2.new_list_b, Wrap=True)
entwine_2 = Entwine(
    Branch00=list_item_22,
    Branch01=list_item_23,
    Branch02=list_item_24,
    Branch03=list_item_25,
    Branch04=list_item_26,
    FlattenInputs=True)
subtraction_5 = Subtraction(A=layer, B="1")
tree_branch_8 = TreeBranch(Tree=simplify(entwine_2), Path=subtraction_5, MaintainPaths=True)
custom_preview = CustomPreview(Geometry=tree_branch_8, Material=ColourSwatch(SwatchColor=RGB(245, 93, 93)))

# ---- group: Selected Node
tree_statistics_4 = TreeStatistics(Tree=sorted_topology_level_1)  # -> Paths, Length, Count
list_item_27 = ListItem(List=tree_statistics_4.Paths, Index=node_check, Wrap=True)
tree_branch_9 = TreeBranch(Tree=sorted_links_level_1, Path=list_item_27, MaintainPaths=True)
custom_preview_lineweights_7 = CustomPreviewLineweights(
    SelectedEdgesOfNode=tree_branch_9,
    Shader=ColourSwatch(SwatchColor=RGB(255, 125, 125)),
    Thickness=Slider(7, range=0..10),
    Absolute=False)

# ----
ghpython_script = GhPythonScript(edges=sorted_topology_all, file=file_path)  # -> out, connection, flatten(module), all_edge, node_list; inputs edges: tree
# ---------- ghpython_script: Python ----------
"""Provides a scripting component.
    Inputs:
        edges: Tree with Branch No. as nodes and items in branch as nodes it connects to
        file: Filepath to updated Nodes json file
    Output:
        connection: Types of connections (0 = Open, 1 =. Close)
        module: Module type required for each node
        all_edge: Tree with Branch no. = Index of node in node_list, and items in branch as nodes it connects to
        node_list: Nodes involved in allocation on site"""

__author__ = "junwenloo"

import rhinoscriptsyntax as rs
from ghpythonlib import treehelpers as th
import json

#reading exported JSON file
"""with open(str(file)) as json_file:
    nodes = json.load(json_file)
    nodes = {int(k):v for k, v in nodes.items()}"""

#"connection" : 0 = open, 1 = close
nodes = {
    8: {"name":8,"type":"S","use_frequency":"D", "units":3,"tag":"chris","floor":False,"connection":[0, 0, 0, 1],"module":23}, 
    21: {"name":21,"type":"S","use_frequency":"D", "units":3,"tag":"chris","floor":False,"connection":[1, 0, 0, 0],"module":20}, 
    37: {"name":37,"type":"S","use_frequency":"D", "units":3,"tag":"chris","floor":False,"connection":[2, 0, 0, 1],"module":31},
    9: {"name":9,"type":"S","use_frequency":"D", "units":3,"tag":"chris","floor":False,"connection":[2, 0, 0, 1],"module":31},
    25: {"name":25,"type":"S","use_frequency":"D", "units":3,"tag":"chris","floor":False,"connection":[0, 0, 2, 1],"module":51},
    68: {"name":68,"type":"S","use_frequency":"D", "units":3,"tag":"chris","floor":False,"connection":[0, 0, 2, 1],"module":51},
    30: {"name":30,"type":"S","use_frequency":"D", "units":3,"tag":"chris","floor":False,"connection":[1, 0, 0, 1],"module":50},
    47: {"name":47,"type":"S","use_frequency":"D", "units":3,"tag":"chris","floor":False,"connection":[2, 2, 1, 0],"module":46},
    43: {"name":43,"type":"S","use_frequency":"D", "units":3,"tag":"chris","floor":False,"connection":[2, 0, 0, 1],"module":35},
    20: {"name":20,"type":"S","use_frequency":"D", "units":3,"tag":"chris","floor":False,"connection":[0, 1, 1, 0],"module":30},
    36: {"name":36,"type":"S","use_frequency":"D", "units":3,"tag":"chris","floor":False,"connection":[0, 1, 2, 1],"module":45},
    57: {"name":57,"type":"S","use_frequency":"D", "units":3,"tag":"chris","floor":False,"connection":[0, 1, 2, 1],"module":41},
    69: {"name":69,"type":"S","use_frequency":"D", "units":3,"tag":"chris","floor":False,"connection":[1, 1, 1, 0],"module":40},
    496: {"name":496,"type":"S","use_frequency":"D", "units":1,"tag":"chris","floor":False,"connection":[0, 1, 1, 1],"module":40},
    448: {"name":448,"type":"S","use_frequency":"D", "units":3,"tag":"chris","floor":False,"connection":[0, 0, 1, 1],"module":50},
    484: {"name":484,"type":"S","use_frequency":"D", "units":3,"tag":"chris","floor":False,"connection":[0, 1, 1, 1],"module":47},
    11: {"name":11,"type":"S","use_frequency":"D", "units":3,"tag":"chris","floor":False,"connection":[0, 0, 0, 0],"module":10},
    200: {"name":11,"type":"S","use_frequency":"D", "units":3,"tag":"chris","floor":False,"connection":[0, 0, 0, 0],"module":10},
    261: {"name":11,"type":"S","use_frequency":"D", "units":3,"tag":"chris","floor":False,"connection":[0, 0, 0, 0],"module":10},
    588: {"name":588,"type":"S","use_frequency":"D", "units":3,"tag":"chris","floor":False,"connection":[0, 0, 0, 1],"module":21},
    262: {"name":262,"type":"S","use_frequency":"D", "units":3,"tag":"chris","floor":False,"connection":[0, 0, 0, 0],"module":10}
}
"""
if run:
    fpath_nodes = "/Users/junwenloo/OneDrive/2020 ONWARDS/06_Delft/15_Y2Q1/01_Earthy/03_Scripts/GH/erendata.txt"

    with open(str(fpath_nodes), 'w') as outfile:
        json.dump(nodes, outfile)
"""

edges_list = th.tree_to_list(edges, None)

print(nodes)

node_list = []
for keys in nodes:
    node_list.append(keys)

all_edge_list = []
connection_list = []
module_list = []

for node in nodes:
    all_edge = edges_list[node]
    connection = nodes[node]["connection"]
    module = [nodes[node]["module"]]
    all_edge_list.append(all_edge)
    connection_list.append(connection)
    module_list.append(module)

print(module_list)
all_edge = th.list_to_tree(all_edge_list)
connection = th.list_to_tree(connection_list)
module = th.list_to_tree(module_list)
# ---------- end ghpython_script ----------
connection_of_edges = Panel(ghpython_script.connection)
node = Panel(ghpython_script.node_list)
node_to_edge_sequence = Panel(ghpython_script.all_edge)
types_of_modules = Panel(ghpython_script.module)
sorty_module_to_logic = GhPythonScript(module=ghpython_script.module)  # -> out, index_list, module_index; inputs module: list of Int32
# ---------- sorty_module_to_logic: Python ----------
"""Provides a scripting component.
    Inputs:
        module: Module Number combinations, ordered in sequence of nodes
    Output:
        index_list: List of index to apply to specific logic, each branch represent 1 logic
        module_index: Contains the index of the module types"""

__author__ = "junwenloo"

import rhinoscriptsyntax as rs
from ghpythonlib import treehelpers as th

#definition takes in a logic_list, the type of module to evaluate and the current index of the node and sorts it to the logic it
#belongs to and to a nested index_list to be distributed to the 8 different logics required to orient the modules
def append_index_type(logic_list, type, current_node):
    for n, logic in enumerate(logic_list):
        if type in logic:
            print(type)
            print("type index is", type_sequence.index(type))
            module_index.append(type_sequence.index(type))
            index_list[n].append(current_node)

module_index = []

#Each Logic represents a method of orientation, which applies to specific module types only
logic_1 = [10,11]
logic_2 = [20, 21, 22, 23]
logic_31 = [30, 32, 33, 35]
logic_32 = [31, 34]
logic_41 = [40, 43, 44, 47]
logic_42 = [42, 46]
logic_43 = [41, 45]
logic_51 = [50, 52]
logic_52 = [51]

logic_list = [logic_1, logic_2, logic_31, logic_32,
                logic_41, logic_42, logic_43, logic_51, logic_52]

#sequence of types: Index position corresponds to its index in GH Merge component of all types, smallest to largest 
type_sequence = [10, 11, 20, 21, 22, 23, 30, 31, 32, 33, 34, 35, 40, 41, 42, 
                43, 44, 45, 46, 47, 50, 51, 52]
                

#initiating the list of nodes which will require specifc orientation logic
logic_1_index = []
logic_2_index = []
logic_31_index = []
logic_32_index = []
logic_41_index = []
logic_42_index = []
logic_43_index = []
logic_51_index = []
logic_52_index = []

index_list = [logic_1_index, logic_2_index, logic_31_index, logic_32_index,
                logic_41_index, logic_42_index, logic_43_index, logic_51_index,
                logic_52_index]

#adding each nodes to the logic they apply to
for num, type in enumerate(module):
    append_index_type(logic_list, type, num)

index_list = [logic_1_index, logic_2_index, logic_31_index, logic_32_index,
                logic_41_index, logic_42_index, logic_43_index, logic_51_index,
                logic_52_index]

for i in index_list:
    if len(i) == 0:
        i.append("Null")

index_list = th.list_to_tree(index_list, None)
# ---------- end sorty_module_to_logic ----------
param_viewer_2 = ParamViewer(sorty_module_to_logic.index_list)
panel_14 = Panel(sorty_module_to_logic.module_index)

# ----
# {0} = Logic 1
# {1} = Logic 2
# {2} = Logic 3.1
# {3} = Logic 3.2
# {4} = Logic 4.1
# {5} = Logic 4.2
# {6} =  Logic 4.3
# {7} = Logic 5.1
# {8} = Logic 5.2
explode_tree_2 = ExplodeTree(Data=simplify(sorty_module_to_logic.index_list))  # -> Branch0, Branch1, Branch2, Branch3, Branch4, Branch5, Branch6, Branch7, Branch8

# ---- group: Logic 1
list_item_28 = ListItem(List=ghpython_script.node_list, Index=explode_tree_2.Branch0, Wrap=True)
list_item_29 = ListItem(List=nodes_all, Index=list_item_28, Wrap=True)
construct_plane = ConstructPlane(Origin=list_item_29, XAxis=Vector(1, 0, 0), YAxis=Vector(0, 1, 0))

# ---- group: Logic 4.1
tree_branch_10 = TreeBranch(Tree=simplify(ghpython_script.connection), Path=explode_tree_2.Branch4, MaintainPaths=True)
tree_branch_11 = TreeBranch(Tree=simplify(ghpython_script.all_edge), Path=explode_tree_2.Branch4, MaintainPaths=True)
list_item_30 = ListItem(List=ghpython_script.node_list, Index=explode_tree_2.Branch4, Wrap=True)
panel_15 = Panel(tree_branch_10)
panel_16 = Panel(tree_branch_11)
cull_pattern_7 = CullPattern(List=tree_branch_11, CullPattern=invert(tree_branch_10))
base_node = ListItem(List=nodes_all, Index=list_item_30, Wrap=True)
_2_neighbouring_points = ListItem(List=nodes_all, Index=cull_pattern_7, Wrap=True)  # -> flatten(Item)
x_axis_derivation = XAxisDerivation(plane=base_node, geometry=_2_neighbouring_points)
vector_2pt_2 = Vector2Pt(PointA=base_node, PointB=_2_neighbouring_points, Unitize=True)  # -> Vector, Length
construct_plane_2 = ConstructPlane(Origin=graft(base_node), XAxis=graft(x_axis_derivation), YAxis=graft(vector_2pt_2.Vector))  # -> flatten(Plane)

# ----
keep_plane_in_positive_z = KeepPlaneInPositiveZ(plane=construct_plane, offset_height=offset_height)
keep_plane_in_positive_z_2 = KeepPlaneInPositiveZ(plane=construct_plane_2, offset_height=offset_height)
replace_items = ReplaceItems(List=ghpython_script.node_list, Item=keep_plane_in_positive_z, Indices=explode_tree_2.Branch0, Wrap=False)
panel_17 = Panel(replace_items)

# ---- group: Logic 4.2
tree_branch_12 = TreeBranch(Tree=simplify(ghpython_script.connection), Path=explode_tree_2.Branch5, MaintainPaths=True)
tree_branch_13 = TreeBranch(Tree=simplify(ghpython_script.all_edge), Path=explode_tree_2.Branch5, MaintainPaths=True)
list_item_31 = ListItem(List=ghpython_script.node_list, Index=explode_tree_2.Branch5, Wrap=True)
panel_18 = Panel(tree_branch_12)
panel_19 = Panel(tree_branch_13)
equality_2 = Equality(FirstNumber=tree_branch_12, SecondNumber="1")  # -> Equality, Inequality
base_node_2 = ListItem(List=nodes_all, Index=list_item_31, Wrap=True)

# ---- group: Logic 4.2 / Get "0" node
cull_pattern_8 = CullPattern(List=tree_branch_13, CullPattern=invert(tree_branch_12))

# ---- group: Logic 4.2 / Get "1" node
cull_pattern_9 = CullPattern(List=tree_branch_13, CullPattern=equality_2.Equality)

# ---- group: Logic 4.2 (continued)
_2_neighbouring_points_2 = ListItem(List=nodes_all, Index=cull_pattern_8, Wrap=True)  # -> flatten(Item)
vector_2pt_3 = Vector2Pt(PointA=base_node_2, PointB=_2_neighbouring_points_2, Unitize=True)  # -> Vector, Length
_2_neighbouring_points_3 = ListItem(List=nodes_all, Index=cull_pattern_9, Wrap=True)  # -> flatten(Item)
vector_2pt_4 = Vector2Pt(PointA=base_node_2, PointB=_2_neighbouring_points_3, Unitize=True)  # -> Vector, Length
construct_plane_3 = ConstructPlane(Origin=graft(base_node_2), XAxis=graft(vector_2pt_4.Vector), YAxis=graft(vector_2pt_3.Vector))  # -> flatten(Plane)

# ----
keep_plane_in_positive_z_3 = KeepPlaneInPositiveZ(plane=construct_plane_3, offset_height=offset_height)

# ---- group: Logic 4.3
tree_branch_14 = TreeBranch(Tree=simplify(ghpython_script.connection), Path=explode_tree_2.Branch6, MaintainPaths=True)
tree_branch_15 = TreeBranch(Tree=simplify(ghpython_script.all_edge), Path=explode_tree_2.Branch6, MaintainPaths=True)
list_item_32 = ListItem(List=ghpython_script.node_list, Index=explode_tree_2.Branch6, Wrap=True)
panel_20 = Panel(tree_branch_14)
panel_21 = Panel(tree_branch_15)
equality_3 = Equality(FirstNumber=tree_branch_14, SecondNumber="2")  # -> Equality, Inequality
base_node_3 = ListItem(List=nodes_all, Index=list_item_32, Wrap=True)

# ---- group: Logic 4.3 / Get "0" node
cull_pattern_10 = CullPattern(List=tree_branch_15, CullPattern=invert(tree_branch_14))

# ---- group: Logic 4.3 / Get "2" node
cull_pattern_11 = CullPattern(List=tree_branch_15, CullPattern=equality_3.Equality)

# ---- group: Logic 4.3 (continued)
_2_neighbouring_points_4 = ListItem(List=nodes_all, Index=cull_pattern_10, Wrap=True)  # -> flatten(Item)
vector_2pt_5 = Vector2Pt(PointA=base_node_3, PointB=_2_neighbouring_points_4, Unitize=True)  # -> Vector, Length
_2_neighbouring_points_5 = ListItem(List=nodes_all, Index=cull_pattern_11, Wrap=True)  # -> flatten(Item)
vector_2pt_6 = Vector2Pt(PointA=base_node_3, PointB=_2_neighbouring_points_5, Unitize=True)  # -> Vector, Length
construct_plane_4 = ConstructPlane(Origin=graft(base_node_3), XAxis=graft(vector_2pt_6.Vector), YAxis=graft(vector_2pt_5.Vector))  # -> flatten(Plane)

# ----
keep_plane_in_positive_z_4 = KeepPlaneInPositiveZ(plane=construct_plane_4, offset_height=offset_height)

# ---- group: Logic 2
tree_branch_16 = TreeBranch(Tree=simplify(ghpython_script.connection), Path=explode_tree_2.Branch1, MaintainPaths=True)
tree_branch_17 = TreeBranch(Tree=simplify(ghpython_script.all_edge), Path=explode_tree_2.Branch1, MaintainPaths=True)
panel_22 = Panel(tree_branch_16)
panel_23 = Panel(tree_branch_17)
list_item_33 = ListItem(List=ghpython_script.node_list, Index=explode_tree_2.Branch1, Wrap=True)  # -> graft(Item)
base_node_4 = ListItem(List=nodes_all, Index=list_item_33, Wrap=True)

# ---- group: Logic 2 / To get "1" facing nodes
cull_pattern_12 = CullPattern(List=tree_branch_17, CullPattern=tree_branch_16)

# ---- group: Logic 2 (continued)
list_item_34 = ListItem(List=cull_pattern_12, Index=0, Wrap=True)
_1_neighbouring_point = ListItem(List=nodes_all, Index=list_item_34, Wrap=True)
rotate_2 = Rotate(Geometry=_1_neighbouring_point, Angle=degrees("90"), Plane=base_node_4)  # -> Geometry, Transform
vector_2pt_7 = Vector2Pt(PointA=graft(base_node_4), PointB=_1_neighbouring_point, Unitize=True)  # -> Vector, Length
vector_2pt_8 = Vector2Pt(PointA=rotate_2.Geometry, PointB=base_node_4, Unitize=True)  # -> Vector, Length
construct_plane_5 = ConstructPlane(Origin=base_node_4, XAxis=vector_2pt_8.Vector, YAxis=vector_2pt_7.Vector)  # -> flatten(Plane)

# ----
keep_plane_in_positive_z_5 = KeepPlaneInPositiveZ(plane=construct_plane_5, offset_height=offset_height)
replace_items_2 = ReplaceItems(List=replace_items, Item=flatten(keep_plane_in_positive_z_5), Indices=explode_tree_2.Branch1, Wrap=False)
panel_24 = Panel(replace_items_2)

# ---- group: Logic 3.1
tree_branch_18 = TreeBranch(Tree=simplify(ghpython_script.connection), Path=explode_tree_2.Branch2, MaintainPaths=True)
tree_branch_19 = TreeBranch(Tree=simplify(ghpython_script.all_edge), Path=explode_tree_2.Branch2, MaintainPaths=True)
list_item_35 = ListItem(List=ghpython_script.node_list, Index=explode_tree_2.Branch2, Wrap=True)
panel_25 = Panel(tree_branch_18)
panel_26 = Panel(tree_branch_19)
base_node_5 = ListItem(List=nodes_all, Index=list_item_35, Wrap=True)

# ---- group: Logic 3.1 / To get "1" facing nodes
cull_pattern_13 = CullPattern(List=tree_branch_19, CullPattern=tree_branch_18)

# ---- group: Logic 3.1 (continued)
list_item_36 = ListItem(List=cull_pattern_13, Index=0, Wrap=True)
_2_neighbouring_points_6 = ListItem(List=nodes_all, Index=list_item_36, Wrap=True)
vector_2pt_9 = Vector2Pt(PointA=graft(base_node_5), PointB=_2_neighbouring_points_6, Unitize=True)  # -> Vector, Length
list_item_37 = ListItem(List=flatten(vector_2pt_9.Vector), Index=0, Wrap=True)  # -> Item, Item1
construct_plane_6 = ConstructPlane(Origin=graft(base_node_5), XAxis=list_item_37.Item, YAxis=list_item_37.Item1)  # -> flatten(Plane)

# ----
keep_plane_in_positive_z_6 = KeepPlaneInPositiveZ(plane=construct_plane_6, offset_height=offset_height)
replace_items_3 = ReplaceItems(List=replace_items_2, Item=keep_plane_in_positive_z_6, Indices=explode_tree_2.Branch2, Wrap=False)
panel_27 = Panel(replace_items_3)

# ---- group: Logic 3.2
tree_branch_20 = TreeBranch(Tree=simplify(ghpython_script.connection), Path=explode_tree_2.Branch3, MaintainPaths=True)
tree_branch_21 = TreeBranch(Tree=simplify(ghpython_script.all_edge), Path=explode_tree_2.Branch3, MaintainPaths=True)
list_item_38 = ListItem(List=ghpython_script.node_list, Index=explode_tree_2.Branch3, Wrap=True)
panel_28 = Panel(tree_branch_20)
panel_29 = Panel(tree_branch_21)
equality_4 = Equality(FirstNumber=tree_branch_20, SecondNumber="1")  # -> Equality, Inequality
equality_5 = Equality(FirstNumber=tree_branch_20, SecondNumber="2")  # -> Equality, Inequality
base_node_6 = ListItem(List=nodes_all, Index=list_item_38, Wrap=True)  # -> graft(Item)

# ---- group: Logic 3.2 / To get "2" facing node
cull_pattern_14 = CullPattern(List=tree_branch_21, CullPattern=equality_5.Equality)

# ---- group: Logic 3.2 / To get "1" facing nodes
cull_pattern_15 = CullPattern(List=tree_branch_21, CullPattern=equality_4.Equality)

# ---- group: Logic 3.2 (continued)
_2_neighbouring_points_7 = ListItem(List=nodes_all, Index=[cull_pattern_15, cull_pattern_14], Wrap=True)
vector_2pt_10 = Vector2Pt(PointA=simplify(base_node_6), PointB=simplify(_2_neighbouring_points_7), Unitize=True)  # -> Vector, Length
list_item_39 = ListItem(List=vector_2pt_10.Vector, Index=0, Wrap=True)  # -> Item, Item1
_2_neighbouring_points_8 = ListItem(List=nodes_all, Index=cull_pattern_15, Wrap=True)
construct_plane_7 = ConstructPlane(Origin=graft(base_node_6), XAxis=list_item_39.Item, YAxis=list_item_39.Item1)  # -> flatten(Plane)

# ----
keep_plane_in_positive_z_7 = KeepPlaneInPositiveZ(plane=construct_plane_7, offset_height=offset_height)
replace_items_4 = ReplaceItems(List=replace_items_3, Item=keep_plane_in_positive_z_7, Indices=explode_tree_2.Branch3, Wrap=False)
replace_items_5 = ReplaceItems(List=replace_items_4, Item=flatten(keep_plane_in_positive_z_2), Indices=explode_tree_2.Branch4, Wrap=False)
replace_items_6 = ReplaceItems(List=replace_items_5, Item=flatten(keep_plane_in_positive_z_3), Indices=explode_tree_2.Branch5, Wrap=False)
replace_items_7 = ReplaceItems(List=replace_items_6, Item=flatten(keep_plane_in_positive_z_4), Indices=explode_tree_2.Branch6, Wrap=False)
panel_30 = Panel(replace_items_4)
panel_31 = Panel(replace_items_6)
panel_32 = Panel(replace_items_5)
panel_33 = Panel(replace_items_7)

# ---- group: Logic 5.1
tree_branch_22 = TreeBranch(Tree=simplify(ghpython_script.connection), Path=explode_tree_2.Branch7, MaintainPaths=True)
tree_branch_23 = TreeBranch(Tree=simplify(ghpython_script.all_edge), Path=explode_tree_2.Branch7, MaintainPaths=True)
panel_34 = Panel(tree_branch_23)
panel_35 = Panel(tree_branch_22)
list_item_40 = ListItem(List=ghpython_script.node_list, Index=explode_tree_2.Branch7, Wrap=True)  # -> graft(Item)
base_node_7 = ListItem(List=nodes_all, Index=list_item_40, Wrap=True)

# ---- group: Logic 5.1 / To get "1" facing nodes
cull_pattern_16 = CullPattern(List=tree_branch_23, CullPattern=tree_branch_22)

# ---- group: Logic 5.1 (continued)
list_item_41 = ListItem(List=cull_pattern_16, Index=0, Wrap=True)
_1_neighbouring_point_2 = ListItem(List=nodes_all, Index=list_item_41, Wrap=True)
rotate_3 = Rotate(Geometry=_1_neighbouring_point_2, Angle=degrees("90"), Plane=base_node_7)  # -> Geometry, Transform
vector_2pt_11 = Vector2Pt(PointA=graft(base_node_7), PointB=_1_neighbouring_point_2, Unitize=True)  # -> Vector, Length
vector_2pt_12 = Vector2Pt(PointA=rotate_3.Geometry, PointB=base_node_7, Unitize=True)  # -> Vector, Length
construct_plane_8 = ConstructPlane(Origin=base_node_7, XAxis=vector_2pt_12.Vector, YAxis=vector_2pt_11.Vector)  # -> flatten(Plane)

# ----
keep_plane_in_positive_z_8 = KeepPlaneInPositiveZ(plane=construct_plane_8, offset_height=offset_height)
replace_items_8 = ReplaceItems(List=replace_items_7, Item=flatten(keep_plane_in_positive_z_8), Indices=explode_tree_2.Branch7, Wrap=False)  # -> flatten(List)
panel_36 = Panel(replace_items_8)

# ---- group: Logic 5.2
tree_branch_24 = TreeBranch(Tree=simplify(ghpython_script.connection), Path=explode_tree_2.Branch8, MaintainPaths=True)
tree_branch_25 = TreeBranch(Tree=simplify(ghpython_script.all_edge), Path=explode_tree_2.Branch8, MaintainPaths=True)
equality_6 = Equality(FirstNumber=tree_branch_24, SecondNumber="0")  # -> Equality, Inequality
panel_37 = Panel(tree_branch_24)
panel_38 = Panel(tree_branch_25)
list_item_42 = ListItem(List=ghpython_script.node_list, Index=explode_tree_2.Branch8, Wrap=True)  # -> graft(Item)
cull_pattern_17 = CullPattern(List=tree_branch_25, CullPattern=equality_6.Equality)
base_node_8 = ListItem(List=nodes_all, Index=list_item_42, Wrap=True)
list_item_43 = ListItem(List=cull_pattern_17, Index=0, Wrap=True)
_1_neighbouring_point_3 = ListItem(List=nodes_all, Index=list_item_43, Wrap=True)
vector_2pt_13 = Vector2Pt(PointA=base_node_8, PointB=_1_neighbouring_point_3, Unitize=True)  # -> Vector, Length

# ---- group: Logic 5.2 / To get "1" facing nodes
cull_pattern_18 = CullPattern(List=tree_branch_25, CullPattern=tree_branch_24)

# ---- group: Logic 5.2 (continued)
list_item_44 = ListItem(List=cull_pattern_18, Index=0, Wrap=True)
_1_neighbouring_point_4 = ListItem(List=nodes_all, Index=list_item_44, Wrap=True)
vector_2pt_14 = Vector2Pt(PointA=graft(base_node_8), PointB=_1_neighbouring_point_4, Unitize=True)  # -> Vector, Length
construct_plane_9 = ConstructPlane(Origin=base_node_8, XAxis=vector_2pt_13.Vector, YAxis=vector_2pt_14.Vector)  # -> flatten(Plane)

# ----
keep_plane_in_positive_z_9 = KeepPlaneInPositiveZ(plane=construct_plane_9, offset_height=offset_height)
replace_items_9 = ReplaceItems(List=replace_items_8, Item=flatten(keep_plane_in_positive_z_9), Indices=explode_tree_2.Branch8, Wrap=False)  # -> flatten(List)
panel_39 = Panel(replace_items_9)

# ---- group: Final Orientation Sequence
list_item_45 = ListItem(List=all_module_types, Index=sorty_module_to_logic.module_index, Wrap=True)
list_item_46 = ListItem(List=all_modules_plane, Index=sorty_module_to_logic.module_index, Wrap=True)
orient = Orient(Geometry=list_item_45, Source=list_item_46, Target=replace_items_9)  # -> Geometry, Transform

# ----
weaverbird_s_mesh_edges_6 = WeaverbirdsMeshEdges(MeshOrPolylines=orient.Geometry)  # disabled

# ==== cluster XAxisDerivation
geometry = ClusterInput()
plane = ClusterInput()
rotate = Rotate(Geometry=geometry, Angle=expr("-x", degrees("90")), Plane=plane)  # -> Geometry, Transform
vector_2pt = Vector2Pt(PointA=plane, PointB=rotate.Geometry, Unitize=False)  # -> Vector, Length
vector = ClusterOutput(vector_2pt.Vector)

# ==== cluster KeepPlaneInPositiveZ
plane = ClusterInput()
deconstruct_plane = DeconstructPlane(Plane=plane)  # -> Origin, XAxis, YAxis, ZAxis
deconstruct = Deconstruct(Point=deconstruct_plane.ZAxis)  # -> XComponent, YComponent, ZComponent
offset_height = ClusterInput()
unit_z = UnitZ(Factor=offset_height)
equality = Equality(FirstNumber=deconstruct.ZComponent, SecondNumber="-1")  # -> Equality, Inequality
cull_pattern = CullPattern(List=plane, CullPattern=equality.Equality)
move = Move(Geometry=cull_pattern, Motion=unit_z)  # -> Geometry, Transform
member_index = MemberIndex(Set=equality.Equality, Member=Toggle(True))  # -> Index, Count
replace_items = ReplaceItems(List=plane, Item=move.Geometry, Indices=member_index.Index, Wrap=False)
list = ClusterOutput(replace_items)
