# Grasshopper definition 2021_11_02_Brick_Abstraction_Domi_Validation.gh (Grasshopper 1.0.7)
# plug-ins: Human, karambaGH

# BRICKS ABSTRACTION DOMI VALIDATION
# Authors: Felipe Lopez Taverne
# A. Shell case
number_slider = Slider(0, range=0..1)

# ---- group: Materials
# Liberate relaxed mesh to Bricks  Shape Generation
panel = Panel("Composite")
division = Division(A="4.4", B=Slider(2.9, range=0..10))
matprops = MaterialPropertiesKaramba3D(
    FamilyOfMaterial=panel,
    Name="Mud Brick",
    YoungsModulus_kN_cm2="4.4",
    InPlaneShearModulus_kN_cm2=division,
    TransverseShearModulus_kN_cm2=division,
    SpecificWeight_kN_m3="14.71",
    CoefficientOfThermalExpansion_1_C=1e-05,
    YieldStrength_kN_cm2=23.5,
    mode="Isotrop")
matselect = MaterialSelectionKaramba3D(Materials=matprops, menu=[dropdown(1), dropdown(1)])

# ---- group: Type I / Initial Bricks
brep = Brep([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])

# ---- group: Type II / Moving Bricks
vec = VectorXYZ(XComponent="2", YComponent=0, ZComponent=0)  # -> Vector, Length
move = Move(Geometry=brep, Motion=vec.Vector)  # -> Geometry, Transform

# ---- group: Type III / Moving Bricks
vec_2 = VectorXYZ(XComponent="4", YComponent=0, ZComponent=0)  # -> Vector, Length
move_2 = Move(Geometry=brep, Motion=vec_2.Vector)  # -> Geometry, Transform

# ---- group: Type IV / Placing Bricks
vec_3 = VectorXYZ(XComponent="6", YComponent=0, ZComponent=0)  # -> Vector, Length
move_3 = Move(Geometry=brep, Motion=vec_3.Vector)  # -> Geometry, Transform
debrep = DeconstructBrep(Brep=move_3.Geometry)  # -> Faces, Edges, Vertices

# ---- group: From Surface to shell
# A. Shell case
number_slider_2 = Slider(10, range=0..10)
srf = Surface(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)
mesh_uv = MeshSurface(Surface=srf, UCount=number_slider_2, VCount=number_slider_2, Overhang=True, Equalize=False)
cross_section = CrossSectionKaramba3D(FamilyNameOfCrossSection="DefaultCroSec", Material=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, Height_cm="10", mode="Shell - Const")
meshtoshell = MeshToShellKaramba3D(Mesh=mesh_uv, CrossSection=cross_section, LimitDistance_m=0.005)  # -> Element, Points, Info

# ---- group: Type IV / Lines to Beams
data = Data(debrep.Edges)
item = ListItem(List=data, Index="3", Wrap=True)
item_2 = ListItem(List=data, Index="5", Wrap=True)
item_3 = ListItem(List=data, Index="8", Wrap=True)
item_4 = ListItem(List=data, Index="1", Wrap=True)
end = EndPoints(Curve=item)  # -> Start, End
end_2 = EndPoints(Curve=item_2)  # -> Start, End
end_3 = EndPoints(Curve=item_3)  # -> Start, End
end_4 = EndPoints(Curve=item_4)  # -> Start, End
ln = Line(StartPoint=end.Start, EndPoint=end_2.End)
ln_2 = Line(StartPoint=end.End, EndPoint=end_2.Start)
ln_3 = Line(StartPoint=end.Start, EndPoint=end_2.Start)
ln_4 = Line(StartPoint=end_3.Start, EndPoint=end_4.End)
ln_5 = Line(StartPoint=end_3.End, EndPoint=end_4.Start)
ln_6 = Line(StartPoint=end.End, EndPoint=end_2.End)
ln_7 = Line(StartPoint=end_3.Start, EndPoint=end_4.Start)
midpt = CurveMiddle(Curve=ln_7)
ln_8 = Line(StartPoint=end_3.End, EndPoint=end_4.End)
midpt_2 = CurveMiddle(Curve=ln_8)
ln_9 = Line(StartPoint=midpt_2, EndPoint=midpt)
line = Line([item, item_2, item_3, item_4, ln_3, ln, ln_5, ln_6, ln_7, ln_2, ln_8, ln_4, ln_9])
llinter = LineLineIntersectionKaramba3D(Line=line, LimitDistance_m=0.005)  # -> IntersectionPoints, LineSubSegements
line_2 = Line(llinter.LineSubSegements)
null = NullItem(Item=flatten(line_2))  # -> NullFlags, InvalidFlags, Description
dispatch = Dispatch(List=flatten(line_2), DispatchPattern=null.NullFlags)  # -> ListA, ListB
rdlines = RemoveDuplicateLinesKaramba3D(Line=dispatch.ListB, LimitDistance=0.005)  # -> OutLine, Info, Indexes

# ---- group: Type III / Creating lines to elements
debrep_2 = DeconstructBrep(Brep=move_2.Geometry)  # -> Faces, Edges, Vertices
item_5 = ListItem(List=debrep_2.Faces, Index="4", Wrap=True)
item_6 = ListItem(List=debrep_2.Faces, Index="5", Wrap=True)
debrep_3 = DeconstructBrep(Brep=item_5)  # -> Faces, Edges, Vertices
area = Area(Geometry=item_6)  # -> Area, Centroid
panel_2 = Panel("""0
1
2
3""")
pt = Point(debrep_3.Vertices)
item_7 = ListItem(List=pt, Index=panel_2, Wrap=True)
ln_10 = Line(StartPoint=item_7, EndPoint=area.Centroid)
line_3 = Line([debrep_3.Edges, ln_10])
null_2 = NullItem(Item=flatten(line_3))  # -> NullFlags, InvalidFlags, Description
dispatch_2 = Dispatch(List=flatten(line_3), DispatchPattern=null_2.NullFlags)  # -> ListA, ListB
rdlines_2 = RemoveDuplicateLinesKaramba3D(Line=dispatch_2.ListB, LimitDistance=0.005)  # -> OutLine, Info, Indexes

# ---- group: Type III / Cross Section
volume = Volume(Geometry=move_2.Geometry)  # -> Volume, Centroid
null_3 = NullItem(Item=flatten(volume.Volume))  # -> NullFlags, InvalidFlags, Description
dispatch_3 = Dispatch(List=flatten(volume.Volume), DispatchPattern=null_3.NullFlags)  # -> ListA, ListB
len = Length(Curve=rdlines_2.OutLine)
ma = MassAddition(Input=flatten(len))  # -> Result, PartialResults
ma_2 = MassAddition(Input=flatten(dispatch_3.ListB))  # -> Result, PartialResults
total_lenngth = Panel(ma.Result)
panel_3 = Panel(ma_2.Result)
division_2 = Division(A=panel_3, B=total_lenngth)
expression = Expression(x=division_2, Expression="Sqrt(x/π)*200")
panel_4 = Panel("CS Beam level 1")
division_3 = Division(A=expression, B="2")
cross_section_2 = CrossSectionKaramba3D(
    FamilyNameOfCrossSection="DefaultCroSec",
    ElementIdentifier=panel_4,
    Material=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,
    Diameter_cm=expression,
    WallThickness_cm=division_3,
    mode="Circular Hollow")

# ---- group: Type IV / Determing Cross Section
volume_2 = Volume(Geometry=move_3.Geometry)  # -> Volume, Centroid
null_4 = NullItem(Item=flatten(volume_2.Volume))  # -> NullFlags, InvalidFlags, Description
dispatch_4 = Dispatch(List=flatten(volume_2.Volume), DispatchPattern=null_4.NullFlags)  # -> ListA, ListB
len_2 = Length(Curve=rdlines.OutLine)
ma_3 = MassAddition(Input=flatten(dispatch_4.ListB))  # -> Result, PartialResults
ma_4 = MassAddition(Input=flatten(len_2))  # -> Result, PartialResults
total_lenngth_2 = Panel(ma_4.Result)
panel_5 = Panel(ma_3.Result)
division_4 = Division(A=panel_5, B=total_lenngth_2)
expression_2 = Expression(x=division_4, Expression="Sqrt(x/π)*200")
panel_6 = Panel("CS Beam level 1")
division_5 = Division(A=expression_2, B="2")
cross_section_3 = CrossSectionKaramba3D(
    FamilyNameOfCrossSection="DefaultCroSec",
    ElementIdentifier=panel_6,
    Material=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,
    Diameter_cm=expression_2,
    WallThickness_cm=division_5,
    mode="Circular Hollow")

# ---- group: Type I / Creating lines
debrep_4 = DeconstructBrep(Brep=brep)  # -> Faces, Edges, Vertices
item_8 = ListItem(List=debrep_4.Faces, Index="4", Wrap=True)
item_9 = ListItem(List=debrep_4.Faces, Index="5", Wrap=True)
debrep_5 = DeconstructBrep(Brep=item_8)  # -> Faces, Edges, Vertices
area_2 = Area(Geometry=item_9)  # -> Area, Centroid
panel_7 = Panel("""0
1
2
3""")
pt_2 = Point(debrep_5.Vertices)
item_10 = ListItem(List=pt_2, Index=panel_7, Wrap=True)
ln_11 = Line(StartPoint=item_10, EndPoint=area_2.Centroid)
line_4 = Line(ln_11)
null_5 = NullItem(Item=flatten(line_4))  # -> NullFlags, InvalidFlags, Description
dispatch_5 = Dispatch(List=flatten(line_4), DispatchPattern=null_5.NullFlags)  # -> ListA, ListB
rdlines_3 = RemoveDuplicateLinesKaramba3D(Line=dispatch_5.ListB, LimitDistance=0.005)  # -> OutLine, Info, Indexes

# ---- group: Type I / Determing Cross Section
volume_3 = Volume(Geometry=brep)  # -> Volume, Centroid
null_6 = NullItem(Item=flatten(volume_3.Volume))  # -> NullFlags, InvalidFlags, Description
dispatch_6 = Dispatch(List=flatten(volume_3.Volume), DispatchPattern=null_6.NullFlags)  # -> ListA, ListB
len_3 = Length(Curve=rdlines_3.OutLine)
ma_5 = MassAddition(Input=flatten(len_3))  # -> Result, PartialResults
ma_6 = MassAddition(Input=flatten(dispatch_6.ListB))  # -> Result, PartialResults
panel_8 = Panel(ma_6.Result)
total_lenngth_3 = Panel(ma_5.Result)
division_6 = Division(A=panel_8, B=total_lenngth_3)
expression_3 = Expression(x=division_6, Expression="Sqrt(x/π)*200")
panel_9 = Panel("CS Beam level 1")
division_7 = Division(A=expression_3, B="2")
cross_section_4 = CrossSectionKaramba3D(
    FamilyNameOfCrossSection="DefaultCroSec",
    ElementIdentifier=panel_9,
    Material=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,
    Diameter_cm=expression_3,
    WallThickness_cm=division_7,
    mode="Circular Hollow")

# ---- group: Type II / Creating lines
debrep_6 = DeconstructBrep(Brep=move.Geometry)  # -> Faces, Edges, Vertices
item_11 = ListItem(List=debrep_6.Faces, Index="4", Wrap=True)
item_12 = ListItem(List=debrep_6.Faces, Index="5", Wrap=True)
debrep_7 = DeconstructBrep(Brep=item_12)  # -> Faces, Edges, Vertices
debrep_8 = DeconstructBrep(Brep=item_11)  # -> Faces, Edges, Vertices
area_3 = Area(Geometry=item_12)  # -> Area, Centroid
panel_10 = Panel("""0
1
2
3""")
pt_3 = Point(debrep_8.Vertices)
panel_11 = Panel("""1
2
3
4""")
item_13 = ListItem(List=debrep_7.Edges, Index=panel_11, Wrap=True)
item_14 = ListItem(List=pt_3, Index=panel_10, Wrap=True)
midpt_3 = CurveMiddle(Curve=item_13)
ln_12 = Line(StartPoint=item_14, EndPoint=area_3.Centroid)
ln_13 = Line(StartPoint=midpt_3, EndPoint=area_3.Centroid)
line_5 = Line([ln_12, ln_13])
null_7 = NullItem(Item=flatten(line_5))  # -> NullFlags, InvalidFlags, Description
dispatch_7 = Dispatch(List=flatten(line_5), DispatchPattern=null_7.NullFlags)  # -> ListA, ListB
rdlines_4 = RemoveDuplicateLinesKaramba3D(Line=dispatch_7.ListB, LimitDistance=0.005)  # -> OutLine, Info, Indexes

# ---- group: Type II / Cross Section
volume_4 = Volume(Geometry=move.Geometry)  # -> Volume, Centroid
null_8 = NullItem(Item=flatten(volume_4.Volume))  # -> NullFlags, InvalidFlags, Description
dispatch_8 = Dispatch(List=flatten(volume_4.Volume), DispatchPattern=null_8.NullFlags)  # -> ListA, ListB
len_4 = Length(Curve=rdlines_4.OutLine)
ma_7 = MassAddition(Input=flatten(dispatch_8.ListB))  # -> Result, PartialResults
ma_8 = MassAddition(Input=flatten(len_4))  # -> Result, PartialResults
total_lenngth_4 = Panel(ma_8.Result)
panel_12 = Panel(ma_7.Result)
division_8 = Division(A=panel_12, B=total_lenngth_4)
expression_4 = Expression(x=division_8, Expression="Sqrt(x/π)*200")
panel_13 = Panel("CS Beam level 1")
division_9 = Division(A=expression_4, B="2")
cross_section_5 = CrossSectionKaramba3D(
    FamilyNameOfCrossSection="DefaultCroSec",
    ElementIdentifier=panel_13,
    Material=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,
    Diameter_cm=expression_4,
    WallThickness_cm=division_9,
    mode="Circular Hollow")

# ---- group: Loads Cases / Puntual Forces
Z = UnitZ(Factor=1)
pt_4 = Point([Point(-1.153543908, 3.420121002, 0.4), Point(-1.153543908, 3.820121002, 0.4)])
pt_5 = Point(Point(-1.153543908, 3.620121002, 0.4))
amp = Amplitude(Vector=Z, Amplitude="-100")  # -> flatten(Vector)
loads = LoadsKaramba3D(ForceVector=flatten(amp), Local=False, PosInd=flatten([pt_5, pt_4]), LCase="1", mode="Point")

# ---- group: Loads Cases
Z_2 = UnitZ(Factor="-1")
loads_2 = LoadsKaramba3D(Vector=Z_2, LCase="0", mode="Gravity")

# ---- group: Anchor Points
pt_6 = Point([Point(-1.553543908, 3.820121002, 0), Point(-1.553543908, 3.420121002, 0), Point(-0.7535439078, 3.420121002, 0), Point(-0.7535439078, 3.820121002, 0)])
supp = SupportKaramba3D(PosInd=flatten(pt_6), menu=[buttons(on, on, on, off, off, off)])

# ---- group: Type III / Creating points to nodes
end_5 = EndPoints(Curve=rdlines_2.OutLine)  # -> Start, End
rdpoints = RemoveDuplicatePointsKaramba3D(Point=[end_5.Start, end_5.End], LimitDistance="0.005")  # -> OutPoint, Info, Indexes

# ---- group: Type IV / Point to nodes
end_6 = EndPoints(Curve=rdlines.OutLine)  # -> Start, End
rdpoints_2 = RemoveDuplicatePointsKaramba3D(Point=[end_6.Start, end_6.End], LimitDistance="0.005")  # -> OutPoint, Info, Indexes

# ---- group: Type I / Point to node
end_7 = EndPoints(Curve=rdlines_3.OutLine)  # -> Start, End
rdpoints_3 = RemoveDuplicatePointsKaramba3D(Point=[end_7.Start, end_7.End], LimitDistance="0.005")  # -> OutPoint, Info, Indexes

# ---- group: Type II / Points to nodes
end_8 = EndPoints(Curve=rdlines_4.OutLine)  # -> Start, End
rdpoints_4 = RemoveDuplicatePointsKaramba3D(Point=[end_8.Start, end_8.End], LimitDistance="0.005")  # -> OutPoint, Info, Indexes

# ---- group: Model Assambly
assemble = AssembleModelKaramba3D(Elem=flatten(meshtoshell.Element), Support=supp, Load=[loads_2, loads], Material=matselect, LimitDistance_m=0.005)  # -> Model, Info, Mass_kg, CenterOfGravity

# ---- group: Analysis and results
analyze = AnalyzeKaramba3D(Model=assemble.Model)  # -> CalculatedModel, MaximumDisplacement_cm, ResultingForceOfGravity_kN, ElasticEnergy_kNm
modelview = ModelViewKaramba3D(Model=analyze.CalculatedModel, ResultFactors=1, ResultCase=-1)  # -> Model, DeformedMesh, DeformedAxes, DeformedModel
shellview = ShellViewKaramba3D(Model=modelview.Model, IndexOfLayer=0)  # -> Model, MeshesOfRenderedShells, LegendColors, LegendTags
shellvecresults = ResultVectorsOnShellsKaramba3D(AnalyzedModel=shellview.Model, LayerPosition=0, mode="PrincStress")  # -> AnalyzedModel, Points, FirstPrincipalStressVector_kN_cm2, SecondPrincipalStressVector_kN_cm2, FirstPrincipalStressValue_kN_cm2, SecondPrincipalStressValue_kN_cm2
nodedisp = NodalDisplacementsKaramba3D(AnalyzedModel=shellvecresults.AnalyzedModel, ResultCase=0)  # -> AnalyzedModel, NodalTranslations_m, NodalRotations_rad

# ---- group: Shell Approach Results
bnd = Bounds(Numbers=[shellvecresults.FirstPrincipalStressVector_kN_cm2, shellvecresults.FirstPrincipalStressValue_kN_cm2])
bnd_2 = Bounds(Numbers=nodedisp.NodalTranslations_m)
bnd_3 = Bounds(Numbers=[shellvecresults.SecondPrincipalStressValue_kN_cm2, shellvecresults.SecondPrincipalStressVector_kN_cm2])
dedomain = DeconstructDomain(Domain=bnd)  # -> Start, End
dedomain_2 = DeconstructDomain(Domain=bnd_2)  # -> Start, End
dedomain_3 = DeconstructDomain(Domain=bnd_3)  # -> Start, End
maximun_tension = Panel(dedomain.End)
maximun_compresion = Panel(dedomain_3.Start)
maximun_displacement = Panel(dedomain_2.End)

# ---- group: Type I / Loking Anchor point from near centroides
xy = XYPlane(Origin=Point(0, 0, 0))
cp = PlaneClosestPoint(Point=rdpoints_3.OutPoint, Plane=xy)  # -> Point, UVPoint, Distance
sort = SortList(Keys=cp.Distance, ValuesA=rdpoints_3.OutPoint)  # -> Keys, ValuesA
smaller = SmallerThan(FirstNumber=sort.Keys, SecondNumber=Slider(0.05, range=0..1))  # -> SmallerThan, OrEqualTo
cull = CullPattern(List=sort.ValuesA, CullPattern=smaller.SmallerThan)
cullpt = CullDuplicates(Points=cull, Tolerance=Slider(0.01, range=0..0.01), CullMode=3)  # -> Points, Indices, Valence
anchor_points = Point(cullpt.Points)

# ---- group: Type I / Materials
division_10 = Division(A="4.4", B=Slider(2.9, range=0..10))
matprops_2 = MaterialPropertiesKaramba3D(
    FamilyOfMaterial="Composite",
    Name="Mud Brick",
    YoungsModulus_kN_cm2="4.4",
    InPlaneShearModulus_kN_cm2=division_10,
    TransverseShearModulus_kN_cm2=division_10,
    SpecificWeight_kN_m3="14.71",
    CoefficientOfThermalExpansion_1_C=1e-05,
    YieldStrength_kN_cm2=23.5,
    mode="Isotrop")
matselect_2 = MaterialSelectionKaramba3D(Materials=matprops_2, menu=[dropdown(1), dropdown(1)])

# ---- group: Type IV / Load case 0
item_15 = ListItem(List=debrep.Faces, Index="5", Wrap=True)
area_4 = Area(Geometry=item_15)  # -> Area, Centroid
pt_7 = Point(area_4.Centroid)
volume_5 = Volume(Geometry=move_3.Geometry)  # -> Volume, Centroid
lng = ListLength(List=pt_7)
material_density_kn_m3 = Panel("-14.71")
division_11 = Division(A=volume_5.Volume, B=lng)
dup = DuplicateData(Data=material_density_kn_m3, Number=lng, Order=True)
multiplication = Multiplication(A=division_11, B=dup)
Z_3 = UnitZ(Factor=1)
amp_2 = Amplitude(Vector=Z_3, Amplitude=multiplication)  # -> flatten(Vector)
loads_3 = LoadsKaramba3D(ForceVector=flatten(amp_2), Local=False, PosInd=flatten(pt_7), LCase="0", mode="Point")

# ---- group: Type II / Loking Anchor point from near centroides
xy_2 = XYPlane(Origin=Point(0, 0, 0))
cp_2 = PlaneClosestPoint(Point=rdpoints_4.OutPoint, Plane=xy_2)  # -> Point, UVPoint, Distance
sort_2 = SortList(Keys=cp_2.Distance, ValuesA=rdpoints_4.OutPoint)  # -> Keys, ValuesA
smaller_2 = SmallerThan(FirstNumber=sort_2.Keys, SecondNumber=Slider(0.05, range=0..1))  # -> SmallerThan, OrEqualTo
cull_2 = CullPattern(List=sort_2.ValuesA, CullPattern=smaller_2.SmallerThan)
cullpt_2 = CullDuplicates(Points=cull_2, Tolerance=Slider(0.01, range=0..0.01), CullMode=3)  # -> Points, Indices, Valence
anchor_points_2 = Point(cullpt_2.Points)

# ---- group: Type II / Materials
division_12 = Division(A="4.4", B=Slider(2.9, range=0..10))
matprops_3 = MaterialPropertiesKaramba3D(
    FamilyOfMaterial="Composite",
    Name="Mud Brick",
    YoungsModulus_kN_cm2="4.4",
    InPlaneShearModulus_kN_cm2=division_12,
    TransverseShearModulus_kN_cm2=division_12,
    SpecificWeight_kN_m3="14.71",
    CoefficientOfThermalExpansion_1_C=1e-05,
    YieldStrength_kN_cm2=23.5,
    mode="Isotrop")
matselect_3 = MaterialSelectionKaramba3D(Materials=matprops_3, menu=[dropdown(1), dropdown(1)])

# ---- group: Type III / Load case 0
pt_8 = Point(area.Centroid)
volume_6 = Volume(Geometry=move_2.Geometry)  # -> Volume, Centroid
lng_2 = ListLength(List=pt_8)
division_13 = Division(A=volume_6.Volume, B=lng_2)
material_density_kn_m3_2 = Panel("-14.71")
dup_2 = DuplicateData(Data=material_density_kn_m3_2, Number=lng_2, Order=True)
Z_4 = UnitZ(Factor=1)
multiplication_2 = Multiplication(A=division_13, B=dup_2)
amp_3 = Amplitude(Vector=Z_4, Amplitude=multiplication_2)  # -> flatten(Vector)
loads_4 = LoadsKaramba3D(ForceVector=flatten(amp_3), Local=False, PosInd=flatten(pt_8), LCase="0", mode="Point")

# ---- group: Type III / Loking Anchor point from near centroides
xy_3 = XYPlane(Origin=Point(0, 0, 0))
cp_3 = PlaneClosestPoint(Point=rdpoints.OutPoint, Plane=xy_3)  # -> Point, UVPoint, Distance
sort_3 = SortList(Keys=cp_3.Distance, ValuesA=rdpoints.OutPoint)  # -> Keys, ValuesA
smaller_3 = SmallerThan(FirstNumber=sort_3.Keys, SecondNumber=Slider(0.05, range=0..1))  # -> SmallerThan, OrEqualTo
cull_3 = CullPattern(List=sort_3.ValuesA, CullPattern=smaller_3.SmallerThan)
cullpt_3 = CullDuplicates(Points=cull_3, Tolerance=Slider(0.01, range=0..0.01), CullMode=3)  # -> Points, Indices, Valence
anchor_points_3 = Point(cullpt_3.Points)

# ---- group: Type III / Materials
division_14 = Division(A="4.4", B=Slider(2.9, range=0..10))
matprops_4 = MaterialPropertiesKaramba3D(
    FamilyOfMaterial="Composite",
    Name="Mud Brick",
    YoungsModulus_kN_cm2="4.4",
    InPlaneShearModulus_kN_cm2=division_14,
    TransverseShearModulus_kN_cm2=division_14,
    SpecificWeight_kN_m3="14.71",
    CoefficientOfThermalExpansion_1_C=1e-05,
    YieldStrength_kN_cm2=23.5,
    mode="Isotrop")
matselect_4 = MaterialSelectionKaramba3D(Materials=matprops_4, menu=[dropdown(1), dropdown(1)])

# ---- group: Type IV / Anchor point
xy_4 = XYPlane(Origin=Point(0, 0, 0))
cp_4 = PlaneClosestPoint(Point=rdpoints_2.OutPoint, Plane=xy_4)  # -> Point, UVPoint, Distance
sort_4 = SortList(Keys=cp_4.Distance, ValuesA=rdpoints_2.OutPoint)  # -> Keys, ValuesA
smaller_4 = SmallerThan(FirstNumber=sort_4.Keys, SecondNumber=Slider(0.05, range=0..1))  # -> SmallerThan, OrEqualTo
cull_4 = CullPattern(List=sort_4.ValuesA, CullPattern=smaller_4.SmallerThan)
cullpt_4 = CullDuplicates(Points=cull_4, Tolerance=Slider(0.01, range=0..0.01), CullMode=3)  # -> Points, Indices, Valence
anchor_points_4 = Point(cullpt_4.Points)

# ---- group: Type I / Load case 1
Z_5 = UnitZ(Factor=1)
pt_9 = Point([Point(0.4019663089, 3.820121002, 0.4), Point(0.4019663089, 3.420121002, 0.4)])
amp_4 = Amplitude(Vector=Z_5, Amplitude="-100")  # -> flatten(Vector)
pt_10 = Point(Point(0.4019663089, 3.620121002, 0.4))
loads_5 = LoadsKaramba3D(ForceVector=flatten(amp_4), Local=False, PosInd=flatten([pt_10, pt_9]), LCase="1", mode="Point")

# ---- group: Type II / Loads case 1
pt_11 = Point([Point(0.4019663089, 3.820121002, 0.4), Point(0.4019663089, 3.420121002, 0.4)])
pt_12 = Point(Point(0.4019663089, 3.620121002, 0.4))
Z_6 = UnitZ(Factor=1)
move_4 = Move(Geometry=[pt_12, pt_11], Motion=vec.Vector)  # -> Geometry, Transform
amp_5 = Amplitude(Vector=Z_6, Amplitude="-100")  # -> flatten(Vector)
loads_6 = LoadsKaramba3D(ForceVector=flatten(amp_5), Local=False, PosInd=flatten(move_4.Geometry), LCase="1", mode="Point")

# ---- group: Type I / Creating Elements
linetobeam = LineToBeamKaramba3D(
    Line=flatten(rdlines_3.OutLine),
    Identifier=panel_9,
    CrossSection=cross_section_4,
    New=True,
    Remove=True,
    LimitDistance_m=0.005)  # -> Element, Points, Info

# ---- group: Type III / Load Case 1
pt_13 = Point([Point(0.4019663089, 3.820121002, 0.4), Point(0.4019663089, 3.420121002, 0.4)])
move_5 = Move(Geometry=pt_13, Motion=vec_2.Vector)  # -> Geometry, Transform
Z_7 = UnitZ(Factor=1)
amp_6 = Amplitude(Vector=Z_7, Amplitude="-100")  # -> flatten(Vector)
loads_7 = LoadsKaramba3D(ForceVector=flatten(amp_6), Local=False, PosInd=flatten(move_5.Geometry), LCase="1", mode="Point")

# ---- group: Type II / Creating Elements
cre = LineToBeamKaramba3D(
    Line=flatten(rdlines_4.OutLine),
    Identifier=panel_13,
    CrossSection=cross_section_5,
    New=True,
    Remove=True,
    LimitDistance_m=0.005)  # -> Element, Points, Info

# ---- group: Type I / Anchor Points
supp_2 = SupportKaramba3D(PosInd=flatten(anchor_points), menu=[buttons(on, on, on, off, off, off)])

# ---- group: Type IV / Load case 1
pt_14 = Point([Point(0.4019663089, 3.820121002, 0.4), Point(0.4019663089, 3.420121002, 0.4)])
Z_8 = UnitZ(Factor=1)
pt_15 = Point(Point(0.4019663089, 3.620121002, 0.4))
amp_7 = Amplitude(Vector=Z_8, Amplitude="-100")  # -> flatten(Vector)
move_6 = Move(Geometry=[pt_15, pt_14], Motion=vec_3.Vector)  # -> Geometry, Transform
loads_8 = LoadsKaramba3D(ForceVector=flatten(amp_7), Local=False, PosInd=flatten(move_6.Geometry), LCase="1", mode="Point")

# ---- group: Type II / Anchor Points
supp_3 = SupportKaramba3D(PosInd=flatten(anchor_points_2), menu=[buttons(on, on, on, off, off, off)])

# ---- group: Type III / Creating Elements
linetobeam_2 = LineToBeamKaramba3D(
    Line=flatten(rdlines_2.OutLine),
    Identifier=panel_4,
    CrossSection=cross_section_2,
    New=True,
    Remove=True,
    LimitDistance_m=0.005)  # -> Element, Points, Info

# ---- group: Type III / Anchor Points
supp_4 = SupportKaramba3D(PosInd=flatten(anchor_points_3), menu=[buttons(on, on, on, off, off, off)])

# ---- group: Type IV / Anchor Points
supp_5 = SupportKaramba3D(PosInd=flatten(anchor_points_4), menu=[buttons(on, on, on, off, off, off)])

# ---- group: Type IV / Creating lements
linetobeam_3 = LineToBeamKaramba3D(
    Line=flatten(rdlines.OutLine),
    Identifier=panel_6,
    CrossSection=cross_section_3,
    New=True,
    Remove=True,
    LimitDistance_m=0.005)  # -> Element, Points, Info

# ---- group: Type III
assemble_2 = AssembleModelKaramba3D(
    Point=flatten(rdpoints.OutPoint),
    Elem=flatten(linetobeam_2.Element),
    Support=supp_4,
    Load=[loads_4, loads_7],
    Material=matselect,
    LimitDistance_m=0.005)  # -> Model, Info, Mass_kg, CenterOfGravity

# ---- group: Type IV
assemble_3 = AssembleModelKaramba3D(
    Point=flatten(rdpoints_2.OutPoint),
    Elem=flatten(linetobeam_3.Element),
    Support=supp_5,
    Load=[loads_3, loads_8],
    Material=matselect,
    LimitDistance_m=0.005)  # -> Model, Info, Mass_kg, CenterOfGravity

# ---- group: Type III / Analysis and results
analyze_2 = AnalyzeKaramba3D(Model=assemble_2.Model)  # -> CalculatedModel, MaximumDisplacement_cm, ResultingForceOfGravity_kN, ElasticEnergy_kNm
modelview_2 = ModelViewKaramba3D(Model=analyze_2.CalculatedModel, ResultFactors=1, ResultCase=-1)  # -> Model, DeformedMesh, DeformedAxes, DeformedModel
beamview = BeamViewKaramba3D(Model=modelview_2.Model)  # -> Model, MeshesOfRenderedBeams, DeformedBeamAxes, LegendColors, LegendTags
disassemble = DisassembleModelKaramba3D(Model=beamview.Model)  # -> Model, Point, Beam, Shell, Support, Load, Line, Mesh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
utilization = UtilizationOfElementsKaramba3D(
    AnalyzedModel=beamview.Model,
    ResultCase=number_slider,
    NumberOfSamplePoints=3,
    ElasticDesign=True,
    GammaM0=1,
    GammaM1=1,
    WithDetails=False,
    mode="Beams")  # -> AnalyzedModel, Utilization, SigMax_kN_cm2, SigMin_kN_cm2, TauMax_kN_cm2, UtilN, UtilVy, UtilVz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
nodedisp_2 = NodalDisplacementsKaramba3D(AnalyzedModel=utilization.AnalyzedModel, ResultCase=0)  # -> AnalyzedModel, NodalTranslations_m, NodalRotations_rad

# ---- group: Type III results
bnd_4 = Bounds(Numbers=utilization.SigMax_kN_cm2)
bnd_5 = Bounds(Numbers=nodedisp_2.NodalTranslations_m)
bnd_6 = Bounds(Numbers=utilization.TauMax_kN_cm2)
bnd_7 = Bounds(Numbers=utilization.SigMin_kN_cm2)
dedomain_4 = DeconstructDomain(Domain=bnd_4)  # -> Start, End
dedomain_5 = DeconstructDomain(Domain=bnd_5)  # -> Start, End
dedomain_6 = DeconstructDomain(Domain=bnd_6)  # -> Start, End
dedomain_7 = DeconstructDomain(Domain=bnd_7)  # -> Start, End
maximun_tension_2 = Panel(dedomain_4.End)
maximun_compresion_2 = Panel(dedomain_7.Start)
maximun_shear = Panel(dedomain_6.End)
maximun_displacement_2 = Panel(dedomain_5.End)

# ---- group: Type IV / Analysis and results
analyze_3 = AnalyzeKaramba3D(Model=assemble_3.Model)  # -> CalculatedModel, MaximumDisplacement_cm, ResultingForceOfGravity_kN, ElasticEnergy_kNm
modelview_3 = ModelViewKaramba3D(Model=analyze_3.CalculatedModel, ResultFactors=1, ResultCase=-1)  # -> Model, DeformedMesh, DeformedAxes, DeformedModel
beamview_2 = BeamViewKaramba3D(Model=modelview_3.Model)  # -> Model, MeshesOfRenderedBeams, DeformedBeamAxes, LegendColors, LegendTags
disassemble_2 = DisassembleModelKaramba3D(Model=beamview_2.Model)  # -> Model, Point, Beam, Shell, Support, Load, Line, Mesh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
utilization_2 = UtilizationOfElementsKaramba3D(
    AnalyzedModel=beamview_2.Model,
    ResultCase=number_slider,
    NumberOfSamplePoints=3,
    ElasticDesign=True,
    GammaM0=1,
    GammaM1=1,
    WithDetails=False,
    mode="Beams")  # -> AnalyzedModel, Utilization, SigMax_kN_cm2, SigMin_kN_cm2, TauMax_kN_cm2, UtilN, UtilVy, UtilVz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
nodedisp_3 = NodalDisplacementsKaramba3D(AnalyzedModel=utilization_2.AnalyzedModel, ResultCase=0)  # -> AnalyzedModel, NodalTranslations_m, NodalRotations_rad

# ---- group: Type IV results
bnd_8 = Bounds(Numbers=utilization_2.SigMax_kN_cm2)
# Visualization. All cases together
bnd_9 = Bounds(Numbers=nodedisp_3.NodalTranslations_m)
bnd_10 = Bounds(Numbers=utilization_2.TauMax_kN_cm2)
bnd_11 = Bounds(Numbers=utilization_2.SigMin_kN_cm2)
dedomain_8 = DeconstructDomain(Domain=bnd_8)  # -> Start, End
dedomain_9 = DeconstructDomain(Domain=bnd_9)  # -> Start, End
dedomain_10 = DeconstructDomain(Domain=bnd_10)  # -> Start, End
dedomain_11 = DeconstructDomain(Domain=bnd_11)  # -> Start, End
maximun_tension_3 = Panel(dedomain_8.End)
maximun_compresion_3 = Panel(dedomain_11.Start)
maximun_shear_2 = Panel(dedomain_10.End)
maximun_displacement_3 = Panel(dedomain_9.End)

# ---- group: Type I / Load case 0
pt_16 = Point(area_2.Centroid)
volume_7 = Volume(Geometry=brep)  # -> Volume, Centroid
lng_3 = ListLength(List=pt_16)
division_15 = Division(A=volume_7.Volume, B=lng_3)
material_density_kn_m3_3 = Panel("-14.71")
Z_9 = UnitZ(Factor=1)

# ---- group: Type II / Load case 0
pt_17 = Point(area_3.Centroid)
volume_8 = Volume(Geometry=move.Geometry)  # -> Volume, Centroid
lng_4 = ListLength(List=pt_17)
division_16 = Division(A=volume_8.Volume, B=lng_4)
material_density_kn_m3_4 = Panel("-14.71")
Z_10 = UnitZ(Factor=1)

# ---- group: Type I
dup_3 = DuplicateData(Data=material_density_kn_m3_3, Number=lng_3, Order=True)

# ---- group: Type I / Load case 0 (continued)
multiplication_3 = Multiplication(A=division_15, B=dup_3)
amp_8 = Amplitude(Vector=Z_9, Amplitude=multiplication_3)  # -> flatten(Vector)
loads_9 = LoadsKaramba3D(ForceVector=flatten(amp_8), Local=False, PosInd=flatten(pt_16), LCase="0", mode="Point")

# ---- group: Type I (continued)
assemble_4 = AssembleModelKaramba3D(
    Point=flatten(rdpoints_3.OutPoint),
    Elem=flatten(linetobeam.Element),
    Support=supp_2,
    Load=[loads_9, loads_5],
    Material=matselect,
    LimitDistance_m=0.005)  # -> Model, Info, Mass_kg, CenterOfGravity

# ---- group: Type I / Analysis and results
analyze_4 = AnalyzeKaramba3D(Model=assemble_4.Model)  # -> CalculatedModel, MaximumDisplacement_cm, ResultingForceOfGravity_kN, ElasticEnergy_kNm
modelview_4 = ModelViewKaramba3D(Model=analyze_4.CalculatedModel, ResultFactors=1, ResultCase=-1)  # -> Model, DeformedMesh, DeformedAxes, DeformedModel
beamview_3 = BeamViewKaramba3D(Model=modelview_4.Model)  # -> Model, MeshesOfRenderedBeams, DeformedBeamAxes, LegendColors, LegendTags
disassemble_3 = DisassembleModelKaramba3D(Model=beamview_3.Model)  # -> Model, Point, Beam, Shell, Support, Load, Line, Mesh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
utilization_3 = UtilizationOfElementsKaramba3D(
    AnalyzedModel=beamview_3.Model,
    ResultCase=number_slider,
    NumberOfSamplePoints=3,
    ElasticDesign=True,
    GammaM0=1,
    GammaM1=1,
    WithDetails=False,
    mode="Beams")  # -> AnalyzedModel, Utilization, SigMax_kN_cm2, SigMin_kN_cm2, TauMax_kN_cm2, UtilN, UtilVy, UtilVz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
nodedisp_4 = NodalDisplacementsKaramba3D(AnalyzedModel=utilization_3.AnalyzedModel, ResultCase=0)  # -> AnalyzedModel, NodalTranslations_m, NodalRotations_rad

# ---- group: Type I results
# Abstracted cases in linear elements
bnd_12 = Bounds(Numbers=utilization_3.SigMax_kN_cm2)
bnd_13 = Bounds(Numbers=nodedisp_4.NodalTranslations_m)
bnd_14 = Bounds(Numbers=utilization_3.TauMax_kN_cm2)
bnd_15 = Bounds(Numbers=utilization_3.SigMin_kN_cm2)
dedomain_12 = DeconstructDomain(Domain=bnd_12)  # -> Start, End
dedomain_13 = DeconstructDomain(Domain=bnd_13)  # -> Start, End
dedomain_14 = DeconstructDomain(Domain=bnd_14)  # -> Start, End
dedomain_15 = DeconstructDomain(Domain=bnd_15)  # -> Start, End
maximun_tension_4 = Panel(dedomain_12.End)
maximun_compresion_4 = Panel(dedomain_15.Start)
maximun_shear_3 = Panel(dedomain_14.End)
maximun_displacement_4 = Panel(dedomain_13.End)

# ---- group: Type II
dup_4 = DuplicateData(Data=material_density_kn_m3_4, Number=lng_4, Order=True)

# ---- group: Type II / Load case 0 (continued)
multiplication_4 = Multiplication(A=division_16, B=dup_4)
amp_9 = Amplitude(Vector=Z_10, Amplitude=multiplication_4)  # -> flatten(Vector)
loads_10 = LoadsKaramba3D(ForceVector=flatten(amp_9), Local=False, PosInd=flatten(pt_17), LCase="0", mode="Point")

# ---- group: Type II (continued)
assemble_5 = AssembleModelKaramba3D(
    Point=flatten(rdpoints_4.OutPoint),
    Elem=flatten(cre.Element),
    Support=supp_3,
    Load=[loads_10, loads_6],
    Material=matselect,
    LimitDistance_m=0.005)  # -> Model, Info, Mass_kg, CenterOfGravity

# ---- group: Type II / Analysis and results
analyze_5 = AnalyzeKaramba3D(Model=assemble_5.Model)  # -> CalculatedModel, MaximumDisplacement_cm, ResultingForceOfGravity_kN, ElasticEnergy_kNm
modelview_5 = ModelViewKaramba3D(Model=analyze_5.CalculatedModel, ResultFactors=1, ResultCase=-1)  # -> Model, DeformedMesh, DeformedAxes, DeformedModel
beamview_4 = BeamViewKaramba3D(Model=modelview_5.Model)  # -> Model, MeshesOfRenderedBeams, DeformedBeamAxes, LegendColors, LegendTags
disassemble_4 = DisassembleModelKaramba3D(Model=beamview_4.Model)  # -> Model, Point, Beam, Shell, Support, Load, Line, Mesh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
utilization_4 = UtilizationOfElementsKaramba3D(
    AnalyzedModel=beamview_4.Model,
    ResultCase=number_slider,
    NumberOfSamplePoints=3,
    ElasticDesign=True,
    GammaM0=1,
    GammaM1=1,
    WithDetails=False,
    mode="Beams")  # -> AnalyzedModel, Utilization, SigMax_kN_cm2, SigMin_kN_cm2, TauMax_kN_cm2, UtilN, UtilVy, UtilVz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
nodedisp_5 = NodalDisplacementsKaramba3D(AnalyzedModel=utilization_4.AnalyzedModel, ResultCase=0)  # -> AnalyzedModel, NodalTranslations_m, NodalRotations_rad

# ---- group: Normalize legend per element
data_2 = Data(flatten([utilization.SigMax_kN_cm2, utilization_2.SigMax_kN_cm2, utilization_4.SigMax_kN_cm2, utilization_3.SigMax_kN_cm2]))
bnd_16 = Bounds(Numbers=flatten(data_2))
dedomain_16 = DeconstructDomain(Domain=bnd_16)  # -> Start, End
gradient = Gradient(
    LowerLimit=dedomain_16.Start,
    UpperLimit=dedomain_16.End,
    Parameter=data_2,
    stops=[0: RGB(0, 128, 0), 0.505: RGB(255, 255, 0), 1: RGB(255, 0, 0)])
line_6 = Line(flatten([disassemble.Line, disassemble_2.Line, disassemble_4.Line, disassemble_3.Line]))
pipe = Pipe(Curve=line_6, Radius=Slider(0.007, range=0..0.1), Caps=0)  # -> flatten(Pipe)
previewlw = CustomPreviewLineweights(Geometry=pipe, Shader=gradient, Absolute=False)

# ---- group: Type II results
bnd_17 = Bounds(Numbers=utilization_4.SigMax_kN_cm2)
bnd_18 = Bounds(Numbers=nodedisp_5.NodalTranslations_m)
bnd_19 = Bounds(Numbers=utilization_4.TauMax_kN_cm2)
bnd_20 = Bounds(Numbers=utilization_4.SigMin_kN_cm2)
dedomain_17 = DeconstructDomain(Domain=bnd_17)  # -> Start, End
dedomain_18 = DeconstructDomain(Domain=bnd_18)  # -> Start, End
dedomain_19 = DeconstructDomain(Domain=bnd_19)  # -> Start, End
dedomain_20 = DeconstructDomain(Domain=bnd_20)  # -> Start, End
maximun_tension_5 = Panel(dedomain_17.End)
maximun_compresion_5 = Panel(dedomain_20.Start)
maximun_shear_4 = Panel(dedomain_19.End)
maximun_displacement_5 = Panel(dedomain_18.End)
