# Grasshopper definition 2021_11_02_Module_Structural Analisys.gh (Grasshopper 1.0.7)
# plug-ins: MeshEdit Components, Pufferfish, Human, Weaverbird, Kangaroo2 Components, karambaGH

list = ValueList({"Own Mesh": 0, "Internalize mesh": 1}, selected="Internalize mesh")

# ---- group: Canguro Control
number_slider = Slider(1, range=0..2)
number_slider_2 = Slider(20, range=0..20)
number_slider_3 = Slider(0.03, range=0..0.05)
reset_relaxation = Button()
kangaroo_on_off = BooleanToggle(False)

# ---- group: Mesh Parameters
# MODULES BASE ON REGULAR GRID GENERATION
# Authors: Felipe Lopez Taverne
# CONTROL PANEL
size_m = Slider(3, range=0..10)
steps_to_rise_heigth = ValueList({"6", "7", "8", "12", "16", "24", "29"}, selected="24")

# ----
# Set final module heigth (m).
# The diference with the mesh will be absorved by the firts step (Colums or walls)
panel = Panel("3.5")

# ---- group: Creating Triangles
dom = ConstructDomain(DomainStart="0", DomainEnd=steps_to_rise_heigth)
range = Range(Domain=dom, Steps=steps_to_rise_heigth)

# ---- group: Creating Triangles / Creating steps to rice the diagonal
dom_2 = ConstructDomain(DomainStart="0", DomainEnd=range)
range_2 = Range(Domain=dom_2, Steps=range)
lastdex = LastIndex(List=range_2)
cull_i = CullIndex(List=range_2, Indices=lastdex, Wrap=lastdex)  # -> simplify(List)
lastdex_2 = LastIndex(List=cull_i)
cull_i_2 = CullIndex(List=cull_i, Indices=lastdex_2, Wrap=lastdex)  # -> simplify(List)
clean = CleanTree(RemoveNulls=True, RemoveInvalid=True, RemoveEmpty=Toggle(True), Tree=cull_i_2)  # -> simplify(Tree)

# ---- group: Creating Triangles / Creating vector to move triangles
multiplication = Multiplication(A=steps_to_rise_heigth, B="2")
division = Division(A=size_m, B=multiplication)
item = ListItem(List=division, Index=0, Wrap=True)  # -> Item, Item1
vec = VectorXYZ(XComponent=0, YComponent=item.Item, ZComponent=0)  # -> Vector, Length
multiplication_2 = Multiplication(A=simplify(vec.Vector), B=simplify(clean))

# ----
width = Data(size_m)

# ---- group: Creating Surface Vertices
# A. Regular mesh Generation
higth = Data(size_m)
division_2 = Division(A=higth, B="2")
division_3 = Division(A=width, B="2")
panel_2 = Panel(division_2)
panel_3 = Panel(higth)
_1 = ConstructPoint(XCoordinate="0", YCoordinate=panel_2, ZCoordinate=0)
_1_2 = ConstructPoint(XCoordinate="0", YCoordinate=panel_3, ZCoordinate=0)
_1_3 = ConstructPoint(XCoordinate="0", YCoordinate="0", ZCoordinate=0)
panel_4 = Panel(division_2)
panel_5 = Panel(higth)
panel_6 = Panel(division_3)
_1_4 = ConstructPoint(XCoordinate=panel_6, YCoordinate=panel_4, ZCoordinate=0)
_1_5 = ConstructPoint(XCoordinate=panel_6, YCoordinate="0", ZCoordinate=0)
_1_6 = ConstructPoint(XCoordinate=panel_6, YCoordinate=panel_5, ZCoordinate=0)
panel_7 = Panel(width)
panel_8 = Panel(division_2)
panel_9 = Panel(higth)
_1_7 = ConstructPoint(XCoordinate=panel_7, YCoordinate=panel_8, ZCoordinate=0)
_1_8 = ConstructPoint(XCoordinate=panel_7, YCoordinate="0", ZCoordinate=0)
_1_9 = ConstructPoint(XCoordinate=panel_7, YCoordinate=panel_9, ZCoordinate=0)

# ---- group: Creating Triangles / Determing steps to multiplicate vector
dom_3 = ConstructDomain(DomainStart="0", DomainEnd=steps_to_rise_heigth)
range_3 = Range(Domain=dom_3, Steps=steps_to_rise_heigth)
panel_10 = Panel(range_3)
lastdex_3 = LastIndex(List=panel_10)
cull_i_3 = CullIndex(List=panel_10, Indices=lastdex_3, Wrap=True)

# ---- group: Creating Triangles / Creating vector to move triangles
multiplication_3 = Multiplication(A=steps_to_rise_heigth, B="2")
division_4 = Division(A=size_m, B=multiplication_3)
item_2 = ListItem(List=division_4, Index=0, Wrap=True)  # -> Item, Item1
vec_2 = VectorXYZ(XComponent=item_2.Item1, YComponent=item_2.Item, ZComponent=0)  # -> Vector, Length
multiplication_4 = Multiplication(A=vec_2.Vector, B=cull_i_3)

# ---- group: Creating First Squares line / Determing steps to multiplicate vector
dom_4 = ConstructDomain(DomainStart="0", DomainEnd=steps_to_rise_heigth)
range_4 = Range(Domain=dom_4, Steps=steps_to_rise_heigth)
panel_11 = Panel(range_4)
lastdex_4 = LastIndex(List=panel_11)
cull_i_4 = CullIndex(List=panel_11, Indices=flatten([lastdex_4, "0"]), Wrap=True)

# ---- group: Creating First Squares line / Creating vector to move triangles
multiplication_5 = Multiplication(A=steps_to_rise_heigth, B="2")
division_5 = Division(A=size_m, B=multiplication_5)
item_3 = ListItem(List=division_5, Index=0, Wrap=True)  # -> Item, Item1
vec_3 = VectorXYZ(XComponent=item_3.Item1, YComponent=0, ZComponent=0)  # -> Vector, Length
multiplication_6 = Multiplication(A=vec_3.Vector, B=cull_i_4)

# ---- group: Central Axis and mirror plane
Z = UnitZ(Factor=1)
move = Move(Geometry=_1_4, Motion=Z)  # -> Geometry, Transform
ln = Line(StartPoint=_1_4, EndPoint=move.Geometry)
pl_3pt = Plane3Pt(PointA=_1, PointB=_1_7, PointC=move.Geometry)

# ---- group: Base Triangule and Rectangle
srf4pt = _4PointSurface(CornerA=_1_3, CornerB=_1, CornerC=_1_4, CornerD=_1_5)
srf4pt_2 = _4PointSurface(CornerA=_1_3, CornerB=_1_4, CornerC=_1_5)

# ---- group: Creating Triangles / Scaling and Moving Triangles
division_6 = Division(A="1", B=steps_to_rise_heigth)
scale = Scale(Geometry=graft(srf4pt_2), Center=Point(0, 0, 0), Factor=division_6)  # -> Geometry, Transform
move_2 = Move(Geometry=scale.Geometry, Motion=multiplication_4)  # -> Geometry, Transform

# ---- group: Creating First Squares line / Scaling and Moving Triangles
division_7 = Division(A="1", B=steps_to_rise_heigth)
scale_2 = Scale(Geometry=graft(srf4pt), Center=Point(0, 0, 0), Factor=division_7)  # -> Geometry, Transform
move_3 = Move(Geometry=scale_2.Geometry, Motion=multiplication_6)  # -> Geometry, Transform

# ---- group: Creating Triangles / Scaling and Moving Triangles
move_4 = Move(Geometry=simplify(graft(move_3.Geometry)), Motion=multiplication_2)  # -> simplify(Geometry), Transform

# ---- group: Mesh Generation
srf = Surface([move_4.Geometry, move_2.Geometry])
mirror = Mirror(Geometry=srf, Plane=pl_3pt)  # -> Geometry, Transform

panel_12 = Panel("""0
90
180
270""")
rad = Radians(Degrees=panel_12)
rotax = RotateAxis(Geometry=graft([srf, mirror.Geometry]), Angle=rad, Axis=ln)  # -> flatten(Geometry), Transform
wbjoin = WeaverbirdsJoinMeshesAndWeld(Mesh=rotax.Geometry, Weld=Toggle(True))
unifynormals = MeshUnifyNormals(Mesh=wbjoin)

# ---- group: Creating Radius Curve from coplanarity
# B. Dinamic Relaxation (Kangaroo)
subtraction = Subtraction(A=steps_to_rise_heigth, B="1")
dom_5 = ConstructDomain(DomainStart="1", DomainEnd=steps_to_rise_heigth)
step_length = Division(A=division_3, B=steps_to_rise_heigth)
range_5 = Range(Domain=dom_5, Steps=subtraction)
multiplication_7 = Multiplication(A=step_length, B=range_5)  # -> graft(Result)
pt = ConstructPoint(XCoordinate=multiplication_7, YCoordinate=multiplication_7, ZCoordinate=0)
pt_2 = ConstructPoint(XCoordinate=multiplication_7, YCoordinate="0", ZCoordinate=0)
pt_3 = ConstructPoint(XCoordinate="0", YCoordinate=multiplication_7, ZCoordinate=0)
pline = PolyLine(Vertices=[pt_3, pt, pt_2], Closed=False)
panel_13 = Panel("""0
90
180
270""")
rad_2 = Radians(Degrees=panel_13)
rotax_2 = RotateAxis(Geometry=pline, Angle=rad_2, Axis=ln)  # -> simplify(Geometry), Transform

# ---- group: Creating Triangles / Determing steps to multiplicate vector
dom_6 = ConstructDomain(DomainStart="0", DomainEnd=steps_to_rise_heigth)
range_6 = Range(Domain=dom_6, Steps=steps_to_rise_heigth)
panel_14 = Panel(range_6)
lastdex_5 = LastIndex(List=panel_14)
cull_i_5 = CullIndex(List=panel_14, Indices=lastdex_5, Wrap=True)
lastdex_6 = LastIndex(List=cull_i_5)
cull_i_6 = CullIndex(List=cull_i_5, Indices=lastdex_6, Wrap=True)

# ---- group: Creating Triangles / Creating vector to move triangles
# C.Bricks Shape Generation
multiplication_8 = Multiplication(A=steps_to_rise_heigth, B="2")
division_8 = Division(A=size_m, B=multiplication_8)
item_4 = ListItem(List=division_8, Index=0, Wrap=True)  # -> Item, Item1
vec_4 = VectorXYZ(XComponent=item_4.Item1, YComponent=item_4.Item, ZComponent=0)  # -> Vector, Length
multiplication_9 = Multiplication(A=vec_4.Vector, B=cull_i_6)

# ---- group: Creating First Squares line fOR THE vaULT (Not Triangles) / Determing steps to multiplicate vector
dom_7 = ConstructDomain(DomainStart="0", DomainEnd=steps_to_rise_heigth)
range_7 = Range(Domain=dom_7, Steps=steps_to_rise_heigth)
panel_15 = Panel(range_7)
lastdex_7 = LastIndex(List=panel_15)
cull_i_7 = CullIndex(List=panel_15, Indices=flatten(lastdex_7), Wrap=True)

# ---- group: Creating First Squares line fOR THE vaULT (Not Triangles) / Creating vector to move triangles
multiplication_10 = Multiplication(A=steps_to_rise_heigth, B="2")
division_9 = Division(A=size_m, B=multiplication_10)
item_5 = ListItem(List=division_9, Index=0, Wrap=True)  # -> Item, Item1
vec_5 = VectorXYZ(XComponent=item_5.Item1, YComponent=0, ZComponent=0)  # -> Vector, Length
multiplication_11 = Multiplication(A=vec_5.Vector, B=cull_i_7)

# ---- group: Creating First Squares line / Determing steps to multiplicate vector
dom_8 = ConstructDomain(DomainStart="0", DomainEnd=steps_to_rise_heigth)
range_8 = Range(Domain=dom_8, Steps=steps_to_rise_heigth)
panel_16 = Panel(range_8)
lastdex_8 = LastIndex(List=panel_16)
cull_i_8 = CullIndex(List=panel_16, Indices=flatten(lastdex_8), Wrap=True)

# ---- group: Creating First Squares line / Creating vector to move triangles
multiplication_12 = Multiplication(A=steps_to_rise_heigth, B="2")
division_10 = Division(A=size_m, B=multiplication_12)
item_6 = ListItem(List=division_10, Index=0, Wrap=True)  # -> Item, Item1
vec_6 = VectorXYZ(XComponent=0, YComponent=item_6.Item1, ZComponent=0)  # -> Vector, Length
multiplication_13 = Multiplication(A=vec_6.Vector, B=cull_i_8)

# ---- group: Creating First Squares line / Scaling and Moving Rectangles halft size
division_11 = Division(A="2", B=steps_to_rise_heigth)
xy = XYPlane(Origin=Point(0, 0, 0))
division_12 = Division(A=division_11, B="2")
scale_nu = ScaleNU(Geometry=srf4pt, Plane=xy, ScaleX=division_12, ScaleY=division_11, ScaleZ=1)  # -> Geometry, Transform
move_5 = Move(Geometry=scale_nu.Geometry, Motion=multiplication_13)  # -> Geometry, Transform

# ---- group: Creating First Squares line fOR THE vaULT (Not Triangles) / Scaling and Moving Triangles
division_13 = Division(A="2", B=steps_to_rise_heigth)
scale_3 = Scale(Geometry=graft(srf4pt), Center=Point(0, 0, 0), Factor=division_13)  # -> Geometry, Transform
move_6 = Move(Geometry=scale_3.Geometry, Motion=multiplication_11)  # -> Geometry, Transform

# ---- group: Creating Triangles / Scaling and Moving Triangles
division_14 = Division(A="2", B=steps_to_rise_heigth)
scale_4 = Scale(Geometry=graft(srf4pt), Center=Point(0, 0, 0), Factor=division_14)  # -> Geometry, Transform
move_7 = Move(Geometry=scale_4.Geometry, Motion=multiplication_9)  # -> graft(Geometry), Transform

# ---- group: Creating First Squares line / Determing steps to multiplicate vector
dom_9 = ConstructDomain(DomainStart="0", DomainEnd=steps_to_rise_heigth)
range_9 = Range(Domain=dom_9, Steps=steps_to_rise_heigth)
panel_17 = Panel(range_9)
lastdex_9 = LastIndex(List=panel_17)
cull_i_9 = CullIndex(List=panel_17, Indices=flatten([lastdex_9, "0"]), Wrap=True)

# ---- group: Creating First Squares line / Creating vector to move triangles
multiplication_14 = Multiplication(A=steps_to_rise_heigth, B="2")
division_15 = Division(A=size_m, B=multiplication_14)
item_7 = ListItem(List=division_15, Index=0, Wrap=True)  # -> Item, Item1
vec_7 = VectorXYZ(XComponent=item_7.Item1, YComponent=0, ZComponent=0)  # -> Vector, Length
multiplication_15 = Multiplication(A=vec_7.Vector, B=cull_i_9)

# ---- group: Creating First Squares line / Scaling and Moving Triangles
division_16 = Division(A="2", B=steps_to_rise_heigth)
scale_5 = Scale(Geometry=graft(srf4pt), Center=Point(0, 0, 0), Factor=division_16)  # -> Geometry, Transform
move_8 = Move(Geometry=scale_5.Geometry, Motion=multiplication_15)  # -> Geometry, Transform

# ---- group: Creating First Squares line / Determing steps to multiplicate vector
dom_10 = ConstructDomain(DomainStart="0", DomainEnd=steps_to_rise_heigth)
range_10 = Range(Domain=dom_10, Steps=steps_to_rise_heigth)
panel_18 = Panel(range_10)
lastdex_10 = LastIndex(List=panel_18)
cull_i_10 = CullIndex(List=panel_18, Indices=flatten([lastdex_10, "0"]), Wrap=True)

# ---- group: Creating First Squares line / Creating vector to move triangles
multiplication_16 = Multiplication(A=steps_to_rise_heigth, B="2")
division_17 = Division(A=size_m, B=multiplication_16)
item_8 = ListItem(List=division_17, Index=0, Wrap=True)  # -> Item, Item1
vec_8 = VectorXYZ(XComponent=item_8.Item1, YComponent=0, ZComponent=0)  # -> Vector, Length
multiplication_17 = Multiplication(A=vec_8.Vector, B=cull_i_10)

# ---- group: Creating First Squares line / Scaling and Moving Rectangles halft size
division_18 = Division(A="2", B=steps_to_rise_heigth)
xy_2 = XYPlane(Origin=Point(0, 0, 0))
division_19 = Division(A=division_18, B="2")
scale_nu_2 = ScaleNU(Geometry=srf4pt, Plane=xy_2, ScaleX=division_18, ScaleY=division_19, ScaleZ=1)  # -> Geometry, Transform
move_9 = Move(Geometry=scale_nu_2.Geometry, Motion=multiplication_17)  # -> Geometry, Transform

# ---- group: Creating First Squares line
panel_19 = Panel("""1
0""")
cull = CullPattern(List=move_9.Geometry, CullPattern=panel_19)  # -> graft(List)

panel_20 = Panel("""1
0""")
cull_2 = CullPattern(List=move_5.Geometry, CullPattern=panel_20)

# ---- group: Creating Triangles
dom_11 = ConstructDomain(DomainStart="0", DomainEnd=steps_to_rise_heigth)
range_11 = Range(Domain=dom_11, Steps=steps_to_rise_heigth)

# ---- group: Creating last brick to close vault
item_9 = ListItem(List=multiplication_11, Index="2", Wrap=True)
lastdex_11 = LastIndex(List=move_6.Geometry)
division_20 = Division(A=item_9, B="2")
item_10 = ListItem(List=multiplication_11, Index=lastdex_11, Wrap=True)
addition = Addition(A=division_20, B=item_10)
move_10 = Move(Geometry=cull_2, Motion=addition)  # -> Geometry, Transform
entwine = Entwine(Branch00=cull_2, Branch01=move_10.Geometry, FlattenInputs=True)
flip = FlipMatrix(Data=entwine)

# ---- group: Creating Triangles / Creating steps to rice the diagonal
dom_12 = ConstructDomain(DomainStart="0", DomainEnd=range_11)
range_12 = Range(Domain=dom_12, Steps=range_11)
lastdex_12 = LastIndex(List=range_12)
cull_i_11 = CullIndex(List=range_12, Indices=lastdex_12, Wrap=True)  # -> simplify(List)
lastdex_13 = LastIndex(List=cull_i_11)
cull_i_12 = CullIndex(List=cull_i_11, Indices=lastdex_13, Wrap=True)  # -> simplify(List)
clean_2 = CleanTree(RemoveNulls=True, RemoveInvalid=True, RemoveEmpty=Toggle(True), Tree=cull_i_12)  # -> simplify(Tree)

# ---- group: Creating Triangles / Creating vector to move triangles
multiplication_18 = Multiplication(A=steps_to_rise_heigth, B="2")
division_21 = Division(A=size_m, B=multiplication_18)
item_11 = ListItem(List=division_21, Index=0, Wrap=True)  # -> Item, Item1
vec_9 = VectorXYZ(XComponent=0, YComponent=item_11.Item, ZComponent=0)  # -> Vector, Length
multiplication_19 = Multiplication(A=simplify(vec_9.Vector), B=simplify(clean_2))

# ----
integer_division = IntegerDivision(A=range_11, B="2")

# ---- group: Creating Squares for the vault (not Triangles)
dom_13 = ConstructDomain(DomainStart="0", DomainEnd=steps_to_rise_heigth)
range_13 = Range(Domain=dom_13, Steps=steps_to_rise_heigth)

# ---- group: Creating Squares for the vault (not Triangles) / Creating vector to move triangles
multiplication_20 = Multiplication(A=steps_to_rise_heigth, B="2")
division_22 = Division(A=size_m, B=multiplication_20)
item_12 = ListItem(List=division_22, Index=0, Wrap=True)  # -> Item, Item1
vec_10 = VectorXYZ(XComponent=0, YComponent=item_12.Item, ZComponent=0)  # -> Vector, Length
multiplication_21 = Multiplication(A=simplify(vec_10.Vector), B=simplify(range_13))

# ---- group: Creating Triangles / Scaling and Moving Triangles
move_11 = Move(Geometry=simplify(graft(move_8.Geometry)), Motion=multiplication_19)  # -> simplify(Geometry), Transform

# ----
multiplication_22 = Multiplication(A=clean_2, B=2)

# ---- group: Creating Squares for the vault (not Triangles) / Scaling and Moving Triangles
move_12 = Move(Geometry=simplify(graft(move_6.Geometry)), Motion=multiplication_21)  # -> simplify(Geometry), Transform

# ---- group: Selecting Overlaping Squares
lastdex_14 = LastIndex(List=move_12.Geometry)
cull_i_13 = CullIndex(List=move_12.Geometry, Indices=lastdex_14, Wrap=True)  # -> simplify(List)
panel_21 = Panel("""1
0""")
panel_22 = Panel("""0
1""")
cull_3 = CullPattern(List=cull_i_13, CullPattern=panel_22)
cull_4 = CullPattern(List=cull_i_13, CullPattern=panel_21)
flip_2 = FlipMatrix(Data=cull_4)
flip_3 = FlipMatrix(Data=cull_3)
panel_23 = Panel("""1
0""")
panel_24 = Panel("""0
1""")
cull_5 = CullPattern(List=flip_3, CullPattern=panel_23)
cull_6 = CullPattern(List=flip_2, CullPattern=panel_24)

lastdex_15 = LastIndex(List=move_11.Geometry)
cull_i_14 = CullIndex(List=move_11.Geometry, Indices=lastdex_15, Wrap=True)  # -> simplify(List)
panel_25 = Panel("""1
0""")
panel_26 = Panel("""0
1""")
cull_7 = CullPattern(List=cull_i_14, CullPattern=panel_26)
cull_8 = CullPattern(List=cull_i_14, CullPattern=panel_25)
flip_4 = FlipMatrix(Data=cull_8)
flip_5 = FlipMatrix(Data=cull_7)
panel_27 = Panel("""1
0""")
panel_28 = Panel("""0
1""")
cull_9 = CullPattern(List=flip_5, CullPattern=panel_27)
cull_10 = CullPattern(List=flip_4, CullPattern=panel_28)

# ---- group: Organizing Piece A.1 bricks by level
flip_6 = FlipMatrix(Data=cull_9)
flip_7 = FlipMatrix(Data=cull_10)
# C. Organizing Pieces bricks by level
bang = ExplodeTree(Data=flip_7)  # -> Branch0, Branch1, Branch2, Branch3, Branch4, Branch5, Branch6, Branch7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
bang_2 = ExplodeTree(Data=flip_6)  # -> Branch0, Branch1, Branch2, Branch3, Branch4, Branch5, Branch6, Branch7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
bang_3 = ExplodeTree(Data=cull)  # -> _0000, _0001, _0002, _0003, _0004, _0005, _0006, _0007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
bang_4 = ExplodeTree(Data=simplify(move_7.Geometry))  # -> Branch0, Branch1, Branch2, Branch3, Branch4, Branch5, Branch6, Branch7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
srf_2 = Surface([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])
relay = Relay([bang_4.Branch1, bang_3._0000])
srf_3 = Surface(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)
relay_2 = Relay([bang_2.Branch2, bang_3._0002, bang_4.Branch5])
relay_3 = Relay([bang_4.Branch6, bang.Branch2])
relay_4 = Relay([bang_4.Branch7, bang_3._0003, bang_2.Branch3])
relay_5 = Relay([bang_4.Branch9, bang_3._0004, bang_2.Branch4])
relay_6 = Relay([bang_4.Branch14, bang.Branch6])
relay_7 = Relay([bang_4.Branch21, bang_3._00010, bang_2.Branch10])
relay_8 = Relay([bang_2.Branch11, bang_3._00011, bang_4.Branch23])
relay_9 = Relay([bang.Branch0, bang_4.Branch2])
relay_10 = Relay([bang_4.Branch4, bang.Branch1])
relay_11 = Relay([bang_4.Branch8, bang.Branch3])
relay_12 = Relay([bang_4.Branch10, bang.Branch4])
relay_13 = Relay([bang_4.Branch11, bang_3._0005, bang_2.Branch5])
relay_14 = Relay([bang_4.Branch12, bang.Branch5])
relay_15 = Relay([bang_4.Branch13, bang_3._0006, bang_2.Branch6])
relay_16 = Relay([bang_4.Branch15, bang_3._0007, bang_2.Branch7])
relay_17 = Relay([bang_4.Branch16, bang.Branch7])
relay_18 = Relay([bang_3._0008, bang_2.Branch8, bang_4.Branch17])
relay_19 = Relay([bang.Branch8, bang_4.Branch18])
relay_20 = Relay([bang_4.Branch19, bang_3._0009, bang_2.Branch9])
relay_21 = Relay([bang_4.Branch20, bang.Branch9])
relay_22 = Relay([bang_4.Branch22, bang.Branch10])
relay_23 = Relay([bang_4.Branch3, bang_3._0001, bang_2.Branch1])
srf_4 = Surface(bang_4.Branch0)
srf_5 = Surface(relay)
srf_6 = Surface(relay_9)
srf_7 = Surface(relay_23)
srf_8 = Surface(relay_10)
srf_9 = Surface(relay_2)
srf_10 = Surface(relay_3)
srf_11 = Surface(relay_4)
srf_12 = Surface(relay_11)
srf_13 = Surface(relay_5)
srf_14 = Surface(relay_12)
srf_15 = Surface(relay_13)
srf_16 = Surface(relay_14)
srf_17 = Surface(relay_15)
srf_18 = Surface(relay_6)
srf_19 = Surface(relay_16)
srf_20 = Surface(relay_17)
srf_21 = Surface(relay_18)
srf_22 = Surface(relay_20)
srf_23 = Surface(relay_21)
srf_24 = Surface(relay_7)
srf_25 = Surface(relay_22)
srf_26 = Surface([relay_8, srf_3])
srf_27 = Surface(relay_19)

# ----
flip_8 = FlipMatrix(Data=cull_9)
flip_9 = FlipMatrix(Data=cull_10)
bang_5 = ExplodeTree(Data=flip_9)  # -> Branch0, Branch1, Branch2, Branch3, Branch4, Branch5, Branch6, Branch7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
bang_6 = ExplodeTree(Data=flip_8)  # -> Branch0, Branch1, Branch2, Branch3, Branch4, Branch5, Branch6, Branch7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
bang_7 = ExplodeTree(Data=cull)  # -> _0000, _0001, _0002, _0003, _0004, _0005, _0006, _0007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
bang_8 = ExplodeTree(Data=simplify(move_7.Geometry))  # -> Branch0, Branch1, Branch2, Branch3, Branch4, Branch5, Branch6, Branch7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
srf_28 = Surface(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)
srf_29 = Surface(bang_8.Branch0)
srf_30 = Surface([bang_8.Branch1, bang_7._0000])
srf_31 = Surface([bang_5.Branch0, bang_8.Branch2, srf_29])
srf_32 = Surface([bang_8.Branch3, bang_7._0001, bang_6.Branch1, srf_30])
srf_33 = Surface([bang_8.Branch4, bang_5.Branch1, srf_31])
srf_34 = Surface([bang_6.Branch2, bang_7._0002, bang_8.Branch5, srf_32])
srf_35 = Surface([bang_8.Branch6, bang_5.Branch2, srf_33])
srf_36 = Surface([bang_8.Branch7, bang_7._0003, bang_6.Branch3, srf_34])
srf_37 = Surface([bang_8.Branch8, bang_5.Branch3, srf_35])
srf_38 = Surface([bang_8.Branch9, bang_7._0004, bang_6.Branch4, srf_36])
srf_39 = Surface([bang_8.Branch10, bang_5.Branch4, srf_37])
srf_40 = Surface([bang_8.Branch11, bang_7._0005, bang_6.Branch5, srf_38])
srf_41 = Surface([bang_8.Branch12, bang_5.Branch5, srf_39])
srf_42 = Surface([bang_8.Branch13, bang_7._0006, bang_6.Branch6, srf_40])
srf_43 = Surface([bang_8.Branch15, bang_7._0007, bang_6.Branch7, srf_42])
srf_44 = Surface([bang_8.Branch14, bang_5.Branch6, srf_41])
srf_45 = Surface([bang_8.Branch16, bang_5.Branch7, srf_44])
srf_46 = Surface([bang_7._0008, bang_6.Branch8, bang_8.Branch17, srf_43])
srf_47 = Surface([bang_5.Branch8, bang_8.Branch18, srf_45])
srf_48 = Surface([bang_8.Branch19, bang_7._0009, bang_6.Branch9, srf_46])
srf_49 = Surface([bang_8.Branch20, bang_5.Branch9, srf_47])
srf_50 = Surface([bang_8.Branch21, bang_7._00010, bang_6.Branch10, srf_48])
srf_51 = Surface([bang_8.Branch22, bang_5.Branch10, srf_49])
srf_52 = Surface([bang_6.Branch11, bang_7._00011, bang_8.Branch23, srf_28, srf_50])

# ---- group: Central Axis and mirror plane
Z_2 = UnitZ(Factor=1)
move_13 = Move(Geometry=_1_4, Motion=Z_2)  # -> Geometry, Transform
ln_2 = Line(StartPoint=_1_4, EndPoint=move_13.Geometry)
pl_3pt_2 = Plane3Pt(PointA=_1, PointB=_1_7, PointC=move_13.Geometry)

Z_3 = UnitZ(Factor=1)
move_14 = Move(Geometry=_1_4, Motion=Z_3)  # -> Geometry, Transform
ln_3 = Line(StartPoint=_1_4, EndPoint=move_14.Geometry)
pl_3pt_3 = Plane3Pt(PointA=_1, PointB=_1_7, PointC=move_14.Geometry)

# ---- group: Materials
division_23 = Division(A="4.4", B=Slider(2.9, range=0..10))
matprops = MaterialPropertiesKaramba3D(
    FamilyOfMaterial="Composite",
    Name="Mud Brick",
    YoungsModulus_kN_cm2="4.4",
    InPlaneShearModulus_kN_cm2=division_23,
    TransverseShearModulus_kN_cm2=division_23,
    SpecificWeight_kN_m3="14.71",
    CoefficientOfThermalExpansion_1_C=1e-05,
    YieldStrength_kN_cm2=23.5,
    mode="Isotrop")
matselect = MaterialSelectionKaramba3D(Materials=matprops, menu=[dropdown(1), dropdown(1)])

division_24 = Division(A="4.4", B=Slider(2.9, range=0..10))
matprops_2 = MaterialPropertiesKaramba3D(
    FamilyOfMaterial="Composite",
    Name="Mud Brick",
    YoungsModulus_kN_cm2="4.4",
    InPlaneShearModulus_kN_cm2=division_24,
    TransverseShearModulus_kN_cm2=division_24,
    SpecificWeight_kN_m3="14.71",
    CoefficientOfThermalExpansion_1_C=1e-05,
    YieldStrength_kN_cm2=23.5,
    mode="Isotrop")
matselect_2 = MaterialSelectionKaramba3D(Materials=matprops_2, menu=[dropdown(1), dropdown(1)])

# ----
pt_4 = Point([Point(8.125, 0.03125, 2.079825139), Point(8.125, 2.96875, 2.079825139), Point(8.03125, 0.125, 2.079825139), Point(10.875, 2.96875, 2.079825139), Point(8.03125, 2.875, 2.079825139), Point(10.96875, 0.125, 2.079825139)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])
dup = DuplicateData(Data="1", Number="384", Order=True)
dup_2 = DuplicateData(Data="1", Number="384", Order=True)

# ----
# A. Regular mesh Generation
# B. Dinamic Relaxation (Kangaroo)
# Liberate relaxed mesh to Bricks  Shape Generation
# C. Organizing Pieces bricks by level
# D. Extruding pieces (A1, A2, B1, B2, C1 and C2)
# E. Generating pieces in 8 positions
# F. Mixign pieces and geting modules
# Nodes
# Elements
# Pasing information to karamba solver
dam = DataDam(DataA=unifynormals, BufferDelay=10000000, BufferMode=0)

mesh = Mesh(dam)

# ---- group: Kangoroo Inputs
edgelengths = EdgeLengths(Mesh=mesh, LengthFactor=number_slider, Strength=number_slider_2)
show = Show(G=mesh)
vertexloads = VertexLoads(Mesh=mesh, Strength=number_slider_3)

# ---- group: Creating Points to target and anchor
nakededge = MeshNakedEdge(Mesh=mesh)  # -> V, A, B

# ---- group: Restrictions / Coplanar Restrictions
bang_9 = ExplodeTree(Data=rotax_2.Geometry)  # -> Branch0, Branch1, Branch2, Branch3, Branch4, Branch5, Branch6, Branch7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
cluster = Cluster(P=nakededge.V, C=bang_9.Branch21)
cluster_2 = Cluster(P=nakededge.V, C=bang_9.Branch11)
cluster_3 = Cluster(P=nakededge.V, C=bang_9.Branch1)
cluster_4 = Cluster(P=nakededge.V, C=bang_9.Branch22)
cluster_5 = Cluster(P=nakededge.V, C=bang_9.Branch12)
cluster_6 = Cluster(P=nakededge.V, C=bang_9.Branch2)
cluster_7 = Cluster(P=nakededge.V, C=bang_9.Branch23)
cluster_8 = Cluster(P=nakededge.V, C=bang_9.Branch13)
cluster_9 = Cluster(P=nakededge.V, C=bang_9.Branch3)
cluster_10 = Cluster(P=nakededge.V, C=bang_9.Branch24)
cluster_11 = Cluster(P=nakededge.V, C=bang_9.Branch14)
cluster_12 = Cluster(P=nakededge.V, C=bang_9.Branch4)
cluster_13 = Cluster(P=nakededge.V, C=bang_9.Branch25)
cluster_14 = Cluster(P=nakededge.V, C=bang_9.Branch15)
cluster_15 = Cluster(P=nakededge.V, C=bang_9.Branch5)
cluster_16 = Cluster(P=nakededge.V, C=bang_9.Branch26)
cluster_17 = Cluster(P=nakededge.V, C=bang_9.Branch16)
cluster_18 = Cluster(P=nakededge.V, C=bang_9.Branch6)
cluster_19 = Cluster(P=nakededge.V, C=bang_9.Branch27)
cluster_20 = Cluster(P=nakededge.V, C=bang_9.Branch17)
cluster_21 = Cluster(P=nakededge.V, C=bang_9.Branch7)
cluster_22 = Cluster(P=nakededge.V, C=bang_9.Branch28)
cluster_23 = Cluster(P=nakededge.V, C=bang_9.Branch18)
cluster_24 = Cluster(P=nakededge.V, C=bang_9.Branch8)
cluster_25 = Cluster(P=nakededge.V, C=bang_9.Branch19)
cluster_26 = Cluster(P=nakededge.V, C=bang_9.Branch9)
cluster_27 = Cluster(P=nakededge.V, C=bang_9.Branch20)
cluster_28 = Cluster(P=nakededge.V, C=bang_9.Branch10)
data = Data([cluster_3, cluster_6, cluster_9, cluster_12, cluster_15, cluster_18, cluster_21, cluster_24, cluster_26, cluster_28, cluster_2, cluster_5, cluster_8, cluster_11, cluster_14, cluster_17, cluster_20, cluster_23, cluster_25, cluster_27, cluster, cluster_4, cluster_7, cluster_10, cluster_13, cluster_16, cluster_19, cluster_22])

# ---- group: Restrictions / Anchor Points
crv_cp = CurveClosestPoint(Point=nakededge.V, Curve=graft(bang_9.Branch0))  # -> simplify(flatten(Point)), Parameter, Distance
mc = MeshCorners(Mesh=mesh, Angle=2.35619449)
anchor = Anchor(Point=flatten([mc, crv_cp.Point]), Strength=10000)

# ---- group: Restrictions / Vertical Restriction
anchorxyz = AnchorXYZ(Point=nakededge.V, X=Toggle(True), Y=False, Z=False, Strength=1000)
anchorxyz_2 = AnchorXYZ(Point=nakededge.V, X=False, Y=Toggle(True), Z=False, Strength=1000)

# ---- group: Protecting canguro null requirements
subtraction_2 = Subtraction(A=steps_to_rise_heigth, B=1)
split = SplitList(List=data, Index=subtraction_2)  # -> ListA, ListB

# ---- group: Solver
solver = Solver(
    GoalObjects=flatten([edgelengths, vertexloads, show, anchor, anchorxyz, anchorxyz_2, cluster_3, split.ListA]),
    Reset=[Button(), reset_relaxation],
    Threshold=1e-15,
    Tolerance=0.01,
    On=kangaroo_on_off)  # -> I, V, O
item_13 = ListItem(List=solver.O, Index="0", Wrap=True)

# ----
dam_2 = DataDam(DataA=item_13, BufferDelay=10000000, BufferMode=0)

# ---- group: Calculating Vectors to extrude
mesh_2 = Mesh(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)
merge = Merge(Data1=dam_2, Data2=mesh_2)
pt_5 = Point(_1_3)
xz = XZPlane(Origin=pt_5)
item_14 = ListItem(List=merge, Index=list, Wrap=True)
demesh = DeconstructMesh(Mesh=item_14)  # -> Vertices, Faces, Colours, Normals
cp = PlaneClosestPoint(Point=demesh.Vertices, Plane=xz)  # -> Point, UVPoint, Distance
sort = SortList(Keys=cp.Distance, ValuesA=demesh.Vertices)  # -> Keys, ValuesA
multiplication_23 = Multiplication(A=sort.Keys, B="-1")
smaller = SmallerThan(FirstNumber=multiplication_23, SecondNumber=Slider(0.01, range=0..1))  # -> SmallerThan, OrEqualTo
cull_11 = CullPattern(List=sort.ValuesA, CullPattern=smaller.SmallerThan)
cullpt = CullDuplicates(Points=cull_11, Tolerance=Slider(0.01, range=0..0.1), CullMode=3)  # -> Points, Indices, Valence
anchor_points = Point(cullpt.Points)
yz = YZPlane(Origin=pt_5)
cp_2 = PlaneClosestPoint(Point=anchor_points, Plane=yz)  # -> Point, UVPoint, Distance
sort_2 = SortList(Keys=cp_2.Distance, ValuesA=anchor_points)  # -> Keys, reverse(ValuesA)
dom_14 = ConstructDomain(DomainStart=0, DomainEnd=steps_to_rise_heigth)
subset = SubList(List=sort_2.ValuesA, Domain=dom_14, Wrap=True)  # -> List, Index
xy_3 = XYPlane(Origin=Point(0, 0, 0))
project = Project(Geometry=subset.List, Plane=xy_3)  # -> Geometry, Transform
dist = Distance(PointA=subset.List, PointB=project.Geometry)
sort_3 = SortList(Keys=dist)  # -> Keys, ValuesA
lastdex_16 = LastIndex(List=sort_3.Keys)
item_15 = ListItem(List=sort_3.Keys, Index=lastdex_16, Wrap=True)
panel_29 = Panel(sort_3.Keys)
subtraction_3 = Subtraction(A=panel, B=item_15)
addition_2 = Addition(A=subtraction_3, B=dist)
Z_4 = UnitZ(Factor=dist)  # -> graft(UnitVector)

# ---- group: Peace A
# D. Extruding pieces (A1, A2, B1, B2, C1 and C2)
panel_30 = Panel("0")
bang_10 = ExplodeTree(Data=simplify(Z_4))  # -> Branch0, Branch1, Branch2, Branch3, Branch4, Branch5, Branch6, Branch7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
vec_11 = VectorXYZ(XComponent=panel_30, YComponent=panel_30, ZComponent=panel_30)  # -> Vector, Length
cluster_29 = Cluster_3(G=srf_15, step_floor=bang_10.Branch11, step_roof=bang_10.Branch12)  # -> E, C, L
cluster_30 = Cluster_3(G=srf_20, step_floor=bang_10.Branch16, step_roof=bang_10.Branch17)  # -> E, C, L
cluster_31 = Cluster_3(G=srf_24, step_floor=bang_10.Branch21, step_roof=bang_10.Branch22)  # -> E, C, L
cluster_32 = Cluster_3(G=srf_6, step_floor=vec_11.Vector, step_roof=bang_10.Branch2)  # -> E, C, L
cluster_33 = Cluster_3(G=srf_10, step_floor=bang_10.Branch6, step_roof=bang_10.Branch7)  # -> E, C, L
extr = Extrude(Base=srf_2, Direction=bang_10.Branch0)
cluster_34 = Cluster_3(G=srf_11, step_floor=bang_10.Branch7, step_roof=bang_10.Branch8)  # -> E, C, L
cluster_35 = Cluster_3(G=srf_16, step_floor=bang_10.Branch12, step_roof=bang_10.Branch13)  # -> E, C, L
cluster_36 = Cluster_3(G=srf_6, step_floor=bang_10.Branch2, step_roof=bang_10.Branch3)  # -> E, C, L
cluster_37 = Cluster_3(G=srf_21, step_floor=bang_10.Branch17, step_roof=bang_10.Branch18)  # -> E, C, L
cluster_38 = Cluster_3(G=srf_25, step_floor=bang_10.Branch22, step_roof=bang_10.Branch23)  # -> E, C, L
cluster_39 = Cluster_3(G=srf_12, step_floor=bang_10.Branch8, step_roof=bang_10.Branch9)  # -> E, C, L
cluster_40 = Cluster_3(G=srf_7, step_floor=bang_10.Branch3, step_roof=bang_10.Branch4)  # -> E, C, L
cluster_41 = Cluster_3(G=srf_27, step_floor=bang_10.Branch18, step_roof=bang_10.Branch19)  # -> E, C, L
cluster_42 = Cluster_3(G=srf_17, step_floor=bang_10.Branch13, step_roof=bang_10.Branch14)  # -> E, C, L
cluster_43 = Cluster_3(G=srf_26, step_floor=bang_10.Branch23, step_roof=bang_10.Branch24)  # -> E, C, L
cluster_44 = Cluster_3(G=srf_13, step_floor=bang_10.Branch9, step_roof=bang_10.Branch10)  # -> E, C, L
cluster_45 = Cluster_3(G=srf_8, step_floor=bang_10.Branch4, step_roof=bang_10.Branch5)  # -> E, C, L
cluster_46 = Cluster_3(G=srf_22, step_floor=bang_10.Branch19, step_roof=bang_10.Branch20)  # -> E, C, L
cluster_47 = Cluster_3(G=srf_18, step_floor=bang_10.Branch14, step_roof=bang_10.Branch15)  # -> E, C, L
cluster_48 = Cluster_3(step_floor=bang_10.Branch24, step_roof=bang_10.Branch25)  # -> E, C, L
cluster_49 = Cluster_3(G=srf_14, step_floor=bang_10.Branch10, step_roof=bang_10.Branch11)  # -> E, C, L
cluster_50 = Cluster_3(G=srf_9, step_floor=bang_10.Branch5, step_roof=bang_10.Branch6)  # -> E, C, L
cluster_51 = Cluster_3(G=srf_23, step_floor=bang_10.Branch20, step_roof=bang_10.Branch21)  # -> E, C, L
cluster_52 = Cluster_3(G=srf_19, step_floor=bang_10.Branch15, step_roof=bang_10.Branch16)  # -> E, C, L
brep = Brep([cluster_32.E, cluster_36.E, cluster_40.E, cluster_45.E, cluster_50.E, cluster_33.E, cluster_34.E, cluster_39.E, cluster_44.E, cluster_49.E, cluster_29.E, cluster_35.E, cluster_42.E, cluster_47.E, cluster_52.E, cluster_30.E, cluster_37.E, cluster_41.E, cluster_46.E, cluster_51.E, cluster_31.E, cluster_38.E, cluster_43.E, cluster_48.E])

bang_11 = ExplodeTree(Data=simplify(Z_4))  # -> Branch0, Branch1, Branch2, Branch3, Branch4, Branch5, Branch6, Branch7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
vec_12 = VectorXYZ(XComponent="0", YComponent="0", ZComponent="0")  # -> Vector, Length
cluster_53 = Cluster_3(G=srf_40, step_floor=bang_11.Branch11, step_roof=bang_11.Branch12)  # -> E, C, L
cluster_54 = Cluster_3(G=srf_45, step_floor=bang_11.Branch16, step_roof=bang_11.Branch17)  # -> E, C, L
cluster_55 = Cluster_3(G=srf_50, step_floor=bang_11.Branch21, step_roof=bang_11.Branch22)  # -> E, C, L
cluster_56 = Cluster_3(G=srf_31, step_floor=vec_12.Vector, step_roof=bang_11.Branch2)  # -> E, C, L
cluster_57 = Cluster_3(G=srf_35, step_floor=bang_11.Branch6, step_roof=bang_11.Branch7)  # -> E, C, L
extr_2 = Extrude(Base=srf_29, Direction=bang_11.Branch0)
cluster_58 = Cluster_3(G=srf_36, step_floor=bang_11.Branch7, step_roof=bang_11.Branch8)  # -> E, C, L
cluster_59 = Cluster_3(G=srf_41, step_floor=bang_11.Branch12, step_roof=bang_11.Branch13)  # -> E, C, L
cluster_60 = Cluster_3(G=srf_31, step_floor=bang_11.Branch2, step_roof=bang_11.Branch3)  # -> E, C, L
cluster_61 = Cluster_3(G=srf_46, step_floor=bang_11.Branch17, step_roof=bang_11.Branch18)  # -> E, C, L
cluster_62 = Cluster_3(G=srf_51, step_floor=bang_11.Branch22, step_roof=bang_11.Branch23)  # -> E, C, L
cluster_63 = Cluster_3(G=srf_37, step_floor=bang_11.Branch8, step_roof=bang_11.Branch9)  # -> E, C, L
cluster_64 = Cluster_3(G=srf_32, step_floor=bang_11.Branch3, step_roof=bang_11.Branch4)  # -> E, C, L
cluster_65 = Cluster_3(G=srf_47, step_floor=bang_11.Branch18, step_roof=bang_11.Branch19)  # -> E, C, L
cluster_66 = Cluster_3(G=srf_42, step_floor=bang_11.Branch13, step_roof=bang_11.Branch14)  # -> E, C, L
cluster_67 = Cluster_3(G=srf_52, step_floor=bang_11.Branch23, step_roof=bang_11.Branch24)  # -> E, C, L
cluster_68 = Cluster_3(G=srf_38, step_floor=bang_11.Branch9, step_roof=bang_11.Branch10)  # -> E, C, L
cluster_69 = Cluster_3(G=srf_33, step_floor=bang_11.Branch4, step_roof=bang_11.Branch5)  # -> E, C, L
cluster_70 = Cluster_3(G=srf_48, step_floor=bang_11.Branch19, step_roof=bang_11.Branch20)  # -> E, C, L
cluster_71 = Cluster_3(G=srf_44, step_floor=bang_11.Branch14, step_roof=bang_11.Branch15)  # -> E, C, L
cluster_72 = Cluster_3(step_floor=bang_11.Branch24, step_roof=bang_11.Branch25)  # -> E, C, L
cluster_73 = Cluster_3(G=srf_39, step_floor=bang_11.Branch10, step_roof=bang_11.Branch11)  # -> E, C, L
cluster_74 = Cluster_3(G=srf_49, step_floor=bang_11.Branch20, step_roof=bang_11.Branch21)  # -> E, C, L
cluster_75 = Cluster_3(G=srf_43, step_floor=bang_11.Branch15, step_roof=bang_11.Branch16)  # -> E, C, L
cluster_76 = Cluster_3(G=srf_34, step_floor=bang_11.Branch5, step_roof=bang_11.Branch6)  # -> E, C, L
brep_2 = Brep([cluster_56.E, cluster_60.E, cluster_64.E, cluster_69.E, cluster_76.E, cluster_57.E, cluster_58.E, cluster_63.E, cluster_68.E, cluster_73.E, cluster_53.E, cluster_59.E, cluster_66.E, cluster_71.E, cluster_75.E, cluster_54.E, cluster_61.E, cluster_65.E, cluster_70.E, cluster_74.E, cluster_55.E, cluster_62.E, cluster_67.E, cluster_72.E])

# ----
dam_3 = DataDam(DataA=brep_2, BufferDelay=10000000, BufferMode=0)
cluster_77 = Cluster_5(G=srf_52, step_floor=bang_11.Branch24, A=Slider(10, range=0..10))  # -> E, L

# ---- group: Peace "A.1" Generation (8 ones)
data_2 = Data(dam_3)
mirror_2 = Mirror(Geometry=data_2, Plane=pl_3pt)  # -> Geometry, Transform
rad_3 = Radians(Degrees="180")
rad_4 = Radians(Degrees="90")
rad_5 = Radians(Degrees="270")
rad_6 = Radians(Degrees="180")
rad_7 = Radians(Degrees="90")
rad_8 = Radians(Degrees="270")
rotax_3 = RotateAxis(Geometry=graft(data_2), Angle=rad_8, Axis=ln)  # -> Geometry, Transform
rotax_4 = RotateAxis(Geometry=graft(data_2), Angle=rad_3, Axis=ln)  # -> Geometry, Transform
rotax_5 = RotateAxis(Geometry=graft(mirror_2.Geometry), Angle=rad_5, Axis=ln)  # -> Geometry, Transform
rotax_6 = RotateAxis(Geometry=graft(mirror_2.Geometry), Angle=rad_6, Axis=ln)  # -> Geometry, Transform
rotax_7 = RotateAxis(Geometry=graft(mirror_2.Geometry), Angle=rad_4, Axis=ln)  # -> Geometry, Transform
rotax_8 = RotateAxis(Geometry=graft(data_2), Angle=rad_7, Axis=ln)  # -> Geometry, Transform
data_3 = Data(data_2)
data_4 = Data(mirror_2.Geometry)

# ---- group: OOOO
vec_13 = VectorXYZ(XComponent="8", YComponent=0, ZComponent=0)  # -> Vector, Length
move_15 = Move(
    Geometry=[rotax_6.Geometry, rotax_8.Geometry, rotax_5.Geometry, rotax_4.Geometry, data_4, rotax_3.Geometry, rotax_7.Geometry, data_3],
    Motion=vec_13.Vector)  # -> Geometry, Transform

# ---- group: Creating Lines / Level
cluster_78 = Cluster_4(
    data_2=cluster_55.L,
    P=pl_3pt_2,
    data=cluster_55.E,
    P_2=pl_3pt_2,
    rotation_axis=ln_2,
    elem_id="CS Beam level 19",
    id="CS Beam level 19")  # -> C, ip, elem

cluster_79 = Cluster_4(
    data_2=cluster_54.L,
    P=pl_3pt_2,
    data=cluster_54.E,
    P_2=pl_3pt_2,
    rotation_axis=ln_2,
    elem_id="CS Beam level 14",
    id="CS Beam level 14")  # -> C, ip, elem

cluster_80 = Cluster_4(
    data_2=cluster_53.L,
    P=pl_3pt_2,
    data=cluster_53.E,
    P_2=pl_3pt_2,
    rotation_axis=ln_2,
    elem_id="CS Beam level 9",
    id="CS Beam level 9")  # -> C, ip, elem

cluster_81 = Cluster_4(
    data_2=cluster_31.L,
    P=pl_3pt_3,
    data=cluster_31.E,
    P_2=pl_3pt_3,
    rotation_axis=ln_3,
    elem_id="CS Beam level 19",
    id="CS Beam level 19")  # -> C, ip, elem

cluster_82 = Cluster_4(
    data_2=cluster_30.L,
    P=pl_3pt_3,
    data=cluster_30.E,
    P_2=pl_3pt_3,
    rotation_axis=ln_3,
    elem_id="CS Beam level 14",
    id="CS Beam level 14")  # -> C, ip, elem

cluster_83 = Cluster_4(
    data_2=cluster_57.L,
    P=pl_3pt_2,
    data=cluster_57.E,
    P_2=pl_3pt_2,
    rotation_axis=ln_2,
    elem_id="CS Beam level 5",
    id="CS Beam level 5")  # -> C, ip, elem

cluster_84 = Cluster_4(
    data_2=cluster_29.L,
    P=pl_3pt_3,
    data=cluster_29.E,
    P_2=pl_3pt_3,
    rotation_axis=ln_3,
    elem_id="CS Beam level 9",
    id="CS Beam level 9")  # -> C, ip, elem

cluster_85 = Cluster_4(
    data_2=cluster_33.L,
    P=pl_3pt_3,
    data=cluster_33.E,
    P_2=pl_3pt_3,
    rotation_axis=ln_3,
    elem_id="CS Beam level 5",
    id="CS Beam level 5")  # -> C, ip, elem

cluster_86 = Cluster_4(
    data_2=cluster_56.L,
    P=pl_3pt_2,
    data=cluster_56.E,
    P_2=pl_3pt_2,
    rotation_axis=ln_2,
    elem_id="CS Beam level 1",
    id="CS Beam level 1")  # -> C, ip, elem

cluster_87 = Cluster_4(
    data_2=cluster_32.L,
    P=pl_3pt_3,
    data=cluster_32.E,
    P_2=pl_3pt_3,
    rotation_axis=ln_3,
    elem_id="CS Beam level 1",
    id="CS Beam level 1")  # -> C, ip, elem

cluster_88 = Cluster_4(
    data_2=cluster_63.L,
    P=pl_3pt_2,
    data=cluster_63.E,
    P_2=pl_3pt_2,
    rotation_axis=ln_2,
    elem_id="CS Beam level 7",
    id="CS Beam level 7")  # -> C, ip, elem

cluster_89 = Cluster_4(
    data_2=cluster_62.L,
    P=pl_3pt_2,
    data=cluster_62.E,
    P_2=pl_3pt_2,
    rotation_axis=ln_2,
    elem_id="CS Beam level 20",
    id="CS Beam level 20")  # -> C, ip, elem

cluster_90 = Cluster_4(
    data_2=cluster_61.L,
    P=pl_3pt_2,
    data=cluster_61.E,
    P_2=pl_3pt_2,
    rotation_axis=ln_2,
    elem_id="CS Beam level 15",
    id="CS Beam level 15")  # -> C, ip, elem

cluster_91 = Cluster_4(
    data_2=cluster_39.L,
    P=pl_3pt_3,
    data=cluster_39.E,
    P_2=pl_3pt_3,
    rotation_axis=ln_3,
    elem_id="CS Beam level 7",
    id="CS Beam level 7")  # -> C, ip, elem

cluster_92 = Cluster_4(
    data_2=cluster_38.L,
    P=pl_3pt_3,
    data=cluster_38.E,
    P_2=pl_3pt_3,
    rotation_axis=ln_3,
    elem_id="CS Beam level 20",
    id="CS Beam level 20")  # -> C, ip, elem

cluster_93 = Cluster_4(
    data_2=cluster_59.L,
    P=pl_3pt_2,
    data=cluster_59.E,
    P_2=pl_3pt_2,
    rotation_axis=ln_2,
    elem_id="CS Beam level 10",
    id="CS Beam level 10")  # -> C, ip, elem

cluster_94 = Cluster_4(
    data_2=cluster_37.L,
    P=pl_3pt_3,
    data=cluster_37.E,
    P_2=pl_3pt_3,
    rotation_axis=ln_3,
    elem_id="CS Beam level 15",
    id="CS Beam level 15")  # -> C, ip, elem

cluster_95 = Cluster_4(
    data_2=cluster_35.L,
    P=pl_3pt_3,
    data=cluster_35.E,
    P_2=pl_3pt_3,
    rotation_axis=ln_3,
    elem_id="CS Beam level 10",
    id="CS Beam level 10")  # -> C, ip, elem

cluster_96 = Cluster_4(
    data_2=cluster_58.L,
    P=pl_3pt_2,
    data=cluster_58.E,
    P_2=pl_3pt_2,
    rotation_axis=ln_2,
    elem_id="CS Beam level 6",
    id="CS Beam level 6")  # -> C, ip, elem

cluster_97 = Cluster_4(
    data_2=cluster_34.L,
    P=pl_3pt_3,
    data=cluster_34.E,
    P_2=pl_3pt_3,
    rotation_axis=ln_3,
    elem_id="CS Beam level 6",
    id="CS Beam level 6")  # -> C, ip, elem

cluster_98 = Cluster_4(
    data_2=cluster_60.L,
    P=pl_3pt_2,
    data=cluster_60.E,
    P_2=pl_3pt_2,
    rotation_axis=ln_2,
    elem_id="CS Beam level 2",
    id="CS Beam level 2")  # -> C, ip, elem

cluster_99 = Cluster_4(
    data_2=cluster_36.L,
    P=pl_3pt_3,
    data=cluster_36.E,
    P_2=pl_3pt_3,
    rotation_axis=ln_3,
    elem_id="CS Beam level 2",
    id="CS Beam level 2")  # -> C, ip, elem

cluster_100 = Cluster_4(
    data_2=cluster_67.L,
    P=pl_3pt_2,
    data=cluster_67.E,
    P_2=pl_3pt_2,
    rotation_axis=ln_2,
    elem_id="CS Beam level 21",
    id="CS Beam level 21")  # -> C, ip, elem

cluster_101 = Cluster_4(
    data_2=cluster_43.L,
    P=pl_3pt_3,
    data=cluster_43.E,
    P_2=pl_3pt_3,
    rotation_axis=ln_3,
    elem_id="CS Beam level 21",
    id="CS Beam level 21")  # -> C, ip, elem

cluster_102 = Cluster_4(
    data_2=cluster_66.L,
    P=pl_3pt_2,
    data=cluster_66.E,
    P_2=pl_3pt_2,
    rotation_axis=ln_2,
    elem_id="CS Beam level 11",
    id="CS Beam level 11")  # -> C, ip, elem

cluster_103 = Cluster_4(
    data_2=cluster_65.L,
    P=pl_3pt_2,
    data=cluster_65.E,
    P_2=pl_3pt_2,
    rotation_axis=ln_2,
    elem_id="CS Beam level 16",
    id="CS Beam level 16")  # -> C, ip, elem

cluster_104 = Cluster_4(
    data_2=cluster_42.L,
    P=pl_3pt_3,
    data=cluster_42.E,
    P_2=pl_3pt_3,
    rotation_axis=ln_3,
    elem_id="CS Beam level 11",
    id="CS Beam level 11")  # -> C, ip, elem

cluster_105 = Cluster_4(
    data_2=cluster_41.L,
    P=pl_3pt_3,
    data=cluster_41.E,
    P_2=pl_3pt_3,
    rotation_axis=ln_3,
    elem_id="CS Beam level 16",
    id="CS Beam level 16")  # -> C, ip, elem

cluster_106 = Cluster_4(
    data_2=cluster_64.L,
    P=pl_3pt_2,
    data=cluster_64.E,
    P_2=pl_3pt_2,
    rotation_axis=ln_2,
    elem_id="CS Beam level 3",
    id="CS Beam level 3")  # -> C, ip, elem

cluster_107 = Cluster_4(
    data_2=cluster_40.L,
    P=pl_3pt_3,
    data=cluster_40.E,
    P_2=pl_3pt_3,
    rotation_axis=ln_3,
    elem_id="CS Beam level 3",
    id="CS Beam level 3")  # -> C, ip, elem

cluster_108 = Cluster_4(
    data_2=cluster_70.L,
    P=pl_3pt_2,
    data=cluster_70.E,
    P_2=pl_3pt_2,
    rotation_axis=ln_2,
    elem_id="CS Beam level 17",
    id="CS Beam level 17")  # -> C, ip, elem

cluster_109 = Cluster_4(
    data_2=cluster_46.L,
    P=pl_3pt_3,
    data=cluster_46.E,
    P_2=pl_3pt_3,
    rotation_axis=ln_3,
    elem_id="CS Beam level 17",
    id="CS Beam level 17")  # -> C, ip, elem

cluster_110 = Cluster_4(
    data_2=cluster_71.L,
    P=pl_3pt_2,
    data=cluster_71.E,
    P_2=pl_3pt_2,
    rotation_axis=ln_2,
    elem_id="CS Beam level 12",
    id="CS Beam level 12")  # -> C, ip, elem

cluster_111 = Cluster_4(
    data_2=cluster_77.L,
    P=pl_3pt_2,
    data=cluster_77.E,
    P_2=pl_3pt_2,
    rotation_axis=ln_2,
    elem_id="CS Beam level 27",
    id="CS Beam level 27")  # -> flatten(C), ip, elem

cluster_112 = Cluster_4(
    data_2=cluster_47.L,
    P=pl_3pt_3,
    data=cluster_47.E,
    P_2=pl_3pt_3,
    rotation_axis=ln_3,
    elem_id="CS Beam level 12",
    id="CS Beam level 12")  # -> C, ip, elem

cluster_113 = Cluster_4(data_2=cluster_48.L, P=pl_3pt_3, P_2=pl_3pt_3, rotation_axis=ln_3, elem_id="CS Beam level 27", id="CS Beam level 27")  # -> C, ip, elem

cluster_114 = Cluster_4(
    data_2=cluster_68.L,
    P=pl_3pt_2,
    data=cluster_68.E,
    P_2=pl_3pt_2,
    rotation_axis=ln_2,
    elem_id="CS Beam level 8",
    id="CS Beam level 8")  # -> C, ip, elem

cluster_115 = Cluster_4(
    data_2=cluster_44.L,
    P=pl_3pt_3,
    data=cluster_44.E,
    P_2=pl_3pt_3,
    rotation_axis=ln_3,
    elem_id="CS Beam level 8",
    id="CS Beam level 8")  # -> C, ip, elem

cluster_116 = Cluster_4(
    data_2=cluster_69.L,
    P=pl_3pt_2,
    data=cluster_69.E,
    P_2=pl_3pt_2,
    rotation_axis=ln_2,
    elem_id="CS Beam level 4",
    id="CS Beam level 4")  # -> C, ip, elem

cluster_117 = Cluster_4(
    data_2=cluster_45.L,
    P=pl_3pt_3,
    data=cluster_45.E,
    P_2=pl_3pt_3,
    rotation_axis=ln_3,
    elem_id="CS Beam level 4",
    id="CS Beam level 4")  # -> C, ip, elem

cluster_118 = Cluster_4(
    data_2=cluster_75.L,
    P=pl_3pt_2,
    data=cluster_75.E,
    P_2=pl_3pt_2,
    rotation_axis=ln_2,
    elem_id="CS Beam level 13",
    id="CS Beam level 13")  # -> C, ip, elem

cluster_119 = Cluster_4(
    data_2=cluster_74.L,
    P=pl_3pt_2,
    data=cluster_74.E,
    P_2=pl_3pt_2,
    rotation_axis=ln_2,
    elem_id="CS Beam level 18",
    id="CS Beam level 18")  # -> C, ip, elem

cluster_120 = Cluster_4(
    data_2=cluster_52.L,
    P=pl_3pt_3,
    data=cluster_52.E,
    P_2=pl_3pt_3,
    rotation_axis=ln_3,
    elem_id="CS Beam level 13",
    id="CS Beam level 13")  # -> C, ip, elem

cluster_121 = Cluster_4(
    data_2=cluster_51.L,
    P=pl_3pt_3,
    data=cluster_51.E,
    P_2=pl_3pt_3,
    rotation_axis=ln_3,
    elem_id="CS Beam level 18",
    id="CS Beam level 18")  # -> C, ip, elem

# ---- group: Geting Volume
null = NullItem(Item=flatten(move_15.Geometry))  # -> NullFlags, InvalidFlags, Description
dispatch = Dispatch(List=flatten(move_15.Geometry), DispatchPattern=null.NullFlags)  # -> ListA, ListB
volume = Volume(Geometry=dispatch.ListB)  # -> flatten(Volume), Centroid
ma = MassAddition(Input=volume.Volume)  # -> Result, PartialResults

# ---- group: Creating Lines / Level
cluster_122 = Cluster_4(
    data_2=cluster_73.L,
    P=pl_3pt_2,
    data=cluster_73.E,
    P_2=pl_3pt_2,
    rotation_axis=ln_2,
    elem_id="CS Beam level 8",
    id="CS Beam level 8")  # -> C, ip, elem

cluster_123 = Cluster_4(
    data_2=cluster_49.L,
    P=pl_3pt_3,
    data=cluster_49.E,
    P_2=pl_3pt_3,
    rotation_axis=ln_3,
    elem_id="CS Beam level 8",
    id="CS Beam level 8")  # -> C, ip, elem

cluster_124 = Cluster_4(
    data_2=cluster_76.L,
    P=pl_3pt_2,
    data=cluster_76.E,
    P_2=pl_3pt_2,
    rotation_axis=ln_2,
    elem_id="CS Beam level 5",
    id="CS Beam level 5")  # -> C, ip, elem

# ---- group: Creating Lines
pt_6 = Point(cluster_111.C)
data_5 = Data([cluster_86.elem, cluster_98.elem, cluster_116.elem, cluster_124.elem, cluster_83.elem, cluster_96.elem, cluster_88.elem, cluster_114.elem, cluster_106.elem, cluster_122.elem, cluster_80.elem, cluster_93.elem, cluster_102.elem, cluster_110.elem, cluster_118.elem, cluster_79.elem, cluster_90.elem, cluster_103.elem, cluster_108.elem, cluster_78.elem, cluster_89.elem, cluster_100.elem, cluster_111.elem, cluster_119.elem])
null_2 = NullItem(Item=flatten(pt_6))  # -> NullFlags, InvalidFlags, Description
dispatch_2 = Dispatch(List=flatten(pt_6), DispatchPattern=null_2.NullFlags)  # -> ListA, ListB

# ----
dam_4 = DataDam(DataA=data_5, BufferDelay=10000000, BufferMode=0)

# ---- group: Creating Lines / Level
cluster_125 = Cluster_4(
    data_2=cluster_50.L,
    P=pl_3pt_3,
    data=cluster_50.E,
    P_2=pl_3pt_3,
    rotation_axis=ln_3,
    elem_id="CS Beam level 5",
    id="CS Beam level 5")  # -> C, ip, elem

# ---- group: Creating Lines
pt_7 = Point(cluster_113.C)
data_6 = Data([cluster_87.elem, cluster_99.elem, cluster_117.elem, cluster_125.elem, cluster_85.elem, cluster_97.elem, cluster_91.elem, cluster_115.elem, cluster_107.elem, cluster_123.elem, cluster_84.elem, cluster_95.elem, cluster_104.elem, cluster_112.elem, cluster_120.elem, cluster_82.elem, cluster_94.elem, cluster_105.elem, cluster_109.elem, cluster_81.elem, cluster_92.elem, cluster_101.elem, cluster_113.elem, cluster_121.elem])
null_3 = NullItem(Item=flatten(pt_7))  # -> NullFlags, InvalidFlags, Description
dispatch_3 = Dispatch(List=flatten(pt_7), DispatchPattern=null_3.NullFlags)  # -> ListA, ListB

# ---- group: Points to Nodes
data_7 = Data([cluster_86.ip, cluster_98.ip, cluster_116.ip, cluster_124.ip, cluster_83.ip, cluster_96.ip, cluster_88.ip, cluster_114.ip, cluster_106.ip, cluster_122.ip, cluster_80.ip, cluster_93.ip, cluster_102.ip, cluster_110.ip, cluster_118.ip, cluster_79.ip, cluster_90.ip, cluster_103.ip, cluster_108.ip, cluster_78.ip, cluster_89.ip, cluster_100.ip, cluster_111.ip, cluster_119.ip])
panel_31 = Panel("0.005")
rdpoints = RemoveDuplicatePointsKaramba3D(Point=data_7, LimitDistance=panel_31)  # -> OutPoint, Info, Indexes

data_8 = Data([cluster_87.ip, cluster_99.ip, cluster_117.ip, cluster_125.ip, cluster_85.ip, cluster_97.ip, cluster_91.ip, cluster_115.ip, cluster_107.ip, cluster_123.ip, cluster_84.ip, cluster_95.ip, cluster_104.ip, cluster_112.ip, cluster_120.ip, cluster_82.ip, cluster_94.ip, cluster_105.ip, cluster_109.ip, cluster_81.ip, cluster_92.ip, cluster_101.ip, cluster_113.ip, cluster_121.ip])
panel_32 = Panel("0.005")
rdpoints_2 = RemoveDuplicatePointsKaramba3D(Point=data_8, LimitDistance=panel_32)  # -> OutPoint, Info, Indexes

# ---- group: Loking Anchor point from near centroides
xy_4 = XYPlane(Origin=Point(0, 0, 0))
cp_3 = PlaneClosestPoint(Point=rdpoints.OutPoint, Plane=xy_4)  # -> Point, UVPoint, Distance
sort_4 = SortList(Keys=cp_3.Distance, ValuesA=rdpoints.OutPoint)  # -> Keys, ValuesA
smaller_2 = SmallerThan(FirstNumber=sort_4.Keys, SecondNumber=Slider(0.078, range=0..1))  # -> SmallerThan, OrEqualTo
cull_12 = CullPattern(List=sort_4.ValuesA, CullPattern=smaller_2.SmallerThan)
cullpt_2 = CullDuplicates(Points=cull_12, Tolerance=Slider(0.01, range=0..0.01), CullMode=3)  # -> Points, Indices, Valence
anchor_points_2 = Point(cullpt_2.Points)

xy_5 = XYPlane(Origin=Point(0, 0, 0))
cp_4 = PlaneClosestPoint(Point=rdpoints_2.OutPoint, Plane=xy_5)  # -> Point, UVPoint, Distance
sort_5 = SortList(Keys=cp_4.Distance, ValuesA=rdpoints_2.OutPoint)  # -> Keys, ValuesA
smaller_3 = SmallerThan(FirstNumber=sort_5.Keys, SecondNumber=Slider(0.078, range=0..1))  # -> SmallerThan, OrEqualTo
cull_13 = CullPattern(List=sort_5.ValuesA, CullPattern=smaller_3.SmallerThan)
cullpt_3 = CullDuplicates(Points=cull_13, Tolerance=Slider(0.01, range=0..0.01), CullMode=3)  # -> Points, Indices, Valence
anchor_points_3 = Point(cullpt_3.Points)

# ----
cp_5 = ClosestPoint(Point=graft(pt_4), Cloud=dispatch_2.ListB)  # -> ClosestPoint, CPIndex, Distance

# ---- group: Anchor Points
supp = SupportKaramba3D(PosInd=flatten(anchor_points_2), menu=[buttons(on, on, on, off, off, off)])

supp_2 = SupportKaramba3D(PosInd=flatten(anchor_points_3), menu=[buttons(on, on, on, off, off, off)])

# ----
dam_5 = DataDam(DataA=brep, BufferDelay=10000000, BufferMode=0)
dam_6 = DataDam(DataA=data_6, BufferDelay=10000000, BufferMode=0)
dam_7 = DataDam(DataA=brep, BufferDelay=10000000, BufferMode=0)

# ---- group: Peace "A.1" Generation (8 ones)
# E. Generating pieces in 8 positions
data_9 = Data(dam_7)
mirror_3 = Mirror(Geometry=data_9, Plane=pl_3pt)  # -> Geometry, Transform
rad_9 = Radians(Degrees="180")
rad_10 = Radians(Degrees="90")
rad_11 = Radians(Degrees="270")
rad_12 = Radians(Degrees="180")
rad_13 = Radians(Degrees="90")
rad_14 = Radians(Degrees="270")
rotax_9 = RotateAxis(Geometry=graft(data_9), Angle=rad_14, Axis=ln)  # -> Geometry, Transform
rotax_10 = RotateAxis(Geometry=graft(data_9), Angle=rad_9, Axis=ln)  # -> Geometry, Transform
rotax_11 = RotateAxis(Geometry=graft(mirror_3.Geometry), Angle=rad_11, Axis=ln)  # -> Geometry, Transform
rotax_12 = RotateAxis(Geometry=graft(data_9), Angle=rad_13, Axis=ln)  # -> Geometry, Transform
rotax_13 = RotateAxis(Geometry=graft(mirror_3.Geometry), Angle=rad_10, Axis=ln)  # -> Geometry, Transform
rotax_14 = RotateAxis(Geometry=graft(mirror_3.Geometry), Angle=rad_12, Axis=ln)  # -> Geometry, Transform
data_10 = Data(data_9)
data_11 = Data(mirror_3.Geometry)

# ---- group: OOOO
vec_14 = VectorXYZ(XComponent="8", YComponent=0, ZComponent=0)  # -> Vector, Length
move_16 = Move(
    Geometry=[data_10, rotax_13.Geometry, rotax_9.Geometry, data_11, rotax_10.Geometry, rotax_11.Geometry, rotax_12.Geometry, rotax_14.Geometry],
    Motion=vec_14.Vector)  # -> Geometry, Transform

# ---- group: Geting Volume
null_4 = NullItem(Item=flatten(move_16.Geometry))  # -> NullFlags, InvalidFlags, Description
dispatch_4 = Dispatch(List=flatten(move_16.Geometry), DispatchPattern=null_4.NullFlags)  # -> ListA, ListB
volume_2 = Volume(Geometry=dispatch_4.ListB)  # -> flatten(Volume), Centroid
ma_2 = MassAddition(Input=volume_2.Volume)  # -> Result, PartialResults

# ---- group: Fill weigth
lng = ListLength(List=rdpoints.OutPoint)
material_density_kn_m3 = Panel("-14.71")
Z_5 = UnitZ(Factor=1)
pt_8 = Point(rdpoints.OutPoint)

# ----
division_25 = Division(A=ma.Result, B=lng)
dup_3 = DuplicateData(Data=material_density_kn_m3, Number=lng, Order=True)

# ---- group: Fill weigth (continued)
multiplication_24 = Multiplication(A=division_25, B=dup_3)
amp = Amplitude(Vector=Z_5, Amplitude=multiplication_24)  # -> flatten(Vector)
loads = LoadsKaramba3D(ForceVector=flatten(amp), Local=False, PosInd=flatten(pt_8), LCase="0", mode="Point")

lng_2 = ListLength(List=rdpoints_2.OutPoint)
material_density_kn_m3_2 = Panel("-14.71")
Z_6 = UnitZ(Factor=1)
pt_9 = Point(rdpoints_2.OutPoint)

# ----
division_26 = Division(A=ma_2.Result, B=lng_2)
dup_4 = DuplicateData(Data=material_density_kn_m3_2, Number=lng_2, Order=True)

# ---- group: Fill weigth (continued)
multiplication_25 = Multiplication(A=division_26, B=dup_4)
amp_2 = Amplitude(Vector=Z_6, Amplitude=multiplication_25)  # -> flatten(Vector)
loads_2 = LoadsKaramba3D(ForceVector=flatten(amp_2), Local=False, PosInd=flatten(pt_9), LCase="0", mode="Point")

# ---- group: 2° Floor Weigth
multiplication_26 = Multiplication(A=ma.Result, B="0.2")
multiplication_27 = Multiplication(A=multiplication_26, B=material_density_kn_m3)
volume_x_density = Panel(multiplication_27)
Z_7 = UnitZ(Factor=volume_x_density)

# ----
division_27 = Division(A=Z_7, B="384")
multiplication_28 = Multiplication(A=dup, B=division_27)

# ---- group: 2° Floor Weigth (continued)
loads_3 = LoadsKaramba3D(ForceVector=flatten(multiplication_28), Local=False, PosInd=flatten(cp_5.ClosestPoint), LCase="2", mode="Point")

# ---- group: Living Loads
rdpoints_3 = RemoveDuplicatePointsKaramba3D(Point=dispatch_2.ListB, LimitDistance=panel_31)  # -> OutPoint, Info, Indexes
total_m2 = Panel("9")
_5_kn_m2 = Panel("-5")
Z_8 = UnitZ(Factor=_5_kn_m2)
multiplication_29 = Multiplication(A=total_m2, B=Z_8)

# ----
lng_3 = ListLength(List=flatten(rdpoints_3.OutPoint))
dup_5 = DuplicateData(Data="1", Number=lng_3, Order=True)
division_28 = Division(A=multiplication_29, B=lng_3)
multiplication_30 = Multiplication(A=division_28, B=dup_5)

# ---- group: Living Loads (continued)
loads_4 = LoadsKaramba3D(ForceVector=flatten(multiplication_30), Local=False, PosInd=flatten(rdpoints_3.OutPoint), LCase="1", mode="Point")

# ----
assemble = AssembleModelKaramba3D(
    Point=flatten(rdpoints.OutPoint),
    Elem=flatten(dam_4),
    Support=supp,
    Load=[loads, loads_4, loads_3],
    Material=matselect,
    LimitDistance_m=0.005)  # -> Model, Info, Mass_kg, CenterOfGravity

dam_8 = DataDam(DataA=assemble.Model, BufferDelay=10000000, BufferMode=0)

analyze = AnalyzeKaramba3D(Model=dam_8)  # -> CalculatedModel, MaximumDisplacement_cm, ResultingForceOfGravity_kN, ElasticEnergy_kNm
modelview = ModelViewKaramba3D(Model=analyze.CalculatedModel, ResultFactors=1, ResultCase=-1)  # -> Model, DeformedMesh, DeformedAxes, DeformedModel
beamview = BeamViewKaramba3D(Model=modelview.Model)  # -> Model, MeshesOfRenderedBeams, DeformedBeamAxes, LegendColors, LegendTags
utilization = UtilizationOfElementsKaramba3D(
    AnalyzedModel=beamview.Model,
    ResultCase=-1,
    NumberOfSamplePoints=3,
    ElasticDesign=True,
    GammaM0=1,
    GammaM1=1,
    WithDetails=False,
    mode="Beams")  # -> AnalyzedModel, Utilization, SigMax_kN_cm2, SigMin_kN_cm2, TauMax_kN_cm2, UtilN, UtilVy, UtilVz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
disassemble = DisassembleModelKaramba3D(Model=utilization.AnalyzedModel)  # -> Model, Point, Beam, Shell, Support, Load, Line, Mesh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
nodedisp = NodalDisplacementsKaramba3D(AnalyzedModel=disassemble.Model, ResultCase=0)  # -> AnalyzedModel, NodalTranslations_m, NodalRotations_rad

# ---- group: Result Ground Floor
bnd = Bounds(Numbers=utilization.SigMax_kN_cm2)
bnd_2 = Bounds(Numbers=utilization.TauMax_kN_cm2)
bnd_3 = Bounds(Numbers=nodedisp.NodalTranslations_m)
bnd_4 = Bounds(Numbers=utilization.SigMin_kN_cm2)
dedomain = DeconstructDomain(Domain=bnd)  # -> Start, End
dedomain_2 = DeconstructDomain(Domain=bnd_2)  # -> Start, End
dedomain_3 = DeconstructDomain(Domain=bnd_3)  # -> Start, End
dedomain_4 = DeconstructDomain(Domain=bnd_4)  # -> Start, End
maximun_tension = Panel(dedomain.End)
maximun_compresion = Panel(dedomain_4.Start)
maximun_shear = Panel(dedomain_2.End)
maximun_displacement = Panel(dedomain_3.End)
gradient = Gradient(
    LowerLimit=dedomain.Start,
    UpperLimit=dedomain.End,
    Parameter=utilization.SigMax_kN_cm2,
    stops=[0: RGB(0, 128, 0), 0.501: RGB(255, 255, 0), 1: RGB(255, 0, 0)])
previewlw = CustomPreviewLineweights(Geometry=disassemble.Line, Shader=gradient, Absolute=False)

# ---- group: Colum section check
react = ReactionForcesKaramba3D(AnalyzedModel=modelview.Model, ResultCase=0)  # -> AnalyzedModel, ReactionForces_kN, ReactionMoments_kNm, SupportPosition, SumOfReactionForces_kN, SumOfReactionMoments_kNm
panel_33 = Panel(react.SumOfReactionForces_kN)
pdecon = Deconstruct(Point=panel_33)  # -> XComponent, YComponent, ZComponent
division_29 = Division(A=pdecon.ZComponent, B="4")
force_per_colum = Panel(division_29)
_1_mp_per_cm2_0_1_kn = Panel("0.1")
division_30 = Division(A=force_per_colum, B=_1_mp_per_cm2_0_1_kn)  # -> flatten(Result)
cm_2_needed_per_colum = Panel(division_30)
multiplication_31 = Multiplication(A=cm_2_needed_per_colum, B="1")
expression = Expression(x=flatten(multiplication_31), Expression="Sqrt(x)")
panel_34 = Panel(expression)

# ---- group: 2° Floor Weigth
multiplication_32 = Multiplication(A=ma_2.Result, B="0.2")
multiplication_33 = Multiplication(A=multiplication_32, B=material_density_kn_m3_2)
crv = Curve(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)
volume_x_density_2 = Panel(multiplication_33)
crv_cp_2 = CurveClosestPoint(Point=dispatch_3.ListB, Curve=graft(crv))  # -> simplify(flatten(Point)), Parameter, Distance
Z_9 = UnitZ(Factor=volume_x_density_2)

# ----
lng_4 = ListLength(List=flatten(crv_cp_2.Point))
division_31 = Division(A=Z_9, B="384")
multiplication_34 = Multiplication(A=dup_2, B=division_31)

# ---- group: 2° Floor Weigth (continued)
loads_5 = LoadsKaramba3D(ForceVector=flatten(multiplication_34), Local=False, PosInd=flatten(crv_cp_2.Point), LCase="2", mode="Point")

# ---- group: Living Loads
rdpoints_4 = RemoveDuplicatePointsKaramba3D(Point=dispatch_3.ListB, LimitDistance=panel_32)  # -> OutPoint, Info, Indexes
total_m2_2 = Panel("9")
_5_kn_m2_2 = Panel("-5")
Z_10 = UnitZ(Factor=_5_kn_m2_2)
multiplication_35 = Multiplication(A=total_m2_2, B=Z_10)

# ----
lng_5 = ListLength(List=flatten(rdpoints_4.OutPoint))
dup_6 = DuplicateData(Data="1", Number=lng_5, Order=True)
division_32 = Division(A=multiplication_35, B=lng_5)
multiplication_36 = Multiplication(A=division_32, B=dup_6)

# ---- group: Living Loads (continued)
loads_6 = LoadsKaramba3D(ForceVector=flatten(multiplication_36), Local=False, PosInd=flatten(rdpoints_4.OutPoint), LCase="1", mode="Point")

# ----
assemble_2 = AssembleModelKaramba3D(
    Point=flatten(rdpoints_2.OutPoint),
    Elem=flatten(dam_6),
    Support=supp_2,
    Load=[loads_2, loads_6, loads_5],
    Material=matselect_2,
    LimitDistance_m=0.005)  # -> Model, Info, Mass_kg, CenterOfGravity

dam_9 = DataDam(DataA=assemble_2.Model, BufferDelay=10000000, BufferMode=0)

analyze_2 = AnalyzeKaramba3D(Model=dam_9)  # -> CalculatedModel, MaximumDisplacement_cm, ResultingForceOfGravity_kN, ElasticEnergy_kNm
modelview_2 = ModelViewKaramba3D(Model=analyze_2.CalculatedModel, ResultFactors=1, ResultCase=-1)  # -> Model, DeformedMesh, DeformedAxes, DeformedModel
beamview_2 = BeamViewKaramba3D(Model=modelview_2.Model)  # -> Model, MeshesOfRenderedBeams, DeformedBeamAxes, LegendColors, LegendTags
utilization_2 = UtilizationOfElementsKaramba3D(
    AnalyzedModel=beamview_2.Model,
    ResultCase=-1,
    NumberOfSamplePoints=3,
    ElasticDesign=True,
    GammaM0=1,
    GammaM1=1,
    WithDetails=False,
    mode="Beams")  # -> AnalyzedModel, Utilization, SigMax_kN_cm2, SigMin_kN_cm2, TauMax_kN_cm2, UtilN, UtilVy, UtilVz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
disassemble_2 = DisassembleModelKaramba3D(Model=utilization_2.AnalyzedModel)  # -> Model, Point, Beam, Shell, Support, Load, Line, Mesh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
nodedisp_2 = NodalDisplacementsKaramba3D(AnalyzedModel=disassemble_2.Model, ResultCase=0)  # -> AnalyzedModel, NodalTranslations_m, NodalRotations_rad

# ---- group: Result Firts Floor
bnd_5 = Bounds(Numbers=utilization_2.SigMax_kN_cm2)
bnd_6 = Bounds(Numbers=utilization_2.TauMax_kN_cm2)
bnd_7 = Bounds(Numbers=nodedisp_2.NodalTranslations_m)
bnd_8 = Bounds(Numbers=utilization_2.SigMin_kN_cm2)
dedomain_5 = DeconstructDomain(Domain=bnd_5)  # -> Start, End
dedomain_6 = DeconstructDomain(Domain=bnd_6)  # -> Start, End
dedomain_7 = DeconstructDomain(Domain=bnd_7)  # -> Start, End
dedomain_8 = DeconstructDomain(Domain=bnd_8)  # -> Start, End
maximun_tension_2 = Panel(dedomain_5.End)
maximun_compresion_2 = Panel(dedomain_8.Start)
maximun_shear_2 = Panel(dedomain_6.End)
maximun_displacement_2 = Panel(dedomain_7.End)
gradient_2 = Gradient(
    LowerLimit=dedomain_5.Start,
    UpperLimit=dedomain_5.End,
    Parameter=utilization_2.SigMax_kN_cm2,
    stops=[0: RGB(0, 128, 0), 0.501: RGB(255, 255, 0), 1: RGB(255, 0, 0)])
previewlw_2 = CustomPreviewLineweights(Geometry=disassemble_2.Line, Shader=gradient_2, Absolute=False)

# ---- group: Colum section check
react_2 = ReactionForcesKaramba3D(AnalyzedModel=modelview_2.Model, ResultCase=0)  # -> AnalyzedModel, ReactionForces_kN, ReactionMoments_kNm, SupportPosition, SumOfReactionForces_kN, SumOfReactionMoments_kNm
panel_35 = Panel(react_2.SumOfReactionForces_kN)
pdecon_2 = Deconstruct(Point=panel_35)  # -> XComponent, YComponent, ZComponent
division_33 = Division(A=pdecon_2.ZComponent, B="4")
force_per_colum_2 = Panel(division_33)
_1_mp_per_cm2_0_1_kn_2 = Panel("0.1")
division_34 = Division(A=force_per_colum_2, B=_1_mp_per_cm2_0_1_kn_2)  # -> flatten(Result)
cm_2_needed_per_colum_2 = Panel(division_34)
multiplication_37 = Multiplication(A=cm_2_needed_per_colum_2, B="1")
expression_2 = Expression(x=flatten(multiplication_37), Expression="Sqrt(x)")
panel_36 = Panel(expression_2)

# ==== cluster Cluster
P = ClusterInput()
C = ClusterInput()
crv_cp = CurveClosestPoint(Point=P, Curve=graft(C))  # -> simplify(flatten(Point)), Parameter, Distance
coplanar = CoPlanar(Points=crv_cp.Point, Strength=1)
C_2 = ClusterOutput(coplanar)

# ==== cluster Cluster_3
step_roof = ClusterInput()
step_floor = ClusterInput()
step_roof_2 = Data(step_roof)
step_floor_2 = Data(step_floor)
G = ClusterInput()
move = Move(Geometry=G, Motion=step_floor_2)  # -> Geometry, Transform
subtraction = Subtraction(A=step_roof_2, B=step_floor_2)
extr = Extrude(Base=move.Geometry, Direction=subtraction)
debrep = DeconstructBrep(Brep=extr)  # -> Faces, Edges, Vertices
cluster = Cluster_2(data=debrep.Edges)  # -> flatten(line_2)
mesh = MeshBrep(
    Brep=extr,
    Settings={GridMaxCount=0, GridMinCount=16, JaggedSeams=False, MaxEdgeLength=0, MinEdgeLength=0.0001, MinTolerance=0, Refine=True, RefineAngle=0, RelativeTolerance=0.65, SimplePlanes=True, Tolerance=0})
null = NullItem(Item=flatten(cluster))  # -> NullFlags, InvalidFlags, Description
volume = Volume(Geometry=extr)  # -> Volume, Centroid
dispatch = Dispatch(List=flatten(cluster), DispatchPattern=null.NullFlags)  # -> ListA, ListB
E = ClusterOutput([extr, mesh])
C = ClusterOutput(volume.Centroid)
rdlines = RemoveDuplicateLinesKaramba3D(Line=dispatch.ListB, LimitDistance=0.005)  # -> OutLine, Info, Indexes
L = ClusterOutput(rdlines.OutLine)

# ==== cluster Cluster_4
rotation_axis = ClusterInput()
rotation_axis_2 = Data(rotation_axis)
data = ClusterInput()
data_2 = ClusterInput()
data_3 = Data(data)
data_4 = Data(data_2)
P = ClusterInput()
P_2 = ClusterInput()

# ---- group: Peace "A" Generation (8 ones)
mirror = Mirror(Geometry=data_4, Plane=P)  # -> Geometry, Transform
rad = Radians(Degrees="180")
rad_2 = Radians(Degrees="90")
rad_3 = Radians(Degrees="270")
rad_4 = Radians(Degrees="180")
rad_5 = Radians(Degrees="90")
rad_6 = Radians(Degrees="270")
rotax = RotateAxis(Geometry=graft(data_4), Angle=rad, Axis=rotation_axis_2)  # -> Geometry, Transform
rotax_2 = RotateAxis(Geometry=graft(mirror.Geometry), Angle=rad_3, Axis=rotation_axis_2)  # -> Geometry, Transform
rotax_3 = RotateAxis(Geometry=graft(data_4), Angle=rad_5, Axis=rotation_axis_2)  # -> Geometry, Transform
rotax_4 = RotateAxis(Geometry=graft(mirror.Geometry), Angle=rad_4, Axis=rotation_axis_2)  # -> Geometry, Transform
rotax_5 = RotateAxis(Geometry=data_4, Angle=rad_6, Axis=rotation_axis_2)  # -> Geometry, Transform
rotax_6 = RotateAxis(Geometry=mirror.Geometry, Angle=rad_2, Axis=rotation_axis_2)  # -> Geometry, Transform
data_5 = Data(data_4)
data_6 = Data(mirror.Geometry)

mirror_2 = Mirror(Geometry=data_3, Plane=P_2)  # -> Geometry, Transform
rad_7 = Radians(Degrees="180")
rad_8 = Radians(Degrees="90")
rad_9 = Radians(Degrees="270")
rad_10 = Radians(Degrees="180")
rad_11 = Radians(Degrees="90")
rad_12 = Radians(Degrees="270")
rotax_7 = RotateAxis(Geometry=graft(data_3), Angle=rad_12, Axis=rotation_axis_2)  # -> Geometry, Transform
rotax_8 = RotateAxis(Geometry=graft(data_3), Angle=rad_7, Axis=rotation_axis_2)  # -> Geometry, Transform
rotax_9 = RotateAxis(Geometry=graft(mirror_2.Geometry), Angle=rad_9, Axis=rotation_axis_2)  # -> Geometry, Transform
rotax_10 = RotateAxis(Geometry=graft(data_3), Angle=rad_11, Axis=rotation_axis_2)  # -> Geometry, Transform
rotax_11 = RotateAxis(Geometry=graft(mirror_2.Geometry), Angle=rad_10, Axis=rotation_axis_2)  # -> Geometry, Transform
rotax_12 = RotateAxis(Geometry=graft(mirror_2.Geometry), Angle=rad_8, Axis=rotation_axis_2)  # -> Geometry, Transform
data_7 = Data(data_3)
data_8 = Data(mirror_2.Geometry)

# ---- group: OOOO
vec = VectorXYZ(XComponent="8", YComponent=0, ZComponent=0)  # -> Vector, Length
move = Move(
    Geometry=[data_5, rotax_6.Geometry, rotax.Geometry, rotax_5.Geometry, rotax_3.Geometry, data_6, rotax_2.Geometry, rotax_4.Geometry],
    Motion=vec.Vector)  # -> Geometry, Transform

vec_2 = VectorXYZ(XComponent="8", YComponent=0, ZComponent=0)  # -> Vector, Length
move_2 = Move(
    Geometry=[data_7, rotax_12.Geometry, rotax_8.Geometry, rotax_7.Geometry, rotax_10.Geometry, rotax_9.Geometry, data_8, rotax_11.Geometry],
    Motion=vec_2.Vector)  # -> flatten(Geometry), Transform

# ----
debrep = DeconstructBrep(Brep=move_2.Geometry)  # -> Faces, Edges, Vertices
llinter = LineLineIntersectionKaramba3D(Line=flatten(move.Geometry), LimitDistance_m=0.005)  # -> IntersectionPoints, LineSubSegements
item = ListItem(List=debrep.Faces, Index="5", Wrap=True)
volume = Volume(Geometry=move_2.Geometry)  # -> Volume, Centroid
area = Area(Geometry=item)  # -> Area, flatten(Centroid)
len = Length(Curve=llinter.LineSubSegements)
null = NullItem(Item=flatten(volume.Volume))  # -> NullFlags, InvalidFlags, Description
ma = MassAddition(Input=flatten(len))  # -> Result, PartialResults
dispatch = Dispatch(List=flatten(volume.Volume), DispatchPattern=null.NullFlags)  # -> ListA, ListB
total_lenngth = Panel(ma.Result)
ma_2 = MassAddition(Input=flatten(dispatch.ListB))  # -> Result, PartialResults
panel = Panel(ma_2.Result)
division = Division(A=panel, B=total_lenngth)
elem_id = ClusterInput()
expression = Expression(x=division, Expression="Sqrt(x/π)*200*1.88")
division_2 = Division(A=expression, B="2")
cross_section = CrossSectionKaramba3D(
    FamilyNameOfCrossSection="DefaultCroSec",
    ElementIdentifier=elem_id,
    Material=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,
    Diameter_cm=expression,
    WallThickness_cm=division_2,
    mode="Circular Hollow")
id = ClusterInput()
heigth_and_width_of_the_cross_section = Panel(expression)
linetobeam = LineToBeamKaramba3D(
    Line=flatten(llinter.LineSubSegements),
    Identifier=id,
    CrossSection=cross_section,
    New=True,
    Remove=True,
    LimitDistance_m=0.005)  # -> Element, Points, Info
elem = ClusterOutput(linetobeam.Element)
number_slider = Slider(4, range=0..29)
ip = ClusterOutput(llinter.IntersectionPoints)
C = ClusterOutput(area.Centroid)

# ==== cluster Cluster_5
A = ClusterInput()
step_floor = ClusterInput()
division = Division(A=A, B=100)
G = ClusterInput()
step_floor_2 = Data(step_floor)
Z = UnitZ(Factor=division)
move = Move(Geometry=G, Motion=step_floor_2)  # -> Geometry, Transform
extr = Extrude(Base=move.Geometry, Direction=Z)
debrep = DeconstructBrep(Brep=extr)  # -> Faces, Edges, Vertices
panel = Panel(debrep.Faces)
number_slider = Slider(5, range=0..10)
item = ListItem(List=debrep.Faces, Index="5", Wrap=True)
item_2 = ListItem(List=debrep.Faces, Index="0", Wrap=True)
area = Area(Geometry=item)  # -> Area, Centroid
debrep_2 = DeconstructBrep(Brep=item)  # -> Faces, Edges, Vertices
panel_2 = Panel("""0
1
2
3""")
debrep_3 = DeconstructBrep(Brep=item_2)  # -> Faces, Edges, Vertices
panel_3 = Panel("""1
2
3
4""")
pt = Point(debrep_3.Vertices)
item_3 = ListItem(List=pt, Index=panel_2, Wrap=True)
item_4 = ListItem(List=debrep_2.Edges, Index=panel_3, Wrap=True)
midpt = CurveMiddle(Curve=item_4)
ln = Line(StartPoint=item_3, EndPoint=area.Centroid)
ln_2 = Line(StartPoint=midpt, EndPoint=area.Centroid)
line = Line(ln)
null = NullItem(Item=flatten(line))  # -> NullFlags, InvalidFlags, Description
dispatch = Dispatch(List=flatten(line), DispatchPattern=null.NullFlags)  # -> ListA, ListB
rdlines = RemoveDuplicateLinesKaramba3D(Line=dispatch.ListB, LimitDistance=0.005)  # -> OutLine, Info, Indexes
L = ClusterOutput(rdlines.OutLine)
E = ClusterOutput(extr)

# ==== cluster Cluster_2
data = ClusterInput()
data_2 = Data(data)
item = ListItem(List=data_2, Index="6", Wrap=True)
item_2 = ListItem(List=data_2, Index="8", Wrap=True)
item_3 = ListItem(List=data_2, Index="4", Wrap=True)
item_4 = ListItem(List=data_2, Index="10", Wrap=True)
end = EndPoints(Curve=item_2)  # -> Start, End
end_2 = EndPoints(Curve=item_3)  # -> Start, End
end_3 = EndPoints(Curve=item_4)  # -> Start, End
end_4 = EndPoints(Curve=item)  # -> Start, End
ln = Line(StartPoint=end_2.End, EndPoint=end.Start)
ln_2 = Line(StartPoint=end_2.Start, EndPoint=end.Start)
ln_3 = Line(StartPoint=end_2.Start, EndPoint=end.End)
ln_4 = Line(StartPoint=end_4.Start, EndPoint=end_3.End)
ln_5 = Line(StartPoint=end_4.End, EndPoint=end_3.Start)
ln_6 = Line(StartPoint=end_2.End, EndPoint=end.End)
ln_7 = Line(StartPoint=end_4.End, EndPoint=end_3.End)
midpt = CurveMiddle(Curve=ln_7)
ln_8 = Line(StartPoint=end_4.Start, EndPoint=end_3.Start)
midpt_2 = CurveMiddle(Curve=ln_8)
ln_9 = Line(StartPoint=midpt, EndPoint=midpt_2)
line = Line([item_3, item_2, item, item_4, ln_2, ln_3, ln_5, ln_6, ln_8, ln, ln_7, ln_4, ln_9])
line_2 = ClusterOutput(line)
